# Dynamo custom node FEMdesign_GetReinforcement.dyf "FEMdesign.GetReinforcement" (Dynamo 1.3.0.875)
# category: Orchid.Applications.FEMdesign.Query
# Get reinforcement from FEM-design

# group: read source code from the package
filename = StringInput("FEMdesign_GetReinforcement.py")
scriptFileReader = Orchid.Core.Scripting.ScriptFileReader(arg1=filename)

file = Input(file : string)  # Path and Filename to the FEM-design xml file including extension!
element = Input()  # Element(s)
code_block = CodeBlock(elements=element) { t1 = DSCore.List.Flatten(elements, 1); t1.GetParameterValueByName("StruXML Guid"); }
python_source = PythonStringNode(script=scriptFileReader, IN[0]=file, IN[1]=code_block.t1, IN[2]=code_block.out1)
code_block_2 = CodeBlock(OUT=python_source) { OUT[0]; OUT[1]; OUT[2]; OUT[3]; }
element_2 = Output(code_block_2.out0)  # "element"; Element(s)
wire = Output(code_block_2.out1)  # Reinforcement wire
mesh = Output(code_block_2.out2)  # Reinforcement mesh size
location = Output(code_block_2.out3)  # Reinforcement location
