# Dynamo custom node FEMdesign_SetLinearRelease.dyf "FEMdesign.SetLinearRelease" (Dynamo 1.3.0.875)
# category: Orchid.Applications.FEMdesign.Actions
# Write (set) linear release in FEM-design xml-file

# group: read source code from the package
filename = StringInput("FEMdesign_SetLinearRelease.py")
scriptFileReader = Orchid.Core.Scripting.ScriptFileReader(arg1=filename)

file = Input(file : string)  # Path and Filename to the FEM-design xml file including extension!
element = Input()  # Element(s)
code_block = CodeBlock(elements=element) { t1 = DSCore.List.Flatten(elements, 1); t1.GetParameterValueByName("StruXML Guid"); }
release = Input(release : string[]..[])  # Release List order: Top, Bottom, Right & Left
XYaxis = Input()  # Element XY-axis value (in meter) List order: XY StartPoint, XY EndPoint, StruXML Guid
Zaxis = Input()  # Element Z-axis value (in meter) List order: Z MinPoint, Z MaxPoint, StruXML Guid
python_source = PythonStringNode(script=scriptFileReader, IN[0]=file, IN[1]=code_block.t1, IN[2]=code_block.out1, IN[3]=release, IN[4]=XYaxis, IN[5]=Zaxis)
release_2 = Output(python_source)  # "release"; FEM release
