# Dynamo custom node FEMdesign_GetElementID.dyf "FEMdesign.GetElementID" (Dynamo 2.0.0.4655)
# category: Orchid.Applications.Query
# Get element id from FEM-design

# group: read source code from the package
filename = StringInput("FEMdesign_GetElementID.py")  # graph input
scriptFileReader = Orchid.Generic.Core.Scripting.ScriptFileReader(file=filename)

file = Input(file: string)  # Path and Filename to the FEM-design xml file including extension!
element = Input(element: var[]..[])  # Element(s)
code_block = CodeBlock(elements=element) { t1 = DSCore.List.Flatten(elements, 1); t1.GetParameterValueByName("StruXML Guid"); }
python_source = PythonStringNode(script=scriptFileReader, IN[0]=file, IN[1]=code_block.t1, IN[2]=code_block.out1)
FEMid = Output(python_source)  # FEM element id
