# Dynamo custom node FEMdesign_SetStiffnessValue.dyf "FEMdesign.SetStiffnessValue" (Dynamo 2.0.0.4655)
# category: Orchid.Applications.Actions
# Set stiffness value globally in FEM-design

# group: read source code from the package
filename = StringInput("FEMdesign_SetStiffnessValue.py")  # graph input
scriptFileReader = Orchid.Generic.Core.Scripting.ScriptFileReader(file=filename)

file = Input(file: string)  # Path and Filename to the FEM-design xml file including extension!
stiffness = Input(stiffness: string)  # Stiffness to set
value = Input(value: var[]..[])  # Value to set
python_source = PythonStringNode(script=scriptFileReader, IN[0]=file, IN[1]=stiffness, IN[2]=value)
file_2 = Output(python_source)  # "file"; Path and Filename to the FEM-design xml file including extension!
