# Dynamo graph File.NewProject.dyn (Dynamo 1.3.4.6666)

# group: Template and New Projects
directory_path = StringInput(".\testSet\")
project_file_name = CodeBlock { {"new3", "new4"}; }
extension = StringInput(".rvt")
code_block = CodeBlock(a=directory_path, b=project_file_name, c=extension) { a+b+c; }
template_path = StringInput("C:\ProgramData\Autodesk\RVT 2019\Templates\DanEDU\DanEDU Systems.rte")

newProject = Orchid.RevitProject.Common.Document.NewProject(code_block, template_path)
watch = Watch(newProject)

# group: Template and New Projects
directory_path_2 = StringInput(".\testSet\")
project_file_name_2 = CodeBlock { {"new1", "new2"}; }
extension_2 = StringInput(".rvt")
code_block_2 = CodeBlock(a=directory_path_2, b=project_file_name_2, c=extension_2) { a+b+c; }
template_path_2 = StringInput("C:\ProgramData\Autodesk\RVT 2019\Templates\DanEDU\DanEDU Building.rte")

create = List.Create(template_path_2, template_path)
newProject_2 = Orchid.RevitProject.Common.Document.NewProject(code_block_2, create)
watch_2 = Watch(newProject_2)
