# Dynamo graph Info-Clipboard.dyn (Dynamo 1.3.4.6666)

# group: Current document Info and copy to clipboard
info = Orchid.RevitProject.Document.Info()
copyTo = Orchid.Core.Clipboard.CopyTo(info)  # frozen

watch = Watch(info)

# group: File Info and copy to clipboard
path_and_filename = CodeBlock { cur = Orchid.Core.Directory.Current; cur + "\\testSet"; }
contents = Orchid.Core.Directory.Contents(path_and_filename.out1)
info_2 = Orchid.Core.File.Info(contents)
copyTo_2 = Orchid.Core.Clipboard.CopyTo(info_2)

watch_2 = Watch(info_2)
watch_3 = Watch(copyTo_2)
watch_4 = Watch(copyTo)

# group: Clipboard --> copy int
code_block = CodeBlock { 1..5; }
watch_5 = Watch(code_block)
copyTo_3 = Orchid.Core.Clipboard.CopyTo(code_block)  # frozen

# group: Clipboard --> copy element
elementHasMaterial = Orchid.RevitProject.Elements.Selection.ElementHasMaterial()
watch_6 = Watch(elementHasMaterial)
copyTo_4 = Orchid.Core.Clipboard.CopyTo(elementHasMaterial)  # frozen
