# Dynamo graph Print.dyn (Dynamo 1.3.4.6666)

code_block = CodeBlock()
# ---------- code_block.designscript (7 lines) ----------
"Adobe PDF";
"Microsoft Print to PDF";
"Microsoft XPS Document Writer";

//Hidden built-in printer
//not supported at the moment!
"Revit DWF Exporter";
# ----------------------------------------
string = StringInput("Default")
code_block_2 = CodeBlock { 100; }
printer = Printer("Microsoft Print to PDF")
string_2 = StringInput("testSetting")
createSetting = Orchid.Common.Print.CreateSetting(printer, string_2)
print_papersizes = PaperSize("A3", printer, input=Microsoft Print to PDF)
print_pageorientation = PageOrientation("Portrait")
print_margintype = MarginType("User defined")
code_block_3 = CodeBlock { {10,10}; }
changeSetting = Orchid.Common.Print.ChangeSetting(printer, createSetting, print_papersizes, print_pageorientation, arg5=print_margintype, arg6=code_block_3)
printer_2 = Printer("Microsoft Print to PDF")
sheet_set = SheetSet("A3 set")
getView = Orchid.RevitProject.Views.SheetSet.GetView(sheet_set)

# group: filePath --> file name incl. path
current = Orchid.Common.Directory.Current()
string_3 = StringInput("testSet")
sheetNumber = Sheet.SheetNumber(getView)
code_block_4 = CodeBlock(a=current, b=string_3, c=sheetNumber)
# ---------- code_block_4.designscript (3 lines) ----------
a + "\\" +
b + "\\" +
c;
# ----------------------------------------

# note: Print Setting may be set
# both as an element and
# as a string
print_setting = Setting("Default")
byViewSheetSet = Orchid.Common.Print.ByViewSheetSet(printer_2, arg3=code_block_4, arg4=sheet_set, arg5=print_setting)
boolean = BoolSelector(true)
boolean_2 = BoolSelector(true)
byView = Orchid.Common.Print.ByView(printer_2, boolean, boolean_2, code_block_4, arg5=getView, arg6=print_setting)
# note: Set to "Select" to print the selected views
print_range = Range("Selected views/sheets")

# group: Remove print setting
print_setting_2 = Setting("Default")
# note: Print Setting may be set
# both as an element and
# as a string
string_4 = StringInput("testSetting")
deleteSetting = Orchid.Common.Print.DeleteSetting(string_4)  # frozen

print_zoomtype = ZoomType("Zoom")
print_paperplacement = PaperPlacement("Offset from corner")

# group: Print current view (center and fit to page)
printer_3 = Printer("Microsoft Print to PDF")
string_5 = StringInput("testSetting")
print_papersizes_2 = PaperSize("A3", printer_3, input=Microsoft Print to PDF)
print_paperplacement_2 = PaperPlacement("Center")
print_zoomtype_2 = ZoomType("Fit To Page")
createSetting_2 = Orchid.Common.Print.CreateSetting(printer_3, string_5, print_papersizes_2, arg4=print_paperplacement_2, arg7=print_zoomtype_2)
print_range_2 = Range("Current window")
activeView = Orchid.RevitProject.Common.Document.ActiveView()
byView_2 = Orchid.Common.Print.ByView(printer_3, arg4=print_range_2, arg5=activeView, arg6=createSetting_2)
# note: if print options there are rarely set need to be included, then connect:
# "Print.SetOptions" output Printsetting to "Print.ByView" input printSetting!
await_ = Orchid.Common.DataStream.Await(createSetting_2, byView_2)
deleteSetting_2 = Orchid.Common.Print.DeleteSetting(await_)

# group: SheetSet
categories = Categories("Sheets")  # frozen
all_elements_of_category = ElementsOfCategory(categories)
string_6 = StringInput("testSet")
create = Orchid.RevitProject.Views.SheetSet.Create(all_elements_of_category, string_6)
getView_2 = Orchid.RevitProject.Views.SheetSet.GetView(create)
sheet_set_2 = SheetSet("A3 set")
change = Orchid.RevitProject.Views.SheetSet.Change(getView_2, sheet_set_2)
delete = Orchid.RevitProject.Views.SheetSet.Delete(create)

# group: Print options there are rarely set
boolean_3 = BoolSelector(true)
boolean_4 = BoolSelector(false)
print_hiddenlineviews = HiddenLineViewsType("Vector Processing")
print_rasterquality = RasterQualityType("Medium")
print_colordepth = ColorDepthType("Gray Scale")
setOptions = Orchid.Common.Print.SetOptions(createSetting_2, boolean_3, boolean_4, boolean_3, boolean_3, boolean_4, boolean_4, boolean_3, print_hiddenlineviews, print_rasterquality, print_colordepth)  # frozen

# group: Merge PDF files
code_block_5 = CodeBlock()
# ---------- code_block_5.designscript (6 lines) ----------
//input documents
{"%userprofile%\\Downloads\\PDF\\pdf1.pdf",
"%userprofile%\\Downloads\\PDF\\pdf2.pdf"};

//output file path
"%userprofile%\\Downloads\\PDF\\result.pdf";
# ----------------------------------------
mergePDF = Orchid.Common.Print.MergePDF(code_block_5.out0, code_block_5.out1)  # frozen

paperSize = Orchid.Common.Print.PaperSize(printer)
watch = Watch(paperSize)
