# Dynamo graph String.dyn (Dynamo 1.3.4.6666)

# group: Import from txt file
string = StringInput("..\..\Data\test.txt")
fromPath = FileObject(string)  # "File.FromPath"
readText = File.ReadText(fromPath)

string_2 = StringInput("\"Boolean.FaceFlipped|DanEDU\"")
string_3 = StringInput("\"Boolean.Flipped|DanEDU\"")
create = List.Create(string_2, string_3)
string_4 = StringInput("\"FamilyInstance.IsFaceFlipped\"")
string_5 = StringInput("\"FamilyInstance.IsFlipped\"")
create_2 = List.Create(string_4, string_5)

# group: Replace string
replace = Orchid.Common.String.Replace(readText, create, create_2)
watch = Watch(replace)

string_6 = StringInput("e\">")
count = Count(create)
cycle = List.Cycle(list=string_6, amount=count)

# group: Get substring
substring = Orchid.Common.String.Substring(readText, create, cycle)
watch_2 = Watch(substring)
