# Dynamo graph Timer.dyn (Dynamo 1.3.4.6666)

# group: Important! Place DateTime.Now in upper left corner of the graph to get the correct time elapsed
code_block = CodeBlock { 1..80000; }
now = DateTime.Now()
timer = Orchid.Common.DataStream.Timer(code_block, now)
mul = timer.out0 * timer.out0
timer_2 = Orchid.Common.DataStream.Timer(mul, timer.out1)
totalSeconds = TimeSpan.TotalSeconds(timer_2.out2)
watch = Watch(totalSeconds)
totalMilliseconds = TimeSpan.TotalMilliseconds(timer_2.out2)
watch_2 = Watch(totalMilliseconds)
