# Dynamo graph Analytical elements.dyn (Dynamo 1.3.4.6666)

categories = Categories("FloorAnalytical")
all_elements_of_category = ElementsOfCategory(categories)

# group: Changes the alignment method of the analytical element
code_block = CodeBlock { "Alignment Method"; }
# note: false = Automatic detection
# true  = Projection
boolean = BoolSelector(false)
setParameterByName = Element.SetParameterByName(element=all_elements_of_category, parameterName=code_block, value=boolean)

categories_2 = Categories("WallAnalytical")
all_elements_of_category_2 = ElementsOfCategory(categories_2)

# group: Changes the alignment method of the analytical element
code_block_2 = CodeBlock { "Alignment Method"; "Top Extension Method"; "Base Extension Method"; }
# note: false = Automatic detection
# true  = Projection
boolean_2 = BoolSelector(false)
setParameterByName_2 = Element.SetParameterByName(element=all_elements_of_category_2, parameterName=code_block_2.out2, value=boolean_2)
setParameterByName_3 = Element.SetParameterByName(element=all_elements_of_category_2, parameterName=code_block_2.out1, value=boolean_2)
setParameterByName_4 = Element.SetParameterByName(element=all_elements_of_category_2, parameterName=code_block_2.out0, value=boolean_2)

# group: Changes the location of the analytical element
code_block_3 = CodeBlock { "Center of Core"; "Center of Element"; "Interior Face of Element"; "Exterior Face of Element"; }
setAnalyticalLocation = Orchid.RevitProject.Elements.SystemFamily.SetAnalyticalLocation(all_elements_of_category_2, code_block_3.out1)

# group: Changes the location of the analytical element
code_block_4 = CodeBlock { "Top of Element"; "Bottom of Element"; "Center of Element"; }
setAnalyticalLocation_2 = Orchid.RevitProject.Elements.SystemFamily.SetAnalyticalLocation(all_elements_of_category, code_block_4.out0)
