# Dynamo graph CompoundLayer.dyn (Dynamo 1.3.4.6666)

# group: Walls
categories = Categories("Walls")
all_elements_of_category = ElementsOfCategory(categories)
elementType = Element.ElementType(all_elements_of_category)
uniqueItems = List.UniqueItems(elementType)
code_block = CodeBlock { {"MyMat1","MyMat2"}; {"Glass","Copper"}; }
byName = Material.ByName(code_block.out1)
code_block_2 = CodeBlock { {0,1}; }
setCompoundLayerMaterial = Orchid.RevitProject.Elements.SystemFamilyType.SetCompoundLayerMaterial(uniqueItems, byName, code_block_2)

watch = Watch(setCompoundLayerMaterial)

# group: Floors
floor_types = FloorTypes("Suspended - 300mm Timber / Wood Planks")
code_block_3 = CodeBlock { "Glass"; }
byName_2 = Material.ByName(code_block_3)
code_block_4 = CodeBlock()
# ---------- code_block_4.designscript (10 lines) ----------
//function
5;
//thickness
100;
//boolean
true;
//placement
"Interior";
//index
2;
# ----------------------------------------
createCompoundLayer = Orchid.RevitProject.Elements.SystemFamilyType.CreateCompoundLayer(floor_types, arg2=byName_2, arg3=code_block_4.out1, arg6=code_block_4.out2, arg8=code_block_4.out4)

# group: Walls
wall_types = WallTypes("Exterior - 468mm Masonry / LW Concrete")
code_block_5 = CodeBlock { 3; }
deleteCompoundLayer = Orchid.RevitProject.Elements.SystemFamilyType.DeleteCompoundLayer(wall_types, code_block_5)

# group: Walls
wall_types_2 = WallTypes("Exterior - 468mm Masonry / LW Concrete")
code_block_6 = CodeBlock { "Glass"; }
byName_3 = Material.ByName(code_block_6)
code_block_7 = CodeBlock { 1; }
setCompoundLayerMaterial_2 = Orchid.RevitProject.Elements.SystemFamilyType.SetCompoundLayerMaterial(wall_types_2, byName_3, code_block_7)

# group: Walls
wall_types_3 = WallTypes("Exterior - 468mm Masonry / LW Concrete")
code_block_8 = CodeBlock { 300.0; 1; }
setCompoundLayerWidth = Orchid.RevitProject.Elements.SystemFamilyType.SetCompoundLayerWidth(wall_types_3, code_block_8.out0, code_block_8.out1)

# group: Walls
wall_types_4 = WallTypes("Exterior - 468mm Masonry / LW Concrete")
compound_layer_function = LayerFunction("Finish 2 [5]")
code_block_9 = CodeBlock { "Glass"; }
byName_4 = Material.ByName(code_block_9)
code_block_10 = CodeBlock()
# ---------- code_block_10.designscript (6 lines) ----------
//thickness
100;
//wrap as boolean
true;
//index
3;
# ----------------------------------------
compound_layer_placement = LayerPlacement("Interior")
createCompoundLayer_2 = Orchid.RevitProject.Elements.SystemFamilyType.CreateCompoundLayer(wall_types_4, compound_layer_function, byName_4, code_block_10.out0, arg7=compound_layer_placement, arg8=code_block_10.out2)

getCompoundLayerMaterial = Orchid.RevitProject.Elements.SystemFamilyType.GetCompoundLayerMaterial(elementType)
watch_2 = Watch(getCompoundLayerMaterial)
getCompoundLayerWidth = Orchid.RevitProject.Elements.SystemFamilyType.GetCompoundLayerWidth(elementType)
watch_3 = Watch(getCompoundLayerWidth)
name = Element.Name(getCompoundLayerMaterial)
watch_4 = Watch(name)

# group: Floors
categories_2 = Categories("Floors")
all_elements_of_category_2 = ElementsOfCategory(categories_2)
elementType_2 = Element.ElementType(all_elements_of_category_2)
uniqueItems_2 = List.UniqueItems(elementType_2)
code_block_11 = CodeBlock { {"MyMat1","MyMat2"}; {"Glass","Copper"}; }
byName_5 = Material.ByName(code_block_11.out1)
code_block_12 = CodeBlock { {0,1}; }
setCompoundLayerMaterial_3 = Orchid.RevitProject.Elements.SystemFamilyType.SetCompoundLayerMaterial(uniqueItems_2, byName_5, code_block_12)

watch_5 = Watch(setCompoundLayerMaterial_3)

# group: Roofs
categories_3 = Categories("Roofs")
all_elements_of_category_3 = ElementsOfCategory(categories_3)
elementType_3 = Element.ElementType(all_elements_of_category_3)
uniqueItems_3 = List.UniqueItems(elementType_3)
code_block_13 = CodeBlock { {"MyMat1","MyMat2"}; {"Glass","Copper"}; }
byName_6 = Material.ByName(code_block_13.out1)
code_block_14 = CodeBlock { {0,1}; }
setCompoundLayerMaterial_4 = Orchid.RevitProject.Elements.SystemFamilyType.SetCompoundLayerMaterial(uniqueItems_3, byName_6, code_block_14)

watch_6 = Watch(setCompoundLayerMaterial_4)

# group: Ceilings
categories_4 = Categories("Ceilings")
all_elements_of_category_4 = ElementsOfCategory(categories_4)
elementType_4 = Element.ElementType(all_elements_of_category_4)
uniqueItems_4 = List.UniqueItems(elementType_4)
code_block_15 = CodeBlock { "MyMat1"; "Glass"; }
byName_7 = Material.ByName(code_block_15.out1)
code_block_16 = CodeBlock { 0; }
setCompoundLayerMaterial_5 = Orchid.RevitProject.Elements.SystemFamilyType.SetCompoundLayerMaterial(uniqueItems_4, byName_7, code_block_16)

watch_7 = Watch(setCompoundLayerMaterial_5)

# group: Floors
floor_types_2 = FloorTypes("Suspended - 300mm LW Concrete / Wood Planks")
code_block_17 = CodeBlock { "Glass"; }
byName_8 = Material.ByName(code_block_17)
code_block_18 = CodeBlock { 1; }
setCompoundLayerMaterial_6 = Orchid.RevitProject.Elements.SystemFamilyType.SetCompoundLayerMaterial(floor_types_2, byName_8, code_block_18)

# group: Roofs
roof_types = RoofTypes("Warm - 600mm Roofing Asphalt Filt / Concrete")
compound_layer_function_2 = LayerFunction("Finish 2 [5]")
code_block_19 = CodeBlock { "Glass"; }
byName_9 = Material.ByName(code_block_19)
code_block_20 = CodeBlock()  # same code as code_block_10
compound_layer_placement_2 = LayerPlacement("Interior")
createCompoundLayer_3 = Orchid.RevitProject.Elements.SystemFamilyType.CreateCompoundLayer(roof_types, compound_layer_function_2, byName_9, code_block_20.out0, arg7=compound_layer_placement_2, arg8=code_block_20.out2)

# group: Walls
wall_types_5 = WallTypes("Exterior - 468mm Masonry / LW Concrete")
boolean = BoolSelector(true)
code_block_21 = CodeBlock { 1; }
setCompoundLayerWrapping = Orchid.RevitProject.Elements.SystemFamilyType.SetCompoundLayerWrapping(wall_types_5, boolean, code_block_21)

# group: Floors
floor_types_3 = FloorTypes("Suspended - 300mm Timber / Wood Planks")
boolean_2 = BoolSelector(true)
code_block_22 = CodeBlock { 1; }
setCompoundLayerStructural = Orchid.RevitProject.Elements.SystemFamilyType.SetCompoundLayerStructural(floor_types_3, boolean_2, code_block_22)

# group: Roofs
roof_types_2 = RoofTypes("Warm - 600mm Roofing Asphalt Filt / Concrete")
boolean_3 = BoolSelector(true)
code_block_23 = CodeBlock { 1; }
setCompoundLayerVariable = Orchid.RevitProject.Elements.SystemFamilyType.SetCompoundLayerVariable(roof_types_2, boolean_3, code_block_23)
