# Dynamo graph Delete.dyn (Dynamo 1.3.4.6666)

categories = Categories("Windows")
all_elements_of_category = ElementsOfCategory(categories)
categories_2 = Categories("Doors")
all_elements_of_category_2 = ElementsOfCategory(categories_2)
categories_3 = Categories("StructuralColumns")
all_elements_of_category_3 = ElementsOfCategory(categories_3)
code_block = CodeBlock(windows=all_elements_of_category, doors=all_elements_of_category_2, columns=all_elements_of_category_3)
# ---------- code_block.designscript (3 lines) ----------
{windows,
{doors,
{columns}}};
# ----------------------------------------
categories_4 = Categories("Walls")
all_elements_of_category_4 = ElementsOfCategory(categories_4)
code_block_2 = CodeBlock(windows=all_elements_of_category, doors=all_elements_of_category_2, walls=all_elements_of_category_4)
# ---------- code_block_2.designscript (3 lines) ----------
{windows,
{doors,
{walls}}};
# ----------------------------------------
delete = Orchid.RevitProject.Elements.Element.Delete(code_block_2)
watch = Watch(delete)
code_block_3 = CodeBlock(element=code_block_2) { Orchid.RevitProject.Elements.Element.Delete(element); }  # frozen
delete_2 = Orchid.RevitProject.Elements.Element.Delete(arg1=code_block_2)  # frozen
