# Dynamo graph Elem+Fam.dyn (Dynamo 1.3.4.6666)

code_block = CodeBlock { {"Floors","Walls","Windows"}; }
elementByCategory = Orchid.RevitProject.Elements.Selection.ElementByCategory(arg1=code_block)
name = Element.Name(elementByCategory)
watch = Watch(name)
familyName = Orchid.RevitProject.Elements.Element.FamilyName(elementByCategory)
watch_2 = Watch(familyName)
elementType = Element.ElementType(elementByCategory)
uniqueItems = List.UniqueItems(elementType@L2)
name_2 = Orchid.RevitProject.Elements.ElementType.Name(uniqueItems)
watch_3 = Watch(name_2)
familyName_2 = Orchid.RevitProject.Elements.ElementType.FamilyName(uniqueItems)
watch_4 = Watch(familyName_2)
info = Orchid.RevitProject.Elements.Element.Info(arg1=elementByCategory)
watch_5 = Watch(info.out0)
watch_6 = Watch(info.out1)
watch_7 = Watch(info.out2)
watch_8 = Watch(info.out3)

# group: Family
families = Families("Ext. Single-Flush")
elementByFamily = Orchid.RevitProject.Elements.Selection.ElementByFamily(families)
watch_9 = Watch(elementByFamily)
