# Dynamo graph Exterior Direction.dyn (Dynamo 1.3.4.6666)

# group: Collect Family elements
categories = Categories("Windows")
all_elements_of_category = ElementsOfCategory(categories)
categories_2 = Categories("Doors")
all_elements_of_category_2 = ElementsOfCategory(categories_2)
elementType = Element.ElementType(all_elements_of_category_2)
string = StringInput("Function")
getParameterValueByName = Element.GetParameterValueByName(element=elementType, parameterName=string)
code_block = CodeBlock(t=getParameterValueByName) { t == 0 ? false : true; }
groupByKey = List.GroupByKey(list=all_elements_of_category_2, keys=code_block)
code_block_2 = CodeBlock(keys=groupByKey.unique_keys, list=groupByKey.groups) { keys == true ? list : null; }
flatten = Flatten(code_block_2)
code_block_3 = CodeBlock { false; }
clean = List.Clean(list=flatten, preserveIndices=code_block_3)
create = List.Create(all_elements_of_category, clean)
flatten_2 = Flatten(create)
code_block_4 = CodeBlock(elements=flatten_2) { elements; }
facingOrientation = FamilyInstance.FacingOrientation(flatten_2)

# group: Collect Curtain Panels elements
categories_3 = Categories("CurtainWallPanels")
all_elements_of_category_3 = ElementsOfCategory(categories_3)
name = Element.Name(all_elements_of_category_3)
code_block_5 = CodeBlock(t=name) { t == "Wall" ? true : false; }
groupByKey_2 = List.GroupByKey(list=all_elements_of_category_3, keys=code_block_5)
code_block_6 = CodeBlock(keys=groupByKey_2.unique_keys, list=groupByKey_2.groups) { keys == false ? list : null; }
flatten_3 = Flatten(code_block_6)
code_block_7 = CodeBlock { false; }
clean_2 = List.Clean(list=flatten_3, preserveIndices=code_block_7)
elementType_2 = Element.ElementType(clean_2)
groupByKey_3 = List.GroupByKey(list=clean_2, keys=elementType_2)
code_block_8 = CodeBlock(list=groupByKey_3.groups)
# ---------- code_block_8.designscript (4 lines) ----------
// Curtain Panels
list[0];
// Basic Walls as panels (if exist)
list;
# ----------------------------------------

# group: Curtain Panels
code_block_9 = CodeBlock(elements=code_block_8.out0) { elements; }
panelPlane = CurtainPanel.PanelPlane(code_block_8.out0)
normal = Plane.Normal(panelPlane)

# group: Basic Walls as panels
verifyListExist = Python(IN[0]=code_block_8.list)
# ---------- verifyListExist.python (5 lines) ----------
try :
	if len(IN[0]) > 1 :
		OUT = IN[0][1]
except :
	OUT = None
# ----------------------------------------
code_block_10 = CodeBlock(elements=verifyListExist) { elements; }
orientation = Orchid.RevitProject.Elements.Element.Orientation(verifyListExist)

# group: Code Block content
categories_4 = Categories("Walls")
all_elements_of_category_4 = ElementsOfCategory(categories_4)
elementType_3 = Element.ElementType(all_elements_of_category_4)
string_2 = StringInput("Function")
getParameterValueByName_2 = Element.GetParameterValueByName(element=elementType_3, parameterName=string_2)
groupByKey_4 = List.GroupByKey(list=all_elements_of_category_4, keys=getParameterValueByName_2)
code_block_11 = CodeBlock(keys=groupByKey_4.unique_keys, list=groupByKey_4.groups) { keys == 1 ? list : null; }
flatten_4 = Flatten(code_block_11)
code_block_12 = CodeBlock { false; }
clean_3 = List.Clean(list=flatten_4, preserveIndices=code_block_12)
elementType_4 = Element.ElementType(clean_3)
string_3 = StringInput("Family Name")
getParameterValueByName_3 = Element.GetParameterValueByName(element=elementType_4, parameterName=string_3)
groupByKey_5 = List.GroupByKey(list=clean_3, keys=getParameterValueByName_3)
code_block_13 = CodeBlock(list=groupByKey_5.groups)
# ---------- code_block_13.designscript (4 lines) ----------
// Basic  Walls
list[0];
// Curtain Walls (if exist)
list;
# ----------------------------------------

# group: Basic Walls (stacked wall elements removed)
string_4 = StringInput("Mark")
parameterIsReadOnly = Python(IN[0]=code_block_13.out0, IN[1]=string_4)
# ---------- parameterIsReadOnly.python (22 lines) ----------
#Copyright(c) 2014-2017, DanEDU Dynamo
#Erik Falck Jørgensen, Technical University of Denmark (DTU)

import clr
clr.AddReference('RevitAPI')
from Autodesk.Revit.DB import *

elements = UnwrapElement(IN[0])
paramname = IN[1]

t1 = []
for elem in elements :
	try :
		for param in elem.Parameters :
			if param.Definition.Name == paramname :
				if param.IsReadOnly :
					t1.append(True)
				else :
					t1.append(False)
	except :
		t1.append(False)
OUT = t1
# ----------------------------------------
groupByKey_6 = List.GroupByKey(list=code_block_13.out0, keys=parameterIsReadOnly)
code_block_14 = CodeBlock(list=groupByKey_6.groups) { list[0]; }
code_block_15 = CodeBlock(elements=code_block_14) { elements; }
orientation_2 = Orchid.RevitProject.Elements.Element.Orientation(code_block_14)

# group: Curtain Walls
verifyListExist_2 = Python(IN[0]=code_block_13.list)  # same code as verifyListExist
code_block_16 = CodeBlock(elements=verifyListExist_2) { elements; }
orientation_3 = Orchid.RevitProject.Elements.Element.Orientation(verifyListExist_2)

# group: True North relative to Project North
categories_5 = Categories("ProjectBasePoint")
all_elements_of_category_5 = ElementsOfCategory(categories_5)
string_5 = StringInput("Angle to True North")
getParameterValueByName_4 = Element.GetParameterValueByName(element=all_elements_of_category_5, parameterName=string_5)

# group: Create element list. Create 'True North' list based on count
create_2 = List.Create(code_block_4, code_block_9, code_block_10, code_block_15, code_block_16)
code_block_17 = CodeBlock(list=create_2, north=getParameterValueByName_4)
# ---------- code_block_17.designscript (4 lines) ----------
// Element list
t1 = DSCore.List.Clean(Flatten(list), false);
// 'True North' list based on count
DSCore.List.Cycle(north,Count(t1));
# ----------------------------------------

# group: Parameter name to be set
string_6 = StringInput("Exterior Direction")

# group: Calculate orientation relative to True North (and Project North)
create_3 = List.Create(facingOrientation, normal, orientation, orientation_2, orientation_3)
code_block_18 = CodeBlock(list=create_3)
# ---------- code_block_18.designscript (2 lines) ----------
// Element relative direction
DSCore.List.Clean(Flatten(list), false);
# ----------------------------------------
YAxis = Vector.YAxis()
ZAxis = Vector.ZAxis()
angleAboutAxis = Vector.AngleAboutAxis(code_block_18, YAxis, ZAxis)
code_block_19 = CodeBlock(a=angleAboutAxis, b=code_block_17.out1) { Math.Round(a+b >= 360 ? a+b-360 : a+b , 3); }

setParameterByName = Element.SetParameterByName(element=code_block_17.t1, parameterName=string_6, value=code_block_19)
