# Dynamo graph Family.Save.dyn (Dynamo 1.3.4.6666)

# group: selected families by category in project
natural_category_name = CodeBlock()
# ---------- natural_category_name.designscript (12 lines) ----------
{
"Casework",
"Columns",
"Doors",
"Windows",
"Specialty Equipment",
"Structural Columns",
"Structural Foundations",
"Structural Framing",
"Structural Beam Systems",
"Structural Stiffeners"
};
# ----------------------------------------
elementByCategory = Orchid.RevitProject.Elements.Selection.ElementByCategory(arg1=natural_category_name)
string = StringInput(".\testSet")
boolean = BoolSelector(false)

elementType = Element.ElementType(elementByCategory)

# group (continued): selected families by category in project
uniqueItems = List.UniqueItems(elementType, lacing=Longest)
flatten = Flatten(uniqueItems)
family = FamilyType.Family(flatten)
save = Orchid.RevitProject.Elements.Family.Save(family, string, boolean)

watch = Watch(save)
