# Dynamo graph File+Fam-LoadFamily.dyn (Dynamo 1.3.4.6666)

# group: Open all files in directory and sub directories
string = StringInput(".\testSet")
code_block = CodeBlock { "*.rfa"; }
boolean = BoolSelector(false)
contents = Orchid.Core.Directory.Contents(string, code_block, boolean)
loadFamily = Orchid.Core.File.LoadFamily(contents)

watch = Watch(loadFamily)

# group: Open all project files in directory
string_2 = StringInput(".\testSet")
code_block_2 = CodeBlock { "*.rvt"; }
contents_2 = Orchid.Core.Directory.Contents(string_2, code_block_2)
backgroundOpen = Orchid.RevitProject.Common.Document.BackgroundOpen(contents_2)  # frozen
loadFamily_2 = Orchid.Core.File.LoadFamily(backgroundOpen, contents)
await_ = Orchid.Core.DataStream.Await(backgroundOpen, loadFamily_2)
boolean_2 = BoolSelector(true)
close = Orchid.RevitProject.Common.Document.Close(await_, boolean_2)

watch_2 = Watch(loadFamily_2)

# group: Open all files in directory and sub directories
string_3 = StringInput(".\testSet")
code_block_3 = CodeBlock { "*.rfa"; }
boolean_3 = BoolSelector(false)
contents_3 = Orchid.Core.Directory.Contents(string_3, code_block_3, boolean_3)
backgroundOpen_2 = Orchid.RevitProject.Common.Document.BackgroundOpen(contents_3)  # frozen
loadFamily_3 = Orchid.RevitProject.Common.Document.LoadFamily(backgroundOpen_2)
await_2 = Orchid.Core.DataStream.Await(backgroundOpen_2, loadFamily_3)
close_2 = Orchid.RevitProject.Common.Document.Close(await_2)

watch_3 = Watch(loadFamily_3)
