# Dynamo graph Filter.dyn (Dynamo 1.3.4.6666)

# group: Filter elements
code_block = CodeBlock { {"Windows","Doors"}; }
byName = Category.ByName(code_block)
all_elements_of_category = ElementsOfCategory(byName)
code_block_2 = CodeBlock { "=="; "Level"; }
levels = Levels("Level 1")
byParameter = Orchid.RevitProject.Elements.Filter.ByParameter(all_elements_of_category, code_block_2.out0, code_block_2.out1, levels)
elementType = Element.ElementType(all_elements_of_category)
code_block_3 = CodeBlock { "Greater"; "Width"; 1000; }
byParameter_2 = Orchid.RevitProject.Elements.Filter.ByParameter(elementType, code_block_3.out0, code_block_3.out1, code_block_3.out2)
code_block_4 = CodeBlock { "Contains"; "12x"; }
byName_2 = Orchid.RevitProject.Elements.Filter.ByName(all_elements_of_category, code_block_4.out0, code_block_4.out1)
code_block_5 = CodeBlock { "Equals"; "Family"; }
family_types = FamilyTypes("Int. Single-Flush:9x21M")
byParameter_3 = Orchid.RevitProject.Elements.Filter.ByParameter(all_elements_of_category, code_block_5.out0, code_block_5.out1, family_types)
code_block_6 = CodeBlock { "Equals"; "Doors"; "Windows"; }
byCategory = Orchid.RevitProject.Elements.Filter.ByCategory(all_elements_of_category, code_block_6.out0, code_block_6.out1)
byName_3 = Category.ByName(code_block_6.out2)
byCategory_2 = Orchid.RevitProject.Elements.Filter.ByCategory(all_elements_of_category, code_block_6.out0, byName_3)

watch = Watch(byParameter)
watch_2 = Watch(byParameter_2)
watch_3 = Watch(byName_2)
watch_4 = Watch(byParameter_3)
watch_5 = Watch(byCategory)
code_block_7 = CodeBlock()
# ---------- code_block_7.designscript (25 lines) ----------
// Dynamo RuleTypes
// Please notice the spelling
// issue --> GeaterOrEqual
"BeginsWith";
"Contains";
"EndsWith";
"Equals";
"Greater";
"Less";
"GeaterOrEqual";
"GreaterOrEqual";
"LessOrEqual";
"NotBeginsWith";
"NotContains";
"NotEndsWith";
"NotEquals";

// Orchid additional
// Ruletypes
"==";
">";
"<";
">=";
"<=";
"!=";
# ----------------------------------------
select_rule_type = RuleTypes("GeaterOrEqual")
watch_6 = Watch(byCategory_2)
