# Dynamo graph Intersect.dyn (Dynamo 1.3.4.6666)

built_in_categories = CodeBlock()
# ---------- built_in_categories.designscript (26 lines) ----------
{
"OST_Casework",
"OST_Ceilings",
"OST_Columns",
"OST_CurtainWallMullions",
"OST_CurtainWallPanels",
"OST_CurtaSystem",
"OST_Doors",
"OST_Entourage",
"OST_Floors",
"OST_Furniture",
"OST_FurnitureSystems",
"OST_GenericModel",
"OST_PlumbingFixtures",
"OST_Ramps",
"OST_Roofs",
"OST_SpecialityEquipment",
"OST_Stairs",
"OST_StructuralColumns",
"OST_StructuralFoundation",
"OST_StructuralFraming",
"OST_StructuralFramingSystem",
"OST_StructuralStiffener",
"OST_Walls",
"OST_Windows"
};
# ----------------------------------------
natural_category_name = CodeBlock()
# ---------- natural_category_name.designscript (26 lines) ----------
{
"Casework",
"Ceilings",
"Columns",
"Curtain Wall Mullions",
"Curtain Panels",
"Curtain Systems",
"Doors",
"Entourage",
"Floors",
"Furniture",
"Furniture Systems",
"Generic Models",
"Plumbing Fixtures",
"Ramps",
"Roofs",
"Specialty Equipment",
"Stairs",
"Structural Columns",
"Structural Foundations",
"Structural Framing",
"Structural Beam Systems",
"Structural Stiffeners",
"Walls",
"Windows"
};
# ----------------------------------------

# group: Category intersect element
elementByCategory = Orchid.RevitProject.Elements.Selection.ElementByCategory(arg1=natural_category_name)
watch = Watch(elementByCategory.out0)
categoryIntersect = Orchid.RevitProject.Elements.Element.CategoryIntersect(elementByCategory.out0)
watch_2 = Watch(categoryIntersect)
watch_3 = Watch(elementByCategory.out1)

# group: Category intersect element
elementHasMaterial = Orchid.RevitProject.Elements.Selection.ElementHasMaterial()
categoryIntersect_2 = Orchid.RevitProject.Elements.Element.CategoryIntersect(elementHasMaterial.out0)
watch_4 = Watch(categoryIntersect_2)
watch_5 = Watch(elementHasMaterial.out0)
watch_6 = Watch(elementHasMaterial.out1)

# note: OOTB nodes
byName = Category.ByName(natural_category_name)
all_elements_of_category = ElementsOfCategory(byName)
clean = Orchid.Common.List.Clean(all_elements_of_category)
watch_7 = Watch(clean)
categoryIntersect_3 = Orchid.RevitProject.Elements.Element.CategoryIntersect(clean)
watch_8 = Watch(categoryIntersect_3)

# group: Sorting by boolean
flatten = Flatten(elementByCategory.out0)
hasIntersect = Orchid.RevitProject.Elements.Element.HasIntersect(elementByCategory.out0)
anyTrue = Orchid.Common.List.AnyTrue(hasIntersect@L2)
filterByBoolMask = List.FilterByBoolMask(list=flatten, mask=anyTrue)
categoryIntersect_4 = Orchid.RevitProject.Elements.Element.CategoryIntersect(filterByBoolMask.in)
watch_9 = Watch(categoryIntersect_4)
watch_10 = Watch(filterByBoolMask.in)
watch_11 = Watch(flatten)
watch_12 = Watch(anyTrue)

# group: Category intersect element
code_block = CodeBlock { "Structural Framing"; {"Doors", "Walls"}; }
byName_2 = Category.ByName(code_block.out0)
all_elements_of_category_2 = ElementsOfCategory(byName_2)
byName_3 = Category.ByName(code_block.out1)
categoryIntersect_5 = Orchid.RevitProject.Elements.Element.CategoryIntersect(all_elements_of_category_2, byName_3)
watch_13 = Watch(categoryIntersect_5)
watch_14 = Watch(all_elements_of_category_2)

# group: Element intersect element
code_block_2 = CodeBlock { "Structural Framing"; {"Doors", "Walls"}; }
byName_4 = Category.ByName(code_block_2.out0)
all_elements_of_category_3 = ElementsOfCategory(byName_4)
byName_5 = Category.ByName(code_block_2.out1)
all_elements_of_category_4 = ElementsOfCategory(byName_5)
flatten_2 = Flatten(all_elements_of_category_4)
elementIntersect = Orchid.RevitProject.Elements.Element.ElementIntersect(all_elements_of_category_3, flatten_2)
watch_15 = Watch(elementIntersect)
watch_16 = Watch(all_elements_of_category_3)

# group: Element intersect element
elementHasMaterial_2 = Orchid.RevitProject.Elements.Selection.ElementHasMaterial()
watch_17 = Watch(elementHasMaterial_2.out0)
watch_18 = Watch(elementHasMaterial_2.out1)
flatten_3 = Flatten(elementHasMaterial_2.out0)
elementIntersect_2 = Orchid.RevitProject.Elements.Element.ElementIntersect(elementHasMaterial_2.out0, flatten_3)
watch_19 = Watch(elementIntersect_2)

# group: Element intersect
elementHasMaterial_3 = Orchid.RevitProject.Elements.Selection.ElementHasMaterial()
watch_20 = Watch(elementHasMaterial_3.out0)
watch_21 = Watch(elementHasMaterial_3.out1)
elementIntersect_3 = Orchid.RevitProject.Elements.Element.ElementIntersect(elementHasMaterial_3.out0)
watch_22 = Watch(elementIntersect_3)
