# Dynamo graph Material.dyn (Dynamo 1.3.4.6666)

elementHasMaterial = Orchid.RevitProject.Elements.Selection.ElementHasMaterial()
clean = Orchid.Common.List.Clean(elementHasMaterial)
flatten = Flatten(clean)

# group: get elements sorted by used materials including summarized area and volumne
getMaterials = Element.GetMaterials(element=flatten)
flatten_2 = Flatten(getMaterials)
uniqueItems = List.UniqueItems(flatten_2)
sum = Orchid.RevitProject.Elements.Material.Sum(uniqueItems)
element_by_material_watch = Watch(sum.out0)
volumne_watch = Watch(sum.out2)
area_watch = Watch(sum.out1)
name = Element.Name(uniqueItems)
material_name_watch = Watch(name)

natural_category_name = CodeBlock()
# ---------- natural_category_name.designscript (26 lines) ----------
{
"Casework",
"Ceilings",
"Columns",
"Curtain Wall Mullions",
"Curtain Panels",
"Curtain Systems",
"Doors",
"Entourage",
"Floors",
"Furniture",
"Furniture Systems",
"Generic Models",
"Plumbing Fixtures",
"Ramps",
"Roofs",
"Specialty Equipment",
"Stairs",
"Structural Columns",
"Structural Foundations",
"Structural Framing",
"Structural Beam Systems",
"Structural Stiffeners",
"Walls",
"Windows"
};
# ----------------------------------------
byName = Category.ByName(natural_category_name)
all_elements_of_category = ElementsOfCategory(byName)

# group: get materials--their area and volumne--by elements
sumByElement = Orchid.RevitProject.Elements.Material.SumByElement(flatten)
area_watch_2 = Watch(sumByElement.out1)
volumne_watch_2 = Watch(sumByElement.out2)
material_by_element_watch = Watch(sumByElement.out0)
name_2 = Element.Name(sumByElement.out0)
material_name_watch_2 = Watch(name_2)

# group: get summarized (area and volumne) materials by elements and their asset density
quantity = Orchid.RevitProject.Elements.Material.Quantity(flatten)
volumne_watch_3 = Watch(quantity.out2)
density = Orchid.RevitMaterial.Material.Density(quantity.out0)
physical_density_watch = Watch(density.out0)
thermal_density_watch = Watch(density.out1)
name_3 = Element.Name(quantity.out0)
material_name_watch_3 = Watch(name_3)
area_watch_3 = Watch(quantity.out1)
