# Dynamo graph Selection.dyn (Dynamo 1.3.4.6666)

built_in_categories = CodeBlock()
# ---------- built_in_categories.designscript (26 lines) ----------
{
"OST_Casework",
"OST_Ceilings",
"OST_Columns",
"OST_CurtainWallMullions",
"OST_CurtainWallPanels",
"OST_CurtaSystem",
"OST_Doors",
"OST_Entourage",
"OST_Floors",
"OST_Furniture",
"OST_FurnitureSystems",
"OST_GenericModel",
"OST_PlumbingFixtures",
"OST_Ramps",
"OST_Roofs",
"OST_SpecialityEquipment",
"OST_Stairs",
"OST_StructuralColumns",
"OST_StructuralFoundation",
"OST_StructuralFraming",
"OST_StructuralFramingSystem",
"OST_StructuralStiffener",
"OST_Walls",
"OST_Windows"
};
# ----------------------------------------
natural_category_name = CodeBlock()
# ---------- natural_category_name.designscript (26 lines) ----------
{
"Casework",
"Ceilings",
"Columns",
"Curtain Wall Mullions",
"Curtain Panels",
"Curtain Systems",
"Doors",
"Entourage",
"Floors",
"Furniture",
"Furniture Systems",
"Generic Models",
"Plumbing Fixtures",
"Ramps",
"Roofs",
"Specialty Equipment",
"Stairs",
"Structural Columns",
"Structural Foundations",
"Structural Framing",
"Structural Beam Systems",
"Structural Stiffeners",
"Walls",
"Windows"
};
# ----------------------------------------

# group: Selection by element
elementByCategory = Orchid.RevitProject.Elements.Selection.ElementByCategory(arg1=natural_category_name)
watch = Watch(elementByCategory.out0)
elementHasMaterial = Orchid.RevitProject.Elements.Selection.ElementHasMaterial()
watch_2 = Watch(elementHasMaterial.out0)
watch_3 = Watch(elementHasMaterial.out1)
watch_4 = Watch(elementByCategory.out1)

# note: OOTB nodes
byName = Category.ByName(natural_category_name)
all_elements_of_category = ElementsOfCategory(byName)
clean = Orchid.Common.List.Clean(all_elements_of_category)
watch_5 = Watch(clean)
code_block = CodeBlock()
# ---------- code_block.designscript (9 lines) ----------
"Model";
"Annotation";
"AnalyticalModel";
"Internal";

{"Model",
"Annotation",
"AnalyticalModel",
"Internal"};
# ----------------------------------------

# group: Selection by element type
boolean = BoolSelector(false)
elementTypeByCategoryType = Orchid.RevitProject.Elements.Selection.ElementTypeByCategoryType(arg1=code_block.out0, arg2=boolean)
watch_6 = Watch(elementTypeByCategoryType.out0)
watch_7 = Watch(elementTypeByCategoryType.out2)
watch_8 = Watch(elementTypeByCategoryType.out1)

# group: Family
code_block_2 = CodeBlock()
# ---------- code_block_2.designscript (2 lines) ----------
{"Doors",
"Windows"};
# ----------------------------------------
byName_2 = Category.ByName(code_block_2)
byCategory = Orchid.RevitProject.Elements.Family.ByCategory(byName_2)
watch_9 = Watch(byCategory)
all = Orchid.RevitProject.Elements.Family.All()
watch_10 = Watch(all.out1)
watch_11 = Watch(all.out0)

# group: FamilyType
code_block_3 = CodeBlock()  # same code as code_block_2
byCategory_2 = Orchid.RevitProject.Elements.FamilyType.ByCategory(code_block_3)
watch_12 = Watch(byCategory_2)
all_2 = Orchid.RevitProject.Elements.FamilyType.All()
watch_13 = Watch(all_2.out0)
watch_14 = Watch(all_2.out1)

# group: Converters
toRevitType = Orchid.RevitProject.Elements.Category.ToRevitType(byName)
toDynamoType = Orchid.RevitProject.Elements.Category.ToDynamoType(toRevitType)
watch_15 = Watch(toDynamoType)

# group: Converters Note: FamilyType in a project document is denoted FamilySymbol in the Autodesk Revit API!
toRevitType_2 = Orchid.RevitProject.Elements.Element.ToRevitType(byCategory_2)
toDynamoType_2 = Orchid.RevitProject.Elements.Element.ToDynamoType(toRevitType_2)
name = Element.Name(toDynamoType_2)
watch_16 = Watch(name)
watch_17 = Watch(toDynamoType_2)
watch_18 = Watch(toRevitType_2)

# group: Model elements
modelElement = Orchid.RevitProject.Elements.Selection.ModelElement()
watch_19 = Watch(modelElement.out0)
watch_20 = Watch(modelElement.out1)

# group: Selection by level
levels = Levels("Level 1")
boolean_2 = BoolSelector(true)
elementByLevel = Orchid.RevitProject.Elements.Selection.ElementByLevel(arg1=levels, arg2=boolean_2)
watch_21 = Watch(elementByLevel.out0)
watch_22 = Watch(elementByLevel.out1)

# group: Selection by element type
boolean_3 = BoolSelector(false)
elementTypeHasMaterial = Orchid.RevitProject.Elements.Selection.ElementTypeHasMaterial(arg1=boolean_3)
watch_23 = Watch(elementTypeHasMaterial.out1)
watch_24 = Watch(elementTypeHasMaterial.out0)

# group: Selection by element
elementByCategoryType = Orchid.RevitProject.Elements.Selection.ElementByCategoryType(arg1=code_block.out0)
watch_25 = Watch(elementByCategoryType.out0)
watch_26 = Watch(elementByCategoryType.out2)
watch_27 = Watch(elementByCategoryType.out1)

# group: Selection
elementByFamily = Orchid.RevitProject.Elements.Selection.ElementByFamily(byCategory)
watch_28 = Watch(elementByFamily)
