# Dynamo graph SpatialElement.dyn (Dynamo 1.3.4.6666)

# group: Spatial Elements
getBoundary = Orchid.RevitProject.Elements.SpatialElement.GetBoundary()
watch = Watch(getBoundary.out0)
watch_2 = Watch(getBoundary.out1)
getSeparationLine = Orchid.RevitProject.Elements.SpatialElement.GetSeparationLine()
watch_3 = Watch(getSeparationLine.out0)
watch_4 = Watch(getSeparationLine.out1)
watch_5 = Watch(getBoundary.out2)
watch_6 = Watch(getSeparationLine.out2)

# group: Rooms, Spaces, Areas
getAreaBoundary = Orchid.RevitProject.Elements.SpatialElement.GetAreaBoundary()
watch_7 = Watch(getAreaBoundary.out0)
watch_8 = Watch(getAreaBoundary.out1)
getSpaceBoundary = Orchid.RevitProject.Elements.SpatialElement.GetSpaceBoundary()
watch_9 = Watch(getSpaceBoundary.out0)
watch_10 = Watch(getSpaceBoundary.out1)
getRoomBoundary = Orchid.RevitProject.Elements.SpatialElement.GetRoomBoundary()
watch_11 = Watch(getRoomBoundary.out0)
watch_12 = Watch(getRoomBoundary.out1)
watch_13 = Watch(getRoomBoundary.out2)
watch_14 = Watch(getSpaceBoundary.out2)
watch_15 = Watch(getAreaBoundary.out2)

categories = Categories("Areas")
categories_2 = Categories("MEPSpaces")
categories_3 = Categories("Rooms")
all_elements_of_category = ElementsOfCategory(categories_3)
getSeparationLine_2 = Orchid.RevitProject.Elements.SpatialElement.GetSeparationLine(arg1=all_elements_of_category)
watch_16 = Watch(getSeparationLine_2.out0)
watch_17 = Watch(getSeparationLine_2.out1)
getBoundary_2 = Orchid.RevitProject.Elements.SpatialElement.GetBoundary(arg1=all_elements_of_category)
watch_18 = Watch(getBoundary_2.out0)
watch_19 = Watch(getBoundary_2.out1)

# group: Revit links
categories_4 = Categories("Areas")
categories_5 = Categories("MEPSpaces")
getRevitFile = Orchid.RevitProject.Common.Link.GetRevitFile()
instance = Orchid.RevitProject.Common.Link.Instance(getRevitFile)
document = Orchid.RevitProject.Common.Link.Document(instance)
categories_6 = Categories("Rooms")
elementByCategory = Orchid.RevitProject.Elements.Selection.ElementByCategory(document, categories_6)
getSeparationLine_3 = Orchid.RevitProject.Elements.SpatialElement.GetSeparationLine(document, elementByCategory)
watch_20 = Watch(getSeparationLine_3.out1)
getBoundary_3 = Orchid.RevitProject.Elements.SpatialElement.GetBoundary(document, elementByCategory)
watch_21 = Watch(getBoundary_3.out1)
watch_22 = Watch(getSeparationLine_3.out0)
watch_23 = Watch(getBoundary_3.out0)
