# Dynamo graph SystemFamilyType.dyn (Dynamo 1.3.4.6666)

wall_types = WallTypes("Exterior - 468mm Masonry / LW Concrete")
thermalProperties = Orchid.RevitProject.Elements.SystemFamilyType.ThermalProperties(wall_types)
watch = Watch(thermalProperties.out0)
watch_2 = Watch(thermalProperties.out1)
watch_3 = Watch(thermalProperties.out2)
watch_4 = Watch(thermalProperties.out3)
watch_5 = Watch(thermalProperties.out4)
function = Orchid.RevitProject.Elements.WallType.Function(wall_types)
watch_6 = Watch(function)
kind = Orchid.RevitProject.Elements.WallType.Kind(wall_types)
watch_7 = Watch(kind)
width = Orchid.RevitProject.Elements.WallType.Width(wall_types)
watch_8 = Watch(width)

# group: Floor
floor_types = FloorTypes("Suspended - 300mm LW Concrete / Wood Planks")
structuralMaterial = Orchid.RevitProject.Elements.FloorType.StructuralMaterial(floor_types)
watch_9 = Watch(structuralMaterial)
isFoundationSlab = Orchid.RevitProject.Elements.FloorType.IsFoundationSlab(floor_types)
watch_10 = Watch(isFoundationSlab)
thermalProperties_2 = Orchid.RevitProject.Elements.SystemFamilyType.ThermalProperties(floor_types)
watch_11 = Watch(thermalProperties_2.out4)
watch_12 = Watch(thermalProperties_2.out3)
watch_13 = Watch(thermalProperties_2.out2)
watch_14 = Watch(thermalProperties_2.out1)
watch_15 = Watch(thermalProperties_2.out0)

# group: Ceiling
ceiling_types = CeilingTypes("Generic - 300mm")
thermalProperties_3 = Orchid.RevitProject.Elements.SystemFamilyType.ThermalProperties(ceiling_types)
watch_16 = Watch(thermalProperties_3.out0)
watch_17 = Watch(thermalProperties_3.out1)
watch_18 = Watch(thermalProperties_3.out2)
watch_19 = Watch(thermalProperties_3.out3)
watch_20 = Watch(thermalProperties_3.out4)

# group: Roof
roof_types = RoofTypes("Warm - 500mm Steel Bar Joist / Steel Deck / EPDM Membrane")
thermalProperties_4 = Orchid.RevitProject.Elements.SystemFamilyType.ThermalProperties(roof_types)
watch_21 = Watch(thermalProperties_4.out4)
watch_22 = Watch(thermalProperties_4.out3)
watch_23 = Watch(thermalProperties_4.out2)
watch_24 = Watch(thermalProperties_4.out1)
watch_25 = Watch(thermalProperties_4.out0)
