# Dynamo graph Tagging.dyn (Dynamo 1.3.4.6666)

# group: Room tagging
model_views = ModelView("Level 1 (room)")
categories = Categories("Rooms")
all_elements_of_category = ElementsOfCategory(categories)
code_block = CodeBlock { "Room Tag"; "Text Only"; }
byFamilyNameAndTypeName = FamilyType.ByFamilyNameAndTypeName(code_block.out0, code_block.out1)
bySpatialElement = Orchid.RevitProject.Annotations.Tag.BySpatialElement(model_views, all_elements_of_category, byFamilyNameAndTypeName)

watch = Watch(bySpatialElement)

# group: Room tagging by location
model_views_2 = ModelView("Level 1 (room)")
categories_2 = Categories("Rooms")
all_elements_of_category_2 = ElementsOfCategory(categories_2)
code_block_2 = CodeBlock { "Room Tag"; "Text Only"; }
byFamilyNameAndTypeName_2 = FamilyType.ByFamilyNameAndTypeName(code_block_2.out0, code_block_2.out1)
getLocation = Element.GetLocation(all_elements_of_category_2)
bySpatialElementAndLocation = Orchid.RevitProject.Annotations.Tag.BySpatialElementAndLocation(model_views_2, all_elements_of_category_2, byFamilyNameAndTypeName_2, getLocation)

watch_2 = Watch(bySpatialElementAndLocation)

# group: Space tagging
model_views_3 = ModelView("Level 1 (hvac)")
categories_3 = Categories("MEPSpaces")
all_elements_of_category_3 = ElementsOfCategory(categories_3)
code_block_3 = CodeBlock { "Space Tag"; "Text and Area"; }
byFamilyNameAndTypeName_3 = FamilyType.ByFamilyNameAndTypeName(code_block_3.out0, code_block_3.out1)
bySpatialElement_2 = Orchid.RevitProject.Annotations.Tag.BySpatialElement(model_views_3, all_elements_of_category_3, byFamilyNameAndTypeName_3)

watch_3 = Watch(bySpatialElement_2)

# group: Space tagging by location
model_views_4 = ModelView("Level 1 (hvac)")
categories_4 = Categories("MEPSpaces")
all_elements_of_category_4 = ElementsOfCategory(categories_4)
code_block_4 = CodeBlock { "Space Tag"; "Text and Area"; }
byFamilyNameAndTypeName_4 = FamilyType.ByFamilyNameAndTypeName(code_block_4.out0, code_block_4.out1)
getLocation_2 = Element.GetLocation(all_elements_of_category_4)
bySpatialElementAndLocation_2 = Orchid.RevitProject.Annotations.Tag.BySpatialElementAndLocation(model_views_4, all_elements_of_category_4, byFamilyNameAndTypeName_4, getLocation_2)

watch_4 = Watch(bySpatialElementAndLocation_2)

# group: Element tagging
model_views_5 = ModelView("Level 1 (room)")
categories_5 = Categories("Doors")
all_elements_of_category_5 = ElementsOfCategory(categories_5)
code_block_5 = CodeBlock { "Door Tag"; "Hinging"; }
byFamilyNameAndTypeName_5 = FamilyType.ByFamilyNameAndTypeName(code_block_5.out0, code_block_5.out1)
byElement = Orchid.RevitProject.Annotations.Tag.ByElement(model_views_5, all_elements_of_category_5, byFamilyNameAndTypeName_5)

watch_5 = Watch(byElement)

# group: Element tagging by location
model_views_6 = ModelView("Level 1 (room)")
categories_6 = Categories("Doors")
all_elements_of_category_6 = ElementsOfCategory(categories_6)
code_block_6 = CodeBlock { "Door Tag"; "Hinging"; }
byFamilyNameAndTypeName_6 = FamilyType.ByFamilyNameAndTypeName(code_block_6.out0, code_block_6.out1)
getLocation_3 = Element.GetLocation(all_elements_of_category_6)
byElementAndLocation = Orchid.RevitProject.Annotations.Tag.ByElementAndLocation(model_views_6, all_elements_of_category_6, byFamilyNameAndTypeName_6, getLocation_3)

watch_6 = Watch(byElementAndLocation)

# group: Area tagging
model_views_7 = ModelView("Level 1 (area)")
categories_7 = Categories("Areas")
all_elements_of_category_7 = ElementsOfCategory(categories_7)
code_block_7 = CodeBlock { "Area Tag"; "Text Only"; }
byFamilyNameAndTypeName_7 = FamilyType.ByFamilyNameAndTypeName(code_block_7.out0, code_block_7.out1)
bySpatialElement_3 = Orchid.RevitProject.Annotations.Tag.BySpatialElement(model_views_7, all_elements_of_category_7, byFamilyNameAndTypeName_7)

watch_7 = Watch(bySpatialElement_3)

# group: Area tagging by location
model_views_8 = ModelView("Level 1 (area)")
categories_8 = Categories("Areas")
all_elements_of_category_8 = ElementsOfCategory(categories_8)
code_block_8 = CodeBlock { "Area Tag"; "Text Only"; }
byFamilyNameAndTypeName_8 = FamilyType.ByFamilyNameAndTypeName(code_block_8.out0, code_block_8.out1)
getLocation_4 = Element.GetLocation(all_elements_of_category_8)
bySpatialElementAndLocation_3 = Orchid.RevitProject.Annotations.Tag.BySpatialElementAndLocation(model_views_8, all_elements_of_category_8, byFamilyNameAndTypeName_8, getLocation_4)

watch_8 = Watch(bySpatialElementAndLocation_3)
