# Dynamo graph Transfer-Copy.dyn (Dynamo 1.3.4.6666)

string = StringInput(".\")
string_2 = StringInput("2019_defaultProject_extended")
code_block = CodeBlock(a=string, b=string_2) { a+b+".rvt"; }
fromPath = Orchid.Common.File.FromPath(code_block)
backgroundOpen = Orchid.RevitProject.Common.Document.BackgroundOpen(fromPath)

# group: Copy Element
code_block_2 = CodeBlock(document=backgroundOpen) { document; }
categories = Categories("Floors")
elementByCategory = Orchid.RevitProject.Elements.Selection.ElementByCategory(code_block_2, categories)
copyElement = Orchid.RevitProject.Common.Document.CopyElement(code_block_2, arg2=elementByCategory)
watch = Watch(copyElement)
await_ = Orchid.Common.DataStream.Await(code_block_2, copyElement)

# group: Copy Schedule
code_block_3 = CodeBlock(document=backgroundOpen) { document; }
all = Orchid.RevitProject.Views.View.All(code_block_3)
string_from_object = FromObject(all)
code_block_4 = CodeBlock { "Schedule"; }
contains = String.Contains(str=string_from_object, searchFor=code_block_4)
filterByBoolMask = List.FilterByBoolMask(list=all, mask=contains)
copySchedule = Orchid.RevitProject.Common.Document.CopySchedule(code_block_3, arg2=filterByBoolMask.in)
watch_2 = Watch(copySchedule)
await_2 = Orchid.Common.DataStream.Await(code_block_3, copySchedule)

# group: Copy Drafting View
code_block_5 = CodeBlock(document=backgroundOpen) { document; }
all_2 = Orchid.RevitProject.Views.View.All(code_block_5)
string_from_object_2 = FromObject(all_2)
code_block_6 = CodeBlock { "Drafting"; }
contains_2 = String.Contains(str=string_from_object_2, searchFor=code_block_6)
filterByBoolMask_2 = List.FilterByBoolMask(list=all_2, mask=contains_2)
copyDraftingView = Orchid.RevitProject.Common.Document.CopyDraftingView(code_block_5, arg2=filterByBoolMask_2.in)
watch_3 = Watch(copyDraftingView)
await_3 = Orchid.Common.DataStream.Await(code_block_5, copyDraftingView)

# group: Transfer Category
code_block_7 = CodeBlock(document=backgroundOpen) { document; }
categories_2 = Categories("Roofs")
boolean = BoolSelector(true)
transferByCategory = Orchid.RevitProject.Common.Document.TransferByCategory(code_block_7, arg2=categories_2, arg3=boolean)
watch_4 = Watch(transferByCategory)
await_4 = Orchid.Common.DataStream.Await(code_block_7, transferByCategory)

# group: Transfer Type
code_block_8 = CodeBlock(document=backgroundOpen) { document; }
string_3 = StringInput("xExterior - 468mm Masonry / LW Concrete")
string_4 = StringInput("x18x12M")
create = List.Create(string_3, string_4)
boolean_2 = BoolSelector(true)
transferByElementType = Orchid.RevitProject.Common.Document.TransferByElementType(code_block_8, arg2=create, arg3=boolean_2)
watch_5 = Watch(transferByElementType)
await_5 = Orchid.Common.DataStream.Await(code_block_8, transferByElementType)

# group: Transfer Family
code_block_9 = CodeBlock(document=backgroundOpen) { document; }
string_5 = StringInput("Single-Light")
string_6 = StringInput("xSingle-Light")
create_2 = List.Create(string_5, string_6)
boolean_3 = BoolSelector(true)
transferByFamily = Orchid.RevitProject.Common.Document.TransferByFamily(code_block_9, arg2=create_2, arg3=boolean_3)
watch_6 = Watch(transferByFamily)
await_6 = Orchid.Common.DataStream.Await(code_block_9, transferByFamily)

# group: Close document
create_3 = List.Create(await_3, await_2, await_, await_4, await_5, await_6)
firstItem = List.FirstItem(create_3)
close = Orchid.RevitProject.Common.Document.Close(firstItem)
