# Dynamo graph Workset.dyn (Dynamo 1.3.4.6666)

# group: Selection
built_in_categories = CodeBlock()
# ---------- built_in_categories.designscript (26 lines) ----------
{
"OST_Casework",
"OST_Ceilings",
"OST_Columns",
"OST_CurtainWallMullions",
"OST_CurtainWallPanels",
"OST_CurtaSystem",
"OST_Doors",
"OST_Entourage",
"OST_Floors",
"OST_Furniture",
"OST_FurnitureSystems",
"OST_GenericModel",
"OST_PlumbingFixtures",
"OST_Ramps",
"OST_Roofs",
"OST_SpecialityEquipment",
"OST_Stairs",
"OST_StructuralColumns",
"OST_StructuralFoundation",
"OST_StructuralFraming",
"OST_StructuralFramingSystem",
"OST_StructuralStiffener",
"OST_Walls",
"OST_Windows"
};
# ----------------------------------------
natural_category_name = CodeBlock()
# ---------- natural_category_name.designscript (26 lines) ----------
{
"Casework",
"Ceilings",
"Columns",
"Curtain Wall Mullions",
"Curtain Panels",
"Curtain Systems",
"Doors",
"Entourage",
"Floors",
"Furniture",
"Furniture Systems",
"Generic Models",
"Plumbing Fixtures",
"Ramps",
"Roofs",
"Specialty Equipment",
"Stairs",
"Structural Columns",
"Structural Foundations",
"Structural Framing",
"Structural Beam Systems",
"Structural Stiffeners",
"Walls",
"Windows"
};
# ----------------------------------------
byName = Category.ByName(natural_category_name)
elementByCategory = Orchid.RevitProject.Elements.Selection.ElementByCategory(arg1=byName)
code_block = CodeBlock { "Workset Text"; }
getWorkset = Orchid.RevitProject.Elements.Element.GetWorkset(elementByCategory)
name = Orchid.RevitProject.Common.Workset.Name(getWorkset)
setParameterByName = Element.SetParameterByName(element=elementByCategory, parameterName=code_block, value=name)

# group: Selection
code_block_2 = CodeBlock()
# ---------- code_block_2.designscript (9 lines) ----------
"Model";
"Annotation";
"AnalyticalModel";
"Internal";

{"Model",
"Annotation",
"AnalyticalModel",
"Internal"};
# ----------------------------------------
elementByCategoryType = Orchid.RevitProject.Elements.Selection.ElementByCategoryType(arg1=code_block_2.out0)
code_block_3 = CodeBlock { "Workset Text"; }
getWorkset_2 = Orchid.RevitProject.Elements.Element.GetWorkset(elementByCategoryType)
name_2 = Orchid.RevitProject.Common.Workset.Name(getWorkset_2)
setParameterByName_2 = Element.SetParameterByName(element=elementByCategoryType, parameterName=code_block_3, value=name_2)

# group: Selection
elementHasMaterial = Orchid.RevitProject.Elements.Selection.ElementHasMaterial()
code_block_4 = CodeBlock { "Workset Text"; }
getWorkset_3 = Orchid.RevitProject.Elements.Element.GetWorkset(elementHasMaterial)
name_3 = Orchid.RevitProject.Common.Workset.Name(getWorkset_3)
setParameterByName_3 = Element.SetParameterByName(element=elementHasMaterial, parameterName=code_block_4, value=name_3)

# group: Worksets
worksets = Worksets("Shell and Core")
watch = Watch(worksets)

categories = Categories("Walls")
all_elements_of_category = ElementsOfCategory(categories)
code_block_5 = CodeBlock { "something"; }
create = Orchid.RevitProject.Common.Workset.Create(code_block_5)
await_ = Orchid.Common.DataStream.Await(code_block_5, create)
byName_2 = Orchid.RevitProject.Common.Workset.ByName(await_)
setWorkset = Orchid.RevitProject.Elements.Element.SetWorkset(all_elements_of_category, byName_2)
getWorkset_4 = Orchid.RevitProject.Elements.Element.GetWorkset(all_elements_of_category)
watch_2 = Watch(getWorkset_4)
all = Orchid.RevitProject.Common.Workset.All()
watch_3 = Watch(all)
name_4 = Orchid.RevitProject.Common.Workset.Name(all)
byName_3 = Orchid.RevitProject.Common.Workset.ByName(name_4)
watch_4 = Watch(byName_3)
watch_5 = Watch(name_4)
id = Orchid.RevitProject.Common.Workset.Id(all)
byId = Orchid.RevitProject.Common.Workset.ById(id)
watch_6 = Watch(byId)
uniqueId = Orchid.RevitProject.Common.Workset.UniqueId(all)
watch_7 = Watch(uniqueId)
watch_8 = Watch(id)

# group: Convert to Orchid type
python_script = Python()
# ---------- python_script.python (11 lines) ----------
# Common Language Runtime modules
import clr
clr.AddReference('RevitAPI')
clr.AddReference('RevitServices')

# Revit and Dynamo modules
from Autodesk.Revit.DB import FilteredWorksetCollector, WorksetKind
from RevitServices.Persistence import DocumentManager

doc = DocumentManager.Instance.CurrentDBDocument
OUT = FilteredWorksetCollector(doc).OfKind(WorksetKind.UserWorkset)
# ----------------------------------------
toOrchidType = Orchid.RevitProject.Common.Workset.ToOrchidType(python_script)
name_5 = Orchid.RevitProject.Common.Workset.Name(toOrchidType)
watch_9 = Watch(name_5)
