# Dynamo graph AddConvert.dyn (Dynamo 1.3.4.6666)

# group: create family type
current = Orchid.RevitProject.Common.Document.Current()
create = Orchid.RevitFamily.FamilyType.Create(current)
name = Orchid.RevitFamily.FamilyType.Name(create)

# group: Add shared parameter
await_ = Orchid.Common.DataStream.Await(current, create)
code_block = CodeBlock()
# ---------- code_block.designscript (16 lines) ----------
//Parameter name
{"Creator Name",
"Creator Organization",
"Creator Build"};
//SP Parameter group
"Sheet & Project";
//SP Parameter type
"Text";
//Parameter group
"PG_ADSK_MODEL_PROPERTIES";
//Tooltip
"Creator value";
//Instances
true;
//Reporting
false;
# ----------------------------------------
add = Orchid.RevitFamily.SharedParameter.Add(await_, code_block.out0, code_block.out1, code_block.out2, code_block.out3, code_block.out4, code_block.out5)

# group: Set formula
await_2 = Orchid.Common.DataStream.Await(current, add)
code_block_2 = CodeBlock()
# ---------- code_block_2.designscript (8 lines) ----------
//Parameter name
{"Creator Name",
"Creator Organization",
"Creator Build"};
//Values
{"\"Erik Falck Jørgensen\"",
"\"Danish Educational Content\"",
"\"2019.0420.0\""};
# ----------------------------------------
set = Orchid.RevitFamily.Formula.Set(await_2, code_block_2.out0, code_block_2.out1)

# group: Get Formula
await_3 = Orchid.Common.DataStream.Await(await_2, set)
code_block_3 = CodeBlock()
# ---------- code_block_3.designscript (4 lines) ----------
//Parameter name
{"Creator Name",
"Creator Organization",
"Creator Build"};
# ----------------------------------------
get = Orchid.RevitFamily.Formula.Get(await_3, code_block_3)

watch = Watch(get)

# group: Convert shared parameter to family parameter
name_2 = Orchid.RevitFamily.Parameter.Name(add)
code_block_4 = CodeBlock()
# ---------- code_block_4.designscript (2 lines) ----------
//Instances
true;
# ----------------------------------------
convert = Orchid.RevitFamily.SharedParameter.Convert(await_, name_2, code_block_4)

name_3 = Orchid.RevitFamily.Parameter.Name(convert)
watch_2 = Watch(name_3)

# group: Remove formula
await_4 = Orchid.Common.DataStream.Await(await_3, get)
code_block_5 = CodeBlock()  # same code as code_block_3
remove = Orchid.RevitFamily.Formula.Remove(await_4, code_block_5)

# group: Remove parameter value
await_5 = Orchid.Common.DataStream.Await(await_4, remove)
code_block_6 = CodeBlock()
# ---------- code_block_6.designscript (6 lines) ----------
//Parameter name
{"Creator Name",
"Creator Organization",
"Creator Build"};
//value
{"","",""};
# ----------------------------------------
setValue = Orchid.RevitFamily.Parameter.SetValue(await_5, arg2=code_block_6.out0, arg3=code_block_6.out1)

# group: Create shared parameter
await_6 = Orchid.Common.DataStream.Await(current, create)
code_block_7 = CodeBlock()
# ---------- code_block_7.designscript (8 lines) ----------
//Parameter name
"Dynamo test parameter";
//SP Parameter group
"Dynamo test group";
//SP Parameter type
"Text";
//Parameter group
"PG_ADSK_MODEL_PROPERTIES";
# ----------------------------------------
create_2 = Orchid.RevitFamily.SharedParameter.Create(await_6, code_block_7.out0, code_block_7.out1, code_block_7.out2, code_block_7.out3)  # frozen

# group: Add shared parameter
await_7 = Orchid.Common.DataStream.Await(current, create)
code_block_8 = CodeBlock()
# ---------- code_block_8.designscript (8 lines) ----------
//Parameter name
{"test1","test2"};
//SP Parameter group
"Sheet & Project";
//SP Parameter type
"Text";
//Parameter group
"PG_ADSK_MODEL_PROPERTIES";
# ----------------------------------------
add_2 = Orchid.RevitFamily.SharedParameter.Add(await_7, code_block_8.out0, code_block_8.out1, code_block_8.out2, code_block_8.out3)  # frozen

# group: Convert family parameter to shared parameter
code_block_9 = CodeBlock()  # same code as code_block_3
getExternal = Orchid.RevitFamily.Definition.GetExternal(code_block_9)
convert_2 = Orchid.RevitFamily.Parameter.Convert(await_, getExternal)

name_4 = Orchid.RevitFamily.Parameter.Name(convert_2)
watch_3 = Watch(name_4)
