# Dynamo graph AddSetGet.dyn (Dynamo 1.3.4.6666)

current = Orchid.RevitProject.Common.Document.Current()

# group: Utilities
code_block = CodeBlock()
# ---------- code_block.designscript (2 lines) ----------
//Types to create
"Type 1";
# ----------------------------------------
create = Orchid.RevitFamily.FamilyType.Create(current, code_block)

# group: Add parameter
await_ = Orchid.Common.DataStream.Await(current, create)
code_block_2 = CodeBlock()
# ---------- code_block_2.designscript (6 lines) ----------
//Parameter name
"Test2";
//Parameter type
"Number";
//Parameter group
"PG_ADSK_MODEL_PROPERTIES";
# ----------------------------------------
add = Orchid.RevitFamily.Parameter.Add(await_, code_block_2.out0, code_block_2.out1, code_block_2.out2)

# group: Set parameter
await_2 = Orchid.Common.DataStream.Await(await_, add)
code_block_3 = CodeBlock()
# ---------- code_block_3.designscript (6 lines) ----------
//Type
"Type 1";
//Parameter name
"Test2";
//Value
1.5;
# ----------------------------------------
setValue = Orchid.RevitFamily.Parameter.SetValue(await_2, code_block_3.out0, code_block_3.out1, code_block_3.out2)

# group: Add parameter
await_3 = Orchid.Common.DataStream.Await(current, create)
code_block_4 = CodeBlock()
# ---------- code_block_4.designscript (8 lines) ----------
//Parameter name
"Test1";
//Parameter type
"Integer";
//Parameter group
"PG_ADSK_MODEL_PROPERTIES";
//ToolTip
"do this work?";
# ----------------------------------------
add_2 = Orchid.RevitFamily.Parameter.Add(await_3, code_block_4.out0, code_block_4.out1, code_block_4.out2, code_block_4.out3)

# group: Set parameter
await_4 = Orchid.Common.DataStream.Await(await_3, add_2)
code_block_5 = CodeBlock()
# ---------- code_block_5.designscript (6 lines) ----------
//Type
"Type 1";
//Parameter name
"Test1";
//Value
1;
# ----------------------------------------
setValue_2 = Orchid.RevitFamily.Parameter.SetValue(await_4, code_block_5.out0, code_block_5.out1, code_block_5.out2)

# group: Add parameter
await_5 = Orchid.Common.DataStream.Await(current, create)
code_block_6 = CodeBlock()
# ---------- code_block_6.designscript (6 lines) ----------
//Parameter name
"Test3";
//Parameter type
"Text";
//Parameter group
"PG_ADSK_MODEL_PROPERTIES";
# ----------------------------------------
add_3 = Orchid.RevitFamily.Parameter.Add(await_5, code_block_6.out0, code_block_6.out1, code_block_6.out2)

# group: Set parameter
await_6 = Orchid.Common.DataStream.Await(await_5, add_3)
code_block_7 = CodeBlock()
# ---------- code_block_7.designscript (6 lines) ----------
//Type
"Type 1";
//Parameter name
"Test3";
//Value
"string";
# ----------------------------------------
setValue_3 = Orchid.RevitFamily.Parameter.SetValue(await_6, code_block_7.out0, code_block_7.out1, code_block_7.out2)

# group: Add parameter
await_7 = Orchid.Common.DataStream.Await(current, create)
code_block_8 = CodeBlock()
# ---------- code_block_8.designscript (6 lines) ----------
//Parameter name
"Test4";
//Parameter type
"Material";
//Parameter group
"PG_ADSK_MODEL_PROPERTIES";
# ----------------------------------------
add_4 = Orchid.RevitFamily.Parameter.Add(await_7, code_block_8.out0, code_block_8.out1, code_block_8.out2)

# group: Set parameter
await_8 = Orchid.Common.DataStream.Await(await_7, add_4)
code_block_9 = CodeBlock()
# ---------- code_block_9.designscript (4 lines) ----------
//Type
"Type 1";
//Parameter name
"Test4";
# ----------------------------------------
code_block_10 = CodeBlock { "Glass"; }
byName = Material.ByName(code_block_10)
setValue_4 = Orchid.RevitFamily.Parameter.SetValue(await_8, code_block_9.out0, code_block_9.out1, byName)

create_2 = List.Create(setValue_2, setValue, setValue_3, setValue_4)

# group: Parameters
await_9 = Orchid.Common.DataStream.Await(await_2, create_2)
parameters = Orchid.RevitFamily.Document.Parameters(await_9)
name = Orchid.RevitFamily.Parameter.Name(parameters)
watch = Watch(name)

# group: Get Parameter
await_10 = Orchid.Common.DataStream.Await(await_2, create_2)
code_block_11 = CodeBlock()
# ---------- code_block_11.designscript (7 lines) ----------
//Type name
"Type 1";
//Parameter name
{"Test1",
"Test2",
"Test3",
"Test4"};
# ----------------------------------------
byName_2 = Orchid.RevitFamily.FamilyType.ByName(code_block_11.out0)
getValue = Orchid.RevitFamily.Parameter.GetValue(await_10, byName_2, code_block_11.out1)
watch_2 = Watch(getValue.out1)
type = Object.Type(getValue.out1)
watch_3 = Watch(type)
code_block_12 = CodeBlock(t=getValue.out1) { t[3]; }
name_2 = Material.Name(code_block_12)
watch_4 = Watch(name_2)

# group: Convert to Orchid type
python_script = Python(IN[0]=create_2)
# ---------- python_script.python (12 lines) ----------
# Common Language Runtime modules
import clr
clr.AddReference('RevitAPI')
clr.AddReference('RevitServices')

# Revit and Dynamo modules
from Autodesk.Revit.DB import Family
from RevitServices.Persistence import DocumentManager

dummy = IN[0]
doc = DocumentManager.Instance.CurrentDBDocument
OUT = doc.FamilyManager.Parameters
# ----------------------------------------
toOrchidType = Orchid.RevitFamily.Parameter.ToOrchidType(python_script)
name_3 = Orchid.RevitFamily.Parameter.Name(toOrchidType)
watch_5 = Watch(name_3)

# group: Filter by Type
code_block_13 = CodeBlock(data=setValue_4) { data; }
type_2 = Object.Type(code_block_13)
toType = Orchid.Common.String.ToType(type_2)
typeOf = Orchid.Common.Object.TypeOf(code_block_13, toType)
watch_6 = Watch(typeOf)

type_3 = Object.Type(parameters)
