# Dynamo graph CategoryReportingIFC.dyn (Dynamo 1.3.4.6666)

current = Orchid.RevitProject.Common.Document.Current()

# group: Set the document category
categories = Categories("Casework")
setCategory = Orchid.RevitFamily.Document.SetCategory(current, categories)

# group: Get the document category
await_ = Orchid.Core.DataStream.Await(current, setCategory)
getCategory = Orchid.RevitFamily.Document.GetCategory(await_)

# group: Create types
code_block = CodeBlock()
# ---------- code_block.designscript (2 lines) ----------
//Types to create
{"Type 1", "Type 2"};
# ----------------------------------------
create = Orchid.RevitFamily.FamilyType.Create(current, code_block)

# group: Add parameter
await_2 = Orchid.Core.DataStream.Await(current, create)
code_block_2 = CodeBlock()
# ---------- code_block_2.designscript (8 lines) ----------
//Parameter name
"dim";
//Parameter type
"Length";
//Parameter group
"PG_ADSK_MODEL_PROPERTIES";
//Reporting
true;
# ----------------------------------------
addParameter = Orchid.RevitFamily.Parameter.AddParameter(await_2, code_block_2.out0, code_block_2.out1, code_block_2.out2, arg6=code_block_2.out3)

# group: Parameters
parameters = Orchid.RevitFamily.Parameter.Parameters(await_2)
name = Orchid.RevitFamily.Parameter.Name(parameters)

watch = Watch(name)

# group: Add parameter
await_3 = Orchid.Core.DataStream.Await(current, create)
code_block_3 = CodeBlock()
# ---------- code_block_3.designscript (10 lines) ----------
//Parameter name
"Test";
//Parameter type
"Text";
//Parameter group
"PG_ADSK_MODEL_PROPERTIES";
//Tooltip
"Owner value";
//Instances
true;
# ----------------------------------------
addParameter_2 = Orchid.RevitFamily.Parameter.AddParameter(await_3, code_block_3.out0, code_block_3.out1, code_block_3.out2, code_block_3.out3, code_block_3.out4)

# group: Set parameter
await_4 = Orchid.Core.DataStream.Await(await_3, addParameter_2)
code_block_4 = CodeBlock()
# ---------- code_block_4.designscript (6 lines) ----------
//Type
"Type 1";
//Parameter name
"Test";
//Value
"This is a test";
# ----------------------------------------
setValue = Orchid.RevitFamily.Parameter.SetValue(await_4, code_block_4.out0, code_block_4.out1, code_block_4.out2)

create_2 = List.Create(addParameter, addParameter_2)

# group: IsReporting parameter
name_2 = Orchid.RevitFamily.Parameter.Name(create_2)
isReporting = Orchid.RevitFamily.Parameter.IsReporting(await_2, name_2)

watch_2 = Watch(isReporting)
watch_3 = Watch(name_2)

# group: Add basic IFC parameters
addIfcParameters = Orchid.RevitFamily.Parameter.AddIfcParameters(current)
name_3 = Orchid.RevitFamily.Parameter.Name(addIfcParameters)
watch_4 = Watch(name_3)
