# Dynamo graph Collect families in project.dyn (Dynamo 1.3.4.6666)

# group: Open all files in directory and sub directories
string = StringInput("C:\Users\erfajo\Programming\Unit Testing\testSet")
code_block = CodeBlock { "*.rfa"; true; }
contents = Orchid.Core.Directory.Contents(string, code_block.out0)  # frozen
backgroundOpen = Orchid.RevitProject.Document.BackgroundOpen(contents)

# group: Close files
await_ = Orchid.Core.DataStream.Await()  # unwired: arg0, arg1
boolean = BoolSelector(true)
close = Orchid.RevitProject.Document.Close(await_, boolean)  # frozen

# group: Collect family as document from current document
code_block_2 = CodeBlock { {"Doors","Windows"}; }
elementByCategory = Orchid.RevitProject.Elements.Selection.ElementByCategory(arg1=code_block_2)
elementType = Element.ElementType(elementByCategory)
family = FamilyType.Family(elementType)
flatten = Flatten(family)
uniqueItems = List.UniqueItems(flatten)
familyDocument = Orchid.RevitProject.Elements.Family.FamilyDocument(uniqueItems)

# note: Please notice that I use a tab in my "SP Parameter group" names. This is not standard!
# "Sheet & Project" would be the normal way!
code_block_3 = CodeBlock()
# ---------- code_block_3.designscript (12 lines) ----------
//Parameter name
"Creator Build";
//SP Parameter group
"01:   Sheet & Project";
//SP Parameter type
"Text";
//Parameter group
"PG_ADSK_MODEL_PROPERTIES";
//Instances
true;
//Reporting
false;
# ----------------------------------------
addSharedParameter = Orchid.RevitFamily.Parameter.AddSharedParameter(familyDocument, code_block_3.out0, code_block_3.out1, code_block_3.out2, code_block_3.out3, arg6=code_block_3.out4)

# group: load back into the current project
await_2 = Orchid.Core.DataStream.Await(familyDocument, addSharedParameter)
loadFamily = Orchid.RevitFamily.Document.LoadFamily(await_2)
await_3 = Orchid.Core.DataStream.Await(await_2, loadFamily)
close_2 = Orchid.RevitProject.Document.Close(await_3)
