# Dynamo graph FormSetGet.dyn (Dynamo 1.3.4.6666)

# group: Create ordinary parameter
current = Orchid.RevitProject.Common.Document.Current()
code_block = CodeBlock()
# ---------- code_block.designscript (6 lines) ----------
//Parameter name
"Material";
//Parameter type
"Material";
//Parameter group
"PG_ADSK_MODEL_PROPERTIES";
# ----------------------------------------
addParameter = Orchid.RevitFamily.Parameter.AddParameter(current, code_block.out0, code_block.out1, code_block.out2)

# group: Set parameter
await_ = Orchid.Core.DataStream.Await(current, addParameter)
code_block_2 = CodeBlock()
# ---------- code_block_2.designscript (2 lines) ----------
//Parameter name
"Material";
# ----------------------------------------
material = Material("Default")
setValue = Orchid.RevitFamily.Parameter.SetValue(await_, arg2=code_block_2, arg3=material)

# group: Select geometry
element_types = ElementTypes("Extrusion")
all_elements_of_type = ElementsOfType(element_types)

# group: Associate parameter
await_2 = Orchid.Core.DataStream.Await(await_, setValue)
code_block_3 = CodeBlock()  # same code as code_block_2
associate = Orchid.RevitFamily.Parameter.Associate(await_2, all_elements_of_type, code_block_3, code_block_3)
