# Dynamo graph ImportImage.dyn (Dynamo 1.3.4.6666)

# group: Open all files in directory and sub directories
string = StringInput("..\testSet")
code_block = CodeBlock { "*.rfa"; }
boolean = BoolSelector(false)
contents = Orchid.Common.Directory.Contents(string, code_block, boolean)
backgroundOpen = Orchid.RevitProject.Common.Document.BackgroundOpen(contents)  # frozen

current = Orchid.RevitProject.Common.Document.Current()

# group: Create default family type
code_block_2 = CodeBlock()
# ---------- code_block_2.designscript (2 lines) ----------
//Types to create
{"Type 1", "Type 2"};
# ----------------------------------------
create = Orchid.RevitFamily.FamilyType.Create(current)

# group: Create parameter
await_ = Orchid.Common.DataStream.Await(current, create)
code_block_3 = CodeBlock()
# ---------- code_block_3.designscript (10 lines) ----------
//Parameter name
"AddedImage";
//Parameter type
"Image";
//Parameter group
"PG_ADSK_MODEL_PROPERTIES";
//Instances
false;
//Reporting
true;
# ----------------------------------------
add = Orchid.RevitFamily.Parameter.Add(await_, code_block_3.out0, code_block_3.out1, code_block_3.out2)

# group: import image
string_2 = StringInput("..\DefaultCustomNode.Small.png")
boolean_2 = BoolSelector(false)
importImage = Orchid.RevitProject.Common.Document.ImportImage(string_2, boolean_2)

# group: Set parameter
await_2 = Orchid.Common.DataStream.Await(await_, add)
code_block_4 = CodeBlock()
# ---------- code_block_4.designscript (6 lines) ----------
//Type
"Type 1";
//Parameter name
"AddedImage";
//Value
"_default.Large.png";
# ----------------------------------------
setValue = Orchid.RevitFamily.Parameter.SetValue(await_2, arg2=code_block_4.out1, arg3=importImage)

# group: Close files
await_3 = Orchid.Common.DataStream.Await(await_2, setValue)
boolean_3 = BoolSelector(false)
close = Orchid.RevitProject.Common.Document.Close(await_3, boolean_3)  # frozen

watch = Watch(importImage)
element_types = ElementTypes("ImageType")
all_elements_of_type = ElementsOfType(element_types)
watch_2 = Watch(all_elements_of_type)
