# Dynamo graph Nested-Lookup.dyn (Dynamo 1.3.4.6666)

# group: Load a family (nested)
string = StringInput("..\testSet\Front - Plain.rfa")
backgroundOpen = Orchid.RevitProject.Common.Document.BackgroundOpen(string)
load = Orchid.RevitProject.Elements.Family.Load(backgroundOpen)
await_ = Orchid.Common.DataStream.Await(backgroundOpen, load)
close = Orchid.RevitProject.Common.Document.Close(await_)

# group: create default family type
current = Orchid.RevitProject.Common.Document.Current()
create = Orchid.RevitFamily.FamilyType.Create(current)
await_2 = Orchid.Common.DataStream.Await(current, create)

# group: Create ordinary parameter
code_block = CodeBlock()
# ---------- code_block.designscript (6 lines) ----------
//Parameter name
{"Width","Height","testValue"};
//Parameter type
"Length";
//Parameter group
"PG_ADSK_MODEL_PROPERTIES";
# ----------------------------------------
add = Orchid.RevitFamily.Parameter.Add(await_2, code_block.out0, code_block.out1, code_block.out2)

# group: Create ordinary parameter
code_block_2 = CodeBlock()
# ---------- code_block_2.designscript (6 lines) ----------
//Parameter name
{"Lookup Table Name","testKey"};
//Parameter type
"Text";
//Parameter group
"PG_ADSK_MODEL_PROPERTIES";
# ----------------------------------------
add_2 = Orchid.RevitFamily.Parameter.Add(await_2, code_block_2.out0, code_block_2.out1, code_block_2.out2)

# group: Set parameter
create_2 = List.Create(add, add_2)
await_3 = Orchid.Common.DataStream.Await(await_2, create_2)
code_block_3 = CodeBlock()
# ---------- code_block_3.designscript (4 lines) ----------
//Parameter name
{"Lookup Table Name","testKey"};
//Values
{"CSVLookuptable","11x300"};
# ----------------------------------------
setValue = Orchid.RevitFamily.Parameter.SetValue(await_3, arg2=code_block_3.out0, arg3=code_block_3.out1)

# group: Add lookup table and use it by setting a formula
await_4 = Orchid.Common.DataStream.Await(await_3, setValue)
string_2 = StringInput("..\CSVLookuptable.csv")
addLookupTable = Orchid.RevitFamily.Document.AddLookupTable(await_4, string_2)
await_5 = Orchid.Common.DataStream.Await(await_4, addLookupTable)
code_block_4 = CodeBlock()
# ---------- code_block_4.designscript (4 lines) ----------
//Parameter name
"testValue";
//Values
{"size_lookup(Lookup Table Name, \"d\", 0, testKey)"};
# ----------------------------------------
string_3 = StringInput("size_lookup(Lookup Table Name, \"d\", 0, testKey)")
set = Orchid.RevitFamily.Formula.Set(await_5, code_block_4.out0, string_3)

# group: Set parameter
await_6 = Orchid.Common.DataStream.Await(await_2, add)
code_block_5 = CodeBlock()
# ---------- code_block_5.designscript (4 lines) ----------
//Parameter name
"Width";
//Value
800.0;
# ----------------------------------------
setValue_2 = Orchid.RevitFamily.Parameter.SetValue(await_6, arg2=code_block_5.out0, arg3=code_block_5.out1)

types = Family.Types(load)

# group: Associate parameter
await_7 = Orchid.Common.DataStream.Await(await_6, setValue_2)
code_block_6 = CodeBlock()
# ---------- code_block_6.designscript (2 lines) ----------
//Parameter name
"Width";
# ----------------------------------------
associate = Orchid.RevitFamily.Parameter.Associate(await_7, code_block_6, types, code_block_6)
await_8 = Orchid.Common.DataStream.Await(await_7, associate)

# group: Get nested family and converters
getNested = Orchid.RevitFamily.Family.GetNested(await_8)
watch = Watch(getNested)
toRevitType = Orchid.RevitProject.Elements.Element.ToRevitType(getNested)
watch_2 = Watch(toRevitType)
toDynamoType = Orchid.RevitProject.Elements.Element.ToDynamoType(toRevitType)
watch_3 = Watch(toDynamoType)
name = Element.Name(toDynamoType)
watch_4 = Watch(name)

# group: Get nested family type (FamilySymbol) and converters Note: Nested families in a family document is denoted FamilySymbol in the Autodesk Revit API! FamilyType in a project document is also denoted FamilySymbol in the Autodesk Revit API!
getNested_2 = Orchid.RevitFamily.FamilyType.GetNested(await_8)
watch_5 = Watch(getNested_2)
toRevitType_2 = Orchid.RevitProject.Elements.Element.ToRevitType(getNested_2)
toDynamoType_2 = Orchid.RevitProject.Elements.Element.ToDynamoType(toRevitType_2)
watch_6 = Watch(toDynamoType_2)
name_2 = Element.Name(toDynamoType_2)
watch_7 = Watch(name_2)
watch_8 = Watch(toRevitType_2)

# group: Get nested data --> use OOTB nodes inside family document
lastItem = List.LastItem(getNested_2)
code_block_7 = CodeBlock()
# ---------- code_block_7.designscript (2 lines) ----------
//Parameter name
{"Width"};
# ----------------------------------------
getParameterValueByName = Element.GetParameterValueByName(element=lastItem, parameterName=code_block_7)
watch_9 = Watch(getParameterValueByName)

# group: Create Family Type parameter (Category)
code_block_8 = CodeBlock()
# ---------- code_block_8.designscript (8 lines) ----------
//Parameter name
{"testFamily"};
//Parameter group
"PG_ADSK_MODEL_PROPERTIES";
//Instances
true;
//Reporting
false;
# ----------------------------------------
categories = Categories("Casework")
add_3 = Orchid.RevitFamily.Parameter.Add(await_2, code_block_8.out0, categories, code_block_8.out1)

# group: Has the parameter associated element
code_block_9 = CodeBlock()
# ---------- code_block_9.designscript (2 lines) ----------
//Parameter name
{"Width","Height"};
# ----------------------------------------
hasAssociated = Orchid.RevitFamily.Parameter.HasAssociated(await_8, code_block_9)
watch_10 = Watch(hasAssociated)

# group: Get associated element and parameter
getAssociated = Orchid.RevitFamily.Document.GetAssociated(await_8)
watch_11 = Watch(getAssociated.out0)
watch_12 = Watch(getAssociated.out1)
watch_13 = Watch(getAssociated.out2)
code_block_10 = CodeBlock()  # same code as code_block_6
getAssociated_2 = Orchid.RevitFamily.Parameter.GetAssociated(await_8, code_block_10)
watch_14 = Watch(getAssociated_2.out0)
watch_15 = Watch(getAssociated_2.out1)

# group: parameters
parameters = Orchid.RevitFamily.Document.Parameters(await_8)
name_3 = Orchid.RevitFamily.Parameter.Name(parameters)
watch_16 = Watch(name_3)
