# Dynamo graph Apperance.dyn (Dynamo 1.3.4.6666)

# group: Duplicate
appearance_asset = AppearanceAsset("Broom Finish - Gray(1)")
code_block = CodeBlock { "_xx"; }
duplicate = Orchid.RevitMaterial.AppearanceAsset.Duplicate(appearance_asset, code_block)
watch = Watch(duplicate)

# group: All
all = Orchid.RevitMaterial.AppearanceAsset.All()
name = Element.Name(all)
watch_2 = Watch(name)
watch_3 = Watch(all)

# group: Create material: Timber (C24)
code_block_2 = CodeBlock { "_Timber C24"; }
create = Orchid.RevitMaterial.Material.Create(code_block_2)
appearance_schema = AppearanceSchema("Generic")
boolean = BoolSelector(true)
create_2 = Orchid.RevitMaterial.AppearanceAsset.Create(code_block_2, appearance_schema, boolean)
code_block_3 = CodeBlock { "Hardwood material"; "pine,wood,interior,furniture,materials,hardwood"; }
setInformation = Orchid.RevitMaterial.AppearanceAsset.SetInformation(create_2, code_block_3.out0, code_block_3.out1)
code_block_4 = CodeBlock { 145; 15; 65; }
byARGB = Color.ByARGB(r=code_block_4.out0, g=code_block_4.out1, b=code_block_4.out2)
setGeneric = Orchid.RevitMaterial.AppearanceAsset.SetGeneric(setInformation, byARGB)
string = StringInput("%userprofile%\Programming\Source\Testing\Data\Stone_3.bmp")
fromPath = Orchid.Common.File.FromPath(string)
setBump = Orchid.RevitMaterial.AppearanceAsset.SetBump(setGeneric, fromPath)
setAsset = Orchid.RevitMaterial.Material.SetAsset(create, setBump)
name_2 = Material.Name(setAsset)
watch_4 = Watch(name_2)
watch_5 = Watch(setAsset)
getInformation = Orchid.RevitMaterial.AppearanceAsset.GetInformation(setInformation)
watch_6 = Watch(getInformation.out0)
watch_7 = Watch(getInformation.out1)
