# Dynamo graph Graphics.dyn (Dynamo 1.3.4.6666)

# group: Create, Set Render Appearance, SetShadingColor, Set Transparency, Set Surface Pattern, Set Surface Pattern Color, Set Cut Pattern, Set Cut Pattern Color --> For Revit 2019
code_block = CodeBlock { "_test3"; }
create = Orchid.RevitMaterial.Material.Create(code_block)
fill_patterns = FillPatterns("Diagonal crosshatch 3.0mm")
setSurfaceForegroundPattern = Orchid.RevitMaterial.Graphics.SetSurfaceForegroundPattern(create, fill_patterns)
code_block_2 = CodeBlock { DSCore.Color.ByARGB(255,145,185,165); }
setSurfaceForegroundPatternColor = Orchid.RevitMaterial.Graphics.SetSurfaceForegroundPatternColor(setSurfaceForegroundPattern, code_block_2)
getCutForegroundPattern = Orchid.RevitMaterial.Graphics.GetCutForegroundPattern(setSurfaceForegroundPatternColor)
watch = Watch(getCutForegroundPattern)
name = Material.Name(create)
watch_2 = Watch(name)
code_block_3 = CodeBlock { DSCore.Color.ByARGB(255,25,60,30); }
setShadingColor = Orchid.RevitMaterial.Graphics.SetShadingColor(create, code_block_3)
getShadingColor = Orchid.RevitMaterial.Graphics.GetShadingColor(setShadingColor)
watch_3 = Watch(getShadingColor)
code_block_4 = CodeBlock { 75; }
setTransparency = Orchid.RevitMaterial.Graphics.SetTransparency(create, code_block_4)
getTransparency = Orchid.RevitMaterial.Graphics.GetTransparency(setTransparency)
watch_4 = Watch(getTransparency)
watch_5 = Watch(create)
setCutForegroundPattern = Orchid.RevitMaterial.Graphics.SetCutForegroundPattern(create, fill_patterns)
setCutForegroundPatternColor = Orchid.RevitMaterial.Graphics.SetCutForegroundPatternColor(setCutForegroundPattern, code_block_2)
getCutForegroundPatternColor = Orchid.RevitMaterial.Graphics.GetCutForegroundPatternColor(setCutForegroundPatternColor)
watch_6 = Watch(getCutForegroundPatternColor)
fill_patterns_2 = FillPatterns("Diagonal down 3.0mm")
setCutBackgroundPattern = Orchid.RevitMaterial.Graphics.SetCutBackgroundPattern(create, fill_patterns_2)
code_block_5 = CodeBlock { 55; 125; 85; }
byARGB = Color.ByARGB(r=code_block_5.out0, g=code_block_5.out1, b=code_block_5.out2)
setCutBackgroundPatternColor = Orchid.RevitMaterial.Graphics.SetCutBackgroundPatternColor(setCutBackgroundPattern, byARGB)
getCutBackgroundPatternColor = Orchid.RevitMaterial.Graphics.GetCutBackgroundPatternColor(setCutBackgroundPatternColor)
watch_7 = Watch(getCutBackgroundPatternColor)
setSurfaceBackgroundPattern = Orchid.RevitMaterial.Graphics.SetSurfaceBackgroundPattern(create, fill_patterns_2)
setSurfaceBackgroundPatternColor = Orchid.RevitMaterial.Graphics.SetSurfaceBackgroundPatternColor(setSurfaceBackgroundPattern, byARGB)
getCutBackgroundPattern = Orchid.RevitMaterial.Graphics.GetCutBackgroundPattern(setSurfaceBackgroundPatternColor)
watch_8 = Watch(getCutBackgroundPattern)
boolean = BoolSelector(false)
setRenderAppearance = Orchid.RevitMaterial.Graphics.SetRenderAppearance(create, boolean)
getRenderAppearance = Orchid.RevitMaterial.Graphics.GetRenderAppearance(setRenderAppearance)
watch_9 = Watch(getRenderAppearance)
watch_10 = Watch(setCutBackgroundPattern)
watch_11 = Watch(setSurfaceBackgroundPattern)
watch_12 = Watch(setSurfaceForegroundPattern)
watch_13 = Watch(setCutForegroundPattern)

# group: Create, Get --> For Revit 2019
code_block_6 = CodeBlock { "_test2"; }
create_2 = Orchid.RevitMaterial.Material.Create(code_block_6)
watch_14 = Watch(create_2)
boolean_2 = BoolSelector(false)
code_block_7 = CodeBlock { DSCore.Color.ByARGB(255,25,60,30); 50; }
fill_patterns_3 = FillPatterns("Earth")
code_block_8 = CodeBlock { 45; 85; 65; }
byARGB_2 = Color.ByARGB(r=code_block_8.out0, g=code_block_8.out1, b=code_block_8.out2)
set = Orchid.RevitMaterial.Graphics.Set(create_2, boolean_2, code_block_7.out0, code_block_7.out1, fill_patterns_3, byARGB_2, arg10=fill_patterns_3, arg11=byARGB_2)
get = Orchid.RevitMaterial.Graphics.Get(set)
watch_15 = Watch(get.out0)
watch_16 = Watch(get.out1)
watch_17 = Watch(get.out2)
watch_18 = Watch(get.out3)
watch_19 = Watch(get.out4)
watch_20 = Watch(get.out5)
name_2 = Material.Name(create_2)
watch_21 = Watch(name_2)
watch_22 = Watch(get.out6)
watch_23 = Watch(get.out9)
watch_24 = Watch(get.out10)
watch_25 = Watch(get.out8)
watch_26 = Watch(get.out7)

# group: Smoothness, Shininess
code_block_9 = CodeBlock { "_test1"; }
create_3 = Orchid.RevitMaterial.Material.Create(code_block_9)
code_block_10 = CodeBlock { 50; }
setSmoothness = Orchid.RevitMaterial.Graphics.SetSmoothness(create_3, code_block_10)
getSmoothness = Orchid.RevitMaterial.Graphics.GetSmoothness(setSmoothness)
watch_27 = Watch(getSmoothness)
setShininess = Orchid.RevitMaterial.Graphics.SetShininess(create_3, code_block_10)
getShininess = Orchid.RevitMaterial.Graphics.GetShininess(setShininess)
watch_28 = Watch(getShininess)

# group: Create, Get --> For Revit 2018
code_block_11 = CodeBlock { "_test4"; }
create_4 = Orchid.RevitMaterial.Material.Create(code_block_11)
watch_29 = Watch(create_4)
boolean_3 = BoolSelector(false)
code_block_12 = CodeBlock { DSCore.Color.ByARGB(255,25,60,30); 50; }
fill_patterns_4 = FillPatterns("200mm Squares")
code_block_13 = CodeBlock { 45; 85; 65; }
byARGB_3 = Color.ByARGB(r=code_block_13.out0, g=code_block_13.out1, b=code_block_13.out2)
setGraphics = Orchid.RevitMaterial.Graphics.SetGraphics(create_4, boolean_3, code_block_12.out0, code_block_12.out1, fill_patterns_4, byARGB_3)
getGraphics = Orchid.RevitMaterial.Graphics.GetGraphics(setGraphics)
watch_30 = Watch(getGraphics.out0)
watch_31 = Watch(getGraphics.out1)
watch_32 = Watch(getGraphics.out2)
watch_33 = Watch(getGraphics.out3)
watch_34 = Watch(getGraphics.out4)
watch_35 = Watch(getGraphics.out5)
name_3 = Material.Name(create_4)
watch_36 = Watch(name_3)
watch_37 = Watch(getGraphics.out6)

# group: Create, Set Render Appearance, SetShadingColor, Set Transparency, Set Surface Pattern, Set Surface Pattern Color, Set Cut Pattern, Set Cut Pattern Color --> For Revit 2018
code_block_14 = CodeBlock { "_test5"; }
create_5 = Orchid.RevitMaterial.Material.Create(code_block_14)
watch_38 = Watch(create_5)
name_4 = Material.Name(create_5)
watch_39 = Watch(name_4)
code_block_15 = CodeBlock { DSCore.Color.ByARGB(255,25,60,30); }
setShadingColor_2 = Orchid.RevitMaterial.Graphics.SetShadingColor(create_5, code_block_15)
getShadingColor_2 = Orchid.RevitMaterial.Graphics.GetShadingColor(setShadingColor_2)
watch_40 = Watch(getShadingColor_2)
code_block_16 = CodeBlock { 75; }
setTransparency_2 = Orchid.RevitMaterial.Graphics.SetTransparency(create_5, code_block_16)
getTransparency_2 = Orchid.RevitMaterial.Graphics.GetTransparency(setTransparency_2)
watch_41 = Watch(getTransparency_2)
fill_patterns_5 = FillPatterns("100mm Horizontal")
setSurfacePattern = Orchid.RevitMaterial.Graphics.SetSurfacePattern(create_5, fill_patterns_5)
getSurfacePattern = Orchid.RevitMaterial.Graphics.GetSurfacePattern(setSurfacePattern)
watch_42 = Watch(getSurfacePattern)
setCutPattern = Orchid.RevitMaterial.Graphics.SetCutPattern(create_5, fill_patterns_5)
getCutPattern = Orchid.RevitMaterial.Graphics.GetCutPattern(setCutPattern)
watch_43 = Watch(getCutPattern)
code_block_17 = CodeBlock { 145; 185; 165; }
byARGB_4 = Color.ByARGB(r=code_block_17.out0, g=code_block_17.out1, b=code_block_17.out2)
setCutPatternColor = Orchid.RevitMaterial.Graphics.SetCutPatternColor(setCutPattern, byARGB_4)
getCutPatternColor = Orchid.RevitMaterial.Graphics.GetCutPatternColor(setCutPatternColor)
watch_44 = Watch(getCutPatternColor)
setSurfacePatternColor = Orchid.RevitMaterial.Graphics.SetSurfacePatternColor(setSurfacePattern, byARGB_4)
getSurfacePatternColor = Orchid.RevitMaterial.Graphics.GetSurfacePatternColor(setSurfacePatternColor)
watch_45 = Watch(getSurfacePatternColor)
boolean_4 = BoolSelector(false)
setRenderAppearance_2 = Orchid.RevitMaterial.Graphics.SetRenderAppearance(create_5, boolean_4)
getRenderAppearance_2 = Orchid.RevitMaterial.Graphics.GetRenderAppearance(setRenderAppearance_2)
watch_46 = Watch(getRenderAppearance_2)
