# Dynamo graph Graphics_2018.dyn (Dynamo 1.3.4.6666)

# group: Smoothness, Shininess
code_block = CodeBlock { "_test1"; }
create = Orchid.RevitMaterial.Material.Create(code_block)
code_block_2 = CodeBlock { 50; }
setSmoothness = Orchid.RevitMaterial.Graphics.SetSmoothness(create, code_block_2)
getSmoothness = Orchid.RevitMaterial.Graphics.GetSmoothness(setSmoothness)
watch = Watch(getSmoothness)
setShininess = Orchid.RevitMaterial.Graphics.SetShininess(create, code_block_2)
getShininess = Orchid.RevitMaterial.Graphics.GetShininess(setShininess)
watch_2 = Watch(getShininess)

# group: Create, Get --> For Revit 2018
code_block_3 = CodeBlock { "_test4"; }
create_2 = Orchid.RevitMaterial.Material.Create(code_block_3)
watch_3 = Watch(create_2)
boolean = BoolSelector(false)
code_block_4 = CodeBlock { DSCore.Color.ByARGB(255,25,60,30); 50; }
fill_patterns = FillPatterns("200mm Squares")
code_block_5 = CodeBlock { 45; 85; 65; }
byARGB = Color.ByARGB(r=code_block_5.out0, g=code_block_5.out1, b=code_block_5.out2)
setGraphics = Orchid.RevitMaterial.Graphics.SetGraphics(create_2, boolean, code_block_4.out0, code_block_4.out1, fill_patterns, byARGB)
getGraphics = Orchid.RevitMaterial.Graphics.GetGraphics(setGraphics)
watch_4 = Watch(getGraphics.out0)
watch_5 = Watch(getGraphics.out1)
watch_6 = Watch(getGraphics.out2)
watch_7 = Watch(getGraphics.out3)
watch_8 = Watch(getGraphics.out4)
watch_9 = Watch(getGraphics.out5)
name = Material.Name(create_2)
watch_10 = Watch(name)
watch_11 = Watch(getGraphics.out6)

# group: Create, Set Render Appearance, SetShadingColor, Set Transparency, Set Surface Pattern, Set Surface Pattern Color, Set Cut Pattern, Set Cut Pattern Color --> For Revit 2018
code_block_6 = CodeBlock { "_test5"; }
create_3 = Orchid.RevitMaterial.Material.Create(code_block_6)
watch_12 = Watch(create_3)
name_2 = Material.Name(create_3)
watch_13 = Watch(name_2)
code_block_7 = CodeBlock { DSCore.Color.ByARGB(255,25,60,30); }
setShadingColor = Orchid.RevitMaterial.Graphics.SetShadingColor(create_3, code_block_7)
getShadingColor = Orchid.RevitMaterial.Graphics.GetShadingColor(setShadingColor)
watch_14 = Watch(getShadingColor)
code_block_8 = CodeBlock { 75; }
setTransparency = Orchid.RevitMaterial.Graphics.SetTransparency(create_3, code_block_8)
getTransparency = Orchid.RevitMaterial.Graphics.GetTransparency(setTransparency)
watch_15 = Watch(getTransparency)
fill_patterns_2 = FillPatterns("100mm Horizontal")
setSurfacePattern = Orchid.RevitMaterial.Graphics.SetSurfacePattern(create_3, fill_patterns_2)
getSurfacePattern = Orchid.RevitMaterial.Graphics.GetSurfacePattern(setSurfacePattern)
watch_16 = Watch(getSurfacePattern)
setCutPattern = Orchid.RevitMaterial.Graphics.SetCutPattern(create_3, fill_patterns_2)
getCutPattern = Orchid.RevitMaterial.Graphics.GetCutPattern(setCutPattern)
watch_17 = Watch(getCutPattern)
code_block_9 = CodeBlock { 145; 185; 165; }
byARGB_2 = Color.ByARGB(r=code_block_9.out0, g=code_block_9.out1, b=code_block_9.out2)
setCutPatternColor = Orchid.RevitMaterial.Graphics.SetCutPatternColor(setCutPattern, byARGB_2)
getCutPatternColor = Orchid.RevitMaterial.Graphics.GetCutPatternColor(setCutPatternColor)
watch_18 = Watch(getCutPatternColor)
setSurfacePatternColor = Orchid.RevitMaterial.Graphics.SetSurfacePatternColor(setSurfacePattern, byARGB_2)
getSurfacePatternColor = Orchid.RevitMaterial.Graphics.GetSurfacePatternColor(setSurfacePatternColor)
watch_19 = Watch(getSurfacePatternColor)
boolean_2 = BoolSelector(false)
setRenderAppearance = Orchid.RevitMaterial.Graphics.SetRenderAppearance(create_3, boolean_2)
getRenderAppearance = Orchid.RevitMaterial.Graphics.GetRenderAppearance(setRenderAppearance)
watch_20 = Watch(getRenderAppearance)
