# Dynamo graph Material.dyn (Dynamo 1.3.4.6666)

# group: All
all = Orchid.RevitMaterial.Material.All()
name = Material.Name(all)
watch = Watch(name)
watch_2 = Watch(all)

# group: Class/Category
material = Material("Brick, Common")
getCategory = Orchid.RevitMaterial.Material.GetCategory(material)
watch_3 = Watch(getCategory)
getClass = Orchid.RevitMaterial.Material.GetClass(material)
watch_4 = Watch(getClass)

# group: Asset
material_2 = Material("Brick, Common")
asset = Orchid.RevitMaterial.Material.Asset(material_2)
watch_5 = Watch(asset.out0)
watch_6 = Watch(asset.out1)
watch_7 = Watch(asset.out2)

# group: Asset Parameter
material_3 = Material("Brick, Common")
assetParameter = Orchid.RevitMaterial.Material.AssetParameter(material_3)
watch_8 = Watch(assetParameter.out0)
watch_9 = Watch(assetParameter.out1)
watch_10 = Watch(assetParameter.out2)

# group: Parameter
material_4 = Material("Brick, Common")
parameter = Orchid.RevitMaterial.Material.Parameter(material_4)
watch_11 = Watch(parameter)

# group: Asset
material_5 = Material("Brick, Common")
appearanceAsset = Orchid.RevitMaterial.Material.AppearanceAsset(material_5)
watch_12 = Watch(appearanceAsset)
physicalAsset = Orchid.RevitMaterial.Material.PhysicalAsset(material_5)
watch_13 = Watch(physicalAsset)
thermalAsset = Orchid.RevitMaterial.Material.ThermalAsset(material_5)
watch_14 = Watch(thermalAsset)
