# Dynamo graph Physical-Thermal.dyn (Dynamo 1.3.4.6666)

# group: Create material: Concrete (C30)
code_block = CodeBlock { "_Concrete"; }
create = Orchid.RevitMaterial.Material.Create(code_block)
material_aspect = MaterialAspect("Thermal")
thermal_type = ThermalType("Solid")
boolean = BoolSelector(true)
create_2 = Orchid.RevitMaterial.ThermalAsset.Create(code_block, thermal_type, boolean)
code_block_2 = CodeBlock()
# ---------- code_block_2.designscript (6 lines) ----------
"Concrete f'c=30 MPa";
"structural,concrete,CC:BS 8110";
"thermal,solid";
"Concrete";
"Orchid generated";
"https://github.com/erfajo/OrchidForDynamo";
# ----------------------------------------
setInformation = Orchid.RevitMaterial.ThermalAsset.SetInformation(create_2, code_block_2.out0, code_block_2.out2, code_block_2.out3, code_block_2.out4, code_block_2.out5)
boolean_2 = BoolSelector(false)
asset_behavior = AssetBehavior("Isotropic")
code_block_3 = CodeBlock { 1.046; 0.657; 2300; 0.95; 182.4; 0.01; 0; 2000000; }
setProperties = Orchid.RevitMaterial.ThermalAsset.SetProperties(setInformation, boolean_2, asset_behavior, code_block_3.out0, code_block_3.out1, code_block_3.out2, code_block_3.out3, code_block_3.out4, code_block_3.out5, code_block_3.out6, code_block_3.out7)
setAsset = Orchid.RevitMaterial.Material.SetAsset(create, material_aspect, setProperties)
name = Material.Name(setAsset)
watch = Watch(name)
watch_2 = Watch(setAsset)
material_aspect_2 = MaterialAspect("Physical (Structural)")
physical_type = PhysicalType("Concrete")
create_3 = Orchid.RevitMaterial.PhysicalAsset.Create(code_block, physical_type, boolean)
setInformation_2 = Orchid.RevitMaterial.PhysicalAsset.SetInformation(create_3, code_block_2.out0, code_block_2.out1, code_block_2.out3, code_block_2.out4, code_block_2.out5)
asset_behavior_2 = AssetBehavior("Isotropic")
setBehavior = Orchid.RevitMaterial.PhysicalAsset.SetBehavior(setInformation_2, asset_behavior_2)
code_block_4 = CodeBlock { 0.00001; }
setBasicThermal = Orchid.RevitMaterial.PhysicalAsset.SetBasicThermal(setBehavior, code_block_4)
code_block_5 = CodeBlock { 20500; 0.2; 11200; 2406.45; }
setMechanical = Orchid.RevitMaterial.PhysicalAsset.SetMechanical(setBasicThermal, code_block_5.out0, code_block_5.out1, code_block_5.out2, code_block_5.out3)
code_block_6 = CodeBlock { 30.0; 1.0; }
boolean_3 = BoolSelector(false)
setConcrete = Orchid.RevitMaterial.PhysicalAsset.SetConcrete(setMechanical, code_block_6.out0, code_block_6.out1, boolean_3)
setAsset_2 = Orchid.RevitMaterial.Material.SetAsset(create, material_aspect_2, setConcrete)
name_2 = Material.Name(setAsset_2)
watch_3 = Watch(name_2)
watch_4 = Watch(setAsset_2)

# group: Create material: Oxygen
code_block_7 = CodeBlock { "_Oxygen"; }
create_4 = Orchid.RevitMaterial.Material.Create(code_block_7)
material_aspect_3 = MaterialAspect("Thermal")
thermal_type_2 = ThermalType("Gas")
boolean_4 = BoolSelector(true)
create_5 = Orchid.RevitMaterial.ThermalAsset.Create(code_block_7, thermal_type_2, boolean_4)
code_block_8 = CodeBlock()
# ---------- code_block_8.designscript (6 lines) ----------
"Oxygen, properties at atmospheric pressure";
"structural,gas";
"thermal,gas";
"Gas";
"Orchid generated";
"https://github.com/erfajo/OrchidForDynamo";
# ----------------------------------------
setInformation_3 = Orchid.RevitMaterial.ThermalAsset.SetInformation(create_5, code_block_8.out0, code_block_8.out2, code_block_8.out3, code_block_8.out4, code_block_8.out5)
code_block_9 = CodeBlock { 0.0242; 0.9118; 1.35; 0.01; 0; 1; }
setBasicThermal_2 = Orchid.RevitMaterial.ThermalAsset.SetBasicThermal(setInformation_3, code_block_9.out0, code_block_9.out1, code_block_9.out2, code_block_9.out3, code_block_9.out4, code_block_9.out5)
setAsset_3 = Orchid.RevitMaterial.Material.SetAsset(create_4, material_aspect_3, setBasicThermal_2)
watch_5 = Watch(setAsset_3)
name_3 = Material.Name(setAsset_3)
watch_6 = Watch(name_3)
material_aspect_4 = MaterialAspect("Physical (Structural)")
physical_type_2 = PhysicalType("Gas")
create_6 = Orchid.RevitMaterial.PhysicalAsset.Create(code_block_7, physical_type_2, boolean_4)
setInformation_4 = Orchid.RevitMaterial.PhysicalAsset.SetInformation(create_6, code_block_8.out0, code_block_8.out1, code_block_8.out3, code_block_8.out4, code_block_8.out5)
code_block_10 = CodeBlock { 500; }
setBasicThermal_3 = Orchid.RevitMaterial.PhysicalAsset.SetBasicThermal(setInformation_4, code_block_10)
code_block_11 = CodeBlock { 1.35; }
setMechanical_2 = Orchid.RevitMaterial.PhysicalAsset.SetMechanical(setBasicThermal_3, code_block_11)
setAsset_4 = Orchid.RevitMaterial.Material.SetAsset(create_4, material_aspect_4, setMechanical_2)
watch_7 = Watch(setAsset_4)
name_4 = Material.Name(setAsset_4)
watch_8 = Watch(name_4)

# group: Create material: Steel (S275)
code_block_12 = CodeBlock { "_Steel S275"; }
create_7 = Orchid.RevitMaterial.Material.Create(code_block_12)
material_aspect_5 = MaterialAspect("Physical (Structural)")
physical_type_3 = PhysicalType("Metal")
boolean_5 = BoolSelector(true)
create_8 = Orchid.RevitMaterial.PhysicalAsset.Create(code_block_12, physical_type_3, boolean_5)
code_block_13 = CodeBlock()
# ---------- code_block_13.designscript (6 lines) ----------
"Steel, S275 (EN 10025-2)";
"1.0044,structural,metal,CC:EN 10025";
"thermal,solid";
"Steel";
"Orchid generated";
"https://github.com/erfajo/OrchidForDynamo";
# ----------------------------------------
setInformation_5 = Orchid.RevitMaterial.PhysicalAsset.SetInformation(create_8, code_block_13.out0, code_block_13.out1, code_block_13.out3, code_block_13.out4, code_block_13.out5)
asset_behavior_3 = AssetBehavior("Isotropic")
setBehavior_2 = Orchid.RevitMaterial.PhysicalAsset.SetBehavior(setInformation_5, asset_behavior_3)
code_block_14 = CodeBlock { 0.00001; }
setBasicThermal_4 = Orchid.RevitMaterial.PhysicalAsset.SetBasicThermal(setBehavior_2, code_block_14)
code_block_15 = CodeBlock { 205000; 0.3; 80000; 7850; }
setMechanical_3 = Orchid.RevitMaterial.PhysicalAsset.SetMechanical(setBasicThermal_4, code_block_15.out0, code_block_15.out1, code_block_15.out2, code_block_15.out3)
code_block_16 = CodeBlock { 275; 430; }
boolean_6 = BoolSelector(false)
setStrength = Orchid.RevitMaterial.PhysicalAsset.SetStrength(setMechanical_3, code_block_16.out0, code_block_16.out1, boolean_6)
setAsset_5 = Orchid.RevitMaterial.Material.SetAsset(create_7, material_aspect_5, setStrength)
name_5 = Material.Name(setAsset_5)
watch_9 = Watch(name_5)
watch_10 = Watch(setAsset_5)
material_aspect_6 = MaterialAspect("Thermal")
thermal_type_3 = ThermalType("Solid")
create_9 = Orchid.RevitMaterial.ThermalAsset.Create(code_block_12, thermal_type_3, boolean_5)
setInformation_6 = Orchid.RevitMaterial.ThermalAsset.SetInformation(create_9, code_block_13.out0, code_block_13.out2, code_block_13.out3, code_block_13.out4, code_block_13.out5)
boolean_7 = BoolSelector(false)
asset_behavior_4 = AssetBehavior("Isotropic")
code_block_17 = CodeBlock { 45; 0.48; 7850; 0.4; 0; 0.01; 0; 0; }
setProperties_2 = Orchid.RevitMaterial.ThermalAsset.SetProperties(setInformation_6, boolean_7, asset_behavior_4, code_block_17.out0, code_block_17.out1, code_block_17.out2, code_block_17.out3, code_block_17.out4, code_block_17.out5, code_block_17.out6, code_block_17.out7)
setAsset_6 = Orchid.RevitMaterial.Material.SetAsset(create_7, material_aspect_6, setProperties_2)
name_6 = Material.Name(setAsset_6)
watch_11 = Watch(name_6)
watch_12 = Watch(setAsset_6)

# group: Create material: Timber (C24)
code_block_18 = CodeBlock { "_Timber C24"; }
create_10 = Orchid.RevitMaterial.Material.Create(code_block_18)
material_aspect_7 = MaterialAspect("Physical (Structural)")
physical_type_4 = PhysicalType("Wood")
boolean_8 = BoolSelector(true)
create_11 = Orchid.RevitMaterial.PhysicalAsset.Create(code_block_18, physical_type_4, boolean_8)
code_block_19 = CodeBlock()
# ---------- code_block_19.designscript (6 lines) ----------
"Strength Class C24 Timber";
"Eurocode,Structural,structural,wood,CC:EN 338";
"Wood,thermal,solid";
"Wood";
"Orchid generated";
"https://github.com/erfajo/OrchidForDynamo";
# ----------------------------------------
setInformation_7 = Orchid.RevitMaterial.PhysicalAsset.SetInformation(create_11, code_block_19.out0, code_block_19.out1, code_block_19.out3, code_block_19.out4, code_block_19.out5)
asset_behavior_5 = AssetBehavior("Orthotropic")
setBehavior_3 = Orchid.RevitMaterial.PhysicalAsset.SetBehavior(setInformation_7, asset_behavior_5)
code_block_20 = CodeBlock { 0.00004; }
setBasicThermal_5 = Orchid.RevitMaterial.PhysicalAsset.SetBasicThermal(setBehavior_3, code_block_20)
code_block_21 = CodeBlock { 11000; 0.38; 690; 420; }
setMechanical_4 = Orchid.RevitMaterial.PhysicalAsset.SetMechanical(setBasicThermal_5, code_block_21.out0, code_block_21.out1, code_block_21.out2, code_block_21.out3)
code_block_22 = CodeBlock { "Multiple"; "C24"; 24; 21; 2.5; 4; 14; 0.5; 11000; }
wood_construction = WoodConstruction("Natural")
setStrengthExtended = Orchid.RevitMaterial.PhysicalAsset.SetStrengthExtended(setMechanical_4, code_block_22.out0, code_block_22.out1, code_block_22.out2, code_block_22.out3, code_block_22.out4, code_block_22.out5, code_block_22.out6, code_block_22.out7, code_block_22.out8, wood_construction)
setAsset_7 = Orchid.RevitMaterial.Material.SetAsset(create_10, material_aspect_7, setStrengthExtended)
name_7 = Material.Name(setAsset_7)
watch_13 = Watch(name_7)
watch_14 = Watch(setAsset_7)
material_aspect_8 = MaterialAspect("Thermal")
thermal_type_4 = ThermalType("Solid")
create_12 = Orchid.RevitMaterial.ThermalAsset.Create(code_block_18, thermal_type_4, boolean_8)
setInformation_8 = Orchid.RevitMaterial.ThermalAsset.SetInformation(create_12, code_block_19.out0, code_block_19.out2, code_block_19.out3, code_block_19.out4, code_block_19.out5)
boolean_9 = BoolSelector(false)
asset_behavior_6 = AssetBehavior("Isotropic")
code_block_23 = CodeBlock { 0.12; 0.19; 496; 0.85; 0; 0.01; 0; 10000000; }
setProperties_3 = Orchid.RevitMaterial.ThermalAsset.SetProperties(setInformation_8, boolean_9, asset_behavior_6, code_block_23.out0, code_block_23.out1, code_block_23.out2, code_block_23.out3, code_block_23.out4, code_block_23.out5, code_block_23.out6, code_block_23.out7)
setAsset_8 = Orchid.RevitMaterial.Material.SetAsset(create_10, material_aspect_8, setProperties_3)
name_8 = Material.Name(setAsset_8)
watch_15 = Watch(name_8)
watch_16 = Watch(setAsset_8)

# group: All --> Physical Asset
all = Orchid.RevitMaterial.PhysicalAsset.All()
watch_17 = Watch(all)
name_9 = Element.Name(all)
watch_18 = Watch(name_9)

# group: All --> Thermal Asset
all_2 = Orchid.RevitMaterial.ThermalAsset.All()
watch_19 = Watch(all_2)
name_10 = Element.Name(all_2)
watch_20 = Watch(name_10)

# group: Duplicate --> Physical Asset
physical_propertyset = PhysicalPropertySet("Brick - Common 1800kg")
code_block_24 = CodeBlock { "_xx (physical)"; }
duplicate = Orchid.RevitMaterial.PhysicalAsset.Duplicate(physical_propertyset, code_block_24)
watch_21 = Watch(duplicate)

# group: Duplicate --> Thermal Asset
thermal_propertyset = ThermalPropertySet("Brick - Common")
code_block_25 = CodeBlock { "_xx (thermal)"; }
duplicate_2 = Orchid.RevitMaterial.ThermalAsset.Duplicate(thermal_propertyset, code_block_25)
watch_22 = Watch(duplicate_2)

getInformation = Orchid.RevitMaterial.ThermalAsset.GetInformation(setInformation_3)
watch_23 = Watch(getInformation.out2)
watch_24 = Watch(getInformation.out1)
watch_25 = Watch(getInformation.out0)
watch_26 = Watch(getInformation.out3)
watch_27 = Watch(getInformation.out4)
getBasicThermal = Orchid.RevitMaterial.ThermalAsset.GetBasicThermal(setBasicThermal_2)
watch_28 = Watch(getBasicThermal.out2)
watch_29 = Watch(getBasicThermal.out3)
watch_30 = Watch(getBasicThermal.out4)
watch_31 = Watch(getBasicThermal.out1)
watch_32 = Watch(getBasicThermal.out0)
watch_33 = Watch(getBasicThermal.out5)
getExpansionCoefficient = Orchid.RevitMaterial.PhysicalAsset.GetExpansionCoefficient(setBasicThermal_3)
watch_34 = Watch(getExpansionCoefficient.out2)
watch_35 = Watch(getExpansionCoefficient.out3)
watch_36 = Watch(getExpansionCoefficient.out4)
watch_37 = Watch(getExpansionCoefficient.out1)
watch_38 = Watch(getExpansionCoefficient.out5)
watch_39 = Watch(getExpansionCoefficient.out0)
getInformation_2 = Orchid.RevitMaterial.PhysicalAsset.GetInformation(setInformation_4)
watch_40 = Watch(getInformation_2.out1)
watch_41 = Watch(getInformation_2.out0)
watch_42 = Watch(getInformation_2.out2)
watch_43 = Watch(getInformation_2.out3)
watch_44 = Watch(getInformation_2.out4)
getDensity = Orchid.RevitMaterial.PhysicalAsset.GetDensity(setMechanical_2)
watch_45 = Watch(getDensity)
getInformation_3 = Orchid.RevitMaterial.ThermalAsset.GetInformation(setInformation)
watch_46 = Watch(getInformation_3.out4)
watch_47 = Watch(getInformation_3.out3)
watch_48 = Watch(getInformation_3.out2)
watch_49 = Watch(getInformation_3.out1)
watch_50 = Watch(getInformation_3.out0)
getInformation_4 = Orchid.RevitMaterial.PhysicalAsset.GetInformation(setInformation_2)
watch_51 = Watch(getInformation_4.out1)
watch_52 = Watch(getInformation_4.out2)
watch_53 = Watch(getInformation_4.out3)
watch_54 = Watch(getInformation_4.out4)
watch_55 = Watch(getInformation_4.out0)
getYoungModulus = Orchid.RevitMaterial.PhysicalAsset.GetYoungModulus(setMechanical)
watch_56 = Watch(getYoungModulus.out1)
watch_57 = Watch(getYoungModulus.out2)
watch_58 = Watch(getYoungModulus.out0)
watch_59 = Watch(getYoungModulus.out3)
watch_60 = Watch(getYoungModulus.out4)
getPoissonRatio = Orchid.RevitMaterial.PhysicalAsset.GetPoissonRatio(setMechanical)
watch_61 = Watch(getPoissonRatio.out1)
watch_62 = Watch(getPoissonRatio.out2)
watch_63 = Watch(getPoissonRatio.out0)
watch_64 = Watch(getPoissonRatio.out3)
watch_65 = Watch(getPoissonRatio.out4)
getShearModulus = Orchid.RevitMaterial.PhysicalAsset.GetShearModulus(setMechanical)
watch_66 = Watch(getShearModulus.out1)
watch_67 = Watch(getShearModulus.out2)
watch_68 = Watch(getShearModulus.out0)
watch_69 = Watch(getShearModulus.out3)
watch_70 = Watch(getShearModulus.out4)
getConcrete = Orchid.RevitMaterial.PhysicalAsset.GetConcrete(setConcrete)
watch_71 = Watch(getConcrete.out1)
watch_72 = Watch(getConcrete.out2)
watch_73 = Watch(getConcrete.out0)
watch_74 = Watch(getYoungModulus.out5)
watch_75 = Watch(getPoissonRatio.out5)
getExpansionCoefficient_2 = Orchid.RevitMaterial.PhysicalAsset.GetExpansionCoefficient(setBasicThermal)
watch_76 = Watch(getExpansionCoefficient_2.out1)
watch_77 = Watch(getExpansionCoefficient_2.out2)
watch_78 = Watch(getExpansionCoefficient_2.out0)
watch_79 = Watch(getExpansionCoefficient_2.out3)
watch_80 = Watch(getExpansionCoefficient_2.out4)
watch_81 = Watch(getExpansionCoefficient_2.out5)
getBehavior = Orchid.RevitMaterial.PhysicalAsset.GetBehavior(setBehavior)
watch_82 = Watch(getBehavior)

# group: Create material: Timber (C24) --> XYZ values for SetBasicThermal and SetMechanical
code_block_26 = CodeBlock { "_Timber C24 (XYZ)"; }
physical_type_5 = PhysicalType("Wood")
boolean_10 = BoolSelector(true)
create_13 = Orchid.RevitMaterial.PhysicalAsset.Create(code_block_26, physical_type_5, boolean_10)
code_block_27 = CodeBlock()  # same code as code_block_19
setInformation_9 = Orchid.RevitMaterial.PhysicalAsset.SetInformation(create_13, code_block_27.out0, code_block_27.out1, code_block_27.out3, code_block_27.out4, code_block_27.out5)
asset_behavior_7 = AssetBehavior("Orthotropic")
setBehavior_4 = Orchid.RevitMaterial.PhysicalAsset.SetBehavior(setInformation_9, asset_behavior_7)
code_block_28 = CodeBlock { 0.0001; 0.0002; 0.0003; }
byCoordinates = Point.ByCoordinates(x=code_block_28.out0, y=code_block_28.out1, z=code_block_28.out2)
setBasicThermalByXYZ = Orchid.RevitMaterial.PhysicalAsset.SetBasicThermalByXYZ(setBehavior_4, byCoordinates)
code_block_29 = CodeBlock()
# ---------- code_block_29.designscript (4 lines) ----------
Autodesk.Point.ByCoordinates(10000,11000,12000);
Autodesk.Point.ByCoordinates(0.3,0.35,0.4);
Autodesk.Point.ByCoordinates(650,700,750);
420;
# ----------------------------------------
setMechanicalByXYZ = Orchid.RevitMaterial.PhysicalAsset.SetMechanicalByXYZ(setBasicThermalByXYZ, code_block_29.out0, code_block_29.out1, code_block_29.out2, code_block_29.out3)
thermal_type_5 = ThermalType("Solid")
create_14 = Orchid.RevitMaterial.ThermalAsset.Create(code_block_26, thermal_type_5, boolean_10)
setInformation_10 = Orchid.RevitMaterial.ThermalAsset.SetInformation(create_14, code_block_27.out0, code_block_27.out2, code_block_27.out3, code_block_27.out4, code_block_27.out5)
boolean_11 = BoolSelector(false)
asset_behavior_8 = AssetBehavior("Isotropic")
code_block_30 = CodeBlock { 0.12; 0.19; 496; 0.85; 0; 0.01; 0; 10000000; }
setProperties_4 = Orchid.RevitMaterial.ThermalAsset.SetProperties(setInformation_10, boolean_11, asset_behavior_8, code_block_30.out0, code_block_30.out1, code_block_30.out2, code_block_30.out3, code_block_30.out4, code_block_30.out5, code_block_30.out6, code_block_30.out7)
code_block_31 = CodeBlock { "Multiple"; "C24"; 24; 21; 2.5; 4; 14; 0.5; 11000; }
wood_construction_2 = WoodConstruction("Natural")
setStrengthExtended_2 = Orchid.RevitMaterial.PhysicalAsset.SetStrengthExtended(setMechanicalByXYZ, code_block_31.out0, code_block_31.out1, code_block_31.out2, code_block_31.out3, code_block_31.out4, code_block_31.out5, code_block_31.out6, code_block_31.out7, code_block_31.out8, wood_construction_2)
create_15 = Orchid.RevitMaterial.Material.Create(code_block_26)
material_aspect_9 = MaterialAspect("Physical (Structural)")
setAsset_9 = Orchid.RevitMaterial.Material.SetAsset(create_15, material_aspect_9, setStrengthExtended_2)
name_11 = Material.Name(setAsset_9)
watch_83 = Watch(name_11)
watch_84 = Watch(setAsset_9)
material_aspect_10 = MaterialAspect("Thermal")
setAsset_10 = Orchid.RevitMaterial.Material.SetAsset(create_15, material_aspect_10, setProperties_4)
name_12 = Material.Name(setAsset_10)
watch_85 = Watch(name_12)
watch_86 = Watch(setAsset_10)

getInformation_5 = Orchid.RevitMaterial.PhysicalAsset.GetInformation(setInformation_9)
watch_87 = Watch(getInformation_5.out2)
watch_88 = Watch(getInformation_5.out3)
watch_89 = Watch(getInformation_5.out4)
getYoungModulus_2 = Orchid.RevitMaterial.PhysicalAsset.GetYoungModulus(setMechanicalByXYZ)
watch_90 = Watch(getYoungModulus_2.out2)
watch_91 = Watch(getYoungModulus_2.out3)
watch_92 = Watch(getYoungModulus_2.out4)
getPoissonRatio_2 = Orchid.RevitMaterial.PhysicalAsset.GetPoissonRatio(setMechanicalByXYZ)
watch_93 = Watch(getPoissonRatio_2.out1)
watch_94 = Watch(getPoissonRatio_2.out2)
watch_95 = Watch(getPoissonRatio_2.out3)
watch_96 = Watch(getPoissonRatio_2.out4)
getShearModulus_2 = Orchid.RevitMaterial.PhysicalAsset.GetShearModulus(setMechanicalByXYZ)
watch_97 = Watch(getShearModulus_2.out1)
watch_98 = Watch(getShearModulus_2.out2)
watch_99 = Watch(getShearModulus_2.out0)
watch_100 = Watch(getShearModulus_2.out3)
watch_101 = Watch(getShearModulus_2.out4)
watch_102 = Watch(getYoungModulus_2.out5)
watch_103 = Watch(getPoissonRatio_2.out5)
getExpansionCoefficient_3 = Orchid.RevitMaterial.PhysicalAsset.GetExpansionCoefficient(setBasicThermalByXYZ)
watch_104 = Watch(getExpansionCoefficient_3.out1)
watch_105 = Watch(getExpansionCoefficient_3.out2)
watch_106 = Watch(getExpansionCoefficient_3.out3)
watch_107 = Watch(getExpansionCoefficient_3.out4)
watch_108 = Watch(getExpansionCoefficient_3.out5)
getBehavior_2 = Orchid.RevitMaterial.PhysicalAsset.GetBehavior(setBehavior_4)
watch_109 = Watch(getBehavior_2)
watch_110 = Watch(getInformation_5.out1)
watch_111 = Watch(getInformation_5.out0)
watch_112 = Watch(getPoissonRatio_2.out0)
watch_113 = Watch(getYoungModulus_2.out1)
watch_114 = Watch(getYoungModulus_2.out0)
watch_115 = Watch(getExpansionCoefficient_3.out0)
getInformation_6 = Orchid.RevitMaterial.ThermalAsset.GetInformation(setInformation_10)
watch_116 = Watch(getInformation_6.out4)
watch_117 = Watch(getInformation_6.out3)
watch_118 = Watch(getInformation_6.out2)
watch_119 = Watch(getInformation_6.out1)
watch_120 = Watch(getInformation_6.out0)
getProperties = Orchid.RevitMaterial.ThermalAsset.GetProperties(setProperties_4)
watch_121 = Watch(getProperties.out5)
watch_122 = Watch(getProperties.out4)
watch_123 = Watch(getProperties.out3)
watch_124 = Watch(getProperties.out2)
watch_125 = Watch(getProperties.out1)
watch_126 = Watch(getProperties.out0)
watch_127 = Watch(getProperties.out9)
watch_128 = Watch(getProperties.out8)
watch_129 = Watch(getProperties.out7)
watch_130 = Watch(getProperties.out6)
getStrengthExtended = Orchid.RevitMaterial.PhysicalAsset.GetStrengthExtended(setStrengthExtended_2)
watch_131 = Watch(getStrengthExtended.out5)
watch_132 = Watch(getStrengthExtended.out6)
watch_133 = Watch(getStrengthExtended.out7)
watch_134 = Watch(getStrengthExtended.out4)
watch_135 = Watch(getStrengthExtended.out3)
watch_136 = Watch(getStrengthExtended.out8)
watch_137 = Watch(getStrengthExtended.out9)
watch_138 = Watch(getStrengthExtended.out0)
watch_139 = Watch(getStrengthExtended.out1)
watch_140 = Watch(getStrengthExtended.out2)
getStrength = Orchid.RevitMaterial.PhysicalAsset.GetStrength(setStrength)
watch_141 = Watch(getStrength.out2)
watch_142 = Watch(getStrength.out1)
watch_143 = Watch(getStrength.out0)
getShearModulus_3 = Orchid.RevitMaterial.PhysicalAsset.GetShearModulus(setMechanical_3)
watch_144 = Watch(getShearModulus_3.out1)
watch_145 = Watch(getShearModulus_3.out2)
watch_146 = Watch(getShearModulus_3.out0)
getPoissonRatio_3 = Orchid.RevitMaterial.PhysicalAsset.GetPoissonRatio(setMechanical_3)
watch_147 = Watch(getPoissonRatio_3.out1)
watch_148 = Watch(getPoissonRatio_3.out2)
watch_149 = Watch(getPoissonRatio_3.out0)
watch_150 = Watch(getShearModulus_3.out3)
watch_151 = Watch(getShearModulus_3.out4)
watch_152 = Watch(getPoissonRatio_3.out3)
watch_153 = Watch(getPoissonRatio_3.out4)
getYoungModulus_3 = Orchid.RevitMaterial.PhysicalAsset.GetYoungModulus(setMechanical_3)
watch_154 = Watch(getYoungModulus_3.out2)
watch_155 = Watch(getYoungModulus_3.out3)
watch_156 = Watch(getYoungModulus_3.out4)
watch_157 = Watch(getYoungModulus_3.out1)
watch_158 = Watch(getYoungModulus_3.out0)
watch_159 = Watch(getPoissonRatio_3.out5)
watch_160 = Watch(getYoungModulus_3.out5)
getExpansionCoefficient_4 = Orchid.RevitMaterial.PhysicalAsset.GetExpansionCoefficient(setBasicThermal_4)
watch_161 = Watch(getExpansionCoefficient_4.out1)
watch_162 = Watch(getExpansionCoefficient_4.out2)
watch_163 = Watch(getExpansionCoefficient_4.out3)
watch_164 = Watch(getExpansionCoefficient_4.out4)
watch_165 = Watch(getExpansionCoefficient_4.out5)
watch_166 = Watch(getExpansionCoefficient_4.out0)
getInformation_7 = Orchid.RevitMaterial.PhysicalAsset.GetInformation(setInformation_5)
watch_167 = Watch(getInformation_7.out2)
watch_168 = Watch(getInformation_7.out3)
watch_169 = Watch(getInformation_7.out4)
getBehavior_3 = Orchid.RevitMaterial.PhysicalAsset.GetBehavior(setBehavior_2)
watch_170 = Watch(getBehavior_3)
watch_171 = Watch(getInformation_7.out1)
watch_172 = Watch(getInformation_7.out0)
getInformation_8 = Orchid.RevitMaterial.ThermalAsset.GetInformation(setInformation_6)
watch_173 = Watch(getInformation_8.out4)
watch_174 = Watch(getInformation_8.out3)
watch_175 = Watch(getInformation_8.out2)
watch_176 = Watch(getInformation_8.out1)
watch_177 = Watch(getInformation_8.out0)
getProperties_2 = Orchid.RevitMaterial.ThermalAsset.GetProperties(setProperties_2)
watch_178 = Watch(getProperties_2.out2)
watch_179 = Watch(getProperties_2.out3)
watch_180 = Watch(getProperties_2.out4)
watch_181 = Watch(getProperties_2.out1)
watch_182 = Watch(getProperties_2.out0)
watch_183 = Watch(getProperties_2.out9)
watch_184 = Watch(getProperties_2.out8)
watch_185 = Watch(getProperties_2.out7)
watch_186 = Watch(getProperties_2.out6)
watch_187 = Watch(getProperties_2.out5)
getProperties_3 = Orchid.RevitMaterial.ThermalAsset.GetProperties(setProperties)
watch_188 = Watch(getProperties_3.out2)
watch_189 = Watch(getProperties_3.out3)
watch_190 = Watch(getProperties_3.out4)
watch_191 = Watch(getProperties_3.out1)
watch_192 = Watch(getProperties_3.out0)
watch_193 = Watch(getProperties_3.out9)
watch_194 = Watch(getProperties_3.out8)
watch_195 = Watch(getProperties_3.out7)
watch_196 = Watch(getProperties_3.out6)
watch_197 = Watch(getProperties_3.out5)
