# Dynamo graph AutoIFCexport.dyn (Dynamo 1.3.4.6666)

# group: Prebuild IFC setting
ifc_setting = Setting("IFC4 Design Transfer View")  # frozen
settingByName = Orchid.RevitProject.Common.IFC.SettingByName(ifc_setting)

# group: IFC setting --> General
ifc_version = Version("IFC4 Design Transfer View")
ifc_file_type = FileType("IFC")
ifc_space_boundary = SpaceBoundary("1st Level")
ifc_project_origin = SitePlacement("Internal coordinates")
boolean = BoolSelector(true)
settingGeneral = Orchid.RevitProject.Common.IFC.SettingGeneral(settingByName, arg3=ifc_space_boundary, arg4=ifc_project_origin, arg5=boolean)

# group: IFC setting --> Additional/LOD
boolean_2 = BoolSelector(true)
ifc_level_of_detail = LevelOfDetail("Medium")
settingAdditional = Orchid.RevitProject.Common.IFC.SettingAdditional(settingGeneral, arg3=boolean_2, arg5=ifc_level_of_detail)

# group: IFC setting --> Property
boolean_3 = BoolSelector(true)
code_block = CodeBlock { t1 = Orchid.Directory.Current; t2 = "test"; t1+"\\"+t2; }
settingProperty = Orchid.RevitProject.Common.IFC.SettingProperty(settingAdditional, arg3=boolean_3, arg7=code_block.out2)

# group: IFC setting --> Advanced
boolean_4 = BoolSelector(true)
settingAdvanced = Orchid.RevitProject.Common.IFC.SettingAdvanced(settingProperty, arg7=boolean_4)

# group: IFC Export
current = Orchid.Core.Directory.Current()
string = StringInput("test")
code_block_2 = CodeBlock(t1=current, t2=string) { t1+"\\"+t2; }
boolean_5 = BoolSelector(false)
phases = Phase("Existing")
views = Views("{3D}")
export = Orchid.RevitProject.Common.IFC.Export(arg1=settingAdvanced, arg2=views)
watch = Watch(export)

# group: IFC setting file format
type = Object.Type(settingAdvanced)
watch_2 = Watch(type)
watch_3 = Watch(settingAdvanced)

# group: Open all files in directory and sub directories
string_2 = StringInput(".\testSet")
string_3 = StringInput("*.rfa")
boolean_6 = BoolSelector(false)
contents = Orchid.Core.Directory.Contents(string_2, string_3, boolean_6)
loadFamily = Orchid.Core.File.LoadFamily(contents)

# group: Place families in document
boolean_7 = BoolSelector(false)
fileName = FilePath.FileName(loadFamily, boolean_7)
byName = Family.ByName(fileName)
types = Family.Types(byName)
flatten = Flatten(types)
count = Count(flatten)
code_block_3 = CodeBlock(num=count) { (1..num)*2500; }
byCoordinates = Point.ByCoordinates(x=code_block_3)
levels = Levels("Level 1")
byPointAndLevel = FamilyInstance.ByPointAndLevel(familyType=flatten, point=byCoordinates, level=levels)

# group: IFC Export based on prebuild IFC setting and a view
current_2 = Orchid.RevitProject.Common.Document.Current()
await_ = Orchid.Core.DataStream.Await(current_2, byPointAndLevel)
ifc_setting_2 = Setting("IFC2x3 Coordination View 2.0")
settingByName_2 = Orchid.RevitProject.Common.IFC.SettingByName(ifc_setting_2)
views_2 = Views("{3D}")
export_2 = Orchid.RevitProject.Common.IFC.Export(await_, settingByName_2, views_2)
