# Dynamo graph BuiltInParameter.dyn (Dynamo 1.3.4.6666)

all = Orchid.RevitProject.Parameters.BuiltInParameter.All()
name = Orchid.RevitProject.Parameters.BuiltInParameter.Name(all)
watch = Watch(name)
watch_2 = Watch(all)
builtin_parameter = BuiltInParameter("MATERIAL_ID_PARAM")
watch_3 = Watch(builtin_parameter)
name_2 = Orchid.RevitProject.Parameters.BuiltInParameter.Name(builtin_parameter)
watch_4 = Watch(name_2)
label = Orchid.RevitProject.Parameters.BuiltInParameter.Label(all)
watch_5 = Watch(label)
label_2 = Orchid.RevitProject.Parameters.BuiltInParameter.Label(builtin_parameter)
watch_6 = Watch(label_2)
