# Dynamo graph Document.dyn (Dynamo 1.3.4.6666)

# group: Does document contain category?
code_block = CodeBlock()
# ---------- code_block.designscript (4 lines) ----------
// Categories to verify
{"Areas","Rooms","Spaces"};
"Levels";
"Stairs";
# ----------------------------------------
containCategory = Orchid.RevitProject.Common.Document.ContainCategory(code_block.out0)
watch = Watch(containCategory)
categories = Categories("MEPSpaces")

# group: Does document contain type?
code_block_2 = CodeBlock()
# ---------- code_block_2.designscript (4 lines) ----------
// Types to verify
{"Area","Room","Space"};
"Level";
"Stairs";
# ----------------------------------------
containType = Orchid.RevitProject.Common.Document.ContainType(code_block_2.out0)
watch_2 = Watch(containType)
element_types = ElementTypes("Space")

# group: All background open documents
opened = Orchid.RevitProject.Common.Document.Opened()
directory_path = StringInput("..\testSet")
string = StringInput("*.rfa")
boolean = BoolSelector(false)
contents = Orchid.Common.Directory.Contents(directory_path, string, boolean)
backgroundOpen = Orchid.RevitProject.Common.Document.BackgroundOpen(contents)
await_ = Orchid.Common.DataStream.Await(opened, backgroundOpen)
watch_3 = Watch(await_)

# group: Convert documents
current = Document.Current()
toOrchidType = Orchid.RevitProject.Common.Document.ToOrchidType(current)
watch_4 = Watch(toOrchidType)
python_script = Python()
# ---------- python_script.python (4 lines) ----------
import clr
clr.AddReference('RevitServices')
from RevitServices.Persistence import DocumentManager
OUT = DocumentManager.Instance.CurrentDBDocument
# ----------------------------------------
toOrchidType_2 = Orchid.RevitProject.Common.Document.ToOrchidType(python_script)
watch_5 = Watch(toOrchidType_2)
