# Dynamo graph ExportSchedules.dyn (Dynamo 1.3.4.6666)

# group: Schedules
code_block = CodeBlock { "Room Schedule"; }
byName = Orchid.RevitProject.Views.View.ByName(code_block)
getData = Orchid.RevitProject.Schedules.Schedule.GetData(byName)

# group: Export to Excel
string = StringInput(".\Skemaer")
code_block_2 = CodeBlock { 0; }
writeToFile = Excel.WriteToFile(filePath=string, sheetName=code_block, startRow=code_block_2, startCol=code_block_2, data=getData)
