# Dynamo graph Filter.dyn (Dynamo 1.3.4.6666)

# group: Orchid -> Filter rule for (element) parameters
code_block = CodeBlock { "test2"; }
code_block_2 = CodeBlock { "Windows"; }
byName = Category.ByName(code_block_2)
all_elements_of_category = ElementsOfCategory(byName)
firstItem = List.FirstItem(all_elements_of_category)
elementType = Element.ElementType(firstItem)
code_block_3 = CodeBlock { "Width"; "Greater"; 1000; }
parameterByName = Parameter.ParameterByName(element=elementType, name=code_block_3.out0)
create = Orchid.RevitProject.Filters.FilterRule.Create(parameterByName, code_block_3.out1, code_block_3.out2)
code_block_4 = CodeBlock { {"Doors","Windows"}; }
byName_2 = Category.ByName(code_block_4)
byRule = Orchid.RevitProject.Filters.ParameterFilter.ByRule(code_block, create, byName_2)

# group: Add filter to view, and set visibility
views = Views("{3D}")
boolean = BoolSelector(false)
addFilter = Orchid.RevitProject.Views.View.AddFilter(views, byRule, boolean)
filters = View.Filters(addFilter)

# group: Convert to Orchid type
code_block_5 = CodeBlock()  # unwired: FilterRule
# ---------- code_block_5.designscript (3 lines) ----------
//provide an
//Autodesk.Revit.DB.FilterRule
FilterRule;
# ----------------------------------------
toOrchidType = Orchid.RevitProject.Filters.FilterRule.ToOrchidType(code_block_5)

# group: Ruletype
select_rule_type = RuleTypes("GeaterOrEqual")
code_block_6 = CodeBlock()
# ---------- code_block_6.designscript (25 lines) ----------
// Dynamo RuleTypes
// Please notice the spelling
// issue --> GeaterOrEqual
"BeginsWith";
"Contains";
"EndsWith";
"Equals";
"Greater";
"Less";
"GeaterOrEqual";
"GreaterOrEqual";
"LessOrEqual";
"NotBeginsWith";
"NotContains";
"NotEndsWith";
"NotEquals";

// Orchid additional
// Ruletypes
"==";
">";
"<";
">=";
"<=";
"!=";
# ----------------------------------------

# group: Filter rule for user-defined parameters (project, shared, and global parameters)
code_block_7 = CodeBlock()
# ---------- code_block_7.designscript (12 lines) ----------
// Parameter name
"TestStringParameter";
"TestIntegerParameter";
"TestDoubleParameter";

// Rule Type
"==";

// values
"Something";
1000;
1000.0;
# ----------------------------------------
byName_3 = Orchid.RevitProject.Parameters.Parameter.ByName(code_block_7.out2)
name = Element.Name(byName_3)
watch = Watch(name)
id = Element.Id(byName_3)
watch_2 = Watch(id)
code_block_8 = CodeBlock { "test1"; }
create_2 = Orchid.RevitProject.Filters.FilterRule.Create(code_block_7.out0, code_block_7.out3, code_block_7.out4)
create_3 = Orchid.RevitProject.Filters.FilterRule.Create(byName_3, code_block_7.out3, code_block_7.out6)
code_block_9 = CodeBlock { {"Doors","Windows"}; }
byName_4 = Category.ByName(code_block_9)
boolean_2 = BoolSelector(false)

# group: OOTB -> Filter rule for (element) parameters. Notice the need to convert between SI and Imperial units!
code_block_10 = CodeBlock { "test3"; }
code_block_11 = CodeBlock { {"Windows","Doors"}; }
byName_5 = Category.ByName(code_block_11)
code_block_12 = CodeBlock { "Greater"; "Width"; 1000; }
convert_between_units = DynamoConvert(code_block_12.out2, conversionMetric=Length, conversionFrom=Millimeters, conversionTo=Feet)
code_block_13 = CodeBlock { "Windows"; }
byName_6 = Category.ByName(code_block_13)
all_elements_of_category_2 = ElementsOfCategory(byName_6)
firstItem_2 = List.FirstItem(all_elements_of_category_2)
elementType_2 = Element.ElementType(firstItem_2)
parameterByName_2 = Parameter.ParameterByName(element=elementType_2, name=code_block_12.out1)
byRuleType = Revit.Filter.FilterRule.ByRuleType(code_block_12.out0, convert_between_units, parameterByName_2)
byRules = Revit.Filter.ParameterFilterElement.ByRules(code_block_10, byName_5, byRuleType)

# group: Get FilterRule and convert to Orchid type ...it can now be sat as an OR filter
code_block_14 = CodeBlock { "test4"; }
getRule = Orchid.RevitProject.Filters.ParameterFilter.GetRule(byRules)
boolean_3 = BoolSelector(false)
byRule_2 = Orchid.RevitProject.Filters.ParameterFilter.ByRule(code_block_14, getRule, byName_2, boolean_3)

parameter_filters = ParameterFilter("Architectural")
watch_3 = Watch(parameter_filters)
all = Orchid.RevitProject.Filters.ParameterFilter.All()
watch_4 = Watch(all)
create_4 = List.Create(create_2, create_3)

# group (continued): Filter rule for user-defined parameters (project, shared, and global parameters)
byRule_3 = Orchid.RevitProject.Filters.ParameterFilter.ByRule(code_block_8, create_4, byName_4, boolean_2)

await_ = Orchid.Common.DataStream.Await(code_block_8, byRule_3)
byName_7 = Orchid.RevitProject.Filters.ParameterFilter.ByName(await_)
watch_5 = Watch(byName_7)

# group: Add filter rule set
ruleTree = Orchid.RevitProject.Filters.ParameterFilter.RuleTree(byRule_3)
addRuleSet = Orchid.RevitProject.Filters.ParameterFilter.AddRuleSet(byRule_3, create, ruleTree)
ruleTree_2 = Orchid.RevitProject.Filters.ParameterFilter.RuleTree(addRuleSet)
watch_6 = Watch(ruleTree_2)
boolean_4 = BoolSelector(false)
addRuleSet_2 = Orchid.RevitProject.Filters.ParameterFilter.AddRuleSet(addRuleSet, getRule, ruleTree_2, arg4=boolean_4)
ruleTree_3 = Orchid.RevitProject.Filters.ParameterFilter.RuleTree(addRuleSet_2)
watch_7 = Watch(ruleTree_3)
code_block_15 = CodeBlock(filterRule=create) { filterRule; {3}; {3,2}; }
boolean_5 = BoolSelector(true)
addRuleSet_3 = Orchid.RevitProject.Filters.ParameterFilter.AddRuleSet(addRuleSet_2, code_block_15.filterRule, ruleTree_3, code_block_15.out1, boolean_5)
ruleTree_4 = Orchid.RevitProject.Filters.ParameterFilter.RuleTree(addRuleSet_3)
watch_8 = Watch(ruleTree_4)
