# Dynamo graph Grid.dyn (Dynamo 1.3.4.6666)

# group: Get grid
code_block = CodeBlock { "Grids"; }
byName = Category.ByName(code_block)
all_elements_of_category = ElementsOfCategory(byName)

# group: Get level location
code_block_2 = CodeBlock { "Levels"; }
byName_2 = Category.ByName(code_block_2)
all_elements_of_category_2 = ElementsOfCategory(byName_2)
elevation = Level.Elevation(all_elements_of_category_2)

# group: Adjust grid line extents
maximumItem = List.MaximumItem(elevation)
code_block_3 = CodeBlock()
# ---------- code_block_3.designscript (3 lines) ----------
// extent grid lines
// above/below model
2000;
# ----------------------------------------
minimumItem = List.MinimumItem(elevation)
code_block_4 = CodeBlock(top=maximumItem, value=code_block_3, bottom=minimumItem) { top+value; bottom-value; }
setVerticalExtents = Orchid.RevitProject.Common.Grid.SetVerticalExtents(all_elements_of_category, code_block_4.out0, code_block_4.out1)

# group: Move grid line extents
code_block_5 = CodeBlock()
# ---------- code_block_5.designscript (2 lines) ----------
// distance
-2000;
# ----------------------------------------
moveVerticalExtents = Orchid.RevitProject.Common.Grid.MoveVerticalExtents(all_elements_of_category, code_block_5)

# group: Get vertical extents
getVerticalExtents = Orchid.RevitProject.Common.Grid.GetVerticalExtents(moveVerticalExtents)
watch = Watch(getVerticalExtents.out0)
watch_2 = Watch(getVerticalExtents.out1)
watch_3 = Watch(getVerticalExtents.out2)
