# Dynamo graph Group.dyn (Dynamo 1.3.4.6666)

# group: Does document contain category?
code_block = CodeBlock()
# ---------- code_block.designscript (9 lines) ----------
"Model";
"Annotation";
"AnalyticalModel";
"Internal";

{"Model",
"Annotation",
"AnalyticalModel",
"Internal"};
# ----------------------------------------
elementByCategoryType = Orchid.RevitProject.Elements.Selection.ElementByCategoryType(arg1=code_block.out0)
watch = Watch(elementByCategoryType)
code_block_2 = CodeBlock { "test"; }
flatten = Flatten(elementByCategoryType)
create = Orchid.RevitProject.Elements.Group.Create(code_block_2, flatten)

# group: Group delete
code_block_3 = CodeBlock { "test"; }
delete = Orchid.RevitProject.Elements.Group.Delete(code_block_3)  # frozen
groups = Groups()
delete_2 = Orchid.RevitProject.Elements.Group.Delete(groups)  # frozen
getByName = Orchid.RevitProject.Elements.Group.GetByName(code_block_3)
delete_3 = Orchid.RevitProject.Elements.Group.Delete(getByName)  # frozen

# group: Group ungroup
code_block_4 = CodeBlock { "test"; }
unGroup = Orchid.RevitProject.Elements.Group.UnGroup(code_block_4)  # frozen
groups_2 = Groups()
unGroup_2 = Orchid.RevitProject.Elements.Group.UnGroup(groups_2)  # frozen
getByName_2 = Orchid.RevitProject.Elements.Group.GetByName(code_block_4)
unGroup_3 = Orchid.RevitProject.Elements.Group.UnGroup(getByName_2)  # frozen

# group: GroupType delete
code_block_5 = CodeBlock { "test"; }
delete_4 = Orchid.RevitProject.Elements.GroupType.Delete(code_block_5)  # frozen
groupTypes = GroupTypes()
delete_5 = Orchid.RevitProject.Elements.GroupType.Delete(groupTypes)  # frozen
