# Dynamo graph LinkRepath.dyn (Dynamo 1.3.4.6666)

string = StringInput("%userprofile%\Programming\Source\Testing\Data\2019_Data\")
string_2 = StringInput("2019_LinkedProject")
code_block = CodeBlock(a=string, b=string_2) { a+b+".rvt"; }
fromPath = Orchid.Common.File.FromPath(code_block)
backgroundOpen = Orchid.RevitProject.Common.Document.BackgroundOpen(fromPath)
getRevitFile = Orchid.RevitProject.Common.Link.GetRevitFile(backgroundOpen)
string_3 = StringInput("%userprofile%\Programming\Source\Testing\Data\2019_Data\")
string_4 = StringInput("2019_defaultProject")
code_block_2 = CodeBlock(a=string_3, b=string_4) { a+b+".rvt"; }
fromPath_2 = Orchid.Common.File.FromPath(code_block_2)
repath = Orchid.RevitProject.Common.Link.Repath(getRevitFile, fromPath_2)
await_ = Orchid.Common.DataStream.Await(getRevitFile, repath)
boolean = BoolSelector(false)
close = Orchid.RevitProject.Common.Document.Close(await_, boolean)
