# Dynamo graph LinkedDocument-pin.dyn (Dynamo 1.3.4.6666)

string = StringInput(".\2019_defaultProject.rvt")
backgroundOpen = Orchid.RevitProject.Common.Document.BackgroundOpen(string)

# group: Link revit file
string_2 = StringInput(".\defaultBuilding_2019.rvt")
link_positioning = Positioning("Origin")
code_block = CodeBlock { 10000; }
byCoordinates = Point.ByCoordinates(y=code_block)
attachment_type = AttachmentType("Overlay")
boolean = BoolSelector(true)
setRevitFile = Orchid.RevitProject.Common.Link.SetRevitFile(backgroundOpen, string_2, link_positioning, arg4=byCoordinates, arg5=attachment_type, arg6=boolean)

watch = Watch(setRevitFile.out0)
watch_2 = Watch(setRevitFile.out1)
pin = Orchid.RevitProject.Elements.Element.Pin(backgroundOpen, setRevitFile.out0)
await_ = Orchid.Common.DataStream.Await(backgroundOpen, pin)
name = Orchid.RevitProject.Common.Document.Name(backgroundOpen)
code_block_2 = CodeBlock(name=name) { name+"_copy.rvt"; true; }
saveAs = Orchid.RevitProject.Common.Document.SaveAs(await_, code_block_2.out0, code_block_2.out1)
close = Orchid.RevitProject.Common.Document.Close(saveAs)

# group: Pin
categories = Categories("Walls")
all_elements_of_category = ElementsOfCategory(categories)  # frozen
pin_2 = Orchid.RevitProject.Elements.Element.Pin(all_elements_of_category)
unPin = Orchid.RevitProject.Elements.Element.UnPin(all_elements_of_category)

# group: Pin
categories_2 = Categories("Walls")
all_elements_of_category_2 = ElementsOfCategory(categories_2)  # frozen
pin_3 = Orchid.RevitProject.Elements.Element.Pin(arg1=all_elements_of_category_2)
unPin_2 = Orchid.RevitProject.Elements.Element.UnPin(arg1=all_elements_of_category_2)
