# Dynamo graph LinkedDocument.dyn (Dynamo 1.3.4.6666)

string = StringInput("C:\Users\erfajo\Programming\Source\Testing\Data\")
string_2 = StringInput("2019_defaultProject")
code_block = CodeBlock(a=string, b=string_2) { a+b+".rvt"; }
fromPath = Orchid.Core.File.FromPath(code_block)

# group: Revit links
linkedRevitFile = Orchid.RevitProject.Common.Link.LinkedRevitFile()
linkReload = Orchid.RevitProject.Common.Link.LinkReload(linkedRevitFile)  # frozen
linkRepath = Orchid.RevitProject.Common.Link.LinkRepath(linkedRevitFile, fromPath)  # frozen
linkUnload = Orchid.RevitProject.Common.Link.LinkUnload(linkedRevitFile)  # frozen
watch = Watch(linkedRevitFile)
name = Element.Name(linkedRevitFile)
watch_2 = Watch(name)

# group: CAD links
linkedCadFile = Orchid.RevitProject.Common.Link.LinkedCadFile()
watch_3 = Watch(linkedCadFile)
name_2 = Element.Name(linkedCadFile)
watch_4 = Watch(name_2)
linkReload_2 = Orchid.RevitProject.Common.Link.LinkReload()  # unwired: arg0
watch_5 = Watch(linkReload_2)

# group: Get all linked files
linkedFile = Orchid.RevitProject.Common.Link.LinkedFile()
watch_6 = Watch(linkedFile.out1)
watch_7 = Watch(linkedFile.out0)

# group: Dropdown selector
linked_files = LinkedFile("Assembly Code Settings")
watch_8 = Watch(linked_files)
linked_revit_files = LinkedRevit()
watch_9 = Watch(linked_revit_files)
linked_cad_files = LinkedCad()
watch_10 = Watch(linked_cad_files)

# group: Convert to Revit link
select_model_element = DSModelElementSelection()
watch_11 = Watch(select_model_element)
convertToLink = Orchid.RevitProject.Common.Link.ConvertToLink(arg1=select_model_element)
watch_12 = Watch(convertToLink)

# group: Convert to CAD link
select_model_element_2 = DSModelElementSelection()
watch_13 = Watch(select_model_element_2)
convertToLink_2 = Orchid.RevitProject.Common.Link.ConvertToLink(arg1=select_model_element_2)
watch_14 = Watch(convertToLink_2)

# group: Link revit file
string_3 = StringInput(".\defaultBuilding_2018.rvt")
link_positioning = Positioning("Origin")
code_block_2 = CodeBlock { 10000; }
byCoordinates = Point.ByCoordinates(y=code_block_2)
attachment_type = AttachmentType()
boolean = BoolSelector(true)
linkRevitFile = Orchid.RevitProject.Common.Link.LinkRevitFile(arg1=string_3, arg2=link_positioning, arg4=byCoordinates, arg5=attachment_type, arg6=boolean)
watch_15 = Watch(linkRevitFile.out0)
watch_16 = Watch(linkRevitFile.out1)

# group: Link cad file
string_4 = StringInput(".\Drawing1.dwg")
link_positioning_2 = Positioning("Center")
import_unit = Unit("Millimeter")
import_color_mode = ColorMode("BlackAndWhite")
code_block_3 = CodeBlock { -1000; }
byCoordinates_2 = Point.ByCoordinates(y=code_block_3)
model_views = ModelView("Level 1 (door)")
boolean_2 = BoolSelector(false)
linkCadFile = Orchid.RevitProject.Common.Link.LinkCadFile(arg1=string_4, arg2=link_positioning_2, arg3=import_unit, arg4=import_color_mode, arg5=byCoordinates_2, arg7=model_views, arg8=boolean_2)
watch_17 = Watch(linkCadFile.out0)
watch_18 = Watch(linkCadFile.out1)

# group: Link cad file
string_5 = StringInput(".\Drawing1.dwg")
code_block_4 = CodeBlock { -1000; }
byCoordinates_3 = Point.ByCoordinates(x=code_block_4, y=code_block_4)
model_views_2 = ModelView("Level 1 (door)")
boolean_3 = BoolSelector(true)
linkCadFile_2 = Orchid.RevitProject.Common.Link.LinkCadFile(arg1=string_5, arg2=byCoordinates_3, arg4=model_views_2, arg5=boolean_3)
watch_19 = Watch(linkCadFile_2.out0)
watch_20 = Watch(linkCadFile_2.out1)
