# Dynamo graph MoveToOrigin.dyn (Dynamo 1.3.4.6666)

# group: Revisions -> delete or add
deleteAll = Orchid.RevitProject.Common.Revision.DeleteAll()
all = Orchid.RevitProject.Common.RevisionCloud.All()
# note: If revisions is deleted, then remember to
# remove they are added to the "move" list
deleteAll_2 = Orchid.RevitProject.Common.RevisionCloud.DeleteAll()

# group: new origin -> as vector
select_model_element = DSModelElementSelection()  # 1 picked in the model
getLocation = Element.GetLocation(select_model_element)
reverse = Orchid.Common.Geometry.Point.Reverse(getLocation)

# group: Adjust view crop box
modelAll = Orchid.RevitProject.Views.View.ModelAll()
move = Orchid.RevitProject.Views.View.Move(modelAll, reverse)

# group: Adjust sectionsbox
code_block = CodeBlock { "3D View"; }
byName = Orchid.RevitProject.Views.ViewType.ByName(code_block)
byType = Orchid.RevitProject.Views.View.ByType(byName)
moveSectionBox = Orchid.RevitProject.Views.View.MoveSectionBox(byType, reverse)

# group: Select special elements
element_types = ElementTypes("MultistoryStairs")
all_elements_of_type = ElementsOfType(element_types)
allStackedWall = Orchid.RevitProject.Elements.Wall.AllStackedWall()
allModel = Orchid.RevitProject.Elements.Group.AllModel()
getSeparationLine = Orchid.RevitProject.Elements.SpatialElement.GetSeparationLine()
create = List.Create(all_elements_of_type, allStackedWall, allModel, getSeparationLine)

# group: Select elements
code_block_2 = CodeBlock()
# ---------- code_block_2.designscript (5 lines) ----------
// Category type elements
{"Model",
"Annotation"};
"AnalyticalModel";
"Internal";
# ----------------------------------------
elementByCategoryType = Orchid.RevitProject.Elements.Selection.ElementByCategoryType(arg1=code_block_2.out0)

# group: Select elements
code_block_3 = CodeBlock()
# ---------- code_block_3.designscript (2 lines) ----------
// Category type elements
"Annotation";
# ----------------------------------------
elementByCategoryType_2 = Orchid.RevitProject.Elements.Selection.ElementByCategoryType(arg1=code_block_3)
code_block_4 = CodeBlock(category=elementByCategoryType_2.out1)
# ---------- code_block_4.designscript (3 lines) ----------
category.Name == "Section Boxes" ||
category.Name == "Revision Clouds"
? true : false;
# ----------------------------------------
filterByBoolMask = List.FilterByBoolMask(list=elementByCategoryType_2.out0, mask=code_block_4)

# group: join selection, create temporary group
code_block_5 = CodeBlock { "dummy"; }
join = List.Join(create, elementByCategoryType, filterByBoolMask.out)
clean = Orchid.Common.List.Clean(join)
flatten = Flatten(clean)
create_2 = Orchid.RevitProject.Elements.Group.Create(code_block_5, flatten)

# group: Select additional elements that not can be grouped
allDetail = Orchid.RevitProject.Elements.Group.AllDetail()
ownerViewType = Orchid.RevitProject.Elements.Element.OwnerViewType(allDetail)
code_block_6 = CodeBlock(t=ownerViewType) { t != "Detail"? true : false; }
filterByBoolMask_2 = List.FilterByBoolMask(list=allDetail, mask=code_block_6)

# group: join lists and unpin element
join_2 = List.Join(filterByBoolMask_2.in, all)
flatten_2 = Flatten(join_2)
isPinned = Orchid.RevitProject.Elements.Element.IsPinned(flatten_2)
filterByBoolMask_3 = List.FilterByBoolMask(list=flatten_2, mask=isPinned)
unPin = Orchid.RevitProject.Elements.Element.UnPin(filterByBoolMask_3.in)

# group: Adjust model
join_3 = List.Join(create_2, filterByBoolMask_3.out, unPin)
move_2 = Orchid.RevitProject.Elements.Element.Move(join_3, reverse)

# group: Cleanup temporary group
await_ = Orchid.Common.DataStream.Await(create_2, move_2)
getByGroup = Orchid.RevitProject.Elements.GroupType.GetByGroup(await_)
await_2 = Orchid.Common.DataStream.Await(await_, getByGroup)
unGroup = Orchid.RevitProject.Elements.Group.UnGroup(await_2)
await_3 = Orchid.Common.DataStream.Await(getByGroup, unGroup)
delete = Orchid.RevitProject.Elements.GroupType.Delete(await_3)

# group: re-pin elements
clean_2 = Orchid.Common.List.Clean(unPin)
await_4 = Orchid.Common.DataStream.Await(clean_2, move_2)
pin = Orchid.RevitProject.Elements.Element.Pin(await_4)

# group: copy the coordinates to clipboard
copyTo = Orchid.Common.Clipboard.CopyTo(reverse)
