# Dynamo graph Project.dyn (Dynamo 1.3.4.6666)

# group: Project phase
phases = Phase("New Construction")
watch = Watch(phases)

# group: Project location
project_origin = Origin("Internal")
getVector = Orchid.RevitProject.Common.Location.GetVector(project_origin)
watch_2 = Watch(getVector)
get = Orchid.RevitProject.Common.Location.Get()
watch_3 = Watch(get)
name = Element.Name(get)
watch_4 = Watch(name)
getPoint = Orchid.RevitProject.Common.Location.GetPoint(project_origin)
watch_5 = Watch(getPoint)
set = Orchid.RevitProject.Common.Location.Set(project_origin)
watch_6 = Watch(set)
