# Dynamo graph Revisions.dyn (Dynamo 1.3.4.6666)

# group: Create
code_block = CodeBlock { "Date 1234"; "Some description"; true; "AAA"; "BBB"; }
select_revision_visibility = RevisionVisibility("CloudAndTagVisible")
select_revision_number_type = RevisionNumberType("Alphanumeric")
create = Orchid.RevitProject.Common.Revision.Create(code_block.out0, code_block.out1, code_block.out2, code_block.out3, code_block.out4, select_revision_visibility, select_revision_number_type)

# group: Add to Sheet / Remove from Sheet
sheet_views = SheetView()
revisions = Revision()
addToSheet = Orchid.RevitProject.Common.Revision.AddToSheet(sheet_views, revisions)
removeFromSheet = Orchid.RevitProject.Common.Revision.RemoveFromSheet(sheet_views, revisions)

# group: All
all = Orchid.RevitProject.Common.Revision.All()
lastItem = List.LastItem(all)
delete = Orchid.RevitProject.Common.Revision.Delete(lastItem)
watch = Watch(all)

# group: Set
revisions_2 = Revision()
code_block_2 = CodeBlock { "Date 1234"; "Some description"; true; "AAA"; "BBB"; }
select_revision_visibility_2 = RevisionVisibility("CloudAndTagVisible")
select_revision_number_type_2 = RevisionNumberType("Alphanumeric")
set = Orchid.RevitProject.Common.Revision.Set(revisions_2, code_block_2.out0, code_block_2.out1, code_block_2.out2, code_block_2.out3, code_block_2.out4, select_revision_visibility_2, select_revision_number_type_2)

# group: Numbering
select_revision_numbering = RevisionNumbering("PerProject")
setNumbering = Orchid.RevitProject.Common.Revision.SetNumbering(select_revision_numbering)
getNumbering = Orchid.RevitProject.Common.Revision.GetNumbering()

# group: Get
revisions_3 = Revision()
get = Orchid.RevitProject.Common.Revision.Get(revisions_3)
name = Element.Name(revisions_3)

# group: DeleteAll
deleteAll = Orchid.RevitProject.Common.Revision.DeleteAll()
watch_2 = Watch(deleteAll)

# group: RevisionCloud
all_2 = Orchid.RevitProject.Common.RevisionCloud.All()  # frozen
delete_2 = Orchid.RevitProject.Common.RevisionCloud.Delete(all_2)
watch_3 = Watch(delete_2)
revision = RevisionCloud.Revision(all_2)

# group: DeleteAll
deleteAll_2 = Orchid.RevitProject.Common.RevisionCloud.DeleteAll()  # frozen
watch_4 = Watch(deleteAll_2)
