# Dynamo graph SharedParameter.dyn (Dynamo 1.3.4.6666)

# group: set the shared parameter file
string = StringInput("..\COBie Extension Shared Parameters.txt")
code_block = CodeBlock(data=string) { data; }
setFile = Orchid.RevitProject.Parameters.SharedParameter.SetFile(code_block)
watch = Watch(setFile)
string_2 = StringInput("%userprofile%\Documents\Modellering\Revit\Common\Shared Parameters.txt")
fromPath = Orchid.Common.File.FromPath(string_2)

# group: group by group name and type
groupByGroupNameAndType = Orchid.RevitProject.Parameters.SharedParameter.GroupByGroupNameAndType(setFile)
watch_2 = Watch(groupByGroupNameAndType.out2)
watch_3 = Watch(groupByGroupNameAndType.out0)
watch_4 = Watch(groupByGroupNameAndType.out1)
watch_5 = Watch(groupByGroupNameAndType.out3)
watch_6 = Watch(groupByGroupNameAndType.out4)

# group: group by type and group name
groupByTypeAndGroupName = Orchid.RevitProject.Parameters.SharedParameter.GroupByTypeAndGroupName(setFile)
watch_7 = Watch(groupByTypeAndGroupName.out2)
watch_8 = Watch(groupByTypeAndGroupName.out3)
watch_9 = Watch(groupByTypeAndGroupName.out0)
watch_10 = Watch(groupByTypeAndGroupName.out1)
watch_11 = Watch(groupByTypeAndGroupName.out4)

# group: shared parameters
byFile = Orchid.RevitProject.Parameters.SharedParameter.ByFile(setFile)
watch_12 = Watch(byFile.out0)
watch_13 = Watch(byFile.out1)
watch_14 = Watch(byFile.out2)
watch_15 = Watch(byFile.out3)
watch_16 = Watch(byFile.out4)

# group: get shared parameter file
getFile = Orchid.RevitProject.Parameters.SharedParameter.GetFile()
watch_17 = Watch(getFile)
