# Dynamo graph SpatialElement.dyn (Dynamo 1.3.4.6666)

getBoundary = Orchid.RevitProject.Elements.SpatialElement.GetBoundary()
watch = Watch(getBoundary.out0)
watch_2 = Watch(getBoundary.out1)
getSeparationLine = Orchid.RevitProject.Elements.SpatialElement.GetSeparationLine()
watch_3 = Watch(getSeparationLine.out0)
watch_4 = Watch(getSeparationLine.out1)
getAreaBoundary = Orchid.RevitProject.Elements.SpatialElement.GetAreaBoundary()
watch_5 = Watch(getAreaBoundary.out0)
watch_6 = Watch(getAreaBoundary.out1)
getSpaceBoundary = Orchid.RevitProject.Elements.SpatialElement.GetSpaceBoundary()
watch_7 = Watch(getSpaceBoundary.out0)
watch_8 = Watch(getSpaceBoundary.out1)
getRoomBoundary = Orchid.RevitProject.Elements.SpatialElement.GetRoomBoundary()
watch_9 = Watch(getRoomBoundary.out0)
watch_10 = Watch(getRoomBoundary.out1)
categories = Categories("Areas")
categories_2 = Categories("Rooms")
categories_3 = Categories("MEPSpaces")
all_elements_of_category = ElementsOfCategory(categories_3)
getSeparationLine_2 = Orchid.RevitProject.Elements.SpatialElement.GetSeparationLine(all_elements_of_category)
watch_11 = Watch(getSeparationLine_2.out0)
watch_12 = Watch(getSeparationLine_2.out1)
getBoundary_2 = Orchid.RevitProject.Elements.SpatialElement.GetBoundary(all_elements_of_category)
watch_13 = Watch(getBoundary_2.out0)
watch_14 = Watch(getBoundary_2.out1)
