# Dynamo graph Systems.dyn (Dynamo 1.3.4.6666)

# group: Type
electrical_system_type = ElectricalSystemType("Communication")
duct_system_type = DuctSystemType("ExhaustAir")
pipe_system_type = PipeSystemType("DomesticColdWater")

# group: Filter System by type
all = Orchid.RevitProject.Systems.MEPSystem.All()
element_types = ElementTypes("MechanicalSystem")
typeOf = Orchid.RevitProject.Elements.Element.TypeOf(all, element_types)
name = Element.Name(typeOf)
byName = Orchid.RevitProject.Systems.MEPSystem.ByName(name)
watch = Watch(name)
watch_2 = Watch(typeOf)
code_block = CodeBlock(system=typeOf) { system; system[0]; }
type = Orchid.RevitProject.Systems.MEPSystem.Type(typeOf)
watch_3 = Watch(type)

# group: MEP
mep_system_class = MEPSystemClass("CableTrayConduit")
mep_systems = MEPSystem("100")
mep_system_types = MEPSystemType("57-Udsugning")

# group: Filter SystemType by type
all_2 = Orchid.RevitProject.Systems.MEPSystemType.All()
element_types_2 = ElementTypes("MechanicalSystemType")
typeOf_2 = Orchid.RevitProject.Elements.Element.TypeOf(all_2, element_types_2)
name_2 = Element.Name(typeOf_2)
byName_2 = Orchid.RevitProject.Systems.MEPSystemType.ByName(name_2)
watch_4 = Watch(typeOf_2)
watch_5 = Watch(name_2)

# group: Calculation point
categories = Categories("DuctTerminal")
all_elements_of_category = ElementsOfCategory(categories)
getFromToCalculationPoints = Orchid.RevitProject.Elements.FamilyInstance.GetFromToCalculationPoints(all_elements_of_category)  # frozen
getSpatialCalculationPoint = Orchid.RevitProject.Elements.FamilyInstance.GetSpatialCalculationPoint(all_elements_of_category)
hasFromToCalculationPoints = Orchid.RevitProject.Elements.FamilyInstance.HasFromToCalculationPoints(all_elements_of_category)  # frozen
hasSpatialCalculationPoint = Orchid.RevitProject.Elements.FamilyInstance.HasSpatialCalculationPoint(all_elements_of_category)
families = Family("PCA MBB")
code_block_2 = CodeBlock { "LCA MBB"; "PCA MBB"; }
byName_3 = Family.ByName(code_block_2.out1)
hasSpatialCalculationPoint_2 = Orchid.RevitProject.Elements.Family.HasSpatialCalculationPoint(byName_3)

# group: System elements
components = Orchid.RevitProject.Systems.Mechanical.Components(code_block.out1)
connector = Orchid.RevitProject.Systems.FamilyInstance.Connector(components)
watch_6 = Watch(connector.out0)
watch_7 = Watch(connector.out1)
network = Orchid.RevitProject.Systems.Mechanical.Network(code_block.out1)
ducts = Orchid.RevitProject.Systems.Mechanical.Ducts(code_block.out1)

# group: Duplicate
code_block_3 = CodeBlock { "test"; }
duplicate = Orchid.RevitProject.Systems.Mechanical.Duplicate(code_block.out1, code_block_3)
watch_8 = Watch(duplicate)

# group: Root Component/Terminal
code_block_4 = CodeBlock(system=code_block.system) { system; }
rootTerminal = Orchid.RevitProject.Systems.MEPSystem.RootTerminal(code_block_4)
watch_9 = Watch(rootTerminal)
rootComponent = Orchid.RevitProject.Systems.Mechanical.RootComponent(code_block_4)
watch_10 = Watch(rootComponent)

# group: Components/Terminals
code_block_5 = CodeBlock(system=code_block.system) { system; }
systemTerminals = Orchid.RevitProject.Systems.MEPSystem.SystemTerminals(code_block_5)
watch_11 = Watch(systemTerminals)
systemComponents = Orchid.RevitProject.Systems.Mechanical.SystemComponents(code_block_5)
watch_12 = Watch(systemComponents)
terminals = Orchid.RevitProject.Systems.MEPSystem.Terminals(code_block_5)
connector_2 = Orchid.RevitProject.Systems.Element.Connector(terminals)
watch_13 = Watch(connector_2.out0)
watch_14 = Watch(connector_2.out1)
watch_15 = Watch(terminals)

# group: System
MEPSystem = Orchid.RevitProject.Systems.Connector.MEPSystem(connector.out0)
watch_16 = Watch(MEPSystem.out0)
MEPSystem_2 = Orchid.RevitProject.Systems.FamilyInstance.MEPSystem(components)
watch_17 = Watch(MEPSystem_2.out0)
MEPSystem_3 = Orchid.RevitProject.Systems.Element.MEPSystem(network)
watch_18 = Watch(MEPSystem_3.out0)
watch_19 = Watch(MEPSystem_3.out1)
watch_20 = Watch(MEPSystem_2.out1)
watch_21 = Watch(MEPSystem.out1)

# group: SystemType
MEPSystemType = Orchid.RevitProject.Systems.Connector.MEPSystemType(connector.out0)
watch_22 = Watch(MEPSystemType)
MEPSystemType_2 = Orchid.RevitProject.Systems.FamilyInstance.MEPSystemType(components)
watch_23 = Watch(MEPSystemType_2)
MEPSystemType_3 = Orchid.RevitProject.Systems.Element.MEPSystemType(ducts)
watch_24 = Watch(MEPSystemType_3)
