# Dynamo graph View-Cropbox.dyn (Dynamo 1.3.4.6666)

# group: Collect all view
all = Orchid.RevitProject.Views.View.All()
watch = Watch(all)

# group: Collect sselected view by view type
view_type = ViewType("Floor Plan")
view_type_2 = ViewType("Section")
view_type_3 = ViewType("3D View")
create = List.Create(view_type, view_type_2, view_type_3)
byType = Orchid.RevitProject.Views.View.ByType(create)
watch_2 = Watch(byType)

# group: Model view
model_views = ModelView("Level 1 (door)")
watch_3 = Watch(model_views)

# group: Sheet view
sheet_views = SheetView("Level 1 (door)")
watch_4 = Watch(sheet_views)

# group: Proces by vector
select_model_element = DSModelElementSelection()  # 1 picked in the model
getLocation = Element.GetLocation(select_model_element)
asVector = Point.AsVector(getLocation)
reverse = Vector.Reverse(asVector)

# group: Adjust viewport on sheet
all_2 = Orchid.RevitProject.Views.Viewport.All()
move = Orchid.RevitProject.Views.Viewport.Move(all_2, reverse)

# group: Adjust view
modelAll = Orchid.RevitProject.Views.View.ModelAll()
move_2 = Orchid.RevitProject.Views.View.Move(modelAll, reverse)

# group: Adjust view crop box
modelAll_2 = Orchid.RevitProject.Views.View.ModelAll()
moveCropBox = Orchid.RevitProject.Views.View.MoveCropBox(modelAll_2, reverse)

# group: Adjust sectionsbox
view_type_4 = ViewType("3D View")
byType_2 = Orchid.RevitProject.Views.View.ByType(view_type_4)
moveSectionBox = Orchid.RevitProject.Views.View.MoveSectionBox(byType_2, reverse)

# group: Adjust view crop box
modelAll_3 = Orchid.RevitProject.Views.View.ModelAll()
getCropBox = Orchid.RevitProject.Views.View.GetCropBox(modelAll_3)

# group: ...by bounding box
minPoint = BoundingBox.MinPoint(getCropBox.out0)
add = Point.Add(point=minPoint, vectorToAdd=reverse)
maxPoint = BoundingBox.MaxPoint(getCropBox.out0)
add_2 = Point.Add(point=maxPoint, vectorToAdd=reverse)
byCorners = BoundingBox.ByCorners(min=add, max=add_2)
setCropBox = Orchid.RevitProject.Views.View.SetCropBox(modelAll_3, byCorners)

# group: ...by curve
startPoint = Curve.StartPoint(getCropBox.out1)
add_3 = Point.Add(point=startPoint, vectorToAdd=reverse)
endPoint = Curve.EndPoint(getCropBox.out1)
add_4 = Point.Add(point=endPoint, vectorToAdd=reverse)
byStartPointEndPoint = Line.ByStartPointEndPoint(startPoint=add_3, endPoint=add_4)
setCropBox_2 = Orchid.RevitProject.Views.View.SetCropBox(modelAll_3, byStartPointEndPoint)

# group: Scope box
scope_boxes = ScopeBox("Scope Box 1")
watch_5 = Watch(scope_boxes)

# group: Design option
design_options = DesignOption("Option 1 (primary)")
watch_6 = Watch(design_options)
