# Dynamo graph ViewDuplicate-ViewTemplate.dyn (Dynamo 1.3.4.6666)

# group: Find view in model
all = Orchid.RevitProject.Views.View.All()
code_block = CodeBlock()
# ---------- code_block.designscript (6 lines) ----------
// View name to copy
{"E0_Stue",
"E1_1. sal",
"E2_2. sal",
"EK_Kælder",
"ET_Tag"};
# ----------------------------------------
name = Element.Name(all)
containsItem = List.ContainsItem(list=code_block, item=name@L1)
filterByBoolMask = List.FilterByBoolMask(list=all, mask=containsItem)

# group: Duplicate view
concat = String.Concat()  # unwired: arg0, arg1
code_block_2 = CodeBlock()
# ---------- code_block_2.designscript (5 lines) ----------
// Text to add
{"DTUfm CHECK - ",
"DTUfm UPLOAD - ",
"EXPORT DWG - ",
"Color CHECK - "};
# ----------------------------------------
cartesianProduct = List.CartesianProduct(concat, code_block_2, code_block)
transpose = List.Transpose(cartesianProduct)
view_duplicate_option = ViewDuplicateOption("Duplicate")
duplicate = Orchid.RevitProject.Views.View.Duplicate(filterByBoolMask.in, transpose, view_duplicate_option)
transpose_2 = List.Transpose(duplicate)

# group: Find view template in model
all_2 = Orchid.RevitProject.Views.ViewTemplate.All()
code_block_3 = CodeBlock()
# ---------- code_block_3.designscript (5 lines) ----------
// ViewTemplate to use
{"DTUfm - CHECK",
"DTUfm - UPLOAD",
"DTU Export DWG",
"DTU Color CHECK"};
# ----------------------------------------
name_2 = Element.Name(all_2)
containsItem_2 = List.ContainsItem(list=code_block_3, item=name_2@L1)
filterByBoolMask_2 = List.FilterByBoolMask(list=all_2, mask=containsItem_2)

# group: Set view template
name_3 = Element.Name(filterByBoolMask_2.in)
byKeysValues = Orchid.Core.Dictionary.ByKeysValues(name_3, filterByBoolMask_2.in)
valueAtKey = Orchid.Core.Dictionary.ValueAtKey(byKeysValues, code_block_3)
set = Orchid.RevitProject.Views.ViewTemplate.Set(transpose_2, valueAtKey)

watch = Watch(set)
