# Dynamo graph Sigma-ProductionUnit.dyn (Dynamo 1.3.3.4651)

# group: definitions for Sigma
code_block = CodeBlock()
# ---------- code_block.designscript (14 lines) ----------
//Property identity field for Sigma
def sigmaTypeCode() {
 return = "Type Code";
};

//Components as instances or summarized
def sigmaInstances() {
 return = true;
};

//Enter estimate regulation for Sigma.
def sigmaRegulation() {
 return = 1.05;
};
# ----------------------------------------

# group: diverse Code Block input
code_block_2 = CodeBlock()
# ---------- code_block_2.designscript (4 lines) ----------
// pcs
"stk";
sigmaRegulation();
sigmaInstances();
# ----------------------------------------
code_block_3 = CodeBlock()
# ---------- code_block_3.designscript (4 lines) ----------
// area
"m2";
sigmaRegulation();
sigmaInstances();
# ----------------------------------------
code_block_4 = CodeBlock()
# ---------- code_block_4.designscript (4 lines) ----------
// length
"lbm";
sigmaRegulation();
sigmaInstances();
# ----------------------------------------
code_block_5 = CodeBlock()
# ---------- code_block_5.designscript (4 lines) ----------
// volume
"m3";
sigmaRegulation();
sigmaInstances();
# ----------------------------------------

# group: diverse Branch Root
code_block_6 = CodeBlock { "Modeled (3D)"; "Building"; "Terrain"; "Construction Site"; }
code_block_7 = CodeBlock { "Modelleret (3D)"; "Bygning"; "Terræn"; "Byggeplads"; }

# group: Element collection, grouped by Type Code, quantity in area and length
categories = Categories("Walls")
all_elements_of_category = ElementsOfCategory(categories)
elementType = Element.ElementType(all_elements_of_category)
code_block_8 = CodeBlock { sigmaTypeCode(); }
getParameterValueByName = Element.GetParameterValueByName(element=elementType, parameterName=code_block_8)
groupByKey = List.GroupByKey(list=all_elements_of_category, keys=getParameterValueByName)
code_block_9 = CodeBlock(groups=groupByKey.groups, keys=groupByKey.unique_keys) { groups[1]; keys[1]; }
code_block_10 = CodeBlock { "Length"; }
getParameterValueByName_2 = Element.GetParameterValueByName(element=code_block_9.out0, parameterName=code_block_10)
code_block_11 = CodeBlock(length=getParameterValueByName_2)
# ---------- code_block_11.designscript (2 lines) ----------
// mm --> m
length/1000;
# ----------------------------------------
code_block_12 = CodeBlock(element=code_block_9.out0, code=code_block_9.out1, quantity=code_block_11)
# ---------- code_block_12.designscript (4 lines) ----------
// (12)001
element;
code;
quantity;
# ----------------------------------------
# note: coded types in selection, edit
# code block for proper sorting!
code_block_13 = CodeBlock(groups=groupByKey.groups, keys=groupByKey.unique_keys) { groups[0]; keys[0]; }
code_block_14 = CodeBlock { "Area"; }
getParameterValueByName_3 = Element.GetParameterValueByName(element=code_block_13.out0, parameterName=code_block_14)
code_block_15 = CodeBlock(element=code_block_13.out0, code=code_block_13.out1, quantity=getParameterValueByName_3)
# ---------- code_block_15.designscript (4 lines) ----------
// (21)002
element;
code;
quantity;
# ----------------------------------------

# group: Element Qantifying, grouped by Tree Structure and Type Code
# note: Please note the
# default values!
code_block_16 = CodeBlock { "m2"; sigmaRegulation(); sigmaInstances(); }
code_block_17 = CodeBlock(element=code_block_15.element, code=code_block_15.code, quantity=code_block_15.quantity)
# ---------- code_block_17.designscript (6 lines) ----------
{{"(2.)","PRIMARY ELEMENTS, CARCASS"},
{"(21)","External Walls"}};

element;
code;
quantity;
# ----------------------------------------
# note: Orchid
component = Orchid.Revit.Applications.Sigma.Component(code_block_17.out0, code_block_17.element, code_block_17.code, code_block_17.quantity)

# group: Element Qantifying, grouped by Tree Structure and Type Code
code_block_18 = CodeBlock(element=code_block_12.element, code=code_block_12.code, quantity=code_block_12.quantity)
# ---------- code_block_18.designscript (16 lines) ----------
/*
The Component Tree structure must be kept
inside an outer list, the individual
branches in the tree are built as
a "dictionary" with a key and a value
as sublists.
*/
{
{"(1.)","GROUND, SUB-STRUCTURE"},
{"(12)","Foundation"}
};

// elements must be a flat 1D list
element;
code;
quantity;
# ----------------------------------------
code_block_19 = CodeBlock()
# ---------- code_block_19.designscript (4 lines) ----------
// Sigma unit
"lbm";
sigmaRegulation();
sigmaInstances();
# ----------------------------------------
# note: Orchid
component_2 = Orchid.Revit.Applications.Sigma.Component(code_block_18.out0, code_block_18.element, code_block_18.code, code_block_18.quantity, code_block_19.out0, code_block_19.out1)

# group: Element collection, grouped by Type Code, quantity in pieces
categories_2 = Categories("Windows")
all_elements_of_category_2 = ElementsOfCategory(categories_2)
elementType_2 = Element.ElementType(all_elements_of_category_2)
code_block_20 = CodeBlock { sigmaTypeCode(); }
getParameterValueByName_4 = Element.GetParameterValueByName(element=elementType_2, parameterName=code_block_20)
groupByKey_2 = List.GroupByKey(list=all_elements_of_category_2, keys=getParameterValueByName_4)
code_block_21 = CodeBlock(groups=groupByKey_2.groups, keys=groupByKey_2.unique_keys) { groups[0]; keys[0]; }
# note: coded types in selection, edit
# code block for proper sorting!
code_block_22 = CodeBlock { 1; }
count = Count(code_block_21.out0)
ofRepeatedItem = List.OfRepeatedItem(item=code_block_22, amount=count)
code_block_23 = CodeBlock(element=code_block_21.out0, code=code_block_21.out1, quantity=ofRepeatedItem)
# ---------- code_block_23.designscript (4 lines) ----------
// (31)001
element;
code;
quantity;
# ----------------------------------------

# group: Element Qantifying, grouped by Tree Structure and Type Code
code_block_24 = CodeBlock(element=code_block_23.element, code=code_block_23.code, quantity=code_block_23.quantity)
# ---------- code_block_24.designscript (6 lines) ----------
{{"(3.)","SECONDARY ELEMENTS, COMPLETION"},
{"(31)","External Walls"}};

element;
code;
quantity;
# ----------------------------------------
code_block_25 = CodeBlock { "stk"; sigmaRegulation(); sigmaInstances(); }
# note: Orchid
component_3 = Orchid.Revit.Applications.Sigma.Component(code_block_24.out0, code_block_24.element, code_block_24.code, code_block_24.quantity, code_block_25.out0, code_block_25.out1, code_block_25.out2)

# group: Sigma project from file
# note: Enter path and filename for the Sigma
# project file. Project file must not be compressed!
path_and_filename = CodeBlock { cur = Orchid.Directory.Current; cur + "\\test.sig"; }

# group: Sigma presets
# note: Enter Component Root in Sigma file,
# if DOESN'T exist, remove connection!
# Note: is cAsE sensitive!
branch_root = CodeBlock { {"","Modeled (3D)"}; }
# note: Component Root must
# exist when using clearning!
boolean = BoolSelector(true)

# group: Sigma Revit Integration for Dynamo
join = List.Join(component_2, component, component_3)
watch = Watch(join)
document = Orchid.Generic.Applications.Sigma.Document(path_and_filename.out1)
# note: Orchid
setData = Orchid.Generic.Applications.Sigma.SetData(document, branch_root, boolean, join)
watch_2 = Watch(setData)

# group: Clean a branch
code_block_26 = CodeBlock { {"(2.)","PRIMARY ELEMENTS, CARCASS"}; }
clearing = Orchid.Generic.Applications.Sigma.Clearing(arg1=code_block_26)  # frozen
watch_3 = Watch(clearing)

# group: Delete a branch
code_block_27 = CodeBlock { {"(2.)","PRIMARY ELEMENTS, CARCASS"}; }
delete = Orchid.Generic.Applications.Sigma.Delete(arg1=code_block_27)  # frozen
watch_4 = Watch(delete)

# group: Sigma project from template
path_and_filename_2 = StringInput("%userprofile%\Documents\Sigma Enterprise\Templates\DanEDU\Estimate (DanEDU).sit")
fromPath = Orchid.Generic.Core.File.FromPath(path_and_filename_2)
