# Dynamo graph Dictionary.dyn (Dynamo 1.3.3.4651)

# group: Initiate Dictionary
code_block = CodeBlock { "a".."h"; 1..8; }
byKeysValues = Orchid.Generic.Core.Dictionary.ByKeysValues(code_block.out0, code_block.out1)

values = Orchid.Generic.Core.Dictionary.Values(byKeysValues)
watch = Watch(values)
keys = Orchid.Generic.Core.Dictionary.Keys(byKeysValues)
watch_2 = Watch(keys)
code_block_2 = CodeBlock { "a"; }
valueAtKey = Orchid.Generic.Core.Dictionary.ValueAtKey(byKeysValues, code_block_2)
await_ = Orchid.Generic.Core.Data.Await(byKeysValues, valueAtKey)
code_block_3 = CodeBlock { "a".."h"; 9..16; }
setValueAtKeys = Orchid.Generic.Core.Dictionary.SetValueAtKeys(await_, code_block_3.out0, code_block_3.out1)
components = Orchid.Generic.Core.Dictionary.Components(setValueAtKeys)
watch_3 = Watch(components.out0)
watch_4 = Watch(components.out1)
watch_5 = Watch(valueAtKey)
count = Orchid.Generic.Core.Dictionary.Count(byKeysValues)
watch_6 = Watch(count)
code_block_4 = CodeBlock { "a"; }
removeKeys = Orchid.Generic.Core.Dictionary.RemoveKeys(setValueAtKeys, code_block_4)
components_2 = Orchid.Generic.Core.Dictionary.Components(removeKeys)
watch_7 = Watch(components_2.out0)
watch_8 = Watch(components_2.out1)
