# Dynamo graph File.SaveFamily.dyn (Dynamo 1.3.3.4651)

# group: selected families by category in project
string = StringInput(".\testSet")
natural_category_name = CodeBlock()
# ---------- natural_category_name.designscript (12 lines) ----------
{
"Casework",
"Columns",
"Doors",
"Windows",
"Specialty Equipment",
"Structural Columns",
"Structural Foundations",
"Structural Framing",
"Structural Beam Systems",
"Structural Stiffeners"
};
# ----------------------------------------
elementByCategory = Orchid.Revit.Elements.Selection.ElementByCategory(arg1=natural_category_name)
type = archilab.Revit.Elements.Elements.Type(elementByCategory)
family = FamilyType.Family(type)
flatten = Flatten(family)
uniqueItems = List.UniqueItems(flatten)
clean = Orchid.Generic.Core.List.Clean(uniqueItems)
code_block = CodeBlock { true; }
saveFamily = Orchid.Revit.Core.File.SaveFamily(string, clean, code_block)

watch = Watch(saveFamily)
