# Dynamo graph Purge.dyn (Dynamo 1.3.3.4651)

directory_path = StringInput(".\testSet")
string = StringInput("*.rfa")
boolean = BoolSelector(false)
contents = Orchid.Generic.Core.Directory.Contents(directory_path, string, boolean)
backgroundOpen = Orchid.Revit.Core.Document.BackgroundOpen(contents)

# group: Purge
purge = Orchid.Revit.Core.Document.Purge(backgroundOpen)

await_ = Orchid.Generic.Core.Data.Await(backgroundOpen, purge)
boolean_2 = BoolSelector(true)
close = Orchid.Revit.Core.Document.Close(await_, boolean_2)

# group: Cleanup backup files
await_2 = Orchid.Generic.Core.Data.Await(directory_path, close)
string_2 = StringInput("*.0001.rfa")
boolean_3 = BoolSelector(true)
contents_2 = Orchid.Generic.Core.Directory.Contents(await_2, string_2, boolean_3)
delete = File.Delete(contents_2)
