# Dynamo graph Sorting.dyn (Dynamo 1.3.3.4651)

# group: testbed
code_block = CodeBlock { {"elm0", "elm10", "elm1", "Elm 2", "elm9", "Elm 11", "alm12", "elm13"}; }
code_block_2 = CodeBlock()
# ---------- code_block_2.designscript (6 lines) ----------
{
{"elm0", "Elm 2", "elm10", "elm1","elm9",
{"olm0", "olm10", "olm1", "Olm 2", "olm9"}
},
{"Elm1", "elm5", "alm12"}
};
# ----------------------------------------
code_block_3 = CodeBlock { {{"elm0", "elm10", "elm1", "Elm 2", "elm9"}, {"Elm 11", "alm12", "elm13"}}; }
code_block_4 = CodeBlock { {{1,2,3,{6,4,5}},{2,1,5},{4,3,2}}; }
code_block_5 = CodeBlock()
# ---------- code_block_5.designscript (7 lines) ----------
{
{
{"elm0", "Elm 2", "elm10", "elm1","elm9"},
{"olm0", "olm10", "olm1", "Olm 2", "olm9"}
},
{"Elm11", "alm12", "elm13"}
};
# ----------------------------------------
code_block_6 = CodeBlock { {"c",4,2.2,"b",6,"a1",3,"a10","a9"}; }

boolean = BoolSelector(false)
sort = Orchid.Generic.Core.List.Sort(code_block_2, boolean)
my_sort = Watch(sort)
sort_2 = List.Sort(code_block_2)
built_in = Watch(sort_2)
sortNatural = Orchid.Generic.Core.List.SortNatural(code_block_2, boolean)
my_sort_natural = Watch(sortNatural)
input = Watch(code_block_2)

# group: numbers and chars mixed
sortNatural_2 = Orchid.Generic.Core.List.SortNatural(code_block_6)
code_block_7 = CodeBlock(t=sortNatural_2) { t[0]+t[1]; }
sort_3 = List.Sort(code_block_6)
code_block_8 = CodeBlock(t=sort_3) { t[0]+t[1]; }
type = Object.Type(sortNatural_2)
type_2 = Object.Type(sort_3)
sort_4 = Orchid.Generic.Core.List.Sort(code_block_6)
type_3 = Object.Type(sort_4)

# group: ASCII table
string = StringInput(".\")
string_2 = StringInput("AsciiTable.txt")
contentsAll = Orchid.Generic.Core.Directory.ContentsAll(string, string_2)
readText = File.ReadText(contentsAll)
string_3 = StringInput("\n")
split = String.Split(readText, string_3)
shuffle = List.Shuffle(split)

sort_5 = List.Sort(shuffle)
built_in_2 = Watch(sort_5)
sort_6 = Orchid.Generic.Core.List.Sort(shuffle)
my_sort_2 = Watch(sort_6)
ascii = Watch(split)

# group: Revit elements
categories = Categories("Windows")
all_elements_of_category = ElementsOfCategory(categories)
categories_2 = Categories("Doors")
all_elements_of_category_2 = ElementsOfCategory(categories_2)
categories_3 = Categories("Walls")
all_elements_of_category_3 = ElementsOfCategory(categories_3)
code_block_9 = CodeBlock(Windows=all_elements_of_category, Doors=all_elements_of_category_2, Walls=all_elements_of_category_3)
# ---------- code_block_9.designscript (7 lines) ----------
{Windows,
Doors,
Walls};

{Windows.Name,
Doors.Name,
Walls.Name};
# ----------------------------------------
code_block_10 = CodeBlock(Windows=all_elements_of_category, Doors=all_elements_of_category_2, Walls=all_elements_of_category_3)
# ---------- code_block_10.designscript (7 lines) ----------
{Windows,
{Doors,
{Walls}}};

{Windows.Name,
{Doors.Name,
{Walls.Name}}};
# ----------------------------------------

sort_7 = List.Sort(code_block_9.out1)
built_in_3 = Watch(sort_7)
boolean_2 = BoolSelector(false)
sortNatural_3 = Orchid.Generic.Core.List.SortNatural(code_block_10.out1, boolean_2)
my_sort_natural_2 = Watch(sortNatural_3)
sort_8 = Orchid.Generic.Core.List.Sort(code_block_10.out1, boolean_2)
my_sort_3 = Watch(sort_8)
input_2 = Watch(code_block_9.out1)
sortNatural_4 = Orchid.Generic.Core.List.SortNatural(code_block_10.out0, boolean_2)
my_sort_natural_3 = Watch(sortNatural_4)
sort_9 = Orchid.Generic.Core.List.Sort(code_block_10.out0, boolean_2)
my_sort_4 = Watch(sort_9)
sort_10 = List.Sort(code_block_9.out0)
built_in_4 = Watch(sort_10)
code_block_11 = CodeBlock(list=code_block_2, descending=boolean) { Orchid.List.SortNatural(list,descending); }
watch = Watch(code_block_11)
