# Dynamo graph Analytical areaload.dyn (Dynamo 1.3.3.4651)

# group: Input
categories = Categories("Floors")
all_elements_of_category = ElementsOfCategory(categories)

# group: Get the "Structural Walls"
code_block = CodeBlock { "Structural"; }
getParameterValueByName = Element.GetParameterValueByName(element=all_elements_of_category, parameterName=code_block)
code_block_2 = CodeBlock(key=getParameterValueByName) { key == 1 ? true : false; }
filterByBoolMask = List.FilterByBoolMask(list=all_elements_of_category, mask=code_block_2)
getAnalytical = Orchid.Revit.Elements.Element.GetAnalytical(filterByBoolMask.in)

# group: Import from Excel
string = StringInput(".\Structural Loads.xlsx")
fromPath = FileObject(string)  # "File.FromPath"
string_2 = StringInput("Sheet1")
boolean = BoolSelector(true)
readFromFile = Excel.ReadFromFile(file=fromPath, sheetName=string_2, readAsStrings=boolean)
code_block_3 = CodeBlock { 0; }
removeItemAtIndex = List.RemoveItemAtIndex(list=readFromFile, indices=code_block_3)
transpose = List.Transpose(removeItemAtIndex)

# group: Compares data in Excel, with the floors, and adds the appropriate value to the analytical floors
code_block_4 = CodeBlock()
# ---------- code_block_4.designscript (5 lines) ----------
{
"Variable load [kN/m2]",
"Snowload [kN/m2]",
"Deadload [kN/m2]"
};
# ----------------------------------------
code_block_5 = CodeBlock(list=transpose) { list[0]; list[1]; }
# note: Lunchbox
createDictionary = Lists.Dictionary.CreateDictionary(code_block_5.out0, code_block_5.out1)
getParameterValueByName_2 = Element.GetParameterValueByName(element=filterByBoolMask.in, parameterName=code_block_4, lacing=Longest)
getValueFromDictionary = Lists.Dictionary.GetValueFromDictionary(createDictionary, getParameterValueByName_2)
setParameterByName = Element.SetParameterByName(element=getAnalytical, parameterName=code_block_4, value=getValueFromDictionary, lacing=Longest)

# group: Remove old loads
categories_2 = Categories("AreaLoads")
all_elements_of_category_2 = ElementsOfCategory(categories_2)
delete = Orchid.Revit.Elements.Element.Delete(all_elements_of_category_2)

# group: Adds load corresponding to the analytical floor (kN/m2)
element_types = ElementTypes("AreaLoadType")
all_elements_of_type = ElementsOfType(element_types)
await_ = Orchid.Generic.Core.Data.Await(getAnalytical, setParameterByName)
getParameterValueByName_3 = Element.GetParameterValueByName(element=await_, parameterName=code_block_4, lacing=Longest)
await_2 = Orchid.Generic.Core.Data.Await(getParameterValueByName_3, delete)
code_block_6 = CodeBlock(str=await_2) { String.ToNumber(str) * -1000; }

# group: Load cases
setAreaLoad = Orchid.Revit.Elements.Floor.SetAreaLoad(all_elements_of_category, all_elements_of_type, code_block_6)
code_block_7 = CodeBlock { "Load Case"; }
categories_3 = Categories("LoadCases")
all_elements_of_category_3 = ElementsOfCategory(categories_3)
code_block_8 = CodeBlock(load=all_elements_of_category_3)
# ---------- code_block_8.designscript (8 lines) ----------
{
//Live load
load[1],
//Snow load
load[3],
//Dead load
load[0]
};
# ----------------------------------------
setParameterByName_2 = Element.SetParameterByName(element=setAreaLoad, parameterName=code_block_7, value=code_block_8)
name = Element.Name(all_elements_of_category_3)
watch = Watch(name)
