# Dynamo graph CompoundLayer.dyn (Dynamo 1.3.3.4651)

categories = Categories("Walls")
all_elements_of_category = ElementsOfCategory(categories)
elementType = Element.ElementType(all_elements_of_category)
uniqueItems = List.UniqueItems(elementType)
code_block = CodeBlock { {"MyMat1","MyMat2"}; {"Glass","Copper"}; }
byName = Material.ByName(code_block.out1)
code_block_2 = CodeBlock { {0,1}; }
setCompoundLayerMaterial = Orchid.Revit.Elements.SystemFamily.SetCompoundLayerMaterial(uniqueItems, byName, code_block_2)
watch = Watch(setCompoundLayerMaterial)
wall_types = WallTypes("Exterior - 468mm Masonry / LW Concrete")
code_block_3 = CodeBlock { "Glass"; }
byName_2 = Material.ByName(code_block_3)
code_block_4 = CodeBlock()
# ---------- code_block_4.designscript (10 lines) ----------
//function
5;
//thickness
100;
//wrap as boolean
false;
//placement
"Interior";
//index
3;
# ----------------------------------------
createCompoundLayer = Orchid.Revit.Elements.SystemFamily.CreateCompoundLayer(wall_types, arg2=byName_2, arg3=code_block_4.out1, arg6=code_block_4.out4)  # frozen
wall_types_2 = WallTypes("Exterior - 468mm Masonry / LW Concrete")
code_block_5 = CodeBlock { 3; }
deleteCompoundLayer = Orchid.Revit.Elements.SystemFamily.DeleteCompoundLayer(wall_types_2, code_block_5)  # frozen
wall_types_3 = WallTypes("Exterior - 468mm Masonry / LW Concrete")
code_block_6 = CodeBlock { "Glass"; }
byName_3 = Material.ByName(code_block_6)
code_block_7 = CodeBlock { 1; }
setCompoundLayerMaterial_2 = Orchid.Revit.Elements.SystemFamily.SetCompoundLayerMaterial(wall_types_3, byName_3, code_block_7)  # frozen
wall_types_4 = WallTypes("Exterior - 468mm Masonry / LW Concrete")
code_block_8 = CodeBlock { 300.0; 1; }
setCompoundLayerWidth = Orchid.Revit.Elements.SystemFamily.SetCompoundLayerWidth(wall_types_4, code_block_8.out0, code_block_8.out1)  # frozen
wall_types_5 = WallTypes("Exterior - 468mm Masonry / LW Concrete")
compound_layer_function = LayerFunctionDD("Finish2")
code_block_9 = CodeBlock { "Glass"; }
byName_4 = Material.ByName(code_block_9)
code_block_10 = CodeBlock()
# ---------- code_block_10.designscript (6 lines) ----------
//thickness
100;
//wrap as boolean
false;
//index
3;
# ----------------------------------------
compound_layer_placement = LayerPlacementDD("Interior")
createCompoundLayer_2 = Orchid.Revit.Elements.SystemFamily.CreateCompoundLayer(wall_types_5, compound_layer_function, byName_4, code_block_10.out0, arg5=compound_layer_placement, arg6=code_block_10.out2)  # frozen
getCompoundLayerMaterial = Orchid.Revit.Elements.SystemFamily.GetCompoundLayerMaterial(elementType@L1)
watch_2 = Watch(getCompoundLayerMaterial)
getCompoundLayerWidth = Orchid.Revit.Elements.SystemFamily.GetCompoundLayerWidth(elementType@L1)
watch_3 = Watch(getCompoundLayerWidth)
name = Element.Name(getCompoundLayerMaterial)
watch_4 = Watch(name)
