# Dynamo graph Delete.dyn (Dynamo 1.3.3.4651)

categories = Categories("Windows")
all_elements_of_category = ElementsOfCategory(categories)
categories_2 = Categories("Doors")
all_elements_of_category_2 = ElementsOfCategory(categories_2)
categories_3 = Categories("StructuralColumns")
all_elements_of_category_3 = ElementsOfCategory(categories_3)
code_block = CodeBlock(Windows=all_elements_of_category, Doors=all_elements_of_category_2, columns=all_elements_of_category_3)
# ---------- code_block.designscript (3 lines) ----------
{Windows,
{Doors,
{columns}}};
# ----------------------------------------
categories_4 = Categories("Walls")
all_elements_of_category_4 = ElementsOfCategory(categories_4)
code_block_2 = CodeBlock(Windows=all_elements_of_category, Doors=all_elements_of_category_2, Walls=all_elements_of_category_4)
# ---------- code_block_2.designscript (3 lines) ----------
{Windows,
{Doors,
{Walls}}};
# ----------------------------------------
delete = Orchid.Revit.Elements.Element.Delete(code_block_2)
watch = Watch(delete)
code_block_3 = CodeBlock(element=code_block_2) { Orchid.Element.Delete(element); }  # frozen
