# Dynamo graph Element-Category (3 nodes).dyn (Dynamo 1.3.3.4651)

built_in_categories = CodeBlock()
# ---------- built_in_categories.designscript (26 lines) ----------
{
"OST_Casework",
"OST_Ceilings",
"OST_Columns",
"OST_CurtainWallMullions",
"OST_CurtainWallPanels",
"OST_CurtaSystem",
"OST_Doors",
"OST_Entourage",
"OST_Floors",
"OST_Furniture",
"OST_FurnitureSystems",
"OST_GenericModel",
"OST_PlumbingFixtures",
"OST_Ramps",
"OST_Roofs",
"OST_SpecialityEquipment",
"OST_Stairs",
"OST_StructuralColumns",
"OST_StructuralFoundation",
"OST_StructuralFraming",
"OST_StructuralFramingSystem",
"OST_StructuralStiffener",
"OST_Walls",
"OST_Windows"
};
# ----------------------------------------
natural_category_name = CodeBlock()
# ---------- natural_category_name.designscript (26 lines) ----------
{
"Casework",
"Ceilings",
"Columns",
"Curtain Wall Mullions",
"Curtain Panels",
"Curtain Systems",
"Doors",
"Entourage",
"Floors",
"Furniture",
"Furniture Systems",
"Generic Models",
"Plumbing Fixtures",
"Ramps",
"Roofs",
"Specialty Equipment",
"Stairs",
"Structural Columns",
"Structural Foundations",
"Structural Framing",
"Structural Beam Systems",
"Structural Stiffeners",
"Walls",
"Windows"
};
# ----------------------------------------
# note: Orchid package
elementByCategory = Orchid.Revit.Elements.Selection.ElementByCategory(arg1=natural_category_name)
watch = Watch(elementByCategory.out0)
elementHasMaterial = Orchid.Revit.Elements.Selection.ElementHasMaterial()
watch_2 = Watch(elementHasMaterial.out0)
watch_3 = Watch(elementHasMaterial.out1)
# note: OOTB nodes
byName = Category.ByName(natural_category_name)
all_elements_of_category = ElementsOfCategory(byName)
code_block = CodeBlock { {{},null,""}; }
clean = Orchid.Generic.Core.List.Clean(all_elements_of_category, code_block)
watch_4 = Watch(clean)
watch_5 = Watch(elementByCategory.out1)
code_block_2 = CodeBlock()
# ---------- code_block_2.designscript (7 lines) ----------
"Model";
"Annotation";
"AnalyticalModel";
"Internal";

{"Annotation",
"AnalyticalModel"};
# ----------------------------------------
elementByCategoryType = Orchid.Revit.Elements.Selection.ElementByCategoryType(arg1=code_block_2.out0)
watch_6 = Watch(elementByCategoryType.out0)
watch_7 = Watch(elementByCategoryType.out2)
watch_8 = Watch(elementByCategoryType.out1)
