# Dynamo graph MaterialDensity.dyn (Dynamo 1.3.3.4111)

natural_category_name = CodeBlock()
# ---------- natural_category_name.designscript (26 lines) ----------
{
"Casework",
"Ceilings",
"Columns",
"Curtain Wall Mullions",
"Curtain Panels",
"Curtain Systems",
"Doors",
"Entourage",
"Floors",
"Furniture",
"Furniture Systems",
"Generic Models",
"Plumbing Fixtures",
"Ramps",
"Roofs",
"Specialty Equipment",
"Stairs",
"Structural Columns",
"Structural Foundations",
"Structural Framing",
"Structural Beam Systems",
"Structural Stiffeners",
"Walls",
"Windows"
};
# ----------------------------------------
byName = Category.ByName(natural_category_name)
all_elements_of_category = ElementsOfCategory(byName)
code_block = CodeBlock { {{}, null, ""}; }
clean = Orchid.Generic.Core.List.Clean(all_elements_of_category, code_block)
# note: Clockwork
materials = Custom[Element.Materials](element=clean)  # Retrieves all materials froma given element
flatten = Flatten(materials.materialVolumes)
flatten_2 = Flatten(materials.materials)
groupByKey = List.GroupByKey(list=flatten, keys=flatten_2)
sum = Math.Sum(groupByKey.groups)
watch = Watch(sum)
materialDensity = Orchid.Revit.Elements.Element.MaterialDensity(groupByKey.unique_keys)
watch_2 = Watch(materialDensity.out1)
watch_3 = Watch(materialDensity.out2)
name = Element.Name(groupByKey.unique_keys)
watch_4 = Watch(name)
watch_5 = Watch(materialDensity.out0)
