# Dynamo graph Parameter.dyn (Dynamo 1.3.4.6666)

# group: Add project parameter
code_block = CodeBlock()
# ---------- code_block.designscript (10 lines) ----------
//Parameter name
{"test1","test2"};
//Parameter type
"Text";
//Parameter group
"PG_IDENTITY_DATA";
//Instances
true;
//Category
{"Walls","Windows"};
# ----------------------------------------
byName = Category.ByName(code_block.out4)
addProjectParameter = Orchid.Revit.Elements.Parameter.AddProjectParameter(code_block.out0, code_block.out1, code_block.out2, arg4=byName)

# group: Add shared parameter
# note: Please notice that I use a tab in my "SP Parameter group" names. This is not standard!
# "Sheet & Project" would be the normal way!
code_block_2 = CodeBlock()
# ---------- code_block_2.designscript (14 lines) ----------
//Parameter name
{"Creator Name",
"Creator Organization",
"Creator Build"};
//SP Parameter group
"01:   Sheet & Project";
//SP Parameter type
"Text";
//Parameter group
"PG_ADSK_MODEL_PROPERTIES";
//Instances
true;
//Category
"Doors";
# ----------------------------------------
byName_2 = Category.ByName(code_block_2.out5)
addSharedParameter = Orchid.Revit.Elements.Parameter.AddSharedParameter(code_block_2.out0, code_block_2.out1, code_block_2.out2, code_block_2.out3, arg5=byName_2)  # frozen

# group: Change parameter and category binding in the project
code_block_3 = CodeBlock()
# ---------- code_block_3.designscript (8 lines) ----------
//Parameter name
"Creator Name";
//Instances
true;
//Category
{"Doors",
"Entourage",
"Floors"};
# ----------------------------------------
byName_3 = Category.ByName(code_block_3.out2)
changeCategory = Orchid.Revit.Elements.Parameter.ChangeCategory(code_block_3.out0, arg2=byName_3)  # frozen

# group: Delete parameter
code_block_4 = CodeBlock()
# ---------- code_block_4.designscript (2 lines) ----------
{"Creator Build",
"test2"};
# ----------------------------------------
deleteParameter = Orchid.Revit.Elements.Parameter.DeleteParameter(code_block_4)  # frozen

# group: Add basic IFC parameter
addIfcParameter = Orchid.Revit.Elements.Parameter.AddIfcParameter()
