# Dynamo graph SharedParameter.dyn (Dynamo 1.3.4.6666)

string = StringInput(".\COBie Extension Shared Parameters.txt")
setFile = Orchid.Revit.Elements.SharedParameter.SetFile(string)
watch = Watch(setFile)

# group: Do Stuff
boolean = BoolSelector(true)
circut = Orchid.Generic.Core.Data.Circut(setFile, boolean)
code_block = CodeBlock(data=setFile) { data; "do stuff"; }
await_ = Orchid.Generic.Core.Data.Await(setFile, code_block.data)

setFile_2 = Orchid.Revit.Elements.SharedParameter.SetFile(circut)
watch_2 = Watch(setFile_2)
watch_3 = Watch(string)
string_2 = StringInput("%userprofile%\Documents\Modellering\Revit\Common\Shared Parameters.txt")
fromPath = Orchid.Generic.Core.File.FromPath(string_2)
watch_4 = Watch(fromPath)

# group: group by group name
groupByGroupName = Orchid.Revit.Elements.SharedParameter.GroupByGroupName(string)
watch_5 = Watch(groupByGroupName.out0)
watch_6 = Watch(groupByGroupName.out2)
watch_7 = Watch(groupByGroupName.out3)
watch_8 = Watch(groupByGroupName.out1)

# group: group by type
groupByType = Orchid.Revit.Elements.SharedParameter.GroupByType(string)
watch_9 = Watch(groupByType.out0)
watch_10 = Watch(groupByType.out1)
watch_11 = Watch(groupByType.out3)
watch_12 = Watch(groupByType.out2)
