# Dynamo graph changeMaterial.dyn (Dynamo 1.3.3.4651)

categories = Categories("Walls")
all_elements_of_category = ElementsOfCategory(categories)
elementType = Element.ElementType(all_elements_of_category)
uniqueItems = List.UniqueItems(elementType)
code_block = CodeBlock { {"MyMat1","MyMat2"}; {"Glass","Copper"}; }
byName = Material.ByName(code_block.out1)
code_block_2 = CodeBlock { {0,1}; }
setCompoundLayerMaterial = Orchid.Revit.Elements.SystemFamily.SetCompoundLayerMaterial(uniqueItems, byName, code_block_2)
watch = Watch(setCompoundLayerMaterial)
