# Dynamo graph BulkUpgrade.dyn (Dynamo 1.3.3.4651)

directory_path = StringInput(".\testSet")
string = StringInput("*.rfa")
boolean = BoolSelector(false)
contents = Orchid.Generic.Core.Directory.Contents(directory_path, string, boolean)
backgroundOpen = Orchid.Revit.Core.Document.BackgroundOpen(contents)
create = Orchid.Revit.FamilyDocument.FamilyType.Create(backgroundOpen)
# note: Please notice that I use a tab in my "SP Parameter group" names. This is not standard!
# "Sheet & Project" would be the normal way!
code_block = CodeBlock()
# ---------- code_block.designscript (12 lines) ----------
//Parameter name
"Creator Build";
//SP Parameter group
"01:   Sheet & Project";
//SP Parameter type
"Text";
//Parameter group
"PG_ADSK_MODEL_PROPERTIES";
//Instances
true;
//Reporting
false;
# ----------------------------------------
addSharedParameter = Orchid.Revit.FamilyDocument.Parameter.AddSharedParameter(create, code_block.out0, code_block.out1, code_block.out2, code_block.out3, arg6=code_block.out4)
code_block_2 = CodeBlock()
# ---------- code_block_2.designscript (2 lines) ----------
//parameter name
"Creator Build";
# ----------------------------------------
creator_build = StringInput("\"2018\"")
setValue = Orchid.Revit.FamilyDocument.Formula.SetValue(addSharedParameter, code_block_2, creator_build)
boolean_2 = BoolSelector(true)
close = Orchid.Revit.Core.Document.Close(setValue, boolean_2)

# group: Cleanup backup files
code_block_3 = CodeBlock(waitFor=close, pass=directory_path) { {waitFor,pass}[1]; }
string_2 = StringInput("*.0001.rfa")
boolean_3 = BoolSelector(true)
contents_2 = Orchid.Generic.Core.Directory.Contents(code_block_3, string_2, boolean_3)
delete = File.Delete(contents_2)
