# Dynamo graph Collect families in project.dyn (Dynamo 1.3.3.4651)

# group: Open all files in directory and sub directories
string = StringInput("C:\Users\erfajo\Programming\Unit Testing\testSet")
code_block = CodeBlock { "*.rfa"; true; }
contents = Orchid.Generic.Core.Directory.Contents(string, code_block.out0)  # frozen
backgroundOpen = Orchid.Revit.Core.Document.BackgroundOpen(contents)

# group: Close files
boolean = BoolSelector(true)
close = Orchid.Revit.Core.Document.Close(arg1=boolean)  # frozen; unwired: arg0

# group: Collect family as document from current document
code_block_2 = CodeBlock { {"Doors","Windows"}; }
elementByCategory = Orchid.Revit.Elements.Selection.ElementByCategory(arg1=code_block_2)
type = archilab.Revit.Elements.Elements.Type(elementByCategory)
family = FamilyType.Family(type)
flatten = Flatten(family)
uniqueItems = List.UniqueItems(flatten)
getFamilyDocument = Orchid.Revit.Elements.Family.GetFamilyDocument(uniqueItems)

# note: Please notice that I use a tab in my "SP Parameter group" names. This is not standard!
# "Sheet & Project" would be the normal way!
code_block_3 = CodeBlock()
# ---------- code_block_3.designscript (12 lines) ----------
//Parameter name
"Creator Build";
//SP Parameter group
"01:   Sheet & Project";
//SP Parameter type
"Text";
//Parameter group
"PG_ADSK_MODEL_PROPERTIES";
//Instances
true;
//Reporting
false;
# ----------------------------------------
addSharedParameter = Orchid.Revit.FamilyDocument.Parameter.AddSharedParameter(getFamilyDocument, code_block_3.out0, code_block_3.out1, code_block_3.out2, code_block_3.out3, arg6=code_block_3.out4)

# group: load back into the current project
loadFamily = Orchid.Revit.FamilyDocument.Document.LoadFamily(addSharedParameter)
close_2 = Orchid.Revit.Core.Document.Close(loadFamily)
