# Dynamo graph FamilyDocument (all).dyn (Dynamo 1.3.3.4651)

# group: OOTB parameter nodes
select_builtin_parameter_group = BuiltInParameterGroup("INVALID")
watch = Watch(select_builtin_parameter_group)
select_parameter_type = ParameterType("Invalid")
watch_2 = Watch(select_parameter_type)

# group: Add shared parameter
# note: Please notice that I use a tab in my "SP Parameter group" names. This is not standard!
# "Sheet & Project" would be the normal way!
code_block = CodeBlock()
# ---------- code_block.designscript (16 lines) ----------
//Parameter name
{"Creator Name",
"Creator Organization",
"Creator Build"};
//SP Parameter group
"01:   Sheet & Project";
//SP Parameter type
"Text";
//Parameter group
"PG_ADSK_MODEL_PROPERTIES";
//Tooltip
"Owner value";
//Instances
true;
//Reporting
false;
# ----------------------------------------
addSharedParameter = Orchid.Revit.FamilyDocument.Parameter.AddSharedParameter(arg1=code_block.out0, arg2=code_block.out1, arg3=code_block.out2, arg4=code_block.out3, arg5=code_block.out4, arg6=code_block.out5)

# group: Utilities
current = Orchid.Revit.Core.Document.Current()
name = Orchid.Revit.Core.Document.Name(current)
code_block_2 = CodeBlock()
# ---------- code_block_2.designscript (2 lines) ----------
//Types to create
{"Type 1", "Type 2"};
# ----------------------------------------
create = Orchid.Revit.FamilyDocument.FamilyType.Create(arg1=code_block_2)
current_2 = Orchid.Revit.FamilyDocument.FamilyType.Current()
name_2 = Orchid.Revit.FamilyDocument.FamilyType.Name(current_2)
loadFamily = Orchid.Revit.FamilyDocument.Document.LoadFamily()  # unwired: arg0
save = Orchid.Revit.Core.Document.Save()
code_block_3 = CodeBlock { "test"; }
saveAs = Orchid.Revit.Core.Document.SaveAs(arg1=code_block_3)
parameters = Orchid.Revit.FamilyDocument.Parameter.Parameters()

# group: Close files
boolean = BoolSelector(false)
close = Orchid.Revit.Core.Document.Close(arg1=boolean)  # unwired: arg0

# group: Open all files in directory and sub directories
string = StringInput("C:\Users\erfajo\Programming\Unit Testing\testSet")
code_block_4 = CodeBlock { "*.rfa"; }
boolean_2 = BoolSelector(false)
contents = Orchid.Generic.Core.Directory.Contents(string, code_block_4, boolean_2)
backgroundOpen = Orchid.Revit.Core.Document.BackgroundOpen(contents)

# group: Add parameter
code_block_5 = CodeBlock()
# ---------- code_block_5.designscript (13 lines) ----------
//Parameter name
{"Test","something"};
//Parameter type
"Text";
//"Length";
//Parameter group
"PG_ADSK_MODEL_PROPERTIES";
//Tooltip
"Owner value";
//Instances
false;
//Reporting
true;
# ----------------------------------------
addParameter = Orchid.Revit.FamilyDocument.Parameter.AddParameter(arg1=code_block_5.out0, arg2=code_block_5.out1, arg3=code_block_5.out2)

# group: Get all family type
all = Orchid.Revit.FamilyDocument.FamilyType.All()
name_3 = Orchid.Revit.FamilyDocument.FamilyType.Name(all.out1)

# group: Delete parameter
code_block_6 = CodeBlock()
# ---------- code_block_6.designscript (4 lines) ----------
//Parameter name
{"Creator Name",
"Creator Organization",
"Creator Build"};
# ----------------------------------------
delete = Orchid.Revit.FamilyDocument.Parameter.Delete(arg1=code_block_6)

# group: Delete type
code_block_7 = CodeBlock()
# ---------- code_block_7.designscript (3 lines) ----------
//Type name
"Type 1";
"Type 2";
# ----------------------------------------
delete_2 = Orchid.Revit.FamilyDocument.FamilyType.Delete(arg1=code_block_7.out0)

# group: IsReporting parameter
code_block_8 = CodeBlock()
# ---------- code_block_8.designscript (5 lines) ----------
//Parameter name
{"Test",
"something",
"Keynote",
"Model"};
# ----------------------------------------
isReporting = Orchid.Revit.FamilyDocument.Parameter.IsReporting(arg1=code_block_8)

# group: Rename type
code_block_9 = CodeBlock()
# ---------- code_block_9.designscript (4 lines) ----------
//Source name
"Type 1";
//Target name
"Type 3";
# ----------------------------------------
rename = Orchid.Revit.FamilyDocument.FamilyType.Rename(arg1=code_block_9.out0, arg2=code_block_9.out1)

# group: Rename parameter
code_block_10 = CodeBlock()  # same code as code_block_9
rename_2 = Orchid.Revit.FamilyDocument.Parameter.Rename(arg1=code_block_10.out0, arg2=code_block_10.out1)

# group: Remove formula
code_block_11 = CodeBlock()  # same code as code_block_6
remove = Orchid.Revit.FamilyDocument.Formula.Remove(arg1=code_block_11)

# group: Associate parameter
code_block_12 = CodeBlock()
# ---------- code_block_12.designscript (4 lines) ----------
//Parameter name
"Width";
//Parameter name
"Width";
# ----------------------------------------
associate = Orchid.Revit.FamilyDocument.Parameter.Associate(arg2=code_block_12.out0, arg3=code_block_12.out1)  # unwired: arg1

# group: Get nested families and family types
getNested = Orchid.Revit.FamilyDocument.Family.GetNested()
getNested_2 = Orchid.Revit.FamilyDocument.FamilyType.GetNested()
toDynamoElement = Orchid.Revit.Core.Object.ToDynamoElement(getNested_2.out1)
toAutodeskElement = Orchid.Revit.Core.Object.ToAutodeskElement(toDynamoElement)
name_4 = Element.Name(toDynamoElement)

# group: Add lookup table
string_2 = StringInput("C:\Users\erfajo\Programming\Unit Testing\testSet\CSVLookuptable.csv")
addLookupTable = Orchid.Revit.FamilyDocument.Document.AddLookupTable(arg1=string_2)

# group: Add parameter (Category)
code_block_13 = CodeBlock()
# ---------- code_block_13.designscript (10 lines) ----------
//Parameter name
{"testFamily"};
//Parameter group
"PG_ADSK_MODEL_PROPERTIES";
//Tooltip
"Owner value";
//Instances
true;
//Reporting
false;
# ----------------------------------------
categories = Categories("Casework")
addParameter_2 = Orchid.Revit.FamilyDocument.Parameter.AddParameter(arg1=code_block_13.out0, arg2=categories, arg3=code_block_13.out1)

# group: Set parameter
code_block_14 = CodeBlock()
# ---------- code_block_14.designscript (6 lines) ----------
//Type
"Type 1";
//Parameter name
"Test";
//Value
"This is a test";
# ----------------------------------------
setValue = Orchid.Revit.FamilyDocument.Parameter.SetValue(arg2=code_block_14.out1, arg3=code_block_14.out2)

# group: Get Parameter
code_block_15 = CodeBlock()
# ---------- code_block_15.designscript (7 lines) ----------
//Type name
//"Type 1";
{"Type 1", "Type 2"};
//Parameter name
{"Creator Name",
"Creator Organization",
"Creator Build"};
# ----------------------------------------
getValue = Orchid.Revit.FamilyDocument.Parameter.GetValue(arg1=code_block_15.out0, arg2=code_block_15.out1)

# group: Set formula
code_block_16 = CodeBlock()
# ---------- code_block_16.designscript (8 lines) ----------
//Parameter name
{"Creator Name",
"Creator Organization",
"Creator Build"};
//Values
{"\"Erik Falck Jørgensen\"",
"\"Danish Educational Content\"",
"\"2017.0418.0\""};
# ----------------------------------------
setValue_2 = Orchid.Revit.FamilyDocument.Formula.SetValue(arg1=code_block_16.out0, arg2=code_block_16.out1)

# group: Get Formula
code_block_17 = CodeBlock()  # same code as code_block_6
getValue_2 = Orchid.Revit.FamilyDocument.Formula.GetValue(arg1=code_block_17)

# group: Remove parameter value
code_block_18 = CodeBlock()
# ---------- code_block_18.designscript (6 lines) ----------
//Parameter name
{"Creator Name",
"Creator Organization",
"Creator Build"};
//value
{"","",""};
# ----------------------------------------
setValue_3 = Orchid.Revit.FamilyDocument.Parameter.SetValue(arg2=code_block_18.out0, arg3=code_block_18.out1)

# group: Set the document category
categories_2 = Categories("Casework")
setCategory = Orchid.Revit.FamilyDocument.Document.SetCategory(arg1=categories_2)

# group: Get the document category
getCategory = Orchid.Revit.FamilyDocument.Document.GetCategory()
