# Dynamo graph ImportImage.dyn (Dynamo 1.3.3.4651)

# group: Create default family type
code_block = CodeBlock()
# ---------- code_block.designscript (2 lines) ----------
//Types to create
{"Type 1", "Type 2"};
# ----------------------------------------
create = Orchid.Revit.FamilyDocument.FamilyType.Create()

# group: Open all files in directory and sub directories
string = StringInput(".\testSet")
code_block_2 = CodeBlock { "*.rfa"; }
boolean = BoolSelector(false)
contents = Orchid.Generic.Core.Directory.Contents(string, code_block_2, boolean)
backgroundOpen = Orchid.Revit.Core.Document.BackgroundOpen(contents)  # frozen

# group: Create parameter
code_block_3 = CodeBlock()
# ---------- code_block_3.designscript (10 lines) ----------
//Parameter name
"Test";
//Parameter type
"Image";
//Parameter group
"PG_ADSK_MODEL_PROPERTIES";
//Instances
false;
//Reporting
true;
# ----------------------------------------
addParameter = Orchid.Revit.FamilyDocument.Parameter.AddParameter(create, code_block_3.out0, code_block_3.out1, code_block_3.out2)

# group: import image
string_2 = StringInput(".\DefaultCustomNode.Small.png")
importImage = Orchid.Revit.Core.Document.ImportImage(string_2)

# group: Set parameter
code_block_4 = CodeBlock()
# ---------- code_block_4.designscript (6 lines) ----------
//Type
"Type 1";
//Parameter name
"Test";
//Value
"_default.Large.png";
# ----------------------------------------
setValue = Orchid.Revit.FamilyDocument.Parameter.SetValue(addParameter, arg2=code_block_4.out1, arg3=importImage)

# group: Close files
boolean_2 = BoolSelector(false)
close = Orchid.Revit.Core.Document.Close(arg1=boolean_2)  # frozen; unwired: arg0

watch = Watch(importImage)
element_types = ElementTypes("ImageType")
all_elements_of_type = ElementsOfType(element_types)
watch_2 = Watch(all_elements_of_type)
