# Dynamo graph Nested-Lookup.dyn (Dynamo 2.0.1.5055)

# group: Load a family (nested)
string = StringInput(".\testSet\Front - Plain.rfa")  # graph input
backgroundOpen = Orchid.Revit.Core.Document.BackgroundOpen(file=string)
loadFamily = Orchid.Revit.FamilyDocument.Document.LoadFamily(familyDocument=backgroundOpen)
close = Orchid.Revit.Core.Document.Close(document=loadFamily)

# group: create default family type
create = Orchid.Revit.FamilyDocument.FamilyType.Create()

# group: Create ordinary parameter
code_block = CodeBlock()
# ---------- code_block.designscript (6 lines) ----------
//Parameter name
["Width","testValue"];
//Parameter type
"Length";
//Parameter group
"PG_ADSK_MODEL_PROPERTIES";
# ----------------------------------------
addParameter = Orchid.Revit.FamilyDocument.Parameter.AddParameter(familyDocument=create, parameterName=code_block.out0, type=code_block.out1, group=code_block.out2)

# group: Create ordinary parameter
code_block_2 = CodeBlock()
# ---------- code_block_2.designscript (6 lines) ----------
//Parameter name
["Lookup Table Name","testKey"];
//Parameter type
"Text";
//Parameter group
"PG_ADSK_MODEL_PROPERTIES";
# ----------------------------------------
addParameter_2 = Orchid.Revit.FamilyDocument.Parameter.AddParameter(familyDocument=addParameter, parameterName=code_block_2.out0, type=code_block_2.out1, group=code_block_2.out2)

# group: Set parameter
code_block_3 = CodeBlock()
# ---------- code_block_3.designscript (4 lines) ----------
//Parameter name
["Lookup Table Name","testKey"];
//Values
["CSVLookuptable","11x300"];
# ----------------------------------------
setValue = Orchid.Revit.FamilyDocument.Parameter.SetValue(familyDocument=addParameter_2, parameterName=code_block_3.out0, value=code_block_3.out1)

# group: Add lookup table and use it by setting a formula
string_2 = StringInput("size_lookup(Lookup Table Name, \"d\", 0, testKey)")  # graph input
string_3 = StringInput(".\CSVLookuptable.csv")  # graph input
addLookupTable = Orchid.Revit.FamilyDocument.Document.AddLookupTable(familyDocument=setValue, file=string_3)
code_block_4 = CodeBlock()
# ---------- code_block_4.designscript (4 lines) ----------
//Parameter name
"testValue";
//Values
["size_lookup(Lookup Table Name, \"d\", 0, testKey)"];
# ----------------------------------------
setValue_2 = Orchid.Revit.FamilyDocument.Formula.SetValue(familyDocument=addLookupTable, parameterName=code_block_4.out0, value=code_block_4.out1)

# group: Set parameter
code_block_5 = CodeBlock()
# ---------- code_block_5.designscript (4 lines) ----------
//Parameter name
"Width";
//Value
800.0;
# ----------------------------------------
setValue_3 = Orchid.Revit.FamilyDocument.Parameter.SetValue(familyDocument=addParameter, parameterName=code_block_5.out0, value=code_block_5.out1)

# group: Associate parameter
code_block_6 = CodeBlock { "Front - Plain"; }
code_block_7 = CodeBlock()
# ---------- code_block_7.designscript (4 lines) ----------
//Parameter name
"Width";
//Parameter name
"Width";
# ----------------------------------------

await_ = Orchid.Generic.Core.Data.Await(pass=code_block_6, waitFor=loadFamily)

# group (continued): Associate parameter
byName = FamilyType.ByName(name=await_)
associate = Orchid.Revit.FamilyDocument.Parameter.Associate(familyDocument=setValue_3, familyType=byName, documentParameter=code_block_7.out0, familyParameter=code_block_7.out1)

# group: Get nested families and Converters
getNested = Orchid.Revit.FamilyDocument.Family.GetNested(familyDocument=associate)
watch = Watch(getNested.Family)
toDynamoElement = Orchid.Revit.Core.Object.ToDynamoElement(element=getNested.Family)
watch_2 = Watch(toDynamoElement)
toAutodeskElement = Orchid.Revit.Core.Object.ToAutodeskElement(element=toDynamoElement)
watch_3 = Watch(toAutodeskElement)

# group: Get nested family types, converted to dynamo elements --> use OOTB nodes inside family document
getNested_2 = Orchid.Revit.FamilyDocument.FamilyType.GetNested(familyDocument=associate)
watch_4 = Watch(getNested_2.FamilyType)
toDynamoElement_2 = Orchid.Revit.Core.Object.ToDynamoElement(element=getNested_2.FamilyType)
watch_5 = Watch(toDynamoElement_2)
name = Element.Name(element=toDynamoElement_2)
watch_6 = Watch(name)
lastItem = List.LastItem(list=toDynamoElement_2)
code_block_8 = CodeBlock()
# ---------- code_block_8.designscript (2 lines) ----------
//Parameter name
["Width"];
# ----------------------------------------
getParameterValueByName = Element.GetParameterValueByName(element=lastItem, parameterName=code_block_8)
watch_7 = Watch(getParameterValueByName)

# group: Create Family Type parameter (Category)
code_block_9 = CodeBlock()
# ---------- code_block_9.designscript (8 lines) ----------
//Parameter name
["testFamily"];
//Parameter group
"PG_ADSK_MODEL_PROPERTIES";
//Instances
true;
//Reporting
false;
# ----------------------------------------
categories = Categories(index=106)  # graph input
addParameter_3 = Orchid.Revit.FamilyDocument.Parameter.AddParameter(familyDocument=associate, parameterName=code_block_9.out0, category=categories, group=code_block_9.out1)

# group: OOTB parameter nodes
select_builtin_parameter_group = BuiltInParameterGroup()  # nothing selected; graph input
watch_8 = Watch(select_builtin_parameter_group)
select_parameter_type = ParameterType()  # nothing selected; graph input
watch_9 = Watch(select_parameter_type)
