# Dynamo graph Parameter-Test.dyn (Dynamo 1.3.3.4111)

# group: Utilities
code_block = CodeBlock()
# ---------- code_block.designscript (2 lines) ----------
//Types to create
"Type 1";
# ----------------------------------------
create = Orchid.Revit.FamilyDocument.FamilyType.Create(arg1=code_block)

# group: Add parameter
code_block_2 = CodeBlock()
# ---------- code_block_2.designscript (8 lines) ----------
//Parameter name
"Test1";
//Parameter type
"Integer";
//Parameter group
"PG_ADSK_MODEL_PROPERTIES";
//ToolTip
"do this work?";
# ----------------------------------------
addParameter = Orchid.Revit.FamilyDocument.Parameter.AddParameter(create, code_block_2.out0, code_block_2.out1, code_block_2.out2, code_block_2.out3)

# group: Add parameter
code_block_3 = CodeBlock()
# ---------- code_block_3.designscript (6 lines) ----------
//Parameter name
"Test2";
//Parameter type
"Number";
//Parameter group
"PG_ADSK_MODEL_PROPERTIES";
# ----------------------------------------
addParameter_2 = Orchid.Revit.FamilyDocument.Parameter.AddParameter(addParameter, code_block_3.out0, code_block_3.out1, code_block_3.out2)

# group: Add parameter
code_block_4 = CodeBlock()
# ---------- code_block_4.designscript (6 lines) ----------
//Parameter name
"Test3";
//Parameter type
"Text";
//Parameter group
"PG_ADSK_MODEL_PROPERTIES";
# ----------------------------------------
addParameter_3 = Orchid.Revit.FamilyDocument.Parameter.AddParameter(addParameter_2, code_block_4.out0, code_block_4.out1, code_block_4.out2)

# group: Add parameter
code_block_5 = CodeBlock()
# ---------- code_block_5.designscript (6 lines) ----------
//Parameter name
"Test4";
//Parameter type
"Material";
//Parameter group
"PG_ADSK_MODEL_PROPERTIES";
# ----------------------------------------
addParameter_4 = Orchid.Revit.FamilyDocument.Parameter.AddParameter(addParameter_3, code_block_5.out0, code_block_5.out1, code_block_5.out2)

# group: Set parameter
code_block_6 = CodeBlock()
# ---------- code_block_6.designscript (6 lines) ----------
//Type
"Type 1";
//Parameter name
"Test1";
//Value
1;
# ----------------------------------------
setValue = Orchid.Revit.FamilyDocument.Parameter.SetValue(addParameter_4, code_block_6.out0, code_block_6.out1, code_block_6.out2)

# group: Set parameter
code_block_7 = CodeBlock()
# ---------- code_block_7.designscript (6 lines) ----------
//Type
"Type 1";
//Parameter name
"Test2";
//Value
1.5;
# ----------------------------------------
setValue_2 = Orchid.Revit.FamilyDocument.Parameter.SetValue(setValue, code_block_7.out0, code_block_7.out1, code_block_7.out2)

# group: Set parameter
code_block_8 = CodeBlock()
# ---------- code_block_8.designscript (6 lines) ----------
//Type
"Type 1";
//Parameter name
"Test3";
//Value
"string";
# ----------------------------------------
setValue_3 = Orchid.Revit.FamilyDocument.Parameter.SetValue(setValue_2, code_block_8.out0, code_block_8.out1, code_block_8.out2)

# group: Set parameter
code_block_9 = CodeBlock()
# ---------- code_block_9.designscript (4 lines) ----------
//Type
"Type 1";
//Parameter name
"Test4";
# ----------------------------------------
code_block_10 = CodeBlock { "Glass"; }
byName = Material.ByName(code_block_10)
setValue_4 = Orchid.Revit.FamilyDocument.Parameter.SetValue(setValue_3, code_block_9.out0, code_block_9.out1, byName)

# group: Parameters
parameters = Orchid.Revit.FamilyDocument.Parameter.Parameters(setValue_4)
watch = Watch(parameters.out1)

# group: Get Parameter
code_block_11 = CodeBlock()
# ---------- code_block_11.designscript (7 lines) ----------
//Type name
"Type 1";
//Parameter name
{"Test1",
"Test2",
"Test3",
"Test4"};
# ----------------------------------------
getValue = Orchid.Revit.FamilyDocument.Parameter.GetValue(setValue_4, code_block_11.out0, code_block_11.out1)
watch_2 = Watch(getValue.out1)
type = Object.Type(getValue.out1)
watch_3 = Watch(type)
code_block_12 = CodeBlock(t=getValue.out1) { t[3]; }
name = Material.Name(code_block_12)
watch_4 = Watch(name)
