# Dynamo graph SetGetParameter.dyn (Dynamo 1.3.3.4651)

directory_path = StringInput(".\testSet")
string = StringInput("*.rfa")
boolean = BoolSelector(false)
contents = Orchid.Generic.Core.Directory.Contents(directory_path, string, boolean)
backgroundOpen = Orchid.Revit.Core.Document.BackgroundOpen(contents)
create = Orchid.Revit.FamilyDocument.FamilyType.Create(backgroundOpen)
code_block = CodeBlock(doc=create) { doc; }
all = Orchid.Revit.FamilyDocument.FamilyType.All(code_block)
code_block_2 = CodeBlock()
# ---------- code_block_2.designscript (4 lines) ----------
//parameter name
{"Model", "Description"};
//value
{"Testing1", "Testing2"};
# ----------------------------------------
setValue = Orchid.Revit.FamilyDocument.Parameter.SetValue(all.out0, all.out1, code_block_2.out0, code_block_2.out1)
getValue = Orchid.Revit.FamilyDocument.Parameter.GetValue(setValue, all.out1, code_block_2.out0)
boolean_2 = BoolSelector(true)
close = Orchid.Revit.Core.Document.Close(getValue, boolean_2)

# group: Cleanup backup files
await_ = Orchid.Generic.Core.Data.Await(directory_path, close)
string_2 = StringInput("*.0001.rfa")
boolean_3 = BoolSelector(true)
contents_2 = Orchid.Generic.Core.Directory.Contents(await_, string_2, boolean_3)
delete = File.Delete(contents_2)

code_block_3 = CodeBlock()
# ---------- code_block_3.designscript (4 lines) ----------
//parameter name
"Model";
//value
"Testing";
# ----------------------------------------
current = Orchid.Revit.FamilyDocument.FamilyType.Current()  # frozen
current_2 = Orchid.Revit.FamilyDocument.FamilyType.Current(code_block)  # frozen
name = Orchid.Revit.FamilyDocument.FamilyType.Name(all.out1)
watch = Watch(name)
all_2 = Orchid.Revit.FamilyDocument.FamilyType.All()  # frozen
