# Dynamo graph BuiltInParameter.dyn (Dynamo 1.3.4.6666)

all = Orchid.Revit.Core.BuiltInParameter.All()
name = Orchid.Revit.Core.BuiltInParameter.Name(all)
watch = Watch(name)
watch_2 = Watch(all)
builtin_parameter = BuiltInParameterDD("MATERIAL_ID_PARAM")
watch_3 = Watch(builtin_parameter)
name_2 = Orchid.Revit.Core.BuiltInParameter.Name(builtin_parameter)
watch_4 = Watch(name_2)
label = Orchid.Revit.Core.BuiltInParameter.Label(all)
watch_5 = Watch(label)
label_2 = Orchid.Revit.Core.BuiltInParameter.Label(builtin_parameter)
watch_6 = Watch(label_2)
