# Dynamo graph Directory-Rename.dyn (Dynamo 1.3.3.4651)

# group: Open all files in directory and sub directories
string = StringInput(".\testSet")
code_block = CodeBlock { "*.rfa"; false; }
contents = Orchid.Generic.Core.Directory.Contents(string, code_block.out0, code_block.out1)

watch = Watch(contents)
code_block_2 = CodeBlock { false; }
fileName = FilePath.FileName(contents, code_block_2)

# group: rename all files in directory and sub directories
string_2 = StringInput(".\testSet")
code_block_3 = CodeBlock()
# ---------- code_block_3.designscript (3 lines) ----------
"rfa";
//new names (check list length)
{"dummy1","dummy2"};
# ----------------------------------------
rename = Orchid.Generic.Core.File.Rename(string_2, code_block_3.out0, fileName, code_block_3.out1)

watch_2 = Watch(rename)
directory_path = StringInput(".\testSet")
code_block_4 = CodeBlock { "*.rfa"; false; }
contents_2 = Orchid.Generic.Core.Directory.Contents(directory_path, code_block_4.out0, code_block_4.out1)
partition = DoubleInput(1)
sliced_into = DoubleInput(2)
count = Count(contents_2)
code_block_5 = CodeBlock(partition=partition, sliced=sliced_into, count=count)
# ---------- code_block_5.designscript (4 lines) ----------
//start
Math.Floor(((partition-1)/sliced)*count);
//end
Math.Ceiling((partition/sliced)*count);
# ----------------------------------------
slice = List.Slice(contents_2, code_block_5.out0, code_block_5.out1)
watch_3 = Watch(slice)
