# Dynamo graph Ifc.dyn (Dynamo 1.3.4.6666)

# group: Prebuild IFC setting
ifc_setting = SettingDD("IFC4 Design Transfer View")
settingByName = Orchid.Revit.Core.IFC.SettingByName(ifc_setting)

# group: IFC setting --> General
ifc_space_boundary = SpaceBoundaryDD("1st Level")
ifc_project_origin = SitePlacementDD("Internal coordinates")
boolean = BoolSelector(true)
settingGeneral = Orchid.Revit.Core.IFC.SettingGeneral(settingByName, arg3=ifc_space_boundary, arg4=ifc_project_origin, arg5=boolean)
ifc_file_type = FileTypeDD("IFC")
ifc_version = VersionDD("IFC4 Design Transfer View")

# group: IFC setting --> Additional/LOD
boolean_2 = BoolSelector(true)
ifc_level_of_detail = LevelOfDetailDD("Medium")
settingAdditional = Orchid.Revit.Core.IFC.SettingAdditional(settingGeneral, arg3=boolean_2, arg5=ifc_level_of_detail)

# group: IFC setting --> Property
boolean_3 = BoolSelector(true)
code_block = CodeBlock { t1 = Orchid.Directory.Current; t2 = "test"; t1+"\\"+t2; }
settingProperty = Orchid.Revit.Core.IFC.SettingProperty(settingAdditional, arg3=boolean_3, arg7=code_block.out2)

# group: IFC setting --> Advanced
boolean_4 = BoolSelector(true)
settingAdvanced = Orchid.Revit.Core.IFC.SettingAdvanced(settingProperty, arg7=boolean_4)

# group: IFC setting file format
type = Object.Type(settingAdvanced)
watch = Watch(type)
watch_2 = Watch(settingAdvanced)

# group: IFC Export
current = Orchid.Generic.Core.Directory.Current()
string = StringInput("test")
code_block_2 = CodeBlock(t1=current, t2=string) { t1+"\\"+t2; }
views = Views("{3D}")
export = Orchid.Revit.Core.IFC.Export(arg1=settingAdvanced, arg2=views)
watch_3 = Watch(export)
boolean_5 = BoolSelector(false)
phases = PhaseDD("Existing")

# group: IFC Export --> Multiple document export
file_path = Filename("..\..\Data\2019_defaultBuilding.rvt")
backgroundOpen = Orchid.Revit.Core.Document.BackgroundOpen(file_path)
export_2 = Orchid.Revit.Core.IFC.Export(backgroundOpen)
await_ = Orchid.Generic.Core.DataStream.Await(backgroundOpen, export_2)
close = Orchid.Revit.Core.Document.Close(await_)
watch_4 = Watch(export_2)

# group: IFC Export based on prebuild IFC setting and a view
ifc_setting_2 = SettingDD("IFC2x3 Coordination View 2.0")
settingByName_2 = Orchid.Revit.Core.IFC.SettingByName(ifc_setting_2)
views_2 = Views("{3D}")
export_3 = Orchid.Revit.Core.IFC.Export(arg1=settingByName_2, arg2=views_2)
