# Dynamo graph LinkedDocument.dyn (Dynamo 1.3.4.6666)

string = StringInput("C:\Users\erfajo\Programming\Source\Testing\Data\")
string_2 = StringInput("2019_defaultProject")
code_block = CodeBlock(a=string, b=string_2) { a+b+".rvt"; }
fromPath = Orchid.Generic.Core.File.FromPath(code_block)

# group: Revit links
linkedRevitFile = Orchid.Revit.Core.Document.LinkedRevitFile()
linkReload = Orchid.Revit.Core.Document.LinkReload(arg1=linkedRevitFile)  # frozen
linkRepath = Orchid.Revit.Core.Document.LinkRepath(arg1=linkedRevitFile, arg2=fromPath)  # frozen
linkUnload = Orchid.Revit.Core.Document.LinkUnload(arg1=linkedRevitFile)  # frozen
watch = Watch(linkedRevitFile)
name = Element.Name(linkedRevitFile)
watch_2 = Watch(name)

# group: CAD links
linkedCadFile = Orchid.Revit.Core.Document.LinkedCadFile()
watch_3 = Watch(linkedCadFile)
name_2 = Element.Name(linkedCadFile)
watch_4 = Watch(name_2)
linkReload_2 = Orchid.Revit.Core.Document.LinkReload(arg1=linkedCadFile)
watch_5 = Watch(linkReload_2)

# group: Get all linked files
linkedFile = Orchid.Revit.Core.Document.LinkedFile()
watch_6 = Watch(linkedFile.out1)
watch_7 = Watch(linkedFile.out0)

# group: Dropdown selector
linked_files = LinkFileDD("Assembly Code Settings")
watch_8 = Watch(linked_files)
linked_revit_files = LinkRevitDD("2019_changeMaterial.rvt")
watch_9 = Watch(linked_revit_files)
linked_cad_files = LinkCadDD("Drawing1.dwg")
watch_10 = Watch(linked_cad_files)

# group: Convert to Revit link
select_model_element = DSModelElementSelection()  # 1 picked in the model
watch_11 = Watch(select_model_element)
convertToLink = Orchid.Revit.Core.Document.ConvertToLink(arg1=select_model_element)
watch_12 = Watch(convertToLink)

# group: Convert to CAD link
select_model_element_2 = DSModelElementSelection()  # 1 picked in the model
watch_13 = Watch(select_model_element_2)
convertToLink_2 = Orchid.Revit.Core.Document.ConvertToLink(arg1=select_model_element_2)
watch_14 = Watch(convertToLink_2)
