# Dynamo graph List.SummationByKey.dyn (Dynamo 1.3.3.4651)

categories = Categories("Walls")
all_elements_of_category = ElementsOfCategory(categories)
code_block = CodeBlock { "Area"; }
getParameterValueByName = Element.GetParameterValueByName(element=all_elements_of_category, parameterName=code_block)
code_block_2 = CodeBlock { "Family"; }
getParameterValueByName_2 = Element.GetParameterValueByName(element=all_elements_of_category, parameterName=code_block_2)
summationByKey = Orchid.Generic.Core.List.SummationByKey(getParameterValueByName, getParameterValueByName_2)
watch = Watch(summationByKey.out1)
watch_2 = Watch(summationByKey.out0)
groupByKey = List.GroupByKey(list=getParameterValueByName, keys=getParameterValueByName_2)
watch_3 = Watch(groupByKey.groups)
watch_4 = Watch(groupByKey.unique_keys)
code_block_3 = CodeBlock(x=getParameterValueByName) { x:int[]; }
type = Object.Type(code_block_3)
type_2 = Object.Type(summationByKey.out0)
type_3 = Object.Type(groupByKey.groups)
groupByEqual = Orchid.Generic.Core.List.GroupByEqual(getParameterValueByName_2)
watch_5 = Watch(groupByEqual.out0)
watch_6 = Watch(groupByEqual.out1)
