# Dynamo graph MergePDF.dyn (Dynamo 1.3.4.6666)

code_block = CodeBlock()
# ---------- code_block.designscript (6 lines) ----------
//input documents
{"%userprofile%\\Downloads\\PDF\\pdf1.pdf",
"%userprofile%\\Downloads\\PDF\\pdf2.pdf"};

//output file path
"%userprofile%\\Downloads\\PDF\\result.pdf";
# ----------------------------------------
mergePDF = Orchid.Generic.Core.Print.MergePDF(code_block.out0, code_block.out1)
