# Dynamo graph Print.dyn (Dynamo 1.3.4.6666)

code_block = CodeBlock()
# ---------- code_block.designscript (7 lines) ----------
"Adobe PDF";
"Microsoft Print to PDF";
"Microsoft XPS Document Writer";

//Hidden built-in printer
//not supported at the moment!
"Revit DWF Exporter";
# ----------------------------------------
string = StringInput("Default")
code_block_2 = CodeBlock { 100; }
printer = PrinterDD("Microsoft Print to PDF")
string_2 = StringInput("testSetting")
print_papersizes = PaperSizesDD("A3", printer, input=Microsoft Print to PDF)
print_pageorientation = PageOrientationDD("Portrait")
print_margintype = MarginTypeDD("User defined")
code_block_3 = CodeBlock { {10,10}; }
changeSetting = Orchid.Revit.Core.Print.ChangeSetting(printer, string_2, print_papersizes, print_pageorientation, arg5=print_margintype, arg6=code_block_3)
printer_2 = PrinterDD("Microsoft Print to PDF")
view_sheet_set = ViewSheetSetDD("A3 set")
getView = Orchid.Revit.Core.ViewSheetSet.GetView(view_sheet_set)

# group: filePath --> file name incl. path
current = Orchid.Generic.Core.Directory.Current()
string_3 = StringInput("testSet")
sheetNumber = Sheet.SheetNumber(getView)
code_block_4 = CodeBlock(a=current, b=string_3, c=sheetNumber)
# ---------- code_block_4.designscript (3 lines) ----------
a + "\\" +
b + "\\" +
c;
# ----------------------------------------

# note: Print Setting may be set
# both as an element and
# as a string
print_setting = SettingDD("Default")
byViewSheetSet = Orchid.Revit.Core.Print.ByViewSheetSet(printer_2, arg3=code_block_4, arg4=view_sheet_set, arg5=print_setting)
boolean = BoolSelector(true)
boolean_2 = BoolSelector(true)
byView = Orchid.Revit.Core.Print.ByView(printer_2, boolean, boolean_2, code_block_4, arg5=getView, arg6=print_setting)
# note: Set to "Select" to print the selected views
print_range = RangeDD("Selected views/sheets")

# group: Remove print setting
print_setting_2 = SettingDD("Default")
# note: Print Setting may be set
# both as an element and
# as a string
string_4 = StringInput("testSetting")
deleteSetting = Orchid.Revit.Core.Print.DeleteSetting(string_4)  # frozen

print_zoomtype = ZoomTypeDD("Zoom")
print_paperplacement = PaperPlacementDD("Offset from corner")
createSetting = Orchid.Revit.Core.Print.CreateSetting(printer, string_2)

# group: Print current view (center and fit to page)
printer_3 = PrinterDD("Microsoft Print to PDF")
string_5 = StringInput("testSetting")
print_papersizes_2 = PaperSizesDD("A3", printer_3, input=Microsoft Print to PDF)
print_paperplacement_2 = PaperPlacementDD("Center")
print_zoomtype_2 = ZoomTypeDD("Fit To Page")
createSetting_2 = Orchid.Revit.Core.Print.CreateSetting(printer_3, string_5, print_papersizes_2, arg4=print_paperplacement_2, arg7=print_zoomtype_2)
print_range_2 = RangeDD("Current window")
activeView = Orchid.Revit.Core.Document.ActiveView()
byView_2 = Orchid.Revit.Core.Print.ByView(printer_3, arg4=print_range_2, arg5=activeView, arg6=createSetting_2)
# note: if print options there are rarely set need to be included, then connect:
# "Print.SetOptions" output Printsetting to "Print.ByView" input printSetting!
await_ = Orchid.Generic.Core.DataStream.Await(createSetting_2, byView_2)
deleteSetting_2 = Orchid.Revit.Core.Print.DeleteSetting(await_)

# group: ViewSheetSet
categories = Categories("Sheets")  # frozen
all_elements_of_category = ElementsOfCategory(categories)
string_6 = StringInput("testSet")
create = Orchid.Revit.Core.ViewSheetSet.Create(all_elements_of_category, string_6)
getView_2 = Orchid.Revit.Core.ViewSheetSet.GetView(create)
view_sheet_set_2 = ViewSheetSetDD("A3 set")
change = Orchid.Revit.Core.ViewSheetSet.Change(getView_2, view_sheet_set_2)
delete = Orchid.Revit.Core.ViewSheetSet.Delete(create)

# group: Print options there are rarely set
boolean_3 = BoolSelector(true)
boolean_4 = BoolSelector(false)
print_hiddenlineviews = HiddenLineViewsTypeDD("Vector Processing")
print_rasterquality = RasterQualityTypeDD("Medium")
print_colordepth = ColorDepthTypeDD("Gray Scale")
setOptions = Orchid.Revit.Core.Print.SetOptions(createSetting_2, boolean_3, boolean_4, boolean_3, boolean_3, boolean_4, boolean_4, boolean_3, print_hiddenlineviews, print_rasterquality, print_colordepth)  # frozen

# group: Merge PDF files
code_block_5 = CodeBlock()
# ---------- code_block_5.designscript (6 lines) ----------
//input documents
{"%userprofile%\\Downloads\\PDF\\pdf1.pdf",
"%userprofile%\\Downloads\\PDF\\pdf2.pdf"};

//output file path
"%userprofile%\\Downloads\\PDF\\result.pdf";
# ----------------------------------------
mergePDF = Orchid.Generic.Core.Print.MergePDF(code_block_5.out0, code_block_5.out1)  # frozen
