# Dynamo graph Project.dyn (Dynamo 1.3.4.6666)

# group: Project phase
phases = PhaseDD("New Construction")
watch = Watch(phases)

# group: Project location
project_origin = OriginDD("Internal")
setProjectLocation = Orchid.Revit.Core.Project.SetProjectLocation(project_origin)
watch_2 = Watch(setProjectLocation)
getProjectLocation = Orchid.Revit.Core.Project.GetProjectLocation()
watch_3 = Watch(getProjectLocation)
