# Dynamo graph Purge.dyn (Dynamo 1.3.4.6666)

directory_path = StringInput(".\testSet")
string = StringInput("*.rfa")
boolean = BoolSelector(false)
contents = Orchid.Generic.Core.Directory.Contents(directory_path, string, boolean)
backgroundOpen = Orchid.Revit.Core.Document.BackgroundOpen(contents)

# group: Purge
boolean_2 = BoolSelector(true)
purge = Orchid.Revit.Core.Document.Purge(backgroundOpen, boolean_2)

await_ = Orchid.Generic.Core.DataStream.Await(backgroundOpen, purge)
boolean_3 = BoolSelector(true)
close = Orchid.Revit.Core.Document.Close(await_, boolean_3)

# group: Cleanup backup files
await_2 = Orchid.Generic.Core.DataStream.Await(directory_path, close)
string_2 = StringInput("*.0001.rfa")
boolean_4 = BoolSelector(true)
contents_2 = Orchid.Generic.Core.Directory.Contents(await_2, string_2, boolean_4)
delete = File.Delete(contents_2)
