# Dynamo graph TransferProjectStandards.dyn (Dynamo 1.3.4.6666)

current = Orchid.Generic.Core.Directory.Current()
code_block = CodeBlock { "2019_defaultBuilding.rvt"; }
code_block_2 = CodeBlock(a=current, b=code_block) { a+"\\"+b; }
backgroundOpen = Orchid.Revit.Core.Document.BackgroundOpen(code_block_2)
categories = Categories("Schedules")
boolean = BoolSelector(false)
transfer = Orchid.Revit.Core.Document.Transfer(backgroundOpen, categories, boolean)
watch = Watch(transfer)
await_ = Orchid.Generic.Core.DataStream.Await(backgroundOpen, transfer)
close = Orchid.Revit.Core.Document.Close(await_)
