# Dynamo graph Worksharing.dyn (Dynamo 1.3.4.6666)

string = StringInput("C:\Users\Public\Temp\Worksharing\")
string_2 = StringInput("2019_Central")
code_block = CodeBlock(a=string, b=string_2) { a+b+".rvt"; }
fromPath = Orchid.Generic.Core.File.FromPath(code_block)
boolean = BoolSelector(true)
boolean_2 = BoolSelector(true)
boolean_3 = BoolSelector(false)
backgroundOpen = Orchid.Revit.Core.Document.BackgroundOpen(fromPath, boolean, boolean_2, boolean_3)
string_3 = StringInput("new")
code_block_2 = CodeBlock(a=string, b=string_3) { a+b+".rvt"; }
boolean_4 = BoolSelector(false)
boolean_5 = BoolSelector(false)
saveAs = Orchid.Revit.Core.Document.SaveAs(backgroundOpen, code_block_2, boolean_4, boolean_5)
close = Orchid.Revit.Core.Document.Close(saveAs)
