# Dynamo graph Family-Associated.dyn (Dynamo 1.3.4.6666)

categories = Categories("GenericModel")
all_elements_of_category = ElementsOfCategory(categories)
elementType = Element.ElementType(all_elements_of_category)
family = FamilyType.Family(elementType)
hasAssociated = Orchid.Revit.Elements.Family.HasAssociated(family)
watch = Watch(hasAssociated)
watch_2 = Watch(family)
watch_3 = Watch(elementType)
hasAssociated_2 = Orchid.Revit.Elements.FamilyType.HasAssociated(elementType)
watch_4 = Watch(hasAssociated_2)
