# Dynamo graph FamilyType.dyn (Dynamo 1.3.4.6666)

# group: Family
families = FamiliesDD("Ext. Single-Flush")
elementByFamily = Orchid.Revit.Elements.Selection.ElementByFamily(families)
watch = Watch(elementByFamily)

# group: FamilyType
family_types = FamilyTypes("Ext. Single-Flush:9x21M")
family_types_2 = FamilyTypes("Ext. Single-Flush:9x21M 2")
create = List.Create(family_types, family_types_2)
all_elements_of_family_type = ElementsOfFamilyType(create)
watch_2 = Watch(all_elements_of_family_type)

# group: Family based on FamilyType
flatten = Flatten(all_elements_of_family_type)
id = Element.Id(flatten)
sortByKey = List.SortByKey(list=flatten, keys=id)
watch_3 = Watch(sortByKey.sorted_list)
