# Dynamo graph SetType-Random.dyn (Dynamo 1.3.4.6666)

# group: Collect elements
family_types = FamilyTypes("Sunshade Panel Wide:Expanded metal Small")
family_types_2 = FamilyTypes("Sunshade Panel Wide:Expanded metal Large")
create = List.Create(family_types, family_types_2)
all_elements_of_family_type = ElementsOfFamilyType(create)

flatten = Flatten(all_elements_of_family_type)

# group: Randomization
count = List.Count(flatten)
randomList = Orchid.Generic.Core.Math.RandomList(count)
round = Math.Round(randomList)

getItemAtIndex = List.GetItemAtIndex(list=create, index=round)

# group: SetType
setType = Orchid.Revit.Elements.Element.SetType(flatten, getItemAtIndex)

# group: Random
code_block = CodeBlock { 4; }
random = Orchid.Generic.Core.Math.Random(code_block)
watch = Watch(random)
randomList_2 = Orchid.Generic.Core.Math.RandomList(count, code_block)
watch_2 = Watch(randomList_2)
