# Dynamo graph BulkUpgrade.dyn (Dynamo 1.3.4.6666)

directory_path = StringInput(".\testSet")
string = StringInput("*.rfa")
boolean = BoolSelector(false)
contents = Orchid.Generic.Core.Directory.Contents(directory_path, string, boolean)
backgroundOpen = Orchid.Revit.Core.Document.BackgroundOpen(contents)
# note: Please notice that I use a tab in my "SP Parameter group" names. This is not standard!
# "Sheet & Project" would be the normal way!
code_block = CodeBlock()
# ---------- code_block.designscript (12 lines) ----------
//Parameter name
"Creator Build";
//SP Parameter group
"01:   Sheet & Project";
//SP Parameter type
"Text";
//Parameter group
"PG_ADSK_MODEL_PROPERTIES";
//Instances
true;
//Reporting
false;
# ----------------------------------------
addSharedParameter = Orchid.Revit.FamilyDocument.Parameter.AddSharedParameter(backgroundOpen, code_block.out0, code_block.out1, code_block.out2, code_block.out3, arg6=code_block.out4)
await_ = Orchid.Generic.Core.DataStream.Await(backgroundOpen, addSharedParameter)
code_block_2 = CodeBlock()
# ---------- code_block_2.designscript (2 lines) ----------
//parameter name
"Creator Build";
# ----------------------------------------
creator_build = StringInput("\"2018\"")
set = Orchid.Revit.FamilyDocument.Formula.Set(await_, code_block_2, creator_build)
await_2 = Orchid.Generic.Core.DataStream.Await(await_, set)
boolean_2 = BoolSelector(true)
close = Orchid.Revit.Core.Document.Close(await_2, boolean_2)

# group: Cleanup backup files
await_3 = Orchid.Generic.Core.DataStream.Await(directory_path, close)
string_2 = StringInput("*.0001.rfa")
boolean_3 = BoolSelector(true)
contents_2 = Orchid.Generic.Core.Directory.Contents(await_3, string_2, boolean_3)
delete = File.Delete(contents_2)
