# Dynamo graph CategoryReportingIFC.dyn (Dynamo 1.3.4.6666)

current = Orchid.Revit.Core.Document.Current()

# group: Set the document category
categories = Categories("Casework")
setCategory = Orchid.Revit.FamilyDocument.Document.SetCategory(current, categories)

# group: Get the document category
await_ = Orchid.Generic.Core.DataStream.Await(current, setCategory)
getCategory = Orchid.Revit.FamilyDocument.Document.GetCategory(await_)

# group: Create types
code_block = CodeBlock()
# ---------- code_block.designscript (2 lines) ----------
//Types to create
{"Type 1", "Type 2"};
# ----------------------------------------
create = Orchid.Revit.FamilyDocument.FamilyType.Create(current, code_block)

# group: Add parameter
await_2 = Orchid.Generic.Core.DataStream.Await(current, create)
code_block_2 = CodeBlock()
# ---------- code_block_2.designscript (8 lines) ----------
//Parameter name
"dim";
//Parameter type
"Length";
//Parameter group
"PG_ADSK_MODEL_PROPERTIES";
//Reporting
true;
# ----------------------------------------
addParameter = Orchid.Revit.FamilyDocument.Parameter.AddParameter(await_2, code_block_2.out0, code_block_2.out1, code_block_2.out2, arg6=code_block_2.out3)

# group: Parameters
parameters = Orchid.Revit.FamilyDocument.Parameter.Parameters(await_2)
name = Orchid.Revit.FamilyDocument.Parameter.Name(parameters)

watch = Watch(name)

# group: Add parameter
await_3 = Orchid.Generic.Core.DataStream.Await(current, create)
code_block_3 = CodeBlock()
# ---------- code_block_3.designscript (10 lines) ----------
//Parameter name
"Test";
//Parameter type
"Text";
//Parameter group
"PG_ADSK_MODEL_PROPERTIES";
//Tooltip
"Owner value";
//Instances
true;
# ----------------------------------------
addParameter_2 = Orchid.Revit.FamilyDocument.Parameter.AddParameter(await_3, code_block_3.out0, code_block_3.out1, code_block_3.out2, code_block_3.out3, code_block_3.out4)

# group: Set parameter
await_4 = Orchid.Generic.Core.DataStream.Await(await_3, addParameter_2)
code_block_4 = CodeBlock()
# ---------- code_block_4.designscript (6 lines) ----------
//Type
"Type 1";
//Parameter name
"Test";
//Value
"This is a test";
# ----------------------------------------
setValue = Orchid.Revit.FamilyDocument.Parameter.SetValue(await_4, code_block_4.out0, code_block_4.out1, code_block_4.out2)

create_2 = List.Create(addParameter, addParameter_2)

# group: IsReporting parameter
name_2 = Orchid.Revit.FamilyDocument.Parameter.Name(create_2)
isReporting = Orchid.Revit.FamilyDocument.Parameter.IsReporting(await_2, name_2)

watch_2 = Watch(isReporting)
watch_3 = Watch(name_2)

# group: Add basic IFC parameters
addIfcParameters = Orchid.Revit.FamilyDocument.Parameter.AddIfcParameters(current)
name_3 = Orchid.Revit.FamilyDocument.Parameter.Name(addIfcParameters)
watch_4 = Watch(name_3)
