# Dynamo graph SetGet.dyn (Dynamo 1.3.4.6666)

directory_path = StringInput(".\testSet")
string = StringInput("*.rfa")
boolean = BoolSelector(false)
contents = Orchid.Generic.Core.Directory.Contents(directory_path, string, boolean)
backgroundOpen = Orchid.Revit.Core.Document.BackgroundOpen(contents)
create = Orchid.Revit.FamilyDocument.FamilyType.Create(backgroundOpen)
await_ = Orchid.Generic.Core.DataStream.Await(backgroundOpen, create)
all = Orchid.Revit.FamilyDocument.FamilyType.All(await_)
code_block = CodeBlock()
# ---------- code_block.designscript (4 lines) ----------
//parameter name
{"Model", "Description"};
//value
{"Testing1", "Testing2"};
# ----------------------------------------
setValue = Orchid.Revit.FamilyDocument.Parameter.SetValue(await_, all, code_block.out0, code_block.out1)
await_2 = Orchid.Generic.Core.DataStream.Await(await_, setValue)
getValue = Orchid.Revit.FamilyDocument.Parameter.GetValue(await_2, all, code_block.out0)
await_3 = Orchid.Generic.Core.DataStream.Await(await_2, getValue.out0)
boolean_2 = BoolSelector(true)
close = Orchid.Revit.Core.Document.Close(await_3, boolean_2)

# group: Cleanup backup files
await_4 = Orchid.Generic.Core.DataStream.Await(directory_path, close)
string_2 = StringInput("*.0001.rfa")
boolean_3 = BoolSelector(true)
contents_2 = Orchid.Generic.Core.Directory.Contents(await_4, string_2, boolean_3)
delete = File.Delete(contents_2)

code_block_2 = CodeBlock()
# ---------- code_block_2.designscript (4 lines) ----------
//parameter name
"Model";
//value
"Testing";
# ----------------------------------------
current = Orchid.Revit.FamilyDocument.FamilyType.Current()  # frozen
all_2 = Orchid.Revit.FamilyDocument.FamilyType.All()  # frozen
name = Orchid.Revit.FamilyDocument.FamilyType.Name(all)
watch = Watch(getValue.out0)
watch_2 = Watch(getValue.out1)
name_2 = Orchid.Revit.FamilyDocument.Parameter.Name(setValue)
