# Dynamo graph Apperance.dyn (Dynamo 1.3.4.6666)

# group: Duplicate
appearance_asset = AppearanceAssetDD("Broom Finish - Gray(1)")
code_block = CodeBlock { "_xx"; }
duplicate = Orchid.Revit.Materials.AppearanceAsset.Duplicate(appearance_asset, code_block)
watch = Watch(duplicate)

# group: All
all = Orchid.Revit.Materials.AppearanceAsset.All()
name = Element.Name(all)
watch_2 = Watch(name)
watch_3 = Watch(all)

# group: Create material: Timber (C24)
code_block_2 = CodeBlock { "_Timber C24"; }
create = Orchid.Revit.Materials.Material.Create(code_block_2)
appearance_schema = AppearanceSchemaDD("Generic")
boolean = BoolSelector(true)
create_2 = Orchid.Revit.Materials.AppearanceAsset.Create(code_block_2, appearance_schema, boolean)
code_block_3 = CodeBlock { "Hardwood material"; "pine,wood,interior,furniture,materials,hardwood"; }
setInformation = Orchid.Revit.Materials.AppearanceAsset.SetInformation(create_2, code_block_3.out0, code_block_3.out1)
code_block_4 = CodeBlock { 145; 15; 65; }
byARGB = Color.ByARGB(r=code_block_4.out0, g=code_block_4.out1, b=code_block_4.out2)
setGeneric = Orchid.Revit.Materials.AppearanceAsset.SetGeneric(setInformation, byARGB)
string = StringInput("%userprofile%\Programming\Source\Testing\Data\Stone_3.bmp")
fromPath = Orchid.Generic.Core.File.FromPath(string)
setBump = Orchid.Revit.Materials.AppearanceAsset.SetBump(setGeneric, fromPath)
setAsset = Orchid.Revit.Materials.Material.SetAsset(create, setBump)
name_2 = Material.Name(setAsset)
watch_4 = Watch(name_2)
watch_5 = Watch(setAsset)
getInformation = Orchid.Revit.Materials.AppearanceAsset.GetInformation(setInformation)
watch_6 = Watch(getInformation.out0)
watch_7 = Watch(getInformation.out1)
