# Dynamo graph Asset.dyn (Dynamo 1.3.4.6666)

# group: Duplicate
appearance_asset = AppearanceAssetDD("Broom Finish - Gray(1)")
code_block = CodeBlock { "_xx"; }
duplicate = Orchid.Revit.Materials.AppearanceAsset.Duplicate(appearance_asset, code_block)
watch = Watch(duplicate)

# group: All
all = Orchid.Revit.Materials.AppearanceAsset.All()
name = Element.Name(all)
watch_2 = Watch(name)
watch_3 = Watch(all)

# group: Create material: Concrete (C30)
code_block_2 = CodeBlock { "_Concrete"; }
create = Orchid.Revit.Materials.Material.Create(code_block_2)
material_aspect = MaterialAspectDD("Thermal")
thermal_type = ThermalTypeDD("Solid")
boolean = BoolSelector(true)
create_2 = Orchid.Revit.Materials.ThermalAsset.Create(code_block_2, thermal_type, boolean)
code_block_3 = CodeBlock { "Concrete f'c=30 MPa"; "structural,concrete,CC:BS 8110"; "thermal,solid"; "Orchid generated"; }
setInformation = Orchid.Revit.Materials.ThermalAsset.SetInformation(create_2, code_block_3.out0, code_block_3.out2, code_block_3.out3)
boolean_2 = BoolSelector(false)
asset_behavior = AssetBehaviorDD("Isotropic")
code_block_4 = CodeBlock { 1.046; 0.657; 2300; 0.95; 182.4; 0.01; 0; 2000000; }
setProperties = Orchid.Revit.Materials.ThermalAsset.SetProperties(setInformation, boolean_2, asset_behavior, code_block_4.out0, code_block_4.out1, code_block_4.out2, code_block_4.out3, code_block_4.out4, code_block_4.out5, code_block_4.out6, code_block_4.out7)
propertySet = Orchid.Revit.Materials.ThermalAsset.PropertySet(setProperties)
setAsset = Orchid.Revit.Materials.Material.SetAsset(create, material_aspect, propertySet)
name_2 = Material.Name(setAsset)
watch_4 = Watch(name_2)
watch_5 = Watch(setAsset)
material_aspect_2 = MaterialAspectDD("Physical (Structural)")
physical_type = PhysicalTypeDD("Concrete")
create_3 = Orchid.Revit.Materials.PhysicalAsset.Create(code_block_2, physical_type, boolean)
setInformation_2 = Orchid.Revit.Materials.PhysicalAsset.SetInformation(create_3, code_block_3.out0, code_block_3.out1, code_block_3.out3)
asset_behavior_2 = AssetBehaviorDD("Isotropic")
setBehavior = Orchid.Revit.Materials.PhysicalAsset.SetBehavior(setInformation_2, asset_behavior_2)
code_block_5 = CodeBlock { 0.00001; }
setBasicThermal = Orchid.Revit.Materials.PhysicalAsset.SetBasicThermal(setBehavior, code_block_5)
code_block_6 = CodeBlock { 20500; 0.2; 11200; 2406.45; }
setMechanical = Orchid.Revit.Materials.PhysicalAsset.SetMechanical(setBasicThermal, code_block_6.out0, code_block_6.out1, code_block_6.out2, code_block_6.out3)
code_block_7 = CodeBlock { 30.0; 1.0; }
boolean_3 = BoolSelector(false)
setConcrete = Orchid.Revit.Materials.PhysicalAsset.SetConcrete(setMechanical, code_block_7.out0, code_block_7.out1, boolean_3)
propertySet_2 = Orchid.Revit.Materials.PhysicalAsset.PropertySet(setConcrete)
setAsset_2 = Orchid.Revit.Materials.Material.SetAsset(create, material_aspect_2, propertySet_2)
name_3 = Material.Name(setAsset_2)
watch_6 = Watch(name_3)
watch_7 = Watch(setAsset_2)

# group: Create material: Oxygen
code_block_8 = CodeBlock { "_Oxygen"; }
create_4 = Orchid.Revit.Materials.Material.Create(code_block_8)
material_aspect_3 = MaterialAspectDD("Thermal")
thermal_type_2 = ThermalTypeDD("Gas")
boolean_4 = BoolSelector(true)
create_5 = Orchid.Revit.Materials.ThermalAsset.Create(code_block_8, thermal_type_2, boolean_4)
code_block_9 = CodeBlock { "Oxygen, properties at atmospheric pressure"; "structural,gas"; "thermal,gas"; "Orchid generated"; }
setInformation_3 = Orchid.Revit.Materials.ThermalAsset.SetInformation(create_5, code_block_9.out0, code_block_9.out2, code_block_9.out3)
code_block_10 = CodeBlock { 0.0242; 0.9118; 1.35; 0.01; 0; 1; }
setBasicThermal_2 = Orchid.Revit.Materials.ThermalAsset.SetBasicThermal(setInformation_3, code_block_10.out0, code_block_10.out1, code_block_10.out2, code_block_10.out3, code_block_10.out4, code_block_10.out5)
propertySet_3 = Orchid.Revit.Materials.ThermalAsset.PropertySet(setBasicThermal_2)
setAsset_3 = Orchid.Revit.Materials.Material.SetAsset(create_4, material_aspect_3, propertySet_3)
watch_8 = Watch(setAsset_3)
name_4 = Material.Name(setAsset_3)
watch_9 = Watch(name_4)
material_aspect_4 = MaterialAspectDD("Thermal")
physical_type_2 = PhysicalTypeDD("Gas")
create_6 = Orchid.Revit.Materials.PhysicalAsset.Create(code_block_8, physical_type_2, boolean_4)
setInformation_4 = Orchid.Revit.Materials.PhysicalAsset.SetInformation(create_6, code_block_9.out0, code_block_9.out1, code_block_9.out3)
code_block_11 = CodeBlock { 500; }
setBasicThermal_3 = Orchid.Revit.Materials.PhysicalAsset.SetBasicThermal(setInformation_4, code_block_11)
code_block_12 = CodeBlock { 1.35; }
setMechanical_2 = Orchid.Revit.Materials.PhysicalAsset.SetMechanical(setBasicThermal_3, code_block_12)
propertySet_4 = Orchid.Revit.Materials.PhysicalAsset.PropertySet(setMechanical_2)
setAsset_4 = Orchid.Revit.Materials.Material.SetAsset(create_4, material_aspect_4, propertySet_4)
watch_10 = Watch(setAsset_4)
name_5 = Material.Name(setAsset_4)
watch_11 = Watch(name_5)

# group: Create material: Steel (S275)
code_block_13 = CodeBlock { "_Steel S275"; }
create_7 = Orchid.Revit.Materials.Material.Create(code_block_13)
material_aspect_5 = MaterialAspectDD("Physical (Structural)")
physical_type_3 = PhysicalTypeDD("Metal")
boolean_5 = BoolSelector(true)
create_8 = Orchid.Revit.Materials.PhysicalAsset.Create(code_block_13, physical_type_3, boolean_5)
code_block_14 = CodeBlock { "Steel, S275 (EN 10025-2)"; "1.0044,structural,metal,CC:EN 10025"; "thermal,solid"; "Orchid generated"; }
setInformation_5 = Orchid.Revit.Materials.PhysicalAsset.SetInformation(create_8, code_block_14.out0, code_block_14.out1, code_block_14.out3)
asset_behavior_3 = AssetBehaviorDD("Isotropic")
setBehavior_2 = Orchid.Revit.Materials.PhysicalAsset.SetBehavior(setInformation_5, asset_behavior_3)
code_block_15 = CodeBlock { 0.00001; }
setBasicThermal_4 = Orchid.Revit.Materials.PhysicalAsset.SetBasicThermal(setBehavior_2, code_block_15)
code_block_16 = CodeBlock { 205000; 0.3; 80000; 7850; }
setMechanical_3 = Orchid.Revit.Materials.PhysicalAsset.SetMechanical(setBasicThermal_4, code_block_16.out0, code_block_16.out1, code_block_16.out2, code_block_16.out3)
code_block_17 = CodeBlock { 275; 430; }
boolean_6 = BoolSelector(true)
setStrength = Orchid.Revit.Materials.PhysicalAsset.SetStrength(setMechanical_3, code_block_17.out0, code_block_17.out1, boolean_6)
propertySet_5 = Orchid.Revit.Materials.PhysicalAsset.PropertySet(setStrength)
setAsset_5 = Orchid.Revit.Materials.Material.SetAsset(create_7, material_aspect_5, propertySet_5)
name_6 = Material.Name(setAsset_5)
watch_12 = Watch(name_6)
watch_13 = Watch(setAsset_5)
material_aspect_6 = MaterialAspectDD("Thermal")
thermal_type_3 = ThermalTypeDD("Solid")
create_9 = Orchid.Revit.Materials.ThermalAsset.Create(code_block_13, thermal_type_3, boolean_5)
setInformation_6 = Orchid.Revit.Materials.ThermalAsset.SetInformation(create_9, code_block_14.out0, code_block_14.out2, code_block_14.out3)
boolean_7 = BoolSelector(false)
asset_behavior_4 = AssetBehaviorDD("Isotropic")
code_block_18 = CodeBlock { 45; 0.48; 7850; 0.4; 0; 0.01; 0; 0; }
setProperties_2 = Orchid.Revit.Materials.ThermalAsset.SetProperties(setInformation_6, boolean_7, asset_behavior_4, code_block_18.out0, code_block_18.out1, code_block_18.out2, code_block_18.out3, code_block_18.out4, code_block_18.out5, code_block_18.out6, code_block_18.out7)
propertySet_6 = Orchid.Revit.Materials.ThermalAsset.PropertySet(setProperties_2)
setAsset_6 = Orchid.Revit.Materials.Material.SetAsset(create_7, material_aspect_6, propertySet_6)
name_7 = Material.Name(setAsset_6)
watch_14 = Watch(name_7)
watch_15 = Watch(setAsset_6)

# group: Create material: Timber (C24)
code_block_19 = CodeBlock { "_Timber C24"; }
create_10 = Orchid.Revit.Materials.Material.Create(code_block_19)
material_aspect_7 = MaterialAspectDD("Physical (Structural)")
physical_type_4 = PhysicalTypeDD("Wood")
boolean_8 = BoolSelector(true)
create_11 = Orchid.Revit.Materials.PhysicalAsset.Create(code_block_19, physical_type_4, boolean_8)
code_block_20 = CodeBlock { "Steel, S275 (EN 10025-2)"; "1.0044,structural,metal,CC:EN 10025"; "thermal,solid"; "Orchid generated"; }
setInformation_7 = Orchid.Revit.Materials.PhysicalAsset.SetInformation(create_11, code_block_20.out0, code_block_20.out1, code_block_20.out3)
asset_behavior_5 = AssetBehaviorDD("Orthotropic")
setBehavior_3 = Orchid.Revit.Materials.PhysicalAsset.SetBehavior(setInformation_7, asset_behavior_5)
code_block_21 = CodeBlock { 0.00004; }
setBasicThermal_5 = Orchid.Revit.Materials.PhysicalAsset.SetBasicThermal(setBehavior_3, code_block_21)
code_block_22 = CodeBlock { 11000; 0.38; 690; 420; }
setMechanical_4 = Orchid.Revit.Materials.PhysicalAsset.SetMechanical(setBasicThermal_5, code_block_22.out0, code_block_22.out1, code_block_22.out2, code_block_22.out3)
code_block_23 = CodeBlock { "Multiple"; "C24"; 24; 21; 2.5; }
setStrength_2 = Orchid.Revit.Materials.PhysicalAsset.SetStrength(setMechanical_4, code_block_23.out0, code_block_23.out1, code_block_23.out2, code_block_23.out3, code_block_23.out4)
propertySet_7 = Orchid.Revit.Materials.PhysicalAsset.PropertySet(setStrength_2)
setAsset_7 = Orchid.Revit.Materials.Material.SetAsset(create_10, material_aspect_7, propertySet_7)
name_8 = Material.Name(setAsset_7)
watch_16 = Watch(name_8)
watch_17 = Watch(setAsset_7)
material_aspect_8 = MaterialAspectDD("Thermal")
thermal_type_4 = ThermalTypeDD("Solid")
create_12 = Orchid.Revit.Materials.ThermalAsset.Create(code_block_19, thermal_type_4, boolean_8)
setInformation_8 = Orchid.Revit.Materials.ThermalAsset.SetInformation(create_12, code_block_20.out0, code_block_20.out2, code_block_20.out3)
boolean_9 = BoolSelector(false)
asset_behavior_6 = AssetBehaviorDD("Isotropic")
code_block_24 = CodeBlock { 0.12; 0.19; 496; 0.85; 0; 0.01; 0; 10000000; }
setProperties_3 = Orchid.Revit.Materials.ThermalAsset.SetProperties(setInformation_8, boolean_9, asset_behavior_6, code_block_24.out0, code_block_24.out1, code_block_24.out2, code_block_24.out3, code_block_24.out4, code_block_24.out5, code_block_24.out6, code_block_24.out7)
propertySet_8 = Orchid.Revit.Materials.ThermalAsset.PropertySet(setProperties_3)
setAsset_8 = Orchid.Revit.Materials.Material.SetAsset(create_10, material_aspect_8, propertySet_8)
name_9 = Material.Name(setAsset_8)
watch_18 = Watch(name_9)
watch_19 = Watch(setAsset_8)

# group: Create material: Timber (C24)
code_block_25 = CodeBlock { "_Timber C24"; }
create_13 = Orchid.Revit.Materials.Material.Create(code_block_25)
boolean_10 = BoolSelector(true)
create_14 = Orchid.Revit.Materials.AppearanceAsset.Create(code_block_25, boolean_10)
code_block_26 = CodeBlock { "Hardwood material"; "pine,wood,interior,furniture,materials,hardwood"; }
setInformation_9 = Orchid.Revit.Materials.AppearanceAsset.SetInformation(create_14, code_block_26.out0, code_block_26.out1)
code_block_27 = CodeBlock { 145; 15; 65; }
byARGB = Color.ByARGB(r=code_block_27.out0, g=code_block_27.out1, b=code_block_27.out2)
setGeneric = Orchid.Revit.Materials.AppearanceAsset.SetGeneric(setInformation_9, byARGB)
string = StringInput("%userprofile%\Programming\Source\Testing\Data\Stone_3.bmp")
fromPath = Orchid.Generic.Core.File.FromPath(string)
setBump = Orchid.Revit.Materials.AppearanceAsset.SetBump(setGeneric, fromPath)
setAsset_9 = Orchid.Revit.Materials.Material.SetAsset(create_13, setBump)
name_10 = Material.Name(setAsset_9)
watch_20 = Watch(name_10)
watch_21 = Watch(setAsset_9)
getInformation = Orchid.Revit.Materials.AppearanceAsset.GetInformation(setInformation_9)
watch_22 = Watch(getInformation.out0)
watch_23 = Watch(getInformation.out1)
