# Dynamo graph Density-Sum.dyn (Dynamo 1.3.4.6666)

elementHasMaterial = Orchid.Revit.Elements.Selection.ElementHasMaterial()
clean = Orchid.Generic.Core.List.Clean(elementHasMaterial)
flatten = Flatten(clean)

# group: get elements sorted by used materials including summarized area and volumne
getMaterials = Element.GetMaterials(element=flatten)
flatten_2 = Flatten(getMaterials)
uniqueItems = List.UniqueItems(flatten_2)
sumByMaterial = Orchid.Revit.Elements.Element.SumByMaterial(uniqueItems)
element_by_material_watch = Watch(sumByMaterial.out0)
volumne_watch = Watch(sumByMaterial.out2)
area_watch = Watch(sumByMaterial.out1)
name = Element.Name(uniqueItems)
material_name_watch = Watch(name)

natural_category_name = CodeBlock()
# ---------- natural_category_name.designscript (26 lines) ----------
{
"Casework",
"Ceilings",
"Columns",
"Curtain Wall Mullions",
"Curtain Panels",
"Curtain Systems",
"Doors",
"Entourage",
"Floors",
"Furniture",
"Furniture Systems",
"Generic Models",
"Plumbing Fixtures",
"Ramps",
"Roofs",
"Specialty Equipment",
"Stairs",
"Structural Columns",
"Structural Foundations",
"Structural Framing",
"Structural Beam Systems",
"Structural Stiffeners",
"Walls",
"Windows"
};
# ----------------------------------------
byName = Category.ByName(natural_category_name)
all_elements_of_category = ElementsOfCategory(byName)

# group: get materials--their area and volumne--by elements
getMaterial = Orchid.Revit.Elements.Element.GetMaterial(flatten)
area_watch_2 = Watch(getMaterial.out1)
volumne_watch_2 = Watch(getMaterial.out2)
material_by_element_watch = Watch(getMaterial.out0)

# group: get summarized (area and volumne) materials by elements and their asset density
sumByElement = Orchid.Revit.Materials.Material.SumByElement(flatten)
volumne_watch_3 = Watch(sumByElement.out2)
density = Orchid.Revit.Materials.Material.Density(sumByElement.out0)
physical_density_watch = Watch(density.out0)
thermal_density_watch = Watch(density.out1)
name_2 = Element.Name(sumByElement.out0)
material_name_watch_2 = Watch(name_2)
area_watch_3 = Watch(sumByElement.out1)
