# Dynamo graph Material.dyn (Dynamo 1.3.4.6666)

# group: Duplicate, Set
material = MaterialDD("Batt insulation")
code_block = CodeBlock { "_test3"; }
duplicate = Orchid.Revit.Materials.Material.Duplicate(material, code_block)
code_block_2 = CodeBlock { {125,160,130}; 90; }
fill_patterns = FillPatterns("75mm vertical")
code_block_3 = CodeBlock { 155; 135; 115; }
byARGB = Color.ByARGB(r=code_block_3.out0, g=code_block_3.out1, b=code_block_3.out2)
set = Orchid.Revit.Materials.Material.Set(duplicate, arg2=code_block_2.out0, arg3=code_block_2.out1, arg6=fill_patterns, arg7=byARGB)
watch = Watch(set)

# group: Create, Set Render Appearance, SetShadingColor, Set Transparency, Set Surface Pattern, Set Surface Pattern Color, Set Cut Pattern, Set Cut Pattern Color
code_block_4 = CodeBlock { "_test2"; }
create = Orchid.Revit.Materials.Material.Create(code_block_4)
boolean = BoolSelector(false)
setRenderAppearance = Orchid.Revit.Materials.Material.SetRenderAppearance(create, boolean)
code_block_5 = CodeBlock { {25,60,30,0}; }
setShadingColor = Orchid.Revit.Materials.Material.SetShadingColor(setRenderAppearance, code_block_5)
code_block_6 = CodeBlock { 75; }
setTransparency = Orchid.Revit.Materials.Material.SetTransparency(setShadingColor, code_block_6)
fill_patterns_2 = FillPatterns("100mm Horizontal")
setSurfacePattern = Orchid.Revit.Materials.Material.SetSurfacePattern(setTransparency, fill_patterns_2)
code_block_7 = CodeBlock { 145; 185; 165; }
byARGB_2 = Color.ByARGB(r=code_block_7.out0, g=code_block_7.out1, b=code_block_7.out2)
setSurfacePatternColor = Orchid.Revit.Materials.Material.SetSurfacePatternColor(setSurfacePattern, byARGB_2)
setCutPattern = Orchid.Revit.Materials.Material.SetCutPattern(setSurfacePatternColor, fill_patterns_2)
watch_2 = Watch(setCutPattern)
name = Material.Name(setCutPattern)
watch_3 = Watch(name)
getShadingColor = Orchid.Revit.Materials.Material.GetShadingColor(setShadingColor)
watch_4 = Watch(getShadingColor)
getTransparency = Orchid.Revit.Materials.Material.GetTransparency(setTransparency)
watch_5 = Watch(getTransparency)
getSurfacePattern = Orchid.Revit.Materials.Material.GetSurfacePattern(setSurfacePattern)
watch_6 = Watch(getSurfacePattern)
getSurfacePatternColor = Orchid.Revit.Materials.Material.GetSurfacePatternColor(setSurfacePatternColor)
watch_7 = Watch(getSurfacePatternColor)
setCutPatternColor = Orchid.Revit.Materials.Material.SetCutPatternColor(setCutPattern, byARGB_2)
getCutPatternColor = Orchid.Revit.Materials.Material.GetCutPatternColor(setCutPatternColor)
watch_8 = Watch(getCutPatternColor)
getCutPattern = Orchid.Revit.Materials.Material.GetCutPattern(setCutPattern)
watch_9 = Watch(getCutPattern)
getRenderAppearance = Orchid.Revit.Materials.Material.GetRenderAppearance(setRenderAppearance)
watch_10 = Watch(getRenderAppearance)

# group: Create, Get
code_block_8 = CodeBlock { "_test1"; 50; }
boolean_2 = BoolSelector(false)
code_block_9 = CodeBlock { {25,60,30,0}; }
fill_patterns_3 = FillPatterns("200mm Squares")
code_block_10 = CodeBlock { 45; 85; 65; }
byARGB_3 = Color.ByARGB(r=code_block_10.out0, g=code_block_10.out1, b=code_block_10.out2)
create_2 = Orchid.Revit.Materials.Material.Create(code_block_8.out0, boolean_2, code_block_9, code_block_8.out1, fill_patterns_3, byARGB_3)
watch_11 = Watch(create_2)
get = Orchid.Revit.Materials.Material.Get(create_2)
watch_12 = Watch(get.out0)
watch_13 = Watch(get.out1)
watch_14 = Watch(get.out2)
watch_15 = Watch(get.out3)
watch_16 = Watch(get.out4)
watch_17 = Watch(get.out5)
name_2 = Material.Name(create_2)
watch_18 = Watch(name_2)
watch_19 = Watch(get.out6)

# group: All
all = Orchid.Revit.Materials.Material.All()
name_3 = Material.Name(all)
watch_20 = Watch(name_3)
watch_21 = Watch(all)

material_2 = MaterialDD("Brick, Common")
getCategory = Orchid.Revit.Materials.Material.GetCategory(material_2)
watch_22 = Watch(getCategory)
getClass = Orchid.Revit.Materials.Material.GetClass(material_2)
watch_23 = Watch(getClass)

# group: Asset
material_3 = MaterialDD("Brick, Common")
asset = Orchid.Revit.Materials.Material.Asset(material_3)
watch_24 = Watch(asset.out0)
watch_25 = Watch(asset.out1)
watch_26 = Watch(asset.out2)

# group: Smoothness, Shininess
code_block_11 = CodeBlock { "_test4"; }
create_3 = Orchid.Revit.Materials.Material.Create(code_block_11)
code_block_12 = CodeBlock { 50; }
setSmoothness = Orchid.Revit.Materials.Material.SetSmoothness(create_3, code_block_12)
getSmoothness = Orchid.Revit.Materials.Material.GetSmoothness(setSmoothness)
watch_27 = Watch(getSmoothness)
setShininess = Orchid.Revit.Materials.Material.SetShininess(create_3, code_block_12)
getShininess = Orchid.Revit.Materials.Material.GetShininess(setShininess)
watch_28 = Watch(getShininess)

# group: Asset Parameter
material_4 = MaterialDD("Brick, Common")
assetParameter = Orchid.Revit.Materials.Material.AssetParameter(material_4)
watch_29 = Watch(assetParameter.out0)
watch_30 = Watch(assetParameter.out1)
watch_31 = Watch(assetParameter.out2)

# group: Parameter
material_5 = MaterialDD("Brick, Common")
parameter = Orchid.Revit.Materials.Material.Parameter(material_5)
watch_32 = Watch(parameter)
