# Dynamo graph Physical-Thermal.dyn (Dynamo 1.3.4.6666)

# group: Create material: Concrete (C30)
code_block = CodeBlock { "_Concrete"; }
create = Orchid.Revit.Materials.Material.Create(code_block)
material_aspect = MaterialAspectDD("Thermal")
thermal_type = ThermalTypeDD("Solid")
boolean = BoolSelector(true)
create_2 = Orchid.Revit.Materials.ThermalAsset.Create(code_block, thermal_type, boolean)
code_block_2 = CodeBlock()
# ---------- code_block_2.designscript (6 lines) ----------
"Concrete f'c=30 MPa";
"structural,concrete,CC:BS 8110";
"thermal,solid";
"Concrete";
"Orchid generated";
"https://github.com/erfajo/OrchidForDynamo";
# ----------------------------------------
setInformation = Orchid.Revit.Materials.ThermalAsset.SetInformation(create_2, code_block_2.out0, code_block_2.out2, code_block_2.out3, code_block_2.out4, code_block_2.out5)
boolean_2 = BoolSelector(false)
asset_behavior = AssetBehaviorDD("Isotropic")
code_block_3 = CodeBlock { 1.046; 0.657; 2300; 0.95; 182.4; 0.01; 0; 2000000; }
setProperties = Orchid.Revit.Materials.ThermalAsset.SetProperties(setInformation, boolean_2, asset_behavior, code_block_3.out0, code_block_3.out1, code_block_3.out2, code_block_3.out3, code_block_3.out4, code_block_3.out5, code_block_3.out6, code_block_3.out7)
setAsset = Orchid.Revit.Materials.Material.SetAsset(create, material_aspect, setProperties)
name = Material.Name(setAsset)
watch = Watch(name)
watch_2 = Watch(setAsset)
material_aspect_2 = MaterialAspectDD("Physical (Structural)")
physical_type = PhysicalTypeDD("Concrete")
create_3 = Orchid.Revit.Materials.PhysicalAsset.Create(code_block, physical_type, boolean)
setInformation_2 = Orchid.Revit.Materials.PhysicalAsset.SetInformation(create_3, code_block_2.out0, code_block_2.out1, code_block_2.out3, code_block_2.out4, code_block_2.out5)
asset_behavior_2 = AssetBehaviorDD("Isotropic")
setBehavior = Orchid.Revit.Materials.PhysicalAsset.SetBehavior(setInformation_2, asset_behavior_2)
code_block_4 = CodeBlock { 0.00001; }
setBasicThermal = Orchid.Revit.Materials.PhysicalAsset.SetBasicThermal(setBehavior, code_block_4)
code_block_5 = CodeBlock { 20500; 0.2; 11200; 2406.45; }
setMechanical = Orchid.Revit.Materials.PhysicalAsset.SetMechanical(setBasicThermal, code_block_5.out0, code_block_5.out1, code_block_5.out2, code_block_5.out3)
code_block_6 = CodeBlock { 30.0; 1.0; }
boolean_3 = BoolSelector(false)
setConcrete = Orchid.Revit.Materials.PhysicalAsset.SetConcrete(setMechanical, code_block_6.out0, code_block_6.out1, boolean_3)
setAsset_2 = Orchid.Revit.Materials.Material.SetAsset(create, material_aspect_2, setConcrete)
name_2 = Material.Name(setAsset_2)
watch_3 = Watch(name_2)
watch_4 = Watch(setAsset_2)

# group: Create material: Oxygen
code_block_7 = CodeBlock { "_Oxygen"; }
create_4 = Orchid.Revit.Materials.Material.Create(code_block_7)
material_aspect_3 = MaterialAspectDD("Thermal")
thermal_type_2 = ThermalTypeDD("Gas")
boolean_4 = BoolSelector(true)
create_5 = Orchid.Revit.Materials.ThermalAsset.Create(code_block_7, thermal_type_2, boolean_4)
code_block_8 = CodeBlock()
# ---------- code_block_8.designscript (6 lines) ----------
"Oxygen, properties at atmospheric pressure";
"structural,gas";
"thermal,gas";
"Gas";
"Orchid generated";
"https://github.com/erfajo/OrchidForDynamo";
# ----------------------------------------
setInformation_3 = Orchid.Revit.Materials.ThermalAsset.SetInformation(create_5, code_block_8.out0, code_block_8.out2, code_block_8.out3, code_block_8.out4, code_block_8.out5)
code_block_9 = CodeBlock { 0.0242; 0.9118; 1.35; 0.01; 0; 1; }
setBasicThermal_2 = Orchid.Revit.Materials.ThermalAsset.SetBasicThermal(setInformation_3, code_block_9.out0, code_block_9.out1, code_block_9.out2, code_block_9.out3, code_block_9.out4, code_block_9.out5)
setAsset_3 = Orchid.Revit.Materials.Material.SetAsset(create_4, material_aspect_3, setBasicThermal_2)
watch_5 = Watch(setAsset_3)
name_3 = Material.Name(setAsset_3)
watch_6 = Watch(name_3)
material_aspect_4 = MaterialAspectDD("Physical (Structural)")
physical_type_2 = PhysicalTypeDD("Gas")
create_6 = Orchid.Revit.Materials.PhysicalAsset.Create(code_block_7, physical_type_2, boolean_4)
setInformation_4 = Orchid.Revit.Materials.PhysicalAsset.SetInformation(create_6, code_block_8.out0, code_block_8.out1, code_block_8.out3, code_block_8.out4, code_block_8.out5)
code_block_10 = CodeBlock { 500; }
setBasicThermal_3 = Orchid.Revit.Materials.PhysicalAsset.SetBasicThermal(setInformation_4, code_block_10)
code_block_11 = CodeBlock { 1.35; }
setMechanical_2 = Orchid.Revit.Materials.PhysicalAsset.SetMechanical(setBasicThermal_3, code_block_11)
setAsset_4 = Orchid.Revit.Materials.Material.SetAsset(create_4, material_aspect_4, setMechanical_2)
watch_7 = Watch(setAsset_4)
name_4 = Material.Name(setAsset_4)
watch_8 = Watch(name_4)

# group: Create material: Steel (S275)
code_block_12 = CodeBlock { "_Steel S275"; }
create_7 = Orchid.Revit.Materials.Material.Create(code_block_12)
material_aspect_5 = MaterialAspectDD("Physical (Structural)")
physical_type_3 = PhysicalTypeDD("Metal")
boolean_5 = BoolSelector(true)
create_8 = Orchid.Revit.Materials.PhysicalAsset.Create(code_block_12, physical_type_3, boolean_5)
code_block_13 = CodeBlock()
# ---------- code_block_13.designscript (6 lines) ----------
"Steel, S275 (EN 10025-2)";
"1.0044,structural,metal,CC:EN 10025";
"thermal,solid";
"Steel";
"Orchid generated";
"https://github.com/erfajo/OrchidForDynamo";
# ----------------------------------------
setInformation_5 = Orchid.Revit.Materials.PhysicalAsset.SetInformation(create_8, code_block_13.out0, code_block_13.out1, code_block_13.out3, code_block_13.out4, code_block_13.out5)
asset_behavior_3 = AssetBehaviorDD("Isotropic")
setBehavior_2 = Orchid.Revit.Materials.PhysicalAsset.SetBehavior(setInformation_5, asset_behavior_3)
code_block_14 = CodeBlock { 0.00001; }
setBasicThermal_4 = Orchid.Revit.Materials.PhysicalAsset.SetBasicThermal(setBehavior_2, code_block_14)
code_block_15 = CodeBlock { 205000; 0.3; 80000; 7850; }
setMechanical_3 = Orchid.Revit.Materials.PhysicalAsset.SetMechanical(setBasicThermal_4, code_block_15.out0, code_block_15.out1, code_block_15.out2, code_block_15.out3)
code_block_16 = CodeBlock { 275; 430; }
boolean_6 = BoolSelector(false)
setStrength = Orchid.Revit.Materials.PhysicalAsset.SetStrength(setMechanical_3, code_block_16.out0, code_block_16.out1, boolean_6)
setAsset_5 = Orchid.Revit.Materials.Material.SetAsset(create_7, material_aspect_5, setStrength)
name_5 = Material.Name(setAsset_5)
watch_9 = Watch(name_5)
watch_10 = Watch(setAsset_5)
material_aspect_6 = MaterialAspectDD("Thermal")
thermal_type_3 = ThermalTypeDD("Solid")
create_9 = Orchid.Revit.Materials.ThermalAsset.Create(code_block_12, thermal_type_3, boolean_5)
setInformation_6 = Orchid.Revit.Materials.ThermalAsset.SetInformation(create_9, code_block_13.out0, code_block_13.out2, code_block_13.out3, code_block_13.out4, code_block_13.out5)
boolean_7 = BoolSelector(false)
asset_behavior_4 = AssetBehaviorDD("Isotropic")
code_block_17 = CodeBlock { 45; 0.48; 7850; 0.4; 0; 0.01; 0; 0; }
setProperties_2 = Orchid.Revit.Materials.ThermalAsset.SetProperties(setInformation_6, boolean_7, asset_behavior_4, code_block_17.out0, code_block_17.out1, code_block_17.out2, code_block_17.out3, code_block_17.out4, code_block_17.out5, code_block_17.out6, code_block_17.out7)
setAsset_6 = Orchid.Revit.Materials.Material.SetAsset(create_7, material_aspect_6, setProperties_2)
name_6 = Material.Name(setAsset_6)
watch_11 = Watch(name_6)
watch_12 = Watch(setAsset_6)

# group: Create material: Timber (C24)
code_block_18 = CodeBlock { "_Timber C24"; }
create_10 = Orchid.Revit.Materials.Material.Create(code_block_18)
material_aspect_7 = MaterialAspectDD("Physical (Structural)")
physical_type_4 = PhysicalTypeDD("Wood")
boolean_8 = BoolSelector(true)
create_11 = Orchid.Revit.Materials.PhysicalAsset.Create(code_block_18, physical_type_4, boolean_8)
code_block_19 = CodeBlock()
# ---------- code_block_19.designscript (6 lines) ----------
"Strength Class C24 Timber";
"Eurocode,Structural,structural,wood,CC:EN 338";
"Wood,thermal,solid";
"Wood";
"Orchid generated";
"https://github.com/erfajo/OrchidForDynamo";
# ----------------------------------------
setInformation_7 = Orchid.Revit.Materials.PhysicalAsset.SetInformation(create_11, code_block_19.out0, code_block_19.out1, code_block_19.out3, code_block_19.out4, code_block_19.out5)
asset_behavior_5 = AssetBehaviorDD("Orthotropic")
setBehavior_3 = Orchid.Revit.Materials.PhysicalAsset.SetBehavior(setInformation_7, asset_behavior_5)
code_block_20 = CodeBlock { 0.00004; }
setBasicThermal_5 = Orchid.Revit.Materials.PhysicalAsset.SetBasicThermal(setBehavior_3, code_block_20)
code_block_21 = CodeBlock { 11000; 0.38; 690; 420; }
setMechanical_4 = Orchid.Revit.Materials.PhysicalAsset.SetMechanical(setBasicThermal_5, code_block_21.out0, code_block_21.out1, code_block_21.out2, code_block_21.out3)
code_block_22 = CodeBlock { "Multiple"; "C24"; 24; 21; 2.5; 4; 14; 0.5; 11000; }
wood_construction = WoodConstructionDD("Natural")
setStrengthExtended = Orchid.Revit.Materials.PhysicalAsset.SetStrengthExtended(setMechanical_4, code_block_22.out0, code_block_22.out1, code_block_22.out2, code_block_22.out3, code_block_22.out4, code_block_22.out5, code_block_22.out6, code_block_22.out7, code_block_22.out8, wood_construction)
setAsset_7 = Orchid.Revit.Materials.Material.SetAsset(create_10, material_aspect_7, setStrengthExtended)
name_7 = Material.Name(setAsset_7)
watch_13 = Watch(name_7)
watch_14 = Watch(setAsset_7)
material_aspect_8 = MaterialAspectDD("Thermal")
thermal_type_4 = ThermalTypeDD("Solid")
create_12 = Orchid.Revit.Materials.ThermalAsset.Create(code_block_18, thermal_type_4, boolean_8)
setInformation_8 = Orchid.Revit.Materials.ThermalAsset.SetInformation(create_12, code_block_19.out0, code_block_19.out2, code_block_19.out3, code_block_19.out4, code_block_19.out5)
boolean_9 = BoolSelector(false)
asset_behavior_6 = AssetBehaviorDD("Isotropic")
code_block_23 = CodeBlock { 0.12; 0.19; 496; 0.85; 0; 0.01; 0; 10000000; }
setProperties_3 = Orchid.Revit.Materials.ThermalAsset.SetProperties(setInformation_8, boolean_9, asset_behavior_6, code_block_23.out0, code_block_23.out1, code_block_23.out2, code_block_23.out3, code_block_23.out4, code_block_23.out5, code_block_23.out6, code_block_23.out7)
setAsset_8 = Orchid.Revit.Materials.Material.SetAsset(create_10, material_aspect_8, setProperties_3)
name_8 = Material.Name(setAsset_8)
watch_15 = Watch(name_8)
watch_16 = Watch(setAsset_8)

# group: Create material: Timber (C24) --> XYZ values for SetBasicThermal and SetMechanical
code_block_24 = CodeBlock { "_Timber C24 (XYZ)"; }
create_13 = Orchid.Revit.Materials.Material.Create(code_block_24)
material_aspect_9 = MaterialAspectDD("Thermal")
thermal_type_5 = ThermalTypeDD("Solid")
boolean_10 = BoolSelector(true)
create_14 = Orchid.Revit.Materials.ThermalAsset.Create(code_block_24, thermal_type_5, boolean_10)
code_block_25 = CodeBlock()  # same code as code_block_19
setInformation_9 = Orchid.Revit.Materials.ThermalAsset.SetInformation(create_14, code_block_25.out0, code_block_25.out2, code_block_25.out3, code_block_25.out4, code_block_25.out5)
boolean_11 = BoolSelector(false)
asset_behavior_7 = AssetBehaviorDD("Isotropic")
code_block_26 = CodeBlock { 0.12; 0.19; 496; 0.85; 0; 0.01; 0; 10000000; }
setProperties_4 = Orchid.Revit.Materials.ThermalAsset.SetProperties(setInformation_9, boolean_11, asset_behavior_7, code_block_26.out0, code_block_26.out1, code_block_26.out2, code_block_26.out3, code_block_26.out4, code_block_26.out5, code_block_26.out6, code_block_26.out7)
setAsset_9 = Orchid.Revit.Materials.Material.SetAsset(create_13, material_aspect_9, setProperties_4)
watch_17 = Watch(setAsset_9)
name_9 = Material.Name(setAsset_9)
watch_18 = Watch(name_9)
material_aspect_10 = MaterialAspectDD("Physical (Structural)")
physical_type_5 = PhysicalTypeDD("Wood")
create_15 = Orchid.Revit.Materials.PhysicalAsset.Create(code_block_24, physical_type_5, boolean_10)
setInformation_10 = Orchid.Revit.Materials.PhysicalAsset.SetInformation(create_15, code_block_25.out0, code_block_25.out1, code_block_25.out3, code_block_25.out4, code_block_25.out5)
asset_behavior_8 = AssetBehaviorDD("Orthotropic")
setBehavior_4 = Orchid.Revit.Materials.PhysicalAsset.SetBehavior(setInformation_10, asset_behavior_8)
code_block_27 = CodeBlock { 0.0001; 0.0002; 0.0003; }
XYZ = Orchid.Revit.Core.Object.XYZ(code_block_27.out0, code_block_27.out1, code_block_27.out2)
setBasicThermalByXYZ = Orchid.Revit.Materials.PhysicalAsset.SetBasicThermalByXYZ(setBehavior_4, XYZ)
code_block_28 = CodeBlock()
# ---------- code_block_28.designscript (4 lines) ----------
Orchid.Revit.Object.XYZ(10000,11000,12000);
Orchid.Revit.Object.XYZ(0.3,0.35,0.4);
Orchid.Revit.Object.XYZ(650,700,750);
420;
# ----------------------------------------
setMechanicalByXYZ = Orchid.Revit.Materials.PhysicalAsset.SetMechanicalByXYZ(setBasicThermalByXYZ, code_block_28.out0, code_block_28.out1, code_block_28.out2, code_block_28.out3)
code_block_29 = CodeBlock { "Multiple"; "C24"; 24; 21; 2.5; 4; 14; 0.5; 11000; }
wood_construction_2 = WoodConstructionDD("Natural")
setStrengthExtended_2 = Orchid.Revit.Materials.PhysicalAsset.SetStrengthExtended(setMechanicalByXYZ, code_block_29.out0, code_block_29.out1, code_block_29.out2, code_block_29.out3, code_block_29.out4, code_block_29.out5, code_block_29.out6, code_block_29.out7, code_block_29.out8, wood_construction_2)
setAsset_10 = Orchid.Revit.Materials.Material.SetAsset(create_13, material_aspect_10, setStrengthExtended_2)
watch_19 = Watch(setAsset_10)
name_10 = Material.Name(setAsset_10)
watch_20 = Watch(name_10)

# group: All --> Physical Asset
all = Orchid.Revit.Materials.PhysicalAsset.All()
watch_21 = Watch(all)
name_11 = Element.Name(all)
watch_22 = Watch(name_11)

# group: All --> Thermal Asset
all_2 = Orchid.Revit.Materials.ThermalAsset.All()
watch_23 = Watch(all_2)
name_12 = Element.Name(all_2)
watch_24 = Watch(name_12)

# group: Duplicate --> Physical Asset
physical_propertyset = PhysicalPropertySetDD("Brick - Common 1800kg")
code_block_30 = CodeBlock { "_xx (physical)"; }
duplicate = Orchid.Revit.Materials.PhysicalAsset.Duplicate(physical_propertyset, code_block_30)
watch_25 = Watch(duplicate)

# group: Duplicate --> Thermal Asset
thermal_propertyset = ThermalPropertySetDD("Brick - Common")
code_block_31 = CodeBlock { "_xx (thermal)"; }
duplicate_2 = Orchid.Revit.Materials.ThermalAsset.Duplicate(thermal_propertyset, code_block_31)
watch_26 = Watch(duplicate_2)

getInformation = Orchid.Revit.Materials.ThermalAsset.GetInformation(setInformation_3)
watch_27 = Watch(getInformation.out2)
watch_28 = Watch(getInformation.out1)
watch_29 = Watch(getInformation.out0)
watch_30 = Watch(getInformation.out3)
watch_31 = Watch(getInformation.out4)
getBasicThermal = Orchid.Revit.Materials.ThermalAsset.GetBasicThermal(setBasicThermal_2)
watch_32 = Watch(getBasicThermal.out2)
watch_33 = Watch(getBasicThermal.out3)
watch_34 = Watch(getBasicThermal.out4)
watch_35 = Watch(getBasicThermal.out1)
watch_36 = Watch(getBasicThermal.out0)
watch_37 = Watch(getBasicThermal.out5)
getExpansionCoefficient = Orchid.Revit.Materials.PhysicalAsset.GetExpansionCoefficient(setBasicThermal_3)
watch_38 = Watch(getExpansionCoefficient.out2)
watch_39 = Watch(getExpansionCoefficient.out3)
watch_40 = Watch(getExpansionCoefficient.out4)
watch_41 = Watch(getExpansionCoefficient.out1)
watch_42 = Watch(getExpansionCoefficient.out5)
watch_43 = Watch(getExpansionCoefficient.out0)
getInformation_2 = Orchid.Revit.Materials.PhysicalAsset.GetInformation(setInformation_4)
watch_44 = Watch(getInformation_2.out1)
watch_45 = Watch(getInformation_2.out0)
watch_46 = Watch(getInformation_2.out2)
watch_47 = Watch(getInformation_2.out3)
watch_48 = Watch(getInformation_2.out4)
getDensity = Orchid.Revit.Materials.PhysicalAsset.GetDensity(setMechanical_2)
watch_49 = Watch(getDensity)
getInformation_3 = Orchid.Revit.Materials.ThermalAsset.GetInformation(setInformation)
watch_50 = Watch(getInformation_3.out4)
watch_51 = Watch(getInformation_3.out3)
watch_52 = Watch(getInformation_3.out2)
watch_53 = Watch(getInformation_3.out1)
watch_54 = Watch(getInformation_3.out0)
getInformation_4 = Orchid.Revit.Materials.PhysicalAsset.GetInformation(setInformation_2)
watch_55 = Watch(getInformation_4.out1)
watch_56 = Watch(getInformation_4.out2)
watch_57 = Watch(getInformation_4.out3)
watch_58 = Watch(getInformation_4.out4)
watch_59 = Watch(getInformation_4.out0)
getYoungModulus = Orchid.Revit.Materials.PhysicalAsset.GetYoungModulus(setMechanical)
watch_60 = Watch(getYoungModulus.out1)
watch_61 = Watch(getYoungModulus.out2)
watch_62 = Watch(getYoungModulus.out0)
watch_63 = Watch(getYoungModulus.out3)
watch_64 = Watch(getYoungModulus.out4)
getPoissonRatio = Orchid.Revit.Materials.PhysicalAsset.GetPoissonRatio(setMechanical)
watch_65 = Watch(getPoissonRatio.out1)
watch_66 = Watch(getPoissonRatio.out2)
watch_67 = Watch(getPoissonRatio.out0)
watch_68 = Watch(getPoissonRatio.out3)
watch_69 = Watch(getPoissonRatio.out4)
getShearModulus = Orchid.Revit.Materials.PhysicalAsset.GetShearModulus(setMechanical)
watch_70 = Watch(getShearModulus.out1)
watch_71 = Watch(getShearModulus.out2)
watch_72 = Watch(getShearModulus.out0)
watch_73 = Watch(getShearModulus.out3)
watch_74 = Watch(getShearModulus.out4)
getConcrete = Orchid.Revit.Materials.PhysicalAsset.GetConcrete(setConcrete)
watch_75 = Watch(getConcrete.out1)
watch_76 = Watch(getConcrete.out2)
watch_77 = Watch(getConcrete.out0)
watch_78 = Watch(getYoungModulus.out5)
watch_79 = Watch(getPoissonRatio.out5)
getExpansionCoefficient_2 = Orchid.Revit.Materials.PhysicalAsset.GetExpansionCoefficient(setBasicThermal)
watch_80 = Watch(getExpansionCoefficient_2.out1)
watch_81 = Watch(getExpansionCoefficient_2.out2)
watch_82 = Watch(getExpansionCoefficient_2.out0)
watch_83 = Watch(getExpansionCoefficient_2.out3)
watch_84 = Watch(getExpansionCoefficient_2.out4)
watch_85 = Watch(getExpansionCoefficient_2.out5)
getBehavior = Orchid.Revit.Materials.PhysicalAsset.GetBehavior(setBehavior)
watch_86 = Watch(getBehavior)
getInformation_5 = Orchid.Revit.Materials.PhysicalAsset.GetInformation(setInformation_10)
watch_87 = Watch(getInformation_5.out2)
watch_88 = Watch(getInformation_5.out3)
watch_89 = Watch(getInformation_5.out4)
getYoungModulus_2 = Orchid.Revit.Materials.PhysicalAsset.GetYoungModulus(setMechanicalByXYZ)
watch_90 = Watch(getYoungModulus_2.out2)
watch_91 = Watch(getYoungModulus_2.out3)
watch_92 = Watch(getYoungModulus_2.out4)
getPoissonRatio_2 = Orchid.Revit.Materials.PhysicalAsset.GetPoissonRatio(setMechanicalByXYZ)
watch_93 = Watch(getPoissonRatio_2.out1)
watch_94 = Watch(getPoissonRatio_2.out2)
watch_95 = Watch(getPoissonRatio_2.out3)
watch_96 = Watch(getPoissonRatio_2.out4)
getShearModulus_2 = Orchid.Revit.Materials.PhysicalAsset.GetShearModulus(setMechanicalByXYZ)
watch_97 = Watch(getShearModulus_2.out1)
watch_98 = Watch(getShearModulus_2.out2)
watch_99 = Watch(getShearModulus_2.out0)
watch_100 = Watch(getShearModulus_2.out3)
watch_101 = Watch(getShearModulus_2.out4)
watch_102 = Watch(getYoungModulus_2.out5)
watch_103 = Watch(getPoissonRatio_2.out5)
getExpansionCoefficient_3 = Orchid.Revit.Materials.PhysicalAsset.GetExpansionCoefficient(setBasicThermalByXYZ)
watch_104 = Watch(getExpansionCoefficient_3.out1)
watch_105 = Watch(getExpansionCoefficient_3.out2)
watch_106 = Watch(getExpansionCoefficient_3.out3)
watch_107 = Watch(getExpansionCoefficient_3.out4)
watch_108 = Watch(getExpansionCoefficient_3.out5)
getBehavior_2 = Orchid.Revit.Materials.PhysicalAsset.GetBehavior(setBehavior_4)
watch_109 = Watch(getBehavior_2)
watch_110 = Watch(getInformation_5.out1)
watch_111 = Watch(getInformation_5.out0)
watch_112 = Watch(getPoissonRatio_2.out0)
watch_113 = Watch(getYoungModulus_2.out1)
watch_114 = Watch(getYoungModulus_2.out0)
watch_115 = Watch(getExpansionCoefficient_3.out0)
getInformation_6 = Orchid.Revit.Materials.ThermalAsset.GetInformation(setInformation_9)
watch_116 = Watch(getInformation_6.out4)
watch_117 = Watch(getInformation_6.out3)
watch_118 = Watch(getInformation_6.out2)
watch_119 = Watch(getInformation_6.out1)
watch_120 = Watch(getInformation_6.out0)
getProperties = Orchid.Revit.Materials.ThermalAsset.GetProperties(setProperties_4)
watch_121 = Watch(getProperties.out5)
watch_122 = Watch(getProperties.out4)
watch_123 = Watch(getProperties.out3)
watch_124 = Watch(getProperties.out2)
watch_125 = Watch(getProperties.out1)
watch_126 = Watch(getProperties.out0)
watch_127 = Watch(getProperties.out9)
watch_128 = Watch(getProperties.out8)
watch_129 = Watch(getProperties.out7)
watch_130 = Watch(getProperties.out6)
getStrengthExtended = Orchid.Revit.Materials.PhysicalAsset.GetStrengthExtended(setStrengthExtended_2)
watch_131 = Watch(getStrengthExtended.out5)
watch_132 = Watch(getStrengthExtended.out6)
watch_133 = Watch(getStrengthExtended.out7)
watch_134 = Watch(getStrengthExtended.out4)
watch_135 = Watch(getStrengthExtended.out3)
watch_136 = Watch(getStrengthExtended.out8)
watch_137 = Watch(getStrengthExtended.out9)
watch_138 = Watch(getStrengthExtended.out0)
watch_139 = Watch(getStrengthExtended.out1)
watch_140 = Watch(getStrengthExtended.out2)
getStrength = Orchid.Revit.Materials.PhysicalAsset.GetStrength(setStrength)
watch_141 = Watch(getStrength.out2)
watch_142 = Watch(getStrength.out1)
watch_143 = Watch(getStrength.out0)
getShearModulus_3 = Orchid.Revit.Materials.PhysicalAsset.GetShearModulus(setMechanical_3)
watch_144 = Watch(getShearModulus_3.out1)
watch_145 = Watch(getShearModulus_3.out2)
watch_146 = Watch(getShearModulus_3.out0)
getPoissonRatio_3 = Orchid.Revit.Materials.PhysicalAsset.GetPoissonRatio(setMechanical_3)
watch_147 = Watch(getPoissonRatio_3.out1)
watch_148 = Watch(getPoissonRatio_3.out2)
watch_149 = Watch(getPoissonRatio_3.out0)
watch_150 = Watch(getShearModulus_3.out3)
watch_151 = Watch(getShearModulus_3.out4)
watch_152 = Watch(getPoissonRatio_3.out3)
watch_153 = Watch(getPoissonRatio_3.out4)
getYoungModulus_3 = Orchid.Revit.Materials.PhysicalAsset.GetYoungModulus(setMechanical_3)
watch_154 = Watch(getYoungModulus_3.out2)
watch_155 = Watch(getYoungModulus_3.out3)
watch_156 = Watch(getYoungModulus_3.out4)
watch_157 = Watch(getYoungModulus_3.out1)
watch_158 = Watch(getYoungModulus_3.out0)
watch_159 = Watch(getPoissonRatio_3.out5)
watch_160 = Watch(getYoungModulus_3.out5)
getExpansionCoefficient_4 = Orchid.Revit.Materials.PhysicalAsset.GetExpansionCoefficient(setBasicThermal_4)
watch_161 = Watch(getExpansionCoefficient_4.out1)
watch_162 = Watch(getExpansionCoefficient_4.out2)
watch_163 = Watch(getExpansionCoefficient_4.out3)
watch_164 = Watch(getExpansionCoefficient_4.out4)
watch_165 = Watch(getExpansionCoefficient_4.out5)
watch_166 = Watch(getExpansionCoefficient_4.out0)
getInformation_7 = Orchid.Revit.Materials.PhysicalAsset.GetInformation(setInformation_5)
watch_167 = Watch(getInformation_7.out2)
watch_168 = Watch(getInformation_7.out3)
watch_169 = Watch(getInformation_7.out4)
getBehavior_3 = Orchid.Revit.Materials.PhysicalAsset.GetBehavior(setBehavior_2)
watch_170 = Watch(getBehavior_3)
watch_171 = Watch(getInformation_7.out1)
watch_172 = Watch(getInformation_7.out0)
getInformation_8 = Orchid.Revit.Materials.ThermalAsset.GetInformation(setInformation_6)
watch_173 = Watch(getInformation_8.out4)
watch_174 = Watch(getInformation_8.out3)
watch_175 = Watch(getInformation_8.out2)
watch_176 = Watch(getInformation_8.out1)
watch_177 = Watch(getInformation_8.out0)
getProperties_2 = Orchid.Revit.Materials.ThermalAsset.GetProperties(setProperties_2)
watch_178 = Watch(getProperties_2.out2)
watch_179 = Watch(getProperties_2.out3)
watch_180 = Watch(getProperties_2.out4)
watch_181 = Watch(getProperties_2.out1)
watch_182 = Watch(getProperties_2.out0)
watch_183 = Watch(getProperties_2.out9)
watch_184 = Watch(getProperties_2.out8)
watch_185 = Watch(getProperties_2.out7)
watch_186 = Watch(getProperties_2.out6)
watch_187 = Watch(getProperties_2.out5)
getProperties_3 = Orchid.Revit.Materials.ThermalAsset.GetProperties(setProperties)
watch_188 = Watch(getProperties_3.out2)
watch_189 = Watch(getProperties_3.out3)
watch_190 = Watch(getProperties_3.out4)
watch_191 = Watch(getProperties_3.out1)
watch_192 = Watch(getProperties_3.out0)
watch_193 = Watch(getProperties_3.out9)
watch_194 = Watch(getProperties_3.out8)
watch_195 = Watch(getProperties_3.out7)
watch_196 = Watch(getProperties_3.out6)
watch_197 = Watch(getProperties_3.out5)
