# Dynamo graph Info-Clipboard.dyn (Dynamo 2.1.0.7500)

# group: Current document Info and copy to clipboard
info = Orchid.RevitProject.Document.Info()
copyTo = Orchid.Core.Clipboard.CopyTo(element=info)  # frozen

watch = Watch(info)

# group: File Info and copy to clipboard
path_and_filename = CodeBlock { cur = Orchid.Core.Directory.Current; cur + "\\testSet"; }
contents = Orchid.Core.Directory.Contents(directory=path_and_filename.out1)
info_2 = Orchid.Core.File.Info(file=contents)
copyTo_2 = Orchid.Core.Clipboard.CopyTo(element=info_2)

watch_2 = Watch(info_2)
watch_3 = Watch(copyTo_2)
watch_4 = Watch(copyTo)

# group: Clipboard --> copy int
code_block = CodeBlock { 1..5; }
watch_5 = Watch(code_block)
copyTo_3 = Orchid.Core.Clipboard.CopyTo(element=code_block)  # frozen

# group: Clipboard --> copy element
elementHasMaterial = Orchid.RevitProject.Elements.Selection.ElementHasMaterial()
watch_6 = Watch(elementHasMaterial.Element)
copyTo_4 = Orchid.Core.Clipboard.CopyTo(element=elementHasMaterial.Element)  # frozen
