# Dynamo graph Print.dyn (Dynamo 2.1.0.7500)

code_block = CodeBlock()
# ---------- code_block.designscript (7 lines) ----------
"Adobe PDF";
"Microsoft Print to PDF";
"Microsoft XPS Document Writer";

//Hidden built-in printer
//not supported at the moment!
"Revit DWF Exporter";
# ----------------------------------------
string = StringInput("Default")  # graph input
code_block_2 = CodeBlock { 100; }
printer = Printer("Microsoft Print to PDF")  # graph input
string_2 = StringInput("testSetting")  # graph input
print_papersizes = PaperSizes("A3", p=printer)
print_pageorientation = PageOrientation("Portrait")  # graph input
print_margintype = MarginType("User defined")  # graph input
code_block_3 = CodeBlock { [10,10]; }
changeSetting = Orchid.Core.Print.ChangeSetting(printer=printer, printSetting=string_2, paperZize=print_papersizes, pageOrientation=print_pageorientation, marginType=print_margintype, margin=code_block_3)
printer_2 = Printer("Microsoft Print to PDF")  # graph input
view_sheet_set = ViewSheetSet("A3 set")  # graph input
getView = Orchid.RevitProject.Views.ViewSheetSet.GetView(viewSheetSet=view_sheet_set)

# group: filePath --> file name incl. path
current = Orchid.Core.Directory.Current()
string_3 = StringInput("testSet")  # graph input
sheetNumber = Sheet.SheetNumber(sheet=getView)
code_block_4 = CodeBlock(a=current, b=string_3, c=sheetNumber)
# ---------- code_block_4.designscript (3 lines) ----------
a + "\\" +
b + "\\" +
c;
# ----------------------------------------

# note: Print Setting may be set
# both as an element and
# as a string
print_setting = Setting("Default")  # graph input
byViewSheetSet = Orchid.Core.Print.ByViewSheetSet(printer=printer_2, filePath=code_block_4, viewSheetSet=view_sheet_set, printSetting=print_setting)
boolean = BoolSelector(true)  # graph input
boolean_2 = BoolSelector(true)  # graph input
byView = Orchid.Core.Print.ByView(printer=printer_2, combine=boolean, file=boolean_2, filePath=code_block_4, view=getView, printSetting=print_setting)
# note: Set to "Select" to print the selected views
print_range = Range("Selected views/sheets")  # graph input

# group: Remove print setting
print_setting_2 = Setting("Default")  # graph input
# note: Print Setting may be set
# both as an element and
# as a string
string_4 = StringInput("testSetting")  # graph input
deleteSetting = Orchid.Core.Print.DeleteSetting(printSetting=string_4)  # frozen

print_zoomtype = ZoomType("Zoom")  # graph input
print_paperplacement = PaperPlacement("Offset from corner")  # graph input
createSetting = Orchid.Core.Print.CreateSetting(printer=printer, name=string_2)

# group: Print current view (center and fit to page)
printer_3 = Printer("Microsoft Print to PDF")  # graph input
string_5 = StringInput("testSetting")  # graph input
print_papersizes_2 = PaperSizes("A3", p=printer_3)
print_paperplacement_2 = PaperPlacement("Center")  # graph input
print_zoomtype_2 = ZoomType("Fit To Page")  # graph input
createSetting_2 = Orchid.Core.Print.CreateSetting(printer=printer_3, name=string_5, paperZize=print_papersizes_2, paperPlacement=print_paperplacement_2, zoomType=print_zoomtype_2)
print_range_2 = Range("Current window")  # graph input
activeView = Orchid.RevitProject.Document.ActiveView()
byView_2 = Orchid.Core.Print.ByView(printer=printer_3, printRange=print_range_2, view=activeView, printSetting=createSetting_2)
# note: if print options there are rarely set need to be included, then connect:
# "Print.SetOptions" output Printsetting to "Print.ByView" input printSetting!
await_ = Orchid.Core.DataStream.Await(pass=createSetting_2, waitFor=byView_2)
deleteSetting_2 = Orchid.Core.Print.DeleteSetting(printSetting=await_)

# group: ViewSheetSet
categories = Categories("OST_Sheets")  # graph input; frozen
all_elements_of_category = ElementsOfCategory(Category=categories)
string_6 = StringInput("testSet")  # graph input
create = Orchid.RevitProject.Views.ViewSheetSet.Create(view=all_elements_of_category, name=string_6)
getView_2 = Orchid.RevitProject.Views.ViewSheetSet.GetView(viewSheetSet=create)
view_sheet_set_2 = ViewSheetSet("A3 set")  # graph input
change = Orchid.RevitProject.Views.ViewSheetSet.Change(view=getView_2, viewSheetSet=view_sheet_set_2)
delete = Orchid.RevitProject.Views.ViewSheetSet.Delete(viewSheetSet=create)

# group: Print options there are rarely set
boolean_3 = BoolSelector(true)  # graph input
boolean_4 = BoolSelector(false)  # graph input
print_hiddenlineviews = HiddenLineViewsType("Vector Processing")  # graph input
print_rasterquality = RasterQualityType("Medium")  # graph input
print_colordepth = ColorDepthType("Gray Scale")  # graph input
setOptions = Orchid.Core.Print.SetOptions(printSetting=createSetting_2, viewLinksinBlue=boolean_3, hideReforWorkPlanes=boolean_4, hideUnreferencedViewTags=boolean_3, maskCoincidentLines=boolean_3, hideScopeBoxes=boolean_4, hideCropBoundaries=boolean_4, replaceHalftoneWithThinLines=boolean_3, hiddenLineViews=print_hiddenlineviews, rasterQuality=print_rasterquality, colorDepth=print_colordepth)  # frozen

# group: Merge PDF files
code_block_5 = CodeBlock()
# ---------- code_block_5.designscript (6 lines) ----------
//input documents
["%userprofile%\\Downloads\\PDF\\pdf1.pdf",
"%userprofile%\\Downloads\\PDF\\pdf2.pdf"];

//output file path
"%userprofile%\\Downloads\\PDF\\result.pdf";
# ----------------------------------------
mergePDF = Orchid.Core.Print.MergePDF(documents=code_block_5.out0, filePath=code_block_5.out1)  # frozen
