# Dynamo graph Timer.dyn (Dynamo 2.0.3.8810)

# group: Important! Place DateTime.Now in upper left corner of the graph to get the correct time elapsed
code_block = CodeBlock { 1..80000; }
now = DateTime.Now()
timer = Orchid.Core.DataStream.Timer(pass=code_block, dateTime=now)
mul = timer.pass * timer.pass
timer_2 = Orchid.Core.DataStream.Timer(pass=mul, dateTime=timer.DateTime)
totalMilliseconds = TimeSpan.TotalMilliseconds(timeSpan=timer_2.TimeSpan)
watch = Watch(totalMilliseconds)
totalSeconds = TimeSpan.TotalSeconds(timeSpan=timer_2.TimeSpan)
watch_2 = Watch(totalSeconds)
