# Dynamo graph Delete.dyn (Dynamo 2.1.0.7500)

categories = Categories("OST_Windows")  # graph input
all_elements_of_category = ElementsOfCategory(Category=categories)
categories_2 = Categories("OST_Doors")  # graph input
all_elements_of_category_2 = ElementsOfCategory(Category=categories_2)
categories_3 = Categories("OST_StructuralColumns")  # graph input
all_elements_of_category_3 = ElementsOfCategory(Category=categories_3)
code_block = CodeBlock(windows=all_elements_of_category, doors=all_elements_of_category_2, columns=all_elements_of_category_3)
# ---------- code_block.designscript (3 lines) ----------
[windows,
[doors,
[columns]]];
# ----------------------------------------
categories_4 = Categories("OST_Walls")  # graph input
all_elements_of_category_4 = ElementsOfCategory(Category=categories_4)
code_block_2 = CodeBlock(windows=all_elements_of_category, doors=all_elements_of_category_2, walls=all_elements_of_category_4)
# ---------- code_block_2.designscript (3 lines) ----------
[windows,
[doors,
[walls]]];
# ----------------------------------------
delete = Orchid.RevitProject.Elements.Element.Delete(element=code_block_2)
watch = Watch(delete)
code_block_3 = CodeBlock { Orchid.RevitProject.Elements.Element.Delete(element); }  # frozen
delete_2 = Orchid.RevitProject.Elements.Element.Delete(element=code_block_2)  # frozen
