# Dynamo graph Delete_beta.dyn "Delete_13_Beta" (Dynamo 2.0.3.8810)

categories = Categories(index=619)  # graph input
all_elements_of_category = ElementsOfCategory(Category=categories)
categories_2 = Categories(index=159)  # graph input
all_elements_of_category_2 = ElementsOfCategory(Category=categories_2)
categories_3 = Categories(index=506)  # graph input
all_elements_of_category_3 = ElementsOfCategory(Category=categories_3)
code_block = CodeBlock(windows=all_elements_of_category, doors=all_elements_of_category_2, columns=all_elements_of_category_3)
# ---------- code_block.designscript (3 lines) ----------
[windows,
[doors,
[columns]]];
# ----------------------------------------
categories_4 = Categories(index=604)  # graph input
all_elements_of_category_4 = ElementsOfCategory(Category=categories_4)
code_block_2 = CodeBlock(windows=all_elements_of_category, doors=all_elements_of_category_2, walls=all_elements_of_category_4)
# ---------- code_block_2.designscript (3 lines) ----------
[windows,
[doors,
[walls]]];
# ----------------------------------------
delete = Orchid.RevitProject.Elements.Element.Delete(document=code_block_2)  # unwired: element
watch = Watch(delete)
code_block_3 = CodeBlock(element=code_block_2) { Orchid.RevitProject.Elements.Element.Delete(element); }  # frozen

# group: Open all files in directory and sub directories
string = StringInput(".\testSet")  # graph input
string_2 = StringInput("*.rvt")  # graph input
boolean = BoolSelector(false)  # graph input
contents = Orchid.Core.Directory.Contents(directory=string, searchString=string_2, deepSearch=boolean)  # frozen
backgroundOpen = Orchid.RevitProject.Common.Document.BackgroundOpen(file=contents)

delete_2 = Orchid.RevitProject.Elements.Element.Delete(document=backgroundOpen, element=code_block_2)

# group: Close files
await_ = Orchid.Core.DataStream.Await(pass=backgroundOpen, waitFor=delete_2)
boolean_2 = BoolSelector(true)  # graph input
close = Orchid.RevitProject.Common.Document.Close(document=await_, save=boolean_2)

uniqueId = Element.UniqueId(element=all_elements_of_category)
uniqueId_2 = Element.UniqueId(element=all_elements_of_category_2)
uniqueId_3 = Element.UniqueId(element=all_elements_of_category_3)
code_block_4 = CodeBlock(windows=uniqueId, doors=uniqueId_2, columns=uniqueId_3)  # same code as code_block
uniqueId_4 = Element.UniqueId(element=all_elements_of_category_4)
code_block_5 = CodeBlock(windows=uniqueId, doors=uniqueId_2, walls=uniqueId_4)  # same code as code_block_2
deleteByGuid = TestBed.RevitProject.Elements.Element.DeleteByGuid(guid=code_block_5)
delete_3 = Orchid.RevitProject.Elements.Element.Delete()  # unwired: element
