# Dynamo graph Elem+Fam.dyn (Dynamo 2.1.0.7500)

code_block = CodeBlock { ["Floors","Walls","Windows"]; }
elementByCategory = Orchid.RevitProject.Elements.Selection.ElementByCategory(category=code_block)
name = Element.Name(element=elementByCategory.Element)
watch = Watch(name)
familyName = Orchid.RevitProject.Elements.Element.FamilyName(element=elementByCategory.Element)
watch_2 = Watch(familyName)
elementType = Element.ElementType(element=elementByCategory.Element)
uniqueItems = List.UniqueItems(list=elementType@L2)
name_2 = Orchid.RevitProject.Elements.ElementType.Name(elementType=uniqueItems)
watch_3 = Watch(name_2)
familyName_2 = Orchid.RevitProject.Elements.ElementType.FamilyName(elementType=uniqueItems)
watch_4 = Watch(familyName_2)
info = Orchid.RevitProject.Elements.Element.Info(element=elementByCategory.Element)
watch_5 = Watch(info.Owner)
watch_6 = Watch(info.Creator)
watch_7 = Watch(info.LastChangedBy)
watch_8 = Watch(info.RequestedBy)

# group: Family
families = Families("Ext. Single-Flush")  # graph input
elementByFamily = Orchid.RevitProject.Elements.Selection.ElementByFamily(family=families)
watch_9 = Watch(elementByFamily)
