# Dynamo graph Elem+Fam_beta.dyn "Elem+Fam_20_Beta" (Dynamo 2.1.0.7500)

# group: Family
families = Families("Splash Screen")
all_elements_of_family = ElementsOfFamily(Family=families)
watch = Watch(all_elements_of_family)
watch_2 = Watch(families)
elementByFamily = TestBed.Revit.Elements.Selection.ElementByFamily(family=families)
watch_3 = Watch(elementByFamily)

# group: FamilyType
family_types = FamilyTypes("Ext. Single-Flush:9x21M")
family_types_2 = FamilyTypes("Fascia - Flat:25x250mm")
list_create = List.Create(item0=family_types, item1=family_types_2)
elementByFamilyType = TestBed.Revit.Elements.Selection.ElementByFamilyType(familyType=list_create)
watch_4 = Watch(elementByFamilyType)
watch_5 = Watch(list_create)
all_elements_of_family_type = ElementsOfFamilyType(Family_Type=list_create)
watch_6 = Watch(all_elements_of_family_type)
all_elements_of_family_type_2 = ElementsOfFamilyType(Family_Type=list_create)
watch_7 = Watch(all_elements_of_family_type_2)

code_block = CodeBlock { "Ext. Single-Flush"; }
byName = Family.ByName(name=code_block)

# group: Family based on FamilyType
flatten = List.Flatten(list=all_elements_of_family_type_2)
id = Element.Id(element=flatten)
sortByKey = List.SortByKey(list=flatten, keys=id)
watch_8 = Watch(sortByKey.sorted_list)
