# Dynamo graph Element-Category_beta.dyn "Element-Category_20_beta" (Dynamo 2.0.3.8810)

built_in_categories = CodeBlock()
# ---------- built_in_categories.designscript (26 lines) ----------
[
"OST_Casework",
"OST_Ceilings",
"OST_Columns",
"OST_CurtainWallMullions",
"OST_CurtainWallPanels",
"OST_CurtaSystem",
"OST_Doors",
"OST_Entourage",
"OST_Floors",
"OST_Furniture",
"OST_FurnitureSystems",
"OST_GenericModel",
"OST_PlumbingFixtures",
"OST_Ramps",
"OST_Roofs",
"OST_SpecialityEquipment",
"OST_Stairs",
"OST_StructuralColumns",
"OST_StructuralFoundation",
"OST_StructuralFraming",
"OST_StructuralFramingSystem",
"OST_StructuralStiffener",
"OST_Walls",
"OST_Windows"
];
# ----------------------------------------
natural_category_name = CodeBlock()
# ---------- natural_category_name.designscript (26 lines) ----------
[
"Casework",
"Ceilings",
"Columns",
"Curtain Wall Mullions",
"Curtain Panels",
"Curtain Systems",
"Doors",
"Entourage",
"Floors",
"Furniture",
"Furniture Systems",
"Generic Models",
"Plumbing Fixtures",
"Ramps",
"Roofs",
"Specialty Equipment",
"Stairs",
"Structural Columns",
"Structural Foundations",
"Structural Framing",
"Structural Beam Systems",
"Structural Stiffeners",
"Walls",
"Windows"
];
# ----------------------------------------

# group: Selection
elementByCategory = Orchid.RevitProject.Elements.Selection.ElementByCategory(category=natural_category_name)
watch = Watch(elementByCategory.Element)
elementHasMaterial = Orchid.RevitProject.Elements.Selection.ElementHasMaterial()
watch_2 = Watch(elementHasMaterial.Element)
watch_3 = Watch(elementHasMaterial.Category)
watch_4 = Watch(elementByCategory.Category)

# note: OOTB nodes
byName = Category.ByName(name=natural_category_name)
all_elements_of_category = ElementsOfCategory(Category=byName)
clean = Orchid.Core.List.Clean(list=all_elements_of_category)
watch_5 = Watch(clean)
code_block = CodeBlock()
# ---------- code_block.designscript (9 lines) ----------
"Model";
"Annotation";
"AnalyticalModel";
"Internal";

["Model",
"Annotation",
"AnalyticalModel",
"Internal"];
# ----------------------------------------

# group: Selection
elementByCategoryType = Orchid.RevitProject.Elements.Selection.ElementByCategoryType(categoryType=code_block.out0)
watch_6 = Watch(elementByCategoryType.Element)
watch_7 = Watch(elementByCategoryType.CategoryType)
watch_8 = Watch(elementByCategoryType.Category)

# group: Family
code_block_2 = CodeBlock()
# ---------- code_block_2.designscript (2 lines) ----------
["Doors",
"Windows"];
# ----------------------------------------
byCategory = Orchid.RevitProject.Elements.Family.ByCategory(category=code_block_2)  # frozen
watch_9 = Watch(byCategory)
all = Orchid.RevitProject.Elements.Family.All()  # frozen
watch_10 = Watch(all.Category)
watch_11 = Watch(all.Family)

# group: FamilyType
code_block_3 = CodeBlock()  # same code as code_block_2
byCategory_2 = Orchid.RevitProject.Elements.FamilyType.ByCategory(category=code_block_3)  # frozen
watch_12 = Watch(byCategory_2)
all_2 = Orchid.RevitProject.Elements.FamilyType.All()  # frozen
watch_13 = Watch(all_2.FamilyType)
watch_14 = Watch(all_2.Category)

# group: SubCategory
byCategory_3 = Orchid.RevitProject.Elements.SubCategory.ByCategory(category=natural_category_name)  # frozen
watch_15 = Watch(byCategory_3)
code_block_4 = CodeBlock(list=byCategory_3) { list[0][3]; }
string_from_object = FromObject(obj=code_block_4)
byName_2 = Orchid.RevitProject.Elements.SubCategory.ByName(name=string_from_object)
watch_16 = Watch(byName_2)

# group: SubCategory
code_block_5 = CodeBlock { "Casework"; "Cabinet"; "Test"; }  # frozen
byName_3 = Orchid.RevitProject.Elements.SubCategory.ByName(category=code_block_5.out0, name=code_block_5.out1)
watch_17 = Watch(byName_3)
create = Orchid.RevitProject.Elements.SubCategory.Create(category=code_block_5.out0, name=code_block_5.out2)
watch_18 = Watch(create)
remove = Orchid.RevitProject.Elements.SubCategory.Remove(category=code_block_5.out0, subCategory=create)
watch_19 = Watch(remove)

# group: Category --> InDocument
inDocument = Orchid.RevitProject.Elements.Category.InDocument()  # frozen
watch_20 = Watch(inDocument)

code_block_6 = CodeBlock()  # same code as code_block

# group: Category --> ByCategoryType
byCategoryType = Orchid.RevitProject.Elements.Category.ByCategoryType(categoryType=code_block_6.out0)  # frozen
watch_21 = Watch(byCategoryType)

# group: Category --> BuiltInCategory and CategoryType
builtInCategory = Orchid.RevitProject.Elements.Category.BuiltInCategory()  # frozen
watch_22 = Watch(builtInCategory)
categoryType = Orchid.RevitProject.Elements.Category.CategoryType(category=builtInCategory)
groupByKey = List.GroupByKey(list=builtInCategory, keys=categoryType)
watch_23 = Watch(groupByKey.groups)
watch_24 = Watch(groupByKey.unique_keys)
watch_25 = Watch(categoryType)

modelElement = TestBed.RevitProject.Elements.Selection.ModelElement()
watch_26 = Watch(modelElement.Element)
physicalElement = TestBed.RevitProject.Elements.Selection.PhysicalElement()
watch_27 = Watch(physicalElement.Element)
watch_28 = Watch(modelElement.Category)
watch_29 = Watch(physicalElement.Category)
code_block_7 = CodeBlock { "Walls"; }
byName_4 = Category.ByName(name=code_block_7)
