# Dynamo graph Family.Save.dyn (Dynamo 2.0.3.8810)

# group: selected families by category in project
natural_category_name = CodeBlock()
# ---------- natural_category_name.designscript (12 lines) ----------
[
"Casework",
"Columns",
"Doors",
"Windows",
"Specialty Equipment",
"Structural Columns",
"Structural Foundations",
"Structural Framing",
"Structural Beam Systems",
"Structural Stiffeners"
];
# ----------------------------------------
elementByCategory = Orchid.RevitProject.Elements.Selection.ElementByCategory(category=natural_category_name)
type = archilab.Revit.Elements.Elements.Type(element=elementByCategory.Element)
uniqueItems = List.UniqueItems(list=type, lacing=Longest)
flatten = List.Flatten(list=uniqueItems)
family = FamilyType.Family(familyType=flatten)
string = StringInput(".\testSet")  # graph input
boolean = BoolSelector(true)  # graph input
save = Orchid.RevitProject.Elements.Family.Save(family=family, path=string, subfolder=boolean)

watch = Watch(save)
