# Dynamo graph File+Fam-LoadFamily.dyn (Dynamo 2.0.3.8810)

# group: Open all family files in directory and sub directories
string = StringInput("..\testSet")  # graph input
code_block = CodeBlock { "*.rfa"; }
boolean = BoolSelector(false)  # graph input
contents = Orchid.Core.Directory.Contents(directory=string, searchString=code_block, deepSearch=boolean)
loadFamily = Orchid.Core.File.LoadFamily(family=contents)

# group: Open all project files in directory
string_2 = StringInput("..\testSet")  # graph input
code_block_2 = CodeBlock { "*.rvt"; }
contents_2 = Orchid.Core.Directory.Contents(directory=string_2, searchString=code_block_2)
backgroundOpen = Orchid.RevitProject.Common.Document.BackgroundOpen(file=contents_2)  # frozen
loadFamily_2 = Orchid.Core.File.LoadFamily(document=backgroundOpen, family=contents)
await_ = Orchid.Core.DataStream.Await(pass=backgroundOpen, waitFor=loadFamily_2)
boolean_2 = BoolSelector(true)  # graph input
close = Orchid.RevitProject.Common.Document.Close(document=await_, save=boolean_2)

watch = Watch(loadFamily_2)
watch_2 = Watch(loadFamily)

# group: Open all files in directory and sub directories
string_3 = StringInput("..\testSet")  # graph input
code_block_3 = CodeBlock { "*.rfa"; }
boolean_3 = BoolSelector(false)  # graph input
contents_3 = Orchid.Core.Directory.Contents(directory=string_3, searchString=code_block_3, deepSearch=boolean_3)
backgroundOpen_2 = Orchid.RevitProject.Common.Document.BackgroundOpen(file=contents_3)  # frozen
loadFamily_3 = Orchid.RevitProject.Common.Document.LoadFamily(familyDocument=backgroundOpen_2)
await_2 = Orchid.Core.DataStream.Await(pass=backgroundOpen_2, waitFor=loadFamily_3)
close_2 = Orchid.RevitProject.Common.Document.Close(document=await_2)

watch_3 = Watch(loadFamily_3)
