# Dynamo graph Intersect.dyn (Dynamo 2.0.3.8810)

built_in_categories = CodeBlock()
# ---------- built_in_categories.designscript (26 lines) ----------
[
"OST_Casework",
"OST_Ceilings",
"OST_Columns",
"OST_CurtainWallMullions",
"OST_CurtainWallPanels",
"OST_CurtaSystem",
"OST_Doors",
"OST_Entourage",
"OST_Floors",
"OST_Furniture",
"OST_FurnitureSystems",
"OST_GenericModel",
"OST_PlumbingFixtures",
"OST_Ramps",
"OST_Roofs",
"OST_SpecialityEquipment",
"OST_Stairs",
"OST_StructuralColumns",
"OST_StructuralFoundation",
"OST_StructuralFraming",
"OST_StructuralFramingSystem",
"OST_StructuralStiffener",
"OST_Walls",
"OST_Windows"
];
# ----------------------------------------
natural_category_name = CodeBlock()
# ---------- natural_category_name.designscript (26 lines) ----------
[
"Casework",
"Ceilings",
"Columns",
"Curtain Wall Mullions",
"Curtain Panels",
"Curtain Systems",
"Doors",
"Entourage",
"Floors",
"Furniture",
"Furniture Systems",
"Generic Models",
"Plumbing Fixtures",
"Ramps",
"Roofs",
"Specialty Equipment",
"Stairs",
"Structural Columns",
"Structural Foundations",
"Structural Framing",
"Structural Beam Systems",
"Structural Stiffeners",
"Walls",
"Windows"
];
# ----------------------------------------

# group: Selection
elementByCategory = Orchid.RevitProject.Elements.Selection.ElementByCategory(category=natural_category_name)
watch = Watch(elementByCategory.Element)
intersect = Orchid.RevitProject.Elements.Element.Intersect(element=elementByCategory.Element)
watch_2 = Watch(intersect)
watch_3 = Watch(elementByCategory.Category)

# group: Selection
elementHasMaterial = Orchid.RevitProject.Elements.Selection.ElementHasMaterial()
intersect_2 = Orchid.RevitProject.Elements.Element.Intersect(element=elementHasMaterial.Element)
watch_4 = Watch(intersect_2)
watch_5 = Watch(elementHasMaterial.Element)
watch_6 = Watch(elementHasMaterial.Category)

# note: OOTB nodes
byName = Category.ByName(name=natural_category_name)
all_elements_of_category = ElementsOfCategory(Category=byName)
clean = Orchid.Common.List.Clean(list=all_elements_of_category)
watch_7 = Watch(clean)
intersect_3 = Orchid.RevitProject.Elements.Element.Intersect(element=clean)
watch_8 = Watch(intersect_3)

# group: Sorting by boolean
flatten = List.Flatten(list=elementHasMaterial.Element)
hasIntersect = Orchid.RevitProject.Elements.Element.HasIntersect(element=elementHasMaterial.Element)
anyTrue = Orchid.Common.List.AnyTrue(list=hasIntersect@L2)
filterByBoolMask = List.FilterByBoolMask(list=flatten, mask=anyTrue)
intersect_4 = Orchid.RevitProject.Elements.Element.Intersect(element=filterByBoolMask.in)
watch_9 = Watch(intersect_4)
watch_10 = Watch(filterByBoolMask.in)
watch_11 = Watch(flatten)
watch_12 = Watch(anyTrue)

# group: Selection by category
code_block = CodeBlock { "Structural Framing"; ["Doors", "Walls"]; }
byName_2 = Category.ByName(name=code_block.out0)
all_elements_of_category_2 = ElementsOfCategory(Category=byName_2)
byName_3 = Category.ByName(name=code_block.out1)
intersect_5 = Orchid.RevitProject.Elements.Element.Intersect(element=all_elements_of_category_2, category=byName_3)
watch_13 = Watch(intersect_5)
watch_14 = Watch(all_elements_of_category_2)
