# Dynamo graph SetType-Random.dyn (Dynamo 2.1.0.7500)

# group: Collect elements
family_types = FamilyTypes("Sunshade Panel Wide:Expanded metal Small")  # graph input
family_types_2 = FamilyTypes("Sunshade Panel Wide:Expanded metal Large")  # graph input
create = List.Create(item0=family_types, item1=family_types_2)
all_elements_of_family_type = ElementsOfFamilyType(Family_Type=create)

flatten = List.Flatten(list=all_elements_of_family_type)

# group: Randomization
count = List.Count(list=flatten)
randomList = Orchid.Core.Math.RandomList(amount=count)
round = Math.Round(number=randomList)

getItemAtIndex = List.GetItemAtIndex(list=create, index=round)

# group: SetType
setType = Orchid.RevitProject.Elements.Element.SetType(element=flatten, familyType=getItemAtIndex)

# group: Random
code_block = CodeBlock { 4; }
random = Orchid.Core.Math.Random(range=code_block)
watch = Watch(random)
randomList_2 = Orchid.Core.Math.RandomList(amount=count, range=code_block)
watch_2 = Watch(randomList_2)
