# Dynamo graph SystemFamilyType.dyn (Dynamo 2.0.3.8810)

# group: Roof
roof_types = RoofTypes(index=1)  # graph input
thermalProperties = Orchid.RevitProject.Elements.SystemFamilyType.ThermalProperties(elementType=roof_types)
watch = Watch(thermalProperties.HeatTransferCoefficient)
watch_2 = Watch(thermalProperties.ThermalResistance)
watch_3 = Watch(thermalProperties.ThermalMass)
watch_4 = Watch(thermalProperties.Absorptance)
watch_5 = Watch(thermalProperties.Roughness)

# group: Floor
floor_types = FloorTypes(index=2)  # graph input
thermalProperties_2 = Orchid.RevitProject.Elements.SystemFamilyType.ThermalProperties(elementType=floor_types)
watch_6 = Watch(thermalProperties_2.HeatTransferCoefficient)
watch_7 = Watch(thermalProperties_2.ThermalMass)
watch_8 = Watch(thermalProperties_2.Roughness)
watch_9 = Watch(thermalProperties_2.ThermalResistance)
watch_10 = Watch(thermalProperties_2.Absorptance)
structuralMaterial = Orchid.RevitProject.Elements.FloorType.StructuralMaterial(FloorType=floor_types)
watch_11 = Watch(structuralMaterial)
isFoundationSlab = Orchid.RevitProject.Elements.FloorType.IsFoundationSlab(FloorType=floor_types)
watch_12 = Watch(isFoundationSlab)

# group: Wall
wall_types = WallTypes(index=0)  # graph input
thermalProperties_3 = Orchid.RevitProject.Elements.SystemFamilyType.ThermalProperties(elementType=wall_types)
watch_13 = Watch(thermalProperties_3.HeatTransferCoefficient)
watch_14 = Watch(thermalProperties_3.ThermalMass)
watch_15 = Watch(thermalProperties_3.Roughness)
watch_16 = Watch(thermalProperties_3.ThermalResistance)
watch_17 = Watch(thermalProperties_3.Absorptance)
width = Orchid.RevitProject.Elements.WallType.Width(wallType=wall_types)
watch_18 = Watch(width)
kind = Orchid.RevitProject.Elements.WallType.Kind(wallType=wall_types)
watch_19 = Watch(kind)
function = Orchid.RevitProject.Elements.WallType.Function(wallType=wall_types)
watch_20 = Watch(function)

# group: Ceiling
ceiling_types = CeilingTypes(index=1)
thermalProperties_4 = Orchid.RevitProject.Elements.SystemFamilyType.ThermalProperties(elementType=ceiling_types)
watch_21 = Watch(thermalProperties_4.Absorptance)
watch_22 = Watch(thermalProperties_4.ThermalResistance)
watch_23 = Watch(thermalProperties_4.Roughness)
watch_24 = Watch(thermalProperties_4.ThermalMass)
watch_25 = Watch(thermalProperties_4.HeatTransferCoefficient)
