# Dynamo graph AddConvert.dyn (Dynamo 2.0.3.8810)

# group: create family type
current = Orchid.RevitProject.Common.Document.Current()
create = Orchid.RevitFamily.FamilyType.Create(familyDocument=current)

# group: Add shared parameter
await_ = Orchid.Core.DataStream.Await(pass=current, waitFor=create)
code_block = CodeBlock()
# ---------- code_block.designscript (16 lines) ----------
//Parameter name
["Creator Name",
"Creator Organization",
"Creator Build"];
//SP Parameter group
"01:   Sheet & Project";
//SP Parameter type
"Text";
//Parameter group
"PG_ADSK_MODEL_PROPERTIES";
//Tooltip
"Creator value";
//Instances
true;
//Reporting
false;
# ----------------------------------------
# note: Please notice that I use a tab in my "SP Parameter group" names. This is not standard!
# "Sheet & Project" would be the normal way!
addSharedParameter = Orchid.RevitFamily.Parameter.AddSharedParameter(familyDocument=await_, parameterName=code_block.out0, groupName=code_block.out1, type=code_block.out2, group=code_block.out3, tooltip=code_block.out4, instance=code_block.out5)

# group: Set formula
await_2 = Orchid.Core.DataStream.Await(pass=current, waitFor=addSharedParameter)
code_block_2 = CodeBlock()
# ---------- code_block_2.designscript (8 lines) ----------
//Parameter name
["Creator Name",
"Creator Organization",
"Creator Build"];
//Values
["\"Erik Falck Jørgensen\"",
"\"Danish Educational Content\"",
"\"2017.0418.0\""];
# ----------------------------------------
set = Orchid.RevitFamily.Formula.Set(familyDocument=await_2, parameterName=code_block_2.out0, value=code_block_2.out1)

# group: Get Formula
await_3 = Orchid.Core.DataStream.Await(pass=await_2, waitFor=set)
code_block_3 = CodeBlock()
# ---------- code_block_3.designscript (4 lines) ----------
//Parameter name
["Creator Name",
"Creator Organization",
"Creator Build"];
# ----------------------------------------
get = Orchid.RevitFamily.Formula.Get(familyDocument=await_3, parameterName=code_block_3)

watch = Watch(get)

# group: Convert parameter
name = Orchid.RevitFamily.Parameter.Name(parameter=addSharedParameter)
code_block_4 = CodeBlock()
# ---------- code_block_4.designscript (2 lines) ----------
//Instances
true;
# ----------------------------------------
convert = Orchid.RevitFamily.Parameter.Convert(familyDocument=await_, parameterName=name, instance=code_block_4)

name_2 = Orchid.RevitFamily.Parameter.Name(parameter=convert)
watch_2 = Watch(name_2)

# group: Remove formula
await_4 = Orchid.Core.DataStream.Await(pass=await_3, waitFor=get)
code_block_5 = CodeBlock()  # same code as code_block_3
remove = Orchid.RevitFamily.Formula.Remove(familyDocument=await_4, parameterName=code_block_5)

# group: Remove parameter value
await_5 = Orchid.Core.DataStream.Await(pass=await_4, waitFor=remove)
code_block_6 = CodeBlock()
# ---------- code_block_6.designscript (6 lines) ----------
//Parameter name
["Creator Name",
"Creator Organization",
"Creator Build"];
//value
["","",""];
# ----------------------------------------
setValue = Orchid.RevitFamily.Parameter.SetValue(familyDocument=await_5, parameterName=code_block_6.out0, value=code_block_6.out1)

# group: Create shared parameter
await_6 = Orchid.Core.DataStream.Await(pass=current, waitFor=create)
code_block_7 = CodeBlock()
# ---------- code_block_7.designscript (8 lines) ----------
//Parameter name
"Dynamo test parameter";
//SP Parameter group
"Dynamo test group";
//SP Parameter type
"Text";
//Parameter group
"PG_ADSK_MODEL_PROPERTIES";
# ----------------------------------------
# note: Please notice that I use a tab in my "SP Parameter group" names. This is not standard!
# "Sheet & Project" would be the normal way!
createSharedParameter = Orchid.RevitFamily.Parameter.CreateSharedParameter(familyDocument=await_6, parameterName=code_block_7.out0, groupName=code_block_7.out1, type=code_block_7.out2, group=code_block_7.out3)  # frozen

# group: Add shared parameter
await_7 = Orchid.Core.DataStream.Await(pass=current, waitFor=create)
code_block_8 = CodeBlock()
# ---------- code_block_8.designscript (8 lines) ----------
//Parameter name
["Page","test2"];
//SP Parameter group
"01:   Sheet & Project";
//SP Parameter type
"Text";
//Parameter group
"PG_ADSK_MODEL_PROPERTIES";
# ----------------------------------------
# note: Please notice that I use a tab in my "SP Parameter group" names. This is not standard!
# "Sheet & Project" would be the normal way!
addSharedParameter_2 = Orchid.RevitFamily.Parameter.AddSharedParameter(familyDocument=await_7, parameterName=code_block_8.out0, groupName=code_block_8.out1, type=code_block_8.out2, group=code_block_8.out3)  # frozen
