# Dynamo graph AddSetGet.dyn (Dynamo 2.0.3.8810)

current = Orchid.RevitProject.Common.Document.Current()

# group: Utilities
code_block = CodeBlock()
# ---------- code_block.designscript (2 lines) ----------
//Types to create
"Type 1";
# ----------------------------------------
create = Orchid.RevitFamily.FamilyType.Create(familyDocument=current, name=code_block)

# group: Add parameter
await_ = Orchid.Core.DataStream.Await(pass=current, waitFor=create)
code_block_2 = CodeBlock()
# ---------- code_block_2.designscript (6 lines) ----------
//Parameter name
"Test2";
//Parameter type
"Number";
//Parameter group
"PG_ADSK_MODEL_PROPERTIES";
# ----------------------------------------
addParameter = Orchid.RevitFamily.Parameter.AddParameter(familyDocument=await_, parameterName=code_block_2.out0, type=code_block_2.out1, group=code_block_2.out2)

# group: Set parameter
await_2 = Orchid.Core.DataStream.Await(pass=await_, waitFor=addParameter)
code_block_3 = CodeBlock()
# ---------- code_block_3.designscript (6 lines) ----------
//Type
"Type 1";
//Parameter name
"Test2";
//Value
1.5;
# ----------------------------------------
setValue = Orchid.RevitFamily.Parameter.SetValue(familyDocument=await_2, familyType=code_block_3.out0, parameterName=code_block_3.out1, value=code_block_3.out2)

# group: Add parameter
await_3 = Orchid.Core.DataStream.Await(pass=current, waitFor=create)
code_block_4 = CodeBlock()
# ---------- code_block_4.designscript (8 lines) ----------
//Parameter name
"Test1";
//Parameter type
"Integer";
//Parameter group
"PG_ADSK_MODEL_PROPERTIES";
//ToolTip
"do this work?";
# ----------------------------------------
addParameter_2 = Orchid.RevitFamily.Parameter.AddParameter(familyDocument=await_3, parameterName=code_block_4.out0, type=code_block_4.out1, group=code_block_4.out2, tooltip=code_block_4.out3)

# group: Set parameter
await_4 = Orchid.Core.DataStream.Await(pass=await_3, waitFor=addParameter_2)
code_block_5 = CodeBlock()
# ---------- code_block_5.designscript (6 lines) ----------
//Type
"Type 1";
//Parameter name
"Test1";
//Value
1;
# ----------------------------------------
setValue_2 = Orchid.RevitFamily.Parameter.SetValue(familyDocument=await_4, familyType=code_block_5.out0, parameterName=code_block_5.out1, value=code_block_5.out2)

# group: Add parameter
await_5 = Orchid.Core.DataStream.Await(pass=current, waitFor=create)
code_block_6 = CodeBlock()
# ---------- code_block_6.designscript (6 lines) ----------
//Parameter name
"Test3";
//Parameter type
"Text";
//Parameter group
"PG_ADSK_MODEL_PROPERTIES";
# ----------------------------------------
addParameter_3 = Orchid.RevitFamily.Parameter.AddParameter(familyDocument=await_5, parameterName=code_block_6.out0, type=code_block_6.out1, group=code_block_6.out2)

# group: Set parameter
await_6 = Orchid.Core.DataStream.Await(pass=await_5, waitFor=addParameter_3)
code_block_7 = CodeBlock()
# ---------- code_block_7.designscript (6 lines) ----------
//Type
"Type 1";
//Parameter name
"Test3";
//Value
"string";
# ----------------------------------------
setValue_3 = Orchid.RevitFamily.Parameter.SetValue(familyDocument=await_6, familyType=code_block_7.out0, parameterName=code_block_7.out1, value=code_block_7.out2)

# group: Add parameter
await_7 = Orchid.Core.DataStream.Await(pass=current, waitFor=create)
code_block_8 = CodeBlock()
# ---------- code_block_8.designscript (6 lines) ----------
//Parameter name
"Test4";
//Parameter type
"Material";
//Parameter group
"PG_ADSK_MODEL_PROPERTIES";
# ----------------------------------------
addParameter_4 = Orchid.RevitFamily.Parameter.AddParameter(familyDocument=await_7, parameterName=code_block_8.out0, type=code_block_8.out1, group=code_block_8.out2)

# group: Set parameter
await_8 = Orchid.Core.DataStream.Await(pass=await_7, waitFor=addParameter_4)
code_block_9 = CodeBlock()
# ---------- code_block_9.designscript (4 lines) ----------
//Type
"Type 1";
//Parameter name
"Test4";
# ----------------------------------------
code_block_10 = CodeBlock { "Glass"; }
byName = Material.ByName(name=code_block_10)
setValue_4 = Orchid.RevitFamily.Parameter.SetValue(familyDocument=await_8, familyType=code_block_9.out0, parameterName=code_block_9.out1, value=byName)

create_2 = List.Create(item0=setValue_2, item1=setValue, item2=setValue_3, item3=setValue_4)

# group: Parameters
await_9 = Orchid.Core.DataStream.Await(pass=await_2, waitFor=create_2)
parameters = Orchid.RevitFamily.Parameter.Parameters(familyDocument=await_9)
name = Orchid.RevitFamily.Parameter.Name(parameter=parameters)
watch = Watch(name)

# group: Get Parameter
await_10 = Orchid.Core.DataStream.Await(pass=await_2, waitFor=create_2)
code_block_11 = CodeBlock()
# ---------- code_block_11.designscript (7 lines) ----------
//Type name
"Type 1";
//Parameter name
["Test1",
"Test2",
"Test3",
"Test4"];
# ----------------------------------------
byName_2 = Orchid.RevitFamily.FamilyType.ByName(name=code_block_11.out0)
getValue = Orchid.RevitFamily.Parameter.GetValue(familyDocument=await_10, familyType=byName_2, parameterName=code_block_11.out1)
watch_2 = Watch(getValue.valueByParameter)
type = Object.Type(obj=getValue.valueByParameter)
watch_3 = Watch(type)
code_block_12 = CodeBlock(t=getValue.valueByParameter) { t[3]; }
name_2 = Material.Name(material=code_block_12)
watch_4 = Watch(name_2)

# group: Id and ById
id = Orchid.RevitFamily.Parameter.Id(parameter=setValue_4)
byId = Orchid.RevitProject.Elements.Element.ById(id=id)
id_2 = Element.Id(element=byId)
byId_2 = Orchid.RevitFamily.Parameter.ById(id=id)
