# Dynamo graph AutoIFCexport.dyn (Dynamo 2.1.0.7500)

# group: Prebuild IFC setting
ifc_setting = Setting("IFC4 Design Transfer View")  # graph input; frozen
settingByName = Orchid.RevitProject.IFC.SettingByName(name=ifc_setting)

# group: IFC setting --> General
ifc_version = Version("IFC4 Design Transfer View")  # graph input
ifc_file_type = FileType("IFC")  # graph input
ifc_space_boundary = SpaceBoundary("1st Level")  # graph input
ifc_project_origin = SitePlacement("Internal coordinates")  # graph input
boolean = BoolSelector(true)  # graph input
settingGeneral = Orchid.RevitProject.IFC.SettingGeneral(setting=settingByName, spaceBoundary=ifc_space_boundary, projectOrigin=ifc_project_origin, splitByLevel=boolean)

# group: IFC setting --> Additional/LOD
boolean_2 = BoolSelector(true)  # graph input
ifc_level_of_detail = LevelOfDetail("Medium")  # graph input
settingAdditional = Orchid.RevitProject.IFC.SettingAdditional(setting=settingGeneral, VisibleElements=boolean_2, LOD=ifc_level_of_detail)

# group: IFC setting --> Property
boolean_3 = BoolSelector(true)  # graph input
code_block = CodeBlock { t1 = Orchid.Directory.Current; t2 = "test"; t1+"\\"+t2; }
settingProperty = Orchid.RevitProject.IFC.SettingProperty(setting=settingAdditional, baseQuantities=boolean_3, userPropertyFile=code_block.out2)

# group: IFC setting --> Advanced
boolean_4 = BoolSelector(true)  # graph input
settingAdvanced = Orchid.RevitProject.IFC.SettingAdvanced(setting=settingProperty, storeGuid=boolean_4)

# group: IFC Export
current = Orchid.Core.Directory.Current()
string = StringInput("test")  # graph input
code_block_2 = CodeBlock(t1=current, t2=string) { t1+"\\"+t2; }
boolean_5 = BoolSelector(false)  # graph input
phases = Phase("Existing")  # graph input
views = Views()  # nothing selected; graph input
export = Orchid.RevitProject.IFC.Export(setting=settingAdvanced, view=views)
watch = Watch(export)

# group: IFC setting file format
type = Object.Type(obj=settingAdvanced)
watch_2 = Watch(type)
watch_3 = Watch(settingAdvanced)

# group: Open all files in directory and sub directories
string_2 = StringInput(".\testSet")  # graph input
string_3 = StringInput("*.rfa")  # graph input
boolean_6 = BoolSelector(false)  # graph input
contents = Orchid.Core.Directory.Contents(directory=string_2, searchString=string_3, deepSearch=boolean_6)
loadFamily = Orchid.Core.File.LoadFamily(family=contents)

# group: Place families in document
boolean_7 = BoolSelector(false)  # graph input
fileName = FileSystem.FileName(path=loadFamily, withExtension=boolean_7)
byName = Family.ByName(name=fileName)
types = Family.Types(family=byName)
flatten = List.Flatten(list=types)
count = List.Count(list=flatten)
code_block_3 = CodeBlock(num=count) { (1..num)*2500; }
byCoordinates = Point.ByCoordinates(x=code_block_3)
levels = Levels("Level 1")  # graph input
byPointAndLevel = FamilyInstance.ByPointAndLevel(familyType=flatten, point=byCoordinates, level=levels)

# group: IFC Export based on prebuild IFC setting and a view
current_2 = Orchid.RevitProject.Document.Current()
await_ = Orchid.Core.DataStream.Await(pass=current_2, waitFor=byPointAndLevel)
ifc_setting_2 = Setting("IFC2x3 Coordination View 2.0")  # graph input
settingByName_2 = Orchid.RevitProject.IFC.SettingByName(name=ifc_setting_2)
views_2 = Views("{3D}")  # graph input
export_2 = Orchid.RevitProject.IFC.Export(document=await_, setting=settingByName_2, view=views_2)
