# Dynamo graph BulkUpgrade.dyn (Dynamo 2.1.0.7500)

directory_path = StringInput(".\testSet")  # graph input
string = StringInput("*.rfa")  # graph input
boolean = BoolSelector(false)  # graph input
contents = Orchid.Core.Directory.Contents(directory=directory_path, searchString=string, deepSearch=boolean)
backgroundOpen = Orchid.RevitProject.Document.BackgroundOpen(file=contents)
# note: Please notice that I use a tab in my "SP Parameter group" names. This is not standard!
# "Sheet & Project" would be the normal way!
code_block = CodeBlock()
# ---------- code_block.designscript (12 lines) ----------
//Parameter name
"Creator Build";
//SP Parameter group
"01:   Sheet & Project";
//SP Parameter type
"Text";
//Parameter group
"PG_ADSK_MODEL_PROPERTIES";
//Instances
true;
//Reporting
false;
# ----------------------------------------
addSharedParameter = Orchid.RevitFamily.Parameter.AddSharedParameter(familyDocument=backgroundOpen, parameterName=code_block.out0, groupName=code_block.out1, type=code_block.out2, group=code_block.out3, instance=code_block.out4)
clean = Orchid.Core.List.Clean(list=addSharedParameter)
await_ = Orchid.Core.DataStream.Await(pass=backgroundOpen, waitFor=clean)
code_block_2 = CodeBlock()
# ---------- code_block_2.designscript (2 lines) ----------
//parameter name
"Creator Build";
# ----------------------------------------
creator_build = StringInput("\"2020\"")  # graph input
set = Orchid.RevitFamily.Formula.Set(familyDocument=await_, parameterName=code_block_2, value=creator_build)
await_2 = Orchid.Core.DataStream.Await(pass=await_, waitFor=set)
boolean_2 = BoolSelector(true)  # graph input
close = Orchid.RevitProject.Document.Close(document=await_2, save=boolean_2)

# group: Cleanup backup files
await_3 = Orchid.Core.DataStream.Await(pass=directory_path, waitFor=close)
string_2 = StringInput("*.0001.rfa")  # graph input
boolean_3 = BoolSelector(true)  # graph input
contents_2 = Orchid.Core.Directory.Contents(directory=await_3, searchString=string_2, deepSearch=boolean_3)
deleteFile = FileSystem.DeleteFile(path=contents_2)
