# Dynamo graph CategoryReportingIFC.dyn (Dynamo 2.0.3.8810)

current = Orchid.RevitProject.Common.Document.Current()

# group: Create types
code_block = CodeBlock()
# ---------- code_block.designscript (2 lines) ----------
//Types to create
["Type 1", "Type 2"];
# ----------------------------------------
create = Orchid.RevitFamily.FamilyType.Create(familyDocument=current, name=code_block)

# group: Add parameter
await_ = Orchid.Core.DataStream.Await(pass=current, waitFor=create)
code_block_2 = CodeBlock()
# ---------- code_block_2.designscript (8 lines) ----------
//Parameter name
"dim";
//Parameter type
"Length";
//Parameter group
"PG_ADSK_MODEL_PROPERTIES";
//Reporting
true;
# ----------------------------------------
addParameter = Orchid.RevitFamily.Parameter.AddParameter(familyDocument=await_, parameterName=code_block_2.out0, type=code_block_2.out1, group=code_block_2.out2, reporting=code_block_2.out3)

# group: Parameters
parameters = Orchid.RevitFamily.Parameter.Parameters(familyDocument=await_)
name = Orchid.RevitFamily.Parameter.Name(parameter=parameters)

watch = Watch(name)

# group: Add parameter
await_2 = Orchid.Core.DataStream.Await(pass=current, waitFor=create)
code_block_3 = CodeBlock()
# ---------- code_block_3.designscript (10 lines) ----------
//Parameter name
"Test";
//Parameter type
"Text";
//Parameter group
"PG_ADSK_MODEL_PROPERTIES";
//Tooltip
"Owner value";
//Instances
true;
# ----------------------------------------
addParameter_2 = Orchid.RevitFamily.Parameter.AddParameter(familyDocument=await_2, parameterName=code_block_3.out0, type=code_block_3.out1, group=code_block_3.out2, tooltip=code_block_3.out3, instance=code_block_3.out4)

# group: Set parameter
await_3 = Orchid.Core.DataStream.Await(pass=await_2, waitFor=addParameter_2)
code_block_4 = CodeBlock()
# ---------- code_block_4.designscript (6 lines) ----------
//Type
"Type 1";
//Parameter name
"Test";
//Value
"This is a test";
# ----------------------------------------
setValue = Orchid.RevitFamily.Parameter.SetValue(familyDocument=await_3, familyType=code_block_4.out0, parameterName=code_block_4.out1, value=code_block_4.out2)

create_2 = List.Create(item0=addParameter, item1=addParameter_2)

# group: IsReporting parameter
name_2 = Orchid.RevitFamily.Parameter.Name(parameter=create_2)
isReporting = Orchid.RevitFamily.Parameter.IsReporting(familyDocument=await_, parameterName=name_2)

watch_2 = Watch(isReporting)
watch_3 = Watch(name_2)

# group: Add basic IFC parameters
addIfcParameters = Orchid.RevitFamily.Parameter.AddIfcParameters(familyDocument=current)
name_3 = Orchid.RevitFamily.Parameter.Name(parameter=addIfcParameters)
watch_4 = Watch(name_3)

# group: Set the document category
categories = Categories(index=106)  # graph input
setCategory = Orchid.RevitFamily.Document.SetCategory(familyDocument=current, category=categories)

# group: Get the document category
await_4 = Orchid.Core.DataStream.Await(pass=current, waitFor=setCategory)
getCategory = Orchid.RevitFamily.Document.GetCategory(familyDocument=await_4)
byCategory = Orchid.RevitProject.Elements.Family.ByCategory(category=getCategory)
