# Dynamo graph Collect families in project.dyn (Dynamo 2.1.0.7500)

# group: Open all files in directory and sub directories
string = StringInput("C:\Users\erfajo\Programming\Unit Testing\testSet")  # graph input
code_block = CodeBlock { "*.rfa"; true; }
contents = Orchid.Core.Directory.Contents(directory=string, searchString=code_block.out0)  # frozen
backgroundOpen = Orchid.RevitProject.Document.BackgroundOpen(file=contents)

# group: Close files
await_ = Orchid.Core.DataStream.Await()  # unwired: pass, waitFor
boolean = BoolSelector(true)  # graph input
close = Orchid.RevitProject.Document.Close(document=await_, save=boolean)  # frozen

# group: Collect family as document from current document
code_block_2 = CodeBlock { ["Doors","Windows"]; }
elementByCategory = Orchid.RevitProject.Elements.Selection.ElementByCategory(category=code_block_2)
elementType = Element.ElementType(element=elementByCategory.Element)
family = FamilyType.Family(familyType=elementType)
flatten = List.Flatten(list=family)
uniqueItems = List.UniqueItems(list=flatten)
familyDocument = Orchid.RevitProject.Elements.Family.FamilyDocument(family=uniqueItems)

# note: Please notice that I use a tab in my "SP Parameter group" names. This is not standard!
# "Sheet & Project" would be the normal way!
code_block_3 = CodeBlock()
# ---------- code_block_3.designscript (12 lines) ----------
//Parameter name
"Creator Build";
//SP Parameter group
"01:   Sheet & Project";
//SP Parameter type
"Text";
//Parameter group
"PG_ADSK_MODEL_PROPERTIES";
//Instances
true;
//Reporting
false;
# ----------------------------------------
addSharedParameter = Orchid.RevitFamily.Parameter.AddSharedParameter(familyDocument=familyDocument, parameterName=code_block_3.out0, groupName=code_block_3.out1, type=code_block_3.out2, group=code_block_3.out3, instance=code_block_3.out4)
clean = Orchid.Core.List.Clean(list=addSharedParameter)

# group: load back into the current project
await_2 = Orchid.Core.DataStream.Await(pass=familyDocument, waitFor=clean)
loadFamily = Orchid.RevitFamily.Document.LoadFamily(familyDocument=await_2)
await_3 = Orchid.Core.DataStream.Await(pass=await_2, waitFor=loadFamily)
close_2 = Orchid.RevitProject.Document.Close(document=await_3)
