# Dynamo graph FormSetGet.dyn (Dynamo 2.0.3.8810)

# group: Create ordinary parameter
current = Orchid.RevitProject.Common.Document.Current()
code_block = CodeBlock()
# ---------- code_block.designscript (6 lines) ----------
//Parameter name
"Material";
//Parameter type
"Material";
//Parameter group
"PG_ADSK_MODEL_PROPERTIES";
# ----------------------------------------
addParameter = Orchid.RevitFamily.Parameter.AddParameter(familyDocument=current, parameterName=code_block.out0, type=code_block.out1, group=code_block.out2)

# group: Set parameter
await_ = Orchid.Core.DataStream.Await(pass=current, waitFor=addParameter)
code_block_2 = CodeBlock()
# ---------- code_block_2.designscript (2 lines) ----------
//Parameter name
"Material";
# ----------------------------------------
material = Material(index=0)  # graph input
setValue = Orchid.RevitFamily.Parameter.SetValue(familyDocument=await_, parameterName=code_block_2, value=material)

# group: Select geometry
element_types = ElementTypes(index=106)  # graph input
all_elements_of_type = ElementsOfType(element_type=element_types)

# group: Associate parameter
await_2 = Orchid.Core.DataStream.Await(pass=await_, waitFor=setValue)
code_block_3 = CodeBlock()  # same code as code_block_2
associate = Orchid.RevitFamily.Parameter.Associate(familyDocument=await_2, familyType=all_elements_of_type, documentParameter=code_block_3, familyParameter=code_block_3)
