# Dynamo graph Apperance.dyn (Dynamo 2.1.0.7500)

# group: Duplicate
appearance_asset = AppearanceAsset("Broom Finish - Gray(1)")  # graph input
code_block = CodeBlock { "_xx"; }
duplicate = Orchid.RevitMaterial.AppearanceAsset.Duplicate(appearanceAsset=appearance_asset, name=code_block)
watch = Watch(duplicate)

# group: All
all = Orchid.RevitMaterial.AppearanceAsset.All()
name = Element.Name(element=all)
watch_2 = Watch(name)
watch_3 = Watch(all)

# group: Create material: Timber (C24)
code_block_2 = CodeBlock { "_Timber C24"; }
create = Orchid.RevitMaterial.Material.Create(name=code_block_2)
appearance_schema = AppearanceSchema("Generic")  # graph input
boolean = BoolSelector(true)  # graph input
create_2 = Orchid.RevitMaterial.AppearanceAsset.Create(name=code_block_2, schema=appearance_schema, uniqueName=boolean)
code_block_3 = CodeBlock { "Hardwood material"; "pine,wood,interior,furniture,materials,hardwood"; }
setInformation = Orchid.RevitMaterial.AppearanceAsset.SetInformation(appearanceAsset=create_2, description=code_block_3.out0, keywords=code_block_3.out1)
code_block_4 = CodeBlock { 145; 15; 65; }
byARGB = Color.ByARGB(r=code_block_4.out0, g=code_block_4.out1, b=code_block_4.out2)
setGeneric = Orchid.RevitMaterial.AppearanceAsset.SetGeneric(appearanceAsset=setInformation, color=byARGB)
string = StringInput("%userprofile%\Programming\Source\Testing\Data\Stone_3.bmp")  # graph input
fromPath = Orchid.Core.File.FromPath(path=string)
setBump = Orchid.RevitMaterial.AppearanceAsset.SetBump(appearanceAsset=setGeneric, imagePath=fromPath)
setAsset = Orchid.RevitMaterial.Material.SetAsset(material=create, appearanceAsset=setBump)
name_2 = Material.Name(material=setAsset)
watch_4 = Watch(name_2)
watch_5 = Watch(setAsset)
getInformation = Orchid.RevitMaterial.AppearanceAsset.GetInformation(appearanceAsset=setInformation)
watch_6 = Watch(getInformation.description)
watch_7 = Watch(getInformation.keywords)
