# Dynamo graph Graphics.dyn (Dynamo 2.0.2.6826)

# group: Create, Set Render Appearance, SetShadingColor, Set Transparency, Set Surface Pattern, Set Surface Pattern Color, Set Cut Pattern, Set Cut Pattern Color --> For Revit 2019
code_block = CodeBlock { "_test3"; }
create = Orchid.RevitMaterial.Material.Create(name=code_block)
fill_patterns = FillPatterns(index=31)  # graph input
setSurfaceForegroundPattern = Orchid.RevitMaterial.Graphics.SetSurfaceForegroundPattern(material=create, pattern=fill_patterns)
code_block_2 = CodeBlock { DSCore.Color.ByARGB(255,145,185,165); }
setSurfaceForegroundPatternColor = Orchid.RevitMaterial.Graphics.SetSurfaceForegroundPatternColor(material=setSurfaceForegroundPattern, color=code_block_2)
getCutForegroundPattern = Orchid.RevitMaterial.Graphics.GetCutForegroundPattern(material=setSurfaceForegroundPatternColor)
watch = Watch(getCutForegroundPattern)
name = Material.Name(material=create)
watch_2 = Watch(name)
code_block_3 = CodeBlock { DSCore.Color.ByARGB(255,25,60,30); }
setShadingColor = Orchid.RevitMaterial.Graphics.SetShadingColor(material=create, color=code_block_3)
getShadingColor = Orchid.RevitMaterial.Graphics.GetShadingColor(material=setShadingColor)
watch_3 = Watch(getShadingColor)
code_block_4 = CodeBlock { 75; }
setTransparency = Orchid.RevitMaterial.Graphics.SetTransparency(material=create, transparency=code_block_4)
getTransparency = Orchid.RevitMaterial.Graphics.GetTransparency(material=setTransparency)
watch_4 = Watch(getTransparency)
watch_5 = Watch(create)
setCutForegroundPattern = Orchid.RevitMaterial.Graphics.SetCutForegroundPattern(material=create, pattern=fill_patterns)
setCutForegroundPatternColor = Orchid.RevitMaterial.Graphics.SetCutForegroundPatternColor(material=setCutForegroundPattern, color=code_block_2)
getCutForegroundPatternColor = Orchid.RevitMaterial.Graphics.GetCutForegroundPatternColor(material=setCutForegroundPatternColor)
watch_6 = Watch(getCutForegroundPatternColor)
fill_patterns_2 = FillPatterns(index=36)  # graph input
setCutBackgroundPattern = Orchid.RevitMaterial.Graphics.SetCutBackgroundPattern(material=create, pattern=fill_patterns_2)
code_block_5 = CodeBlock { 55; 125; 85; }
byARGB = Color.ByARGB(r=code_block_5.out0, g=code_block_5.out1, b=code_block_5.out2)
setCutBackgroundPatternColor = Orchid.RevitMaterial.Graphics.SetCutBackgroundPatternColor(material=setCutBackgroundPattern, color=byARGB)
getCutBackgroundPatternColor = Orchid.RevitMaterial.Graphics.GetCutBackgroundPatternColor(material=setCutBackgroundPatternColor)
watch_7 = Watch(getCutBackgroundPatternColor)
setSurfaceBackgroundPattern = Orchid.RevitMaterial.Graphics.SetSurfaceBackgroundPattern(material=create, pattern=fill_patterns_2)
setSurfaceBackgroundPatternColor = Orchid.RevitMaterial.Graphics.SetSurfaceBackgroundPatternColor(material=setSurfaceBackgroundPattern, color=byARGB)
getCutBackgroundPattern = Orchid.RevitMaterial.Graphics.GetCutBackgroundPattern(material=setSurfaceBackgroundPatternColor)
watch_8 = Watch(getCutBackgroundPattern)
boolean = BoolSelector(false)  # graph input
setRenderAppearance = Orchid.RevitMaterial.Graphics.SetRenderAppearance(material=create, useRenderAppearance=boolean)
getRenderAppearance = Orchid.RevitMaterial.Graphics.GetRenderAppearance(material=setRenderAppearance)
watch_9 = Watch(getRenderAppearance)
watch_10 = Watch(setCutBackgroundPattern)
watch_11 = Watch(setSurfaceBackgroundPattern)
watch_12 = Watch(setSurfaceForegroundPattern)
watch_13 = Watch(setCutForegroundPattern)

# group: Create, Get --> For Revit 2019
code_block_6 = CodeBlock { "_test2"; }
create_2 = Orchid.RevitMaterial.Material.Create(name=code_block_6)
watch_14 = Watch(create_2)
boolean_2 = BoolSelector(false)  # graph input
code_block_7 = CodeBlock { DSCore.Color.ByARGB(255,25,60,30); 50; }
fill_patterns_3 = FillPatterns(index=41)  # graph input
code_block_8 = CodeBlock { 45; 85; 65; }
byARGB_2 = Color.ByARGB(r=code_block_8.out0, g=code_block_8.out1, b=code_block_8.out2)
set = Orchid.RevitMaterial.Graphics.Set(material=create_2, useRenderAppearance=boolean_2, shadingColor=code_block_7.out0, transparency=code_block_7.out1, surfaceForegroundPattern=fill_patterns_3, surfaceForegroundPatternColor=byARGB_2, cutBackgroundPattern=fill_patterns_3, cutBackgroundPatternColor=byARGB_2)
get = Orchid.RevitMaterial.Graphics.Get(material=set)
watch_15 = Watch(get.UseRenderAppearance)
watch_16 = Watch(get.ShadingColor)
watch_17 = Watch(get.Transparency)
watch_18 = Watch(get.surfaceForegroundPattern)
watch_19 = Watch(get.surfaceForegroundPatternColor)
watch_20 = Watch(get.surfaceBackgroundPattern)
name_2 = Material.Name(material=create_2)
watch_21 = Watch(name_2)
watch_22 = Watch(get.surfaceBackgroundPatternColor)
watch_23 = Watch(get.cutBackgroundPattern)
watch_24 = Watch(get.cutBackgroundPatternColor)
watch_25 = Watch(get.cutForegroundPatternColor)
watch_26 = Watch(get.cutForegroundPattern)

# group: Smoothness, Shininess
code_block_9 = CodeBlock { "_test1"; }
create_3 = Orchid.RevitMaterial.Material.Create(name=code_block_9)
code_block_10 = CodeBlock { 50; }
setSmoothness = Orchid.RevitMaterial.Graphics.SetSmoothness(material=create_3, smoothness=code_block_10)
getSmoothness = Orchid.RevitMaterial.Graphics.GetSmoothness(material=setSmoothness)
watch_27 = Watch(getSmoothness)
setShininess = Orchid.RevitMaterial.Graphics.SetShininess(material=create_3, shininess=code_block_10)
getShininess = Orchid.RevitMaterial.Graphics.GetShininess(material=setShininess)
watch_28 = Watch(getShininess)

# group: Create, Get --> For Revit 2018
code_block_11 = CodeBlock { "_test4"; }
create_4 = Orchid.RevitMaterial.Material.Create(name=code_block_11)
watch_29 = Watch(create_4)
boolean_3 = BoolSelector(false)  # graph input
code_block_12 = CodeBlock { DSCore.Color.ByARGB(255,25,60,30); 50; }
fill_patterns_4 = FillPatterns(index=5)  # graph input
code_block_13 = CodeBlock { 45; 85; 65; }
byARGB_3 = Color.ByARGB(r=code_block_13.out0, g=code_block_13.out1, b=code_block_13.out2)
setGraphics = Orchid.RevitMaterial.Graphics.SetGraphics(material=create_4, useRenderAppearance=boolean_3, shadingColor=code_block_12.out0, transparency=code_block_12.out1, surfacePattern=fill_patterns_4, surfacePatternColor=byARGB_3)
getGraphics = Orchid.RevitMaterial.Graphics.GetGraphics(material=setGraphics)
watch_30 = Watch(getGraphics.UseRenderAppearance)
watch_31 = Watch(getGraphics.ShadingColor)
watch_32 = Watch(getGraphics.Transparency)
watch_33 = Watch(getGraphics.SurfacePattern)
watch_34 = Watch(getGraphics.SurfacePatternColor)
watch_35 = Watch(getGraphics.CutPattern)
name_3 = Material.Name(material=create_4)
watch_36 = Watch(name_3)
watch_37 = Watch(getGraphics.CutPatternColor)

# group: Create, Set Render Appearance, SetShadingColor, Set Transparency, Set Surface Pattern, Set Surface Pattern Color, Set Cut Pattern, Set Cut Pattern Color --> For Revit 2018
code_block_14 = CodeBlock { "_test5"; }
create_5 = Orchid.RevitMaterial.Material.Create(name=code_block_14)
watch_38 = Watch(create_5)
name_4 = Material.Name(material=create_5)
watch_39 = Watch(name_4)
code_block_15 = CodeBlock { DSCore.Color.ByARGB(255,25,60,30); }
setShadingColor_2 = Orchid.RevitMaterial.Graphics.SetShadingColor(material=create_5, color=code_block_15)
getShadingColor_2 = Orchid.RevitMaterial.Graphics.GetShadingColor(material=setShadingColor_2)
watch_40 = Watch(getShadingColor_2)
code_block_16 = CodeBlock { 75; }
setTransparency_2 = Orchid.RevitMaterial.Graphics.SetTransparency(material=create_5, transparency=code_block_16)
getTransparency_2 = Orchid.RevitMaterial.Graphics.GetTransparency(material=setTransparency_2)
watch_41 = Watch(getTransparency_2)
fill_patterns_5 = FillPatterns(index=1)  # graph input
setSurfacePattern = Orchid.RevitMaterial.Graphics.SetSurfacePattern(material=create_5, pattern=fill_patterns_5)
getSurfacePattern = Orchid.RevitMaterial.Graphics.GetSurfacePattern(material=setSurfacePattern)
watch_42 = Watch(getSurfacePattern)
setCutPattern = Orchid.RevitMaterial.Graphics.SetCutPattern(material=create_5, pattern=fill_patterns_5)
getCutPattern = Orchid.RevitMaterial.Graphics.GetCutPattern(material=setCutPattern)
watch_43 = Watch(getCutPattern)
code_block_17 = CodeBlock { 145; 185; 165; }
byARGB_4 = Color.ByARGB(r=code_block_17.out0, g=code_block_17.out1, b=code_block_17.out2)
setCutPatternColor = Orchid.RevitMaterial.Graphics.SetCutPatternColor(material=setCutPattern, color=byARGB_4)
getCutPatternColor = Orchid.RevitMaterial.Graphics.GetCutPatternColor(material=setCutPatternColor)
watch_44 = Watch(getCutPatternColor)
setSurfacePatternColor = Orchid.RevitMaterial.Graphics.SetSurfacePatternColor(material=setSurfacePattern, color=byARGB_4)
getSurfacePatternColor = Orchid.RevitMaterial.Graphics.GetSurfacePatternColor(material=setSurfacePatternColor)
watch_45 = Watch(getSurfacePatternColor)
boolean_4 = BoolSelector(false)  # graph input
setRenderAppearance_2 = Orchid.RevitMaterial.Graphics.SetRenderAppearance(material=create_5, useRenderAppearance=boolean_4)
getRenderAppearance_2 = Orchid.RevitMaterial.Graphics.GetRenderAppearance(material=setRenderAppearance_2)
watch_46 = Watch(getRenderAppearance_2)
