# Dynamo graph AutoIFCexport.dyn (Dynamo 2.0.3.8810)

# group: Prebuild IFC setting
ifc_setting = Setting(index=9)  # graph input; frozen
settingByName = Orchid.RevitProject.Common.IFC.SettingByName(name=ifc_setting)

# group: IFC setting --> General
ifc_version = Version(index=8)  # graph input
ifc_file_type = FileType(index=0)  # graph input
ifc_space_boundary = SpaceBoundary(index=1)  # graph input
ifc_project_origin = SitePlacement(index=3)  # graph input
boolean = BoolSelector(true)  # graph input
settingGeneral = Orchid.RevitProject.Common.IFC.SettingGeneral(setting=settingByName, spaceBoundary=ifc_space_boundary, projectOrigin=ifc_project_origin, splitByLevel=boolean)

# group: IFC setting --> Additional/LOD
boolean_2 = BoolSelector(true)  # graph input
ifc_level_of_detail = LevelOfDetail(index=2)  # graph input
settingAdditional = Orchid.RevitProject.Common.IFC.SettingAdditional(setting=settingGeneral, VisibleElements=boolean_2, LOD=ifc_level_of_detail)

# group: IFC setting --> Property
boolean_3 = BoolSelector(true)  # graph input
code_block = CodeBlock { t1 = Orchid.Directory.Current; t2 = "test"; t1+"\\"+t2; }
settingProperty = Orchid.RevitProject.Common.IFC.SettingProperty(setting=settingAdditional, baseQuantities=boolean_3, userPropertyFile=code_block.out2)

# group: IFC setting --> Advanced
boolean_4 = BoolSelector(true)  # graph input
settingAdvanced = Orchid.RevitProject.Common.IFC.SettingAdvanced(setting=settingProperty, storeGuid=boolean_4)

# group: IFC Export
current = Orchid.Core.Directory.Current()
string = StringInput("test")  # graph input
code_block_2 = CodeBlock(t1=current, t2=string) { t1+"\\"+t2; }
views = Views(index=0)  # graph input
phases = Phase(index=3)
boolean_5 = BoolSelector(true)  # graph input
export = Orchid.RevitProject.Common.IFC.Export(setting=settingAdvanced, view=views, phase=phases, overwrite=boolean_5)
watch = Watch(export)

# group: IFC setting file format
type = Object.Type(obj=settingAdvanced)
watch_2 = Watch(type)
watch_3 = Watch(settingAdvanced)

# group: Open all files in directory and sub directories
string_2 = StringInput("..\testSet")  # graph input
string_3 = StringInput("*.rfa")  # graph input
boolean_6 = BoolSelector(false)  # graph input
contents = Orchid.Core.Directory.Contents(directory=string_2, searchString=string_3, deepSearch=boolean_6)
loadFamily = Orchid.Core.File.LoadFamily(family=contents)

# group: Place families in document
types = Family.Types(family=loadFamily)
flatten = List.Flatten(list=types)
count = List.Count(list=flatten)
code_block_3 = CodeBlock(num=count) { (1..num)*2500; }
byCoordinates = Point.ByCoordinates(x=code_block_3)
levels = Levels(index=0)  # graph input
byPointAndLevel = FamilyInstance.ByPointAndLevel(familyType=flatten, point=byCoordinates, level=levels)

# group: IFC Export based on prebuild IFC setting and a view
current_2 = Orchid.RevitProject.Common.Document.Current()
await_ = Orchid.Core.DataStream.Await(pass=current_2, waitFor=byPointAndLevel)
ifc_setting_2 = Setting(index=1)  # graph input
settingByName_2 = Orchid.RevitProject.Common.IFC.SettingByName(name=ifc_setting_2)
views_2 = Views(index=0)  # graph input
export_2 = Orchid.RevitProject.Common.IFC.Export(document=await_, setting=settingByName_2, view=views_2)
