# Dynamo graph BuiltInParameter.dyn (Dynamo 2.1.0.7500)

all = Orchid.RevitProject.Parameters.BuiltInParameter.All()
name = Orchid.RevitProject.Parameters.BuiltInParameter.Name(parameter=all)
watch = Watch(name)
watch_2 = Watch(all)
builtin_parameter = BuiltInParameter("MATERIAL_ID_PARAM")  # graph input
watch_3 = Watch(builtin_parameter)
name_2 = Orchid.RevitProject.Parameters.BuiltInParameter.Name(parameter=builtin_parameter)
watch_4 = Watch(name_2)
label = Orchid.RevitProject.Parameters.BuiltInParameter.Label(parameter=all)
watch_5 = Watch(label)
label_2 = Orchid.RevitProject.Parameters.BuiltInParameter.Label(parameter=builtin_parameter)
watch_6 = Watch(label_2)
