# Dynamo graph Filter.dyn (Dynamo 2.0.3.8810)

# group: Filter for user-defined parameters (project, shared, and global parameters)
select_rule_type = RuleTypes(index=5)
code_block = CodeBlock { "test1"; "test2"; }
code_block_2 = CodeBlock { "TestStringParameter"; "TestIntegerParameter"; "TestDoubleParameter"; "Equals"; "Something"; 1000; 1000.0; }
byName = Orchid.RevitProject.Parameters.Parameter.ByName(parameterName=code_block_2.out2)
rule = Orchid.RevitProject.Common.Filter.Rule(parameter=byName, ruleType=code_block_2.out3, value=code_block_2.out6)
code_block_3 = CodeBlock { ["Doors","Windows"]; }
byName_2 = Category.ByName(name=code_block_3)
boolean = BoolSelector(false)
byRule = Orchid.RevitProject.Common.Filter.ByRule(name=code_block.out1, filterRule=rule, category=byName_2, andOr=boolean)
rule_2 = Orchid.RevitProject.Common.Filter.Rule(parameterName=code_block_2.out0, ruleType=code_block_2.out3, value=code_block_2.out4)
byRule_2 = Orchid.RevitProject.Common.Filter.ByRule(name=code_block.out0, filterRule=rule_2, category=byName_2)
name = Element.Name(element=byName)
id = Element.Id(element=byName)

# group: Filter for (element) parameters
code_block_4 = CodeBlock { "test3"; }
code_block_5 = CodeBlock { "Windows"; }
byName_3 = Category.ByName(name=code_block_5)
all_elements_of_category = ElementsOfCategory(Category=byName_3)
firstItem = List.FirstItem(list=all_elements_of_category)
elementType = Element.ElementType(element=firstItem)
code_block_6 = CodeBlock { "Width"; "Greater"; 1000; }
parameterByName = Parameter.ParameterByName(element=elementType, name=code_block_6.out0)
select_rule_type_2 = RuleTypes(index=5)
rule_3 = Orchid.RevitProject.Common.Filter.Rule(parameter=parameterByName, ruleType=select_rule_type_2, value=code_block_6.out2)
code_block_7 = CodeBlock { ["Doors","Windows"]; }
byName_4 = Category.ByName(name=code_block_7)
byRule_3 = Orchid.RevitProject.Common.Filter.ByRule(name=code_block_4, filterRule=rule_3, category=byName_4)
