# Dynamo graph Ifc.dyn (Dynamo 2.1.0.7500)

# group: Prebuild IFC setting
ifc_setting = Setting("IFC4 Design Transfer View")  # graph input
settingByName = Orchid.RevitProject.IFC.SettingByName(name=ifc_setting)

# group: IFC setting --> General
ifc_space_boundary = SpaceBoundary("1st Level")  # graph input
ifc_project_origin = SitePlacement("Internal coordinates")  # graph input
boolean = BoolSelector(true)  # graph input
settingGeneral = Orchid.RevitProject.IFC.SettingGeneral(setting=settingByName, spaceBoundary=ifc_space_boundary, projectOrigin=ifc_project_origin, splitByLevel=boolean)
ifc_file_type = FileType("IFC")  # graph input
ifc_version = Version("IFC4 Design Transfer View")  # graph input

# group: IFC setting --> Additional/LOD
boolean_2 = BoolSelector(true)  # graph input
ifc_level_of_detail = LevelOfDetail("Medium")  # graph input
settingAdditional = Orchid.RevitProject.IFC.SettingAdditional(setting=settingGeneral, VisibleElements=boolean_2, LOD=ifc_level_of_detail)

# group: IFC setting --> Property
boolean_3 = BoolSelector(true)  # graph input
code_block = CodeBlock { t1 = Orchid.Core.Directory.Current; t2 = "test"; t1+"\\"+t2; }
settingProperty = Orchid.RevitProject.IFC.SettingProperty(setting=settingAdditional, baseQuantities=boolean_3, userPropertyFile=code_block.out2)

# group: IFC setting --> Advanced
boolean_4 = BoolSelector(true)  # graph input
settingAdvanced = Orchid.RevitProject.IFC.SettingAdvanced(setting=settingProperty, storeGuid=boolean_4)

# group: IFC setting file format
type = Object.Type(obj=settingAdvanced)
watch = Watch(type)
watch_2 = Watch(settingAdvanced)

# group: IFC Export
current = Orchid.Core.Directory.Current()
string = StringInput("test")  # graph input
code_block_2 = CodeBlock(t1=current, t2=string) { t1+"\\"+t2; }
views = Views("{3D}")  # graph input
export = Orchid.RevitProject.IFC.Export(setting=settingAdvanced, view=views)
watch_3 = Watch(export)
boolean_5 = BoolSelector(false)  # graph input
phases = Phase("Existing")  # graph input

# group: IFC Export --> Multiple document export
file_path = Filename("..\..\Data\defaultBuilding_2020.rvt")  # graph input
backgroundOpen = Orchid.RevitProject.Document.BackgroundOpen(file=file_path)
export_2 = Orchid.RevitProject.IFC.Export(document=backgroundOpen)
await_ = Orchid.Core.DataStream.Await(pass=backgroundOpen, waitFor=export_2)
close = Orchid.RevitProject.Document.Close(document=await_)
watch_4 = Watch(export_2)

# group: IFC Export based on prebuild IFC setting and a view
ifc_setting_2 = Setting("IFC2x3 Coordination View 2.0")  # graph input
settingByName_2 = Orchid.RevitProject.IFC.SettingByName(name=ifc_setting_2)
views_2 = Views("{3D}")  # graph input
export_3 = Orchid.RevitProject.IFC.Export(setting=settingByName_2, view=views_2)
