# Dynamo graph LinkedDocument-pin.dyn "LinkedDocument-pin_beta" (Dynamo 2.0.3.8810)

string = StringInput(".\2019_defaultProject.rvt")
backgroundOpen = Orchid.RevitProject.Common.Document.BackgroundOpen(file=string)

# group: Link revit file
string_2 = StringInput(".\defaultBuilding_2019.rvt")
link_positioning = Positioning(index=1)
code_block = CodeBlock { 10000; }
byCoordinates = Point.ByCoordinates(y=code_block)
attachment_type = AttachmentType(index=0)
boolean = BoolSelector(true)
linkRevitFile = Orchid.RevitProject.Common.Link.LinkRevitFile(document=backgroundOpen, file=string_2, positioning=link_positioning, referencePoint=byCoordinates, attachmentType=attachment_type, relative=boolean)

watch = Watch(linkRevitFile.Link)
watch_2 = Watch(linkRevitFile.Instance)

# group: Pin
categories = Categories(index=604)
all_elements_of_category = ElementsOfCategory(Category=categories)  # frozen
pin = Orchid.RevitProject.Elements.Element.Pin(element=all_elements_of_category)
unPin = Orchid.RevitProject.Elements.Element.UnPin()  # unwired: element

# group: Pin
categories_2 = Categories(index=604)
all_elements_of_category_2 = ElementsOfCategory(Category=categories_2)  # frozen
pin_2 = Orchid.RevitProject.Elements.Element.Pin(element=all_elements_of_category_2)
unPin_2 = Orchid.RevitProject.Elements.Element.UnPin()  # unwired: element

pin_3 = Orchid.RevitProject.Elements.Element.Pin(document=backgroundOpen, element=linkRevitFile.Instance)
await_ = Orchid.Core.DataStream.Await(pass=backgroundOpen, waitFor=pin_3)
name = Orchid.RevitProject.Common.Document.Name(document=backgroundOpen)
code_block_2 = CodeBlock(name=name) { name+"_copy.rvt"; true; }
saveAs = Orchid.RevitProject.Common.Document.SaveAs(document=await_, name=code_block_2.out0, overwrite=code_block_2.out1)
close = Orchid.RevitProject.Common.Document.Close(document=saveAs)
