# Dynamo graph LinkedDocument.dyn (Dynamo 2.0.3.8810)

string = StringInput("%userprofile%\Programming\Source\Testing\Data\")  # graph input
string_2 = StringInput("2019_defaultProject")  # graph input
code_block = CodeBlock(a=string, b=string_2) { a+b+".rvt"; }
fromPath = Orchid.Core.File.FromPath(path=code_block)

# group: Revit links
linkedRevitFile = Orchid.RevitProject.Common.Link.LinkedRevitFile()
linkReload = Orchid.RevitProject.Common.Link.LinkReload(link=linkedRevitFile)  # frozen
linkRepath = Orchid.RevitProject.Common.Link.LinkRepath(link=linkedRevitFile, file=fromPath)
linkUnload = Orchid.RevitProject.Common.Link.LinkUnload(link=linkedRevitFile)  # frozen
watch = Watch(linkedRevitFile)
name = Element.Name(element=linkedRevitFile)
watch_2 = Watch(name)

# group: CAD links
linkedCadFile = Orchid.RevitProject.Common.Link.LinkedCadFile()
watch_3 = Watch(linkedCadFile)
name_2 = Element.Name(element=linkedCadFile)
watch_4 = Watch(name_2)
linkReload_2 = Orchid.RevitProject.Common.Link.LinkReload(link=linkedCadFile)
watch_5 = Watch(linkReload_2)

# group: Get all linked files
linkedFile = Orchid.RevitProject.Common.Link.LinkedFile()
watch_6 = Watch(linkedFile.Type)
watch_7 = Watch(linkedFile.Link)

# group: Dropdown selector
linked_files = LinkedFile(index=1)  # graph input
watch_8 = Watch(linked_files)
linked_revit_files = LinkedRevit(index=0)  # graph input
watch_9 = Watch(linked_revit_files)
linked_cad_files = LinkedCad(index=0)  # graph input
watch_10 = Watch(linked_cad_files)

# group: Convert to Revit link
select_model_element = DSModelElementSelection()  # 1 picked in the model; graph input; frozen
watch_11 = Watch(select_model_element)
convertToLink = Orchid.RevitProject.Common.Link.ConvertToLink(instance=select_model_element)
watch_12 = Watch(convertToLink)

# group: Convert to CAD link
select_model_element_2 = DSModelElementSelection()  # 1 picked in the model; graph input; frozen
watch_13 = Watch(select_model_element_2)
convertToLink_2 = Orchid.RevitProject.Common.Link.ConvertToLink(instance=select_model_element_2)
watch_14 = Watch(convertToLink_2)

# group: Link cad file
string_3 = StringInput(".\Drawing1.dwg")
code_block_2 = CodeBlock { -1000; }
byCoordinates = Point.ByCoordinates(x=code_block_2, y=code_block_2)
model_views = ModelView(index=0)
boolean = BoolSelector(false)
linkCadFile = Orchid.RevitProject.Common.Link.LinkCadFile(file=string_3, referencePoint=byCoordinates, view=model_views, orientToView=boolean)  # frozen
watch_15 = Watch(linkCadFile.Instance)
watch_16 = Watch(linkCadFile.Link)

# group: Link revit file
string_4 = StringInput(".\defaultBuilding_2019.rvt")
link_positioning = Positioning(index=1)
code_block_3 = CodeBlock { 10000; }
byCoordinates_2 = Point.ByCoordinates(y=code_block_3)
attachment_type = AttachmentType(index=0)
boolean_2 = BoolSelector(true)
linkRevitFile = Orchid.RevitProject.Common.Link.LinkRevitFile(file=string_4, positioning=link_positioning, referencePoint=byCoordinates_2, attachmentType=attachment_type, relative=boolean_2)
watch_17 = Watch(linkRevitFile.Link)
watch_18 = Watch(linkRevitFile.Instance)

# group: Link cad file
string_5 = StringInput(".\Drawing1.dwg")
link_positioning_2 = Positioning(index=0)
import_unit = Unit(index=1)
import_color_mode = ColorMode(index=1)
code_block_4 = CodeBlock { -1000; }
byCoordinates_3 = Point.ByCoordinates(x=code_block_4, y=code_block_4)
model_views_2 = ModelView(index=0)
boolean_3 = BoolSelector(false)
linkCadFile_2 = Orchid.RevitProject.Common.Link.LinkCadFile(file=string_5, positioning=link_positioning_2, unit=import_unit, colorMode=import_color_mode, referencePoint=byCoordinates_3, view=model_views_2, orientToView=boolean_3)  # frozen
watch_19 = Watch(linkCadFile_2.Instance)
watch_20 = Watch(linkCadFile_2.Link)

originToOrigin = Custom[LinkModel.OriginToOrigin]()  # Link models origin to origin. Optionally, the node can place the models on the selected worksets and pin them in place.; unwired: Filepaths
projectBasePoint = Custom[LinkModel.ProjectBasePoint]()  # Link models project base point to project base point. Optionally, the node can place the models on the selected worksets and pin them in place.; unwired: Filepaths
sharedCoordinates = Custom[LinkModel.SharedCoordinates]()  # Link models with shared coordinates. Optionally, the node can place the models on the selected worksets and pin them in place.; unwired: Filepaths
atOrigin = Custom[LinkDwg.AtOrigin]()  # Link multiple Dwg files by feeding filepaths and views. Multiple additional options are available.; unwired: Filepaths, SelectedViews
centered = Custom[LinkDwg.Centered]()  # Link multiple Dwg files by feeding filepaths and views. Multiple additional options are available.; unwired: Filepaths, SelectedViews
sharedCoordinates_2 = Custom[LinkDwg.SharedCoordinates]()  # Link multiple Dwg files by feeding filepaths and views. Multiple additional options are available.; unwired: Filepaths, SelectedViews
project_origin = Origin(index=0)
boolean_4 = BoolSelector(false)
string_6 = StringInput("C:\Users\erfajo\Programming\Source\Testing\Data\defaultBuilding_2019.rvt")
linkUnload_2 = Orchid.RevitProject.Common.Link.LinkUnload()  # frozen; unwired: link
linkReload_3 = Orchid.RevitProject.Common.Link.LinkReload(link=linkUnload_2)
