# Dynamo graph MoveToOrigin.dyn (Dynamo 2.0.3.8810)

# group: Revisions -> delete or add
deleteAll = Orchid.RevitProject.Common.Revision.DeleteAll()
all = Orchid.RevitProject.Common.RevisionCloud.All()
# note: If revisions is deleted, then remember to
# remove they are added to the "move" list
deleteAll_2 = Orchid.RevitProject.Common.RevisionCloud.DeleteAll()

# group: new origin -> as vector
select_model_element = DSModelElementSelection()  # 1 picked in the model; graph input
getLocation = Element.GetLocation(element=select_model_element)
reverse = Orchid.Common.Geometry.Point.Reverse(point=getLocation)

# group: Adjust view crop box
modelAll = Orchid.RevitProject.Views.View.ModelAll()
move = Orchid.RevitProject.Views.View.Move(view=modelAll, point=reverse)

# group: Adjust sectionsbox
code_block = CodeBlock { "3D View"; }
byName = Orchid.RevitProject.Views.ViewType.ByName(name=code_block)
byType = Orchid.RevitProject.Views.View.ByType(viewType=byName)
moveSectionBox = Orchid.RevitProject.Views.View.MoveSectionBox(view3D=byType, point=reverse)

# group: Select special elements
element_types = ElementTypes(index=210)  # graph input
all_elements_of_type = ElementsOfType(element_type=element_types)
allStackedWall = Orchid.RevitProject.Elements.Wall.AllStackedWall()
allModel = Orchid.RevitProject.Elements.Group.AllModel()
getSeparationLine = Orchid.RevitProject.Elements.SpatialElement.GetSeparationLine()
create = List.Create(item0=all_elements_of_type, item1=allStackedWall, item2=allModel, item3=getSeparationLine.SpatialElement)

# group: Select elements
code_block_2 = CodeBlock()
# ---------- code_block_2.designscript (5 lines) ----------
// Category type elements
["Model",
"Annotation"];
"AnalyticalModel";
"Internal";
# ----------------------------------------
elementByCategoryType = Orchid.RevitProject.Elements.Selection.ElementByCategoryType(categoryType=code_block_2.out0)

# group: Select elements
code_block_3 = CodeBlock()
# ---------- code_block_3.designscript (2 lines) ----------
// Category type elements
"Annotation";
# ----------------------------------------
elementByCategoryType_2 = Orchid.RevitProject.Elements.Selection.ElementByCategoryType(categoryType=code_block_3)
code_block_4 = CodeBlock(category=elementByCategoryType_2.Category)
# ---------- code_block_4.designscript (3 lines) ----------
category.Name == "Section Boxes" ||
category.Name == "Revision Clouds"
? true : false;
# ----------------------------------------
filterByBoolMask = List.FilterByBoolMask(list=elementByCategoryType_2.Element, mask=code_block_4)

# group: join selection, create temporary group
code_block_5 = CodeBlock { "dummy"; }
join = List.Join(list0=create, list1=elementByCategoryType.Element, list2=filterByBoolMask.out)
clean = Orchid.Common.List.Clean(list=join)
flatten = List.Flatten(list=clean)
create_2 = Orchid.RevitProject.Elements.Group.Create(name=code_block_5, element=flatten)

# group: Select additional elements that not can be grouped
allDetail = Orchid.RevitProject.Elements.Group.AllDetail()
ownerViewType = Orchid.RevitProject.Elements.Element.OwnerViewType(element=allDetail)
code_block_6 = CodeBlock(t=ownerViewType) { t != "Detail"? true : false; }
filterByBoolMask_2 = List.FilterByBoolMask(list=allDetail, mask=code_block_6)

# group: join lists and unpin element
join_2 = List.Join(list0=filterByBoolMask_2.in, list1=all)
flatten_2 = List.Flatten(list=join_2)
isPinned = Orchid.RevitProject.Elements.Element.IsPinned(element=flatten_2)
filterByBoolMask_3 = List.FilterByBoolMask(list=flatten_2, mask=isPinned)
unPin = Orchid.RevitProject.Elements.Element.UnPin(element=filterByBoolMask_3.in)

# group: Adjust model
join_3 = List.Join(list0=create_2, list1=filterByBoolMask_3.out, list2=unPin)
move_2 = Orchid.RevitProject.Elements.Element.Move(element=join_3, point=reverse)

# group: Cleanup temporary group
await_ = Orchid.Common.DataStream.Await(pass=create_2, waitFor=move_2)
getByGroup = Orchid.RevitProject.Elements.GroupType.GetByGroup(group=await_)
await_2 = Orchid.Common.DataStream.Await(pass=await_, waitFor=getByGroup)
unGroup = Orchid.RevitProject.Elements.Group.UnGroup(group=await_2)
await_3 = Orchid.Common.DataStream.Await(pass=getByGroup, waitFor=unGroup)
delete = Orchid.RevitProject.Elements.GroupType.Delete(groupType=await_3)

# group: re-pin elements
clean_2 = Orchid.Common.List.Clean(list=unPin)
await_4 = Orchid.Common.DataStream.Await(pass=clean_2, waitFor=move_2)
pin = Orchid.RevitProject.Elements.Element.Pin(element=await_4)

# group: copy the coordinates to clipboard
copyTo = Orchid.Common.Clipboard.CopyTo(element=reverse)
