# Dynamo graph Parameter.dyn (Dynamo 2.0.3.8810)

# group: Add project parameter
code_block = CodeBlock()
# ---------- code_block.designscript (14 lines) ----------
//Parameter name
["test1","test2"];
//Parameter type
"Text";
//Parameter group
"PG_IDENTITY_DATA";
//Tooltip
"Some tooltip";
//Instances
true;
//Vary Between Groups
true;
//Category
["Walls","Windows"];
# ----------------------------------------
byName = Category.ByName(name=code_block.out6)
addProjectParameter = Orchid.RevitProject.Parameters.Parameter.AddProjectParameter(parameterName=code_block.out0, type=code_block.out1, group=code_block.out2, tooltip=code_block.out3, instance=code_block.out4, vary=code_block.out5, category=byName)  # frozen

# group: Add shared parameter
# note: Please notice that I use a tab in my "SP Parameter group" names. This is not standard!
# "Sheet & Project" would be the normal way!
code_block_2 = CodeBlock()
# ---------- code_block_2.designscript (17 lines) ----------
//Parameter name
["Creator Name",
"Creator Organization",
"Creator Build"];
//["Paper Size","Subject"];
//SP Parameter group
"01:   Sheet & Project";
//SP Parameter type
"Text";
//Parameter group
"PG_ADSK_MODEL_PROPERTIES";
//Instances
true;
//Vary Between Groups
true;
//Category
"Doors";
# ----------------------------------------
byName_2 = Category.ByName(name=code_block_2.out6)
addSharedParameter = Orchid.RevitProject.Parameters.Parameter.AddSharedParameter(parameterName=code_block_2.out0, groupName=code_block_2.out1, type=code_block_2.out2, group=code_block_2.out3, category=byName_2)  # frozen

# group: Change parameter and category binding in the project
code_block_3 = CodeBlock()
# ---------- code_block_3.designscript (8 lines) ----------
//Parameter name
"Creator Name";
//Instances
true;
//Category
["Doors",
"Entourage",
"Floors"];
# ----------------------------------------
byName_3 = Category.ByName(name=code_block_3.out2)
changeCategory = Orchid.RevitProject.Parameters.Parameter.ChangeCategory(parameterName=code_block_3.out0, category=byName_3)  # frozen

# group: Delete parameter
code_block_4 = CodeBlock()
# ---------- code_block_4.designscript (2 lines) ----------
["Creator Build",
"test2"];
# ----------------------------------------
delete = Orchid.RevitProject.Parameters.Parameter.Delete(parameterName=code_block_4)  # frozen

# group: Project parameters in document
projectParameters = Orchid.RevitProject.Parameters.Parameter.ProjectParameters()
watch = Watch(projectParameters)
name = Element.Name(element=projectParameters)
watch_2 = Watch(name)

# group: Global parameters in document
globalParameters = Orchid.RevitProject.Parameters.Parameter.GlobalParameters()
watch_3 = Watch(globalParameters)
name_2 = Element.Name(element=globalParameters)
watch_4 = Watch(name_2)

# group: Shared parameters in document
sharedParameters = Orchid.RevitProject.Parameters.Parameter.SharedParameters()
name_3 = Element.Name(element=sharedParameters.parameter)
watch_5 = Watch(name_3)
watch_6 = Watch(sharedParameters.parameter)
watch_7 = Watch(sharedParameters.guid)

# group: clean for unwanted parameters
string = StringInput("ParameterCopy")  # graph input
contains = String.Contains(str=name_3, searchFor=string)
filterByBoolMask = List.FilterByBoolMask(list=sharedParameters.parameter, mask=contains)
name_4 = Element.Name(element=filterByBoolMask.in)
watch_8 = Watch(name_4)
watch_9 = Watch(filterByBoolMask.in)

# group: Add basic IFC parameter
addIfcParameters = Orchid.RevitProject.Parameters.Parameter.AddIfcParameters()  # frozen

# group: Associate --> global parameters
categories = Categories(index=619)  # graph input
all_elements_of_category = ElementsOfCategory(Category=categories)
code_block_5 = CodeBlock { "sometext"; }
associate = Orchid.RevitProject.Parameters.Parameter.Associate(element=all_elements_of_category, parameterName=code_block_5, globalParameter=globalParameters)
getAssociated = Orchid.RevitProject.Parameters.Parameter.GetAssociated(element=all_elements_of_category, parameterName=code_block_5)
watch_10 = Watch(getAssociated)
hasAssociated = Orchid.RevitProject.Parameters.Parameter.HasAssociated(element=all_elements_of_category, parameterName=code_block_5)
watch_11 = Watch(hasAssociated)

# group: Create shared parameter
# note: Please notice that I use a tab in my "SP Parameter group" names. This is not standard!
# "Sheet & Project" would be the normal way!
code_block_6 = CodeBlock()
# ---------- code_block_6.designscript (16 lines) ----------
//Parameter name
"Dynamo test parameter";
//SP Parameter group
"Dynamo test group";
//SP Parameter type
"Text";
//Parameter group
"PG_ADSK_MODEL_PROPERTIES";
//Tooltip
"Some tooltip";
//Instances
true;
//Vary Between Groups
true;
//Category
"Doors";
# ----------------------------------------
byName_4 = Category.ByName(name=code_block_6.out7)
createSharedParameter = Orchid.RevitProject.Parameters.Parameter.CreateSharedParameter(parameterName=code_block_6.out0, groupName=code_block_6.out1, type=code_block_6.out2, group=code_block_6.out3, category=byName_4)  # frozen
addSharedParameter_2 = Orchid.RevitProject.Parameters.Parameter.AddSharedParameter(parameterName=code_block_6.out0, groupName=code_block_6.out1, type=code_block_6.out2, group=code_block_6.out3, instance=code_block_6.out5, vary=code_block_6.out6, category=byName_4)  # frozen

delete_2 = Orchid.RevitProject.Elements.Element.Delete(element=filterByBoolMask.in)  # frozen
