# Dynamo graph Project.dyn (Dynamo 2.0.3.8810)

# group: Project phase
phases = Phase(index=3)  # graph input
watch = Watch(phases)

# group: Project location
project_origin = Origin(index=0)  # graph input
set = Orchid.RevitProject.Common.Location.Set(location=project_origin)
watch_2 = Watch(set)
get = Orchid.RevitProject.Common.Location.Get()
watch_3 = Watch(get)
name = Element.Name(element=get)
watch_4 = Watch(name)
getVector = Orchid.RevitProject.Common.Location.GetVector(location=project_origin)
watch_5 = Watch(getVector)
getPoint = Orchid.RevitProject.Common.Location.GetPoint(location=project_origin)
watch_6 = Watch(getPoint)
