# Dynamo graph Purge PostCommand.dyn (Dynamo 2.0.3.8810)

# group: orchid
boolean = BoolSelector(false)  # graph input
purge = Orchid.RevitProject.Common.Document.Purge(completely=boolean)

# group: orchid
boolean_2 = BoolSelector(false)  # graph input
purge_2 = Orchid.RevitProject.Common.PostCommand.Purge(activate=boolean_2)  # frozen
