# Dynamo graph Revisions.dyn (Dynamo 2.0.3.8810)

# group: Create
code_block = CodeBlock { "Date 1234"; "Some description"; true; "AAA"; "BBB"; }
select_revision_visibility = RevisionVisibility(index=0)  # graph input
select_revision_number_type = RevisionNumberType(index=2)  # graph input
create = Orchid.RevitProject.Common.Revision.Create(revDate=code_block.out0, description=code_block.out1, issued=code_block.out2, issuedTo=code_block.out3, issuedBy=code_block.out4, visibility=select_revision_visibility, numberType=select_revision_number_type)

# group: Add to Sheet / Remove from Sheet
sheet_views = SheetView(index=0)  # graph input
revisions = Revision(index=0)  # graph input
addToSheet = Orchid.RevitProject.Common.Revision.AddToSheet(sheet=sheet_views, revision=revisions)
removeFromSheet = Orchid.RevitProject.Common.Revision.RemoveFromSheet(sheet=sheet_views, revision=revisions)

# group: All
all = Orchid.RevitProject.Common.Revision.All()
lastItem = List.LastItem(list=all)
delete = Orchid.RevitProject.Common.Revision.Delete(revision=lastItem)
watch = Watch(all)

# group: Set
revisions_2 = Revision(index=1)  # graph input
code_block_2 = CodeBlock { "Date 1234"; "Some description"; true; "AAA"; "BBB"; }
select_revision_visibility_2 = RevisionVisibility(index=0)  # graph input
select_revision_number_type_2 = RevisionNumberType(index=0)  # graph input
set = Orchid.RevitProject.Common.Revision.Set(revision=revisions_2, revDate=code_block_2.out0, description=code_block_2.out1, issued=code_block_2.out2, issuedTo=code_block_2.out3, issuedBy=code_block_2.out4, visibility=select_revision_visibility_2, numberType=select_revision_number_type_2)

# group: Numbering
select_revision_numbering = RevisionNumbering(index=0)  # graph input
setNumbering = Orchid.RevitProject.Common.Revision.SetNumbering(numbering=select_revision_numbering)
getNumbering = Orchid.RevitProject.Common.Revision.GetNumbering()

# group: Get
revisions_3 = Revision(index=1)  # graph input
get = Orchid.RevitProject.Common.Revision.Get(revision=revisions_3)
name = Element.Name(element=revisions_3)

# group: DeleteAll
deleteAll = Orchid.RevitProject.Common.Revision.DeleteAll()
watch_2 = Watch(deleteAll)

# group: RevisionCloud
all_2 = Orchid.RevitProject.Common.RevisionCloud.All()  # frozen
delete_2 = Orchid.RevitProject.Common.RevisionCloud.Delete(revisionCloud=all_2)
watch_3 = Watch(delete_2)
revision = RevisionCloud.Revision(revisionCloud=all_2)

# group: DeleteAll
deleteAll_2 = Orchid.RevitProject.Common.RevisionCloud.DeleteAll()  # frozen
watch_4 = Watch(deleteAll_2)
