# Dynamo graph SharedParameter.dyn (Dynamo 2.0.3.8810)

# group: set the shared parameter file
string = StringInput("..\COBie Extension Shared Parameters.txt")  # graph input
code_block = CodeBlock(data=string) { data; }
setFile = Orchid.RevitProject.Parameters.SharedParameter.SetFile(file=code_block)
watch = Watch(setFile)
string_2 = StringInput("%userprofile%\Documents\Modellering\Revit\Common\Shared Parameters.txt")  # graph input
fromPath = Orchid.Common.File.FromPath(path=string_2)

# group: group by group name and type
groupByGroupNameAndType = Orchid.RevitProject.Parameters.SharedParameter.GroupByGroupNameAndType(file=setFile)
watch_2 = Watch(groupByGroupNameAndType.ParameterName)
watch_3 = Watch(groupByGroupNameAndType.GroupName)
watch_4 = Watch(groupByGroupNameAndType.ParameterType)
watch_5 = Watch(groupByGroupNameAndType.Definition)
watch_6 = Watch(groupByGroupNameAndType.Guid)

# group: group by type and group name
groupByTypeAndGroupName = Orchid.RevitProject.Parameters.SharedParameter.GroupByTypeAndGroupName(file=setFile)
watch_7 = Watch(groupByTypeAndGroupName.ParameterName)
watch_8 = Watch(groupByTypeAndGroupName.Definition)
watch_9 = Watch(groupByTypeAndGroupName.ParameterType)
watch_10 = Watch(groupByTypeAndGroupName.GroupName)
watch_11 = Watch(groupByTypeAndGroupName.Guid)

# group: shared parameters
byFile = Orchid.RevitProject.Parameters.SharedParameter.ByFile(file=setFile)
watch_12 = Watch(byFile.GroupName)
watch_13 = Watch(byFile.ParameterName)
watch_14 = Watch(byFile.ParameterType)
watch_15 = Watch(byFile.Definition)
watch_16 = Watch(byFile.Guid)

# group: get shared parameter file
getFile = Orchid.RevitProject.Parameters.SharedParameter.GetFile()
watch_17 = Watch(getFile)
