# Dynamo graph SpatialElement.dyn (Dynamo 2.0.3.8810)

# group: Spatial Elements
getSeparationLine = Orchid.RevitProject.Elements.SpatialElement.GetSeparationLine()
watch = Watch(getSeparationLine.SpatialElement)
watch_2 = Watch(getSeparationLine.Element)
getBoundary = Orchid.RevitProject.Elements.SpatialElement.GetBoundary()
watch_3 = Watch(getBoundary.SpatialElement)
watch_4 = Watch(getBoundary.Element)
watch_5 = Watch(getSeparationLine.Curve)
watch_6 = Watch(getBoundary.Curve)

# group: Rooms, Spaces, Areas
getRoomBoundary = Orchid.RevitProject.Elements.SpatialElement.GetRoomBoundary()
watch_7 = Watch(getRoomBoundary.Element)
watch_8 = Watch(getRoomBoundary.Room)
getSpaceBoundary = Orchid.RevitProject.Elements.SpatialElement.GetSpaceBoundary()
watch_9 = Watch(getSpaceBoundary.Space)
watch_10 = Watch(getSpaceBoundary.Element)
getAreaBoundary = Orchid.RevitProject.Elements.SpatialElement.GetAreaBoundary()
watch_11 = Watch(getAreaBoundary.Area)
watch_12 = Watch(getAreaBoundary.Element)
watch_13 = Watch(getRoomBoundary.Curve)
watch_14 = Watch(getSpaceBoundary.Curve)
watch_15 = Watch(getAreaBoundary.Curve)

# group: Revit links
getRevitFile = Orchid.RevitProject.Common.Link.GetRevitFile()
instance = Orchid.RevitProject.Common.Link.Instance(link=getRevitFile)
document = Orchid.RevitProject.Common.Link.Document(instance=instance)
categories = Categories(index=425)
elementByCategory = Orchid.RevitProject.Elements.Selection.ElementByCategory(document=document, category=categories)
getSeparationLine_2 = Orchid.RevitProject.Elements.SpatialElement.GetSeparationLine(document=document, spatialElement=elementByCategory.Element)
watch_16 = Watch(getSeparationLine_2.Curve)
watch_17 = Watch(getSeparationLine_2.Element)
getBoundary_2 = Orchid.RevitProject.Elements.SpatialElement.GetBoundary(document=document, spatialElement=elementByCategory.Element)
watch_18 = Watch(getBoundary_2.Element)
watch_19 = Watch(getBoundary_2.Curve)
categories_2 = Categories(index=74)
categories_3 = Categories(index=457)

categories_4 = Categories(index=74)
categories_5 = Categories(index=425)
all_elements_of_category = ElementsOfCategory(Category=categories_5)
getBoundary_3 = Orchid.RevitProject.Elements.SpatialElement.GetBoundary(spatialElement=all_elements_of_category)
watch_20 = Watch(getBoundary_3.Element)
watch_21 = Watch(getBoundary_3.Curve)
getSeparationLine_3 = Orchid.RevitProject.Elements.SpatialElement.GetSeparationLine(spatialElement=all_elements_of_category)
watch_22 = Watch(getSeparationLine_3.Element)
watch_23 = Watch(getSeparationLine_3.Curve)
categories_6 = Categories(index=457)
