# Dynamo graph StartingView.dyn (Dynamo 2.0.3.8810)

views = Views(index=0)  # graph input
setStartingView = Orchid.RevitProject.Common.Document.SetStartingView(view=views)
watch = Watch(setStartingView)
getStartingView = Orchid.RevitProject.Common.Document.GetStartingView()
watch_2 = Watch(getStartingView)
