# Dynamo graph ViewDuplicate-ViewTemplate.dyn (Dynamo 2.0.3.8810)

# group: Find view in model
all = Orchid.RevitProject.Views.View.All()
code_block = CodeBlock()
# ---------- code_block.designscript (6 lines) ----------
// View name to copy
["E0_Stue",
"E1_1. sal",
"E2_2. sal",
"EK_Kælder",
"ET_Tag"];
# ----------------------------------------
name = Element.Name(element=all)
contains = List.Contains(list=code_block, item=name@L1)
filterByBoolMask = List.FilterByBoolMask(list=all, mask=contains)

# group: Duplicate view
concat = String.Concat()  # unwired: string0, string1
code_block_2 = CodeBlock()
# ---------- code_block_2.designscript (5 lines) ----------
//Text to add
["DTUfm CHECK - ",
"DTUfm UPLOAD - ",
"EXPORT DWG - ",
"Color CHECK - "];
# ----------------------------------------
cartesianProduct = List.CartesianProduct(comb=concat, list1=code_block_2, list2=code_block)
transpose = List.Transpose(lists=cartesianProduct)
view_duplicate_option = ViewDuplicateOption(index=0)
duplicate = Orchid.RevitProject.Views.View.Duplicate(view=filterByBoolMask.in, name=transpose, option=view_duplicate_option)
transpose_2 = List.Transpose(lists=duplicate)

# group: Find view template in model
all_2 = Orchid.RevitProject.Views.ViewTemplate.All()
code_block_3 = CodeBlock()
# ---------- code_block_3.designscript (5 lines) ----------
// ViewTemplate to use
["DTUfm - CHECK",
"DTUfm - UPLOAD",
"DTU Export DWG",
"DTU Color CHECK"];
# ----------------------------------------
name_2 = Element.Name(element=all_2)
contains_2 = List.Contains(list=code_block_3, item=name_2@L1)
filterByBoolMask_2 = List.FilterByBoolMask(list=all_2, mask=contains_2)

# group: Set view template
name_3 = Element.Name(element=filterByBoolMask_2.in)
byKeysValues = DesignScript.Builtin.Dictionary.ByKeysValues(keys=name_3, values=filterByBoolMask_2.in)
valueAtKey = DesignScript.Builtin.Dictionary.ValueAtKey(dictionary=byKeysValues, key=code_block_3)
set = Orchid.RevitProject.Views.ViewTemplate.Set(view=transpose_2, viewTemplate=valueAtKey)

watch = Watch(set)
