# Dynamo graph Worksharing.dyn (Dynamo 2.0.3.8810)

string = StringInput("C:\Users\Public\Temp\Worksharing\")  # graph input
string_2 = StringInput("2019_Central")  # graph input
code_block = CodeBlock(a=string, b=string_2) { a+b+".rvt"; }
fromPath = Orchid.Core.File.FromPath(path=code_block)
boolean = BoolSelector(true)  # graph input
boolean_2 = BoolSelector(true)  # graph input
boolean_3 = BoolSelector(false)  # graph input
backgroundOpen = Orchid.RevitProject.Common.Document.BackgroundOpen(file=fromPath, detachFromCentral=boolean, discardWorksets=boolean_2, audit=boolean_3)
string_3 = StringInput("new")  # graph input
code_block_2 = CodeBlock(a=string, b=string_3) { a+b+".rvt"; }
boolean_4 = BoolSelector(false)  # graph input
boolean_5 = BoolSelector(false)  # graph input
saveAs = Orchid.RevitProject.Common.Document.SaveAs(document=backgroundOpen, name=code_block_2, overwrite=boolean_4, saveAsCentral=boolean_5)
close = Orchid.RevitProject.Common.Document.Close(document=saveAs)
