# Dynamo graph grid.dyn (Dynamo 2.0.3.8810)

# group: Get grid
categories = Categories("OST_Grids")
all_elements_of_category = ElementsOfCategory(Category=categories)

# group: Get level location
categories_2 = Categories("OST_Levels")
all_elements_of_category_2 = ElementsOfCategory(Category=categories_2)
elevation = Level.Elevation(level=all_elements_of_category_2)

# group: Adjust grid line extents
maximumItem = List.MaximumItem(list=elevation)
code_block = CodeBlock()
# ---------- code_block.designscript (3 lines) ----------
// extent grid lines
// above/below model
2000;
# ----------------------------------------
minimumItem = List.MinimumItem(list=elevation)
code_block_2 = CodeBlock(top=maximumItem, value=code_block, bottom=minimumItem) { top+value; bottom-value; }
setVerticalExtents = Orchid.RevitProject.Grid.SetVerticalExtents(grid=all_elements_of_category, topExtent=code_block_2.out0, bottomExtent=code_block_2.out1)  # frozen

# group: Move grid line extents
code_block_3 = CodeBlock()
# ---------- code_block_3.designscript (2 lines) ----------
// distance
-2000;
# ----------------------------------------
moveVerticalExtents = Orchid.RevitProject.Grid.MoveVerticalExtents(grid=all_elements_of_category, distance=code_block_3)  # frozen
