# Dynamo graph group.dyn "group 2020" (Dynamo 2.0.3.8810)

# group: Group create... by selection of elements
code_block = CodeBlock()
# ---------- code_block.designscript (9 lines) ----------
"Model";
"Annotation";
"AnalyticalModel";
"Internal";

["Model",
"Annotation",
"AnalyticalModel",
"Internal"];
# ----------------------------------------
elementByCategoryType = Orchid.RevitProject.Elements.Selection.ElementByCategoryType(categoryType=code_block.out0)  # frozen
watch = Watch(elementByCategoryType.Element)
code_block_2 = CodeBlock { "test"; }
flatten = List.Flatten(list=elementByCategoryType.Element)
create = Orchid.RevitProject.Elements.Group.Create(name=code_block_2, element=flatten)

# group: Group ungroup
groups = Groups("test")
unGroup = Orchid.RevitProject.Elements.Group.UnGroup(group=groups)  # frozen
code_block_3 = CodeBlock { "test"; }
unGroup_2 = Orchid.RevitProject.Elements.Group.UnGroup(name=code_block_3)  # frozen
getByName = Orchid.RevitProject.Elements.Group.GetByName(name=code_block_3)
unGroup_3 = Orchid.RevitProject.Elements.Group.UnGroup(group=getByName)  # frozen

# group: GroupType delete
groupTypes = GroupTypes("test")
delete = Orchid.RevitProject.Elements.GroupType.Delete(groupType=groupTypes)  # frozen
code_block_4 = CodeBlock { "test"; }
delete_2 = Orchid.RevitProject.Elements.GroupType.Delete(name=code_block_4)  # frozen

# group: Group delete
code_block_5 = CodeBlock { "test"; }
getByName_2 = Orchid.RevitProject.Elements.Group.GetByName(name=code_block_5)
delete_3 = Orchid.RevitProject.Elements.Group.Delete(group=getByName_2)  # frozen
delete_4 = Orchid.RevitProject.Elements.Group.Delete(name=code_block_5)  # frozen
groups_2 = Groups("test")
delete_5 = Orchid.RevitProject.Elements.Group.Delete(group=groups_2)  # frozen
