# Dynamo graph Sigma-ProductionUnit.dyn (Dynamo 2.0.1.5055)

# group: definitions for Sigma
code_block = CodeBlock()
# ---------- code_block.designscript (14 lines) ----------
//Property identity field for Sigma
def sigmaTypeCode() {
	return = "Type Code";
};

//Components as instances or summarized
def sigmaInstances() {
	return = true;
};

//Enter estimate regulation for Sigma.
def sigmaRegulation() {
	return = 1.05;
};
# ----------------------------------------

# group: diverse Code Block input
code_block_2 = CodeBlock()
# ---------- code_block_2.designscript (4 lines) ----------
// pcs
"stk";
sigmaRegulation();
sigmaInstances();
# ----------------------------------------
code_block_3 = CodeBlock()
# ---------- code_block_3.designscript (4 lines) ----------
// area
"m2";
sigmaRegulation();
sigmaInstances();
# ----------------------------------------
code_block_4 = CodeBlock()
# ---------- code_block_4.designscript (4 lines) ----------
// length
"lbm";
sigmaRegulation();
sigmaInstances();
# ----------------------------------------
code_block_5 = CodeBlock()
# ---------- code_block_5.designscript (4 lines) ----------
// volume
"m3";
sigmaRegulation();
sigmaInstances();
# ----------------------------------------

# group: diverse Branch Root
code_block_6 = CodeBlock { "Modeled (3D)"; "Building"; "Terrain"; "Construction Site"; }
code_block_7 = CodeBlock { "Modelleret (3D)"; "Bygning"; "Terræn"; "Byggeplads"; }

# group: Element collection, grouped by Type Code, quantity in area and length
categories = Categories(index=604)  # graph input
all_elements_of_category = ElementsOfCategory(Category=categories)
elementType = Element.ElementType(element=all_elements_of_category)
code_block_8 = CodeBlock { sigmaTypeCode(); }
getParameterValueByName = Element.GetParameterValueByName(element=elementType, parameterName=code_block_8)
groupByKey = List.GroupByKey(list=all_elements_of_category, keys=getParameterValueByName)
code_block_9 = CodeBlock { "Length"; }
getParameterValueByName_2 = Element.GetParameterValueByName(element=all_elements_of_category, parameterName=code_block_9)
code_block_10 = CodeBlock(length=getParameterValueByName_2)
# ---------- code_block_10.designscript (2 lines) ----------
// mm --> m
length/1000;
# ----------------------------------------
code_block_11 = CodeBlock(elem=groupByKey.groups, code=groupByKey.unique_keys, qty=code_block_10)
# ---------- code_block_11.designscript (4 lines) ----------
// SfB 12
elem[1];
code[1];
qty;
# ----------------------------------------
code_block_12 = CodeBlock { "Area"; }
getParameterValueByName_3 = Element.GetParameterValueByName(element=all_elements_of_category, parameterName=code_block_12)
# note: coded types in selection, edit
# code block for proper sorting!
code_block_13 = CodeBlock(elem=groupByKey.groups, code=groupByKey.unique_keys, qty=getParameterValueByName_3)
# ---------- code_block_13.designscript (4 lines) ----------
// SfB 21
elem[0];
code[0];
qty;
# ----------------------------------------

# group: Element Qantifying, grouped by Tree Structure and Type Code
# note: Please note the
# default values!
code_block_14 = CodeBlock { "m2"; sigmaRegulation(); sigmaInstances(); }
code_block_15 = CodeBlock(element=code_block_13.out0, code=code_block_13.out1, quantity=code_block_13.qty)
# ---------- code_block_15.designscript (6 lines) ----------
[["(2.)","PRIMARY ELEMENTS, CARCASS"],
["(21)","External Walls"]];

element;
code;
quantity;
# ----------------------------------------
# note: Orchid
component = Orchid.Generic.Applications.Sigma.Component(componentTree=code_block_15.out0, element=code_block_15.element, code=code_block_15.code, quantity=code_block_15.quantity)

# group: Element Qantifying, grouped by Tree Structure and Type Code
code_block_16 = CodeBlock(element=code_block_11.out0, code=code_block_11.out1, quantity=code_block_11.qty)
# ---------- code_block_16.designscript (16 lines) ----------
/*
The Component Tree structure must be kept
inside an outer list, the individual
branches in the tree are built as
a "dictionary" with a key and a value
as sublists.
*/
[
["(1.)","GROUND, SUB-STRUCTURE"],
["(12)","Foundation"]
];

// elements must be a flat 1D list
element;
code;
quantity;
# ----------------------------------------
code_block_17 = CodeBlock()
# ---------- code_block_17.designscript (4 lines) ----------
// Sigma unit
"lbm";
sigmaRegulation();
sigmaInstances();
# ----------------------------------------
# note: Orchid
component_2 = Orchid.Generic.Applications.Sigma.Component(componentTree=code_block_16.out0, element=code_block_16.element, code=code_block_16.code, quantity=code_block_16.quantity, sigmaUnit=code_block_17.out0, sigmaRegulation=code_block_17.out1)

# group: Element collection, grouped by Type Code, quantity in pieces
categories_2 = Categories(index=619)  # graph input
all_elements_of_category_2 = ElementsOfCategory(Category=categories_2)
elementType_2 = Element.ElementType(element=all_elements_of_category_2)
code_block_18 = CodeBlock { sigmaTypeCode(); 1; }
getParameterValueByName_4 = Element.GetParameterValueByName(element=elementType_2, parameterName=code_block_18.out0)
groupByKey_2 = List.GroupByKey(list=all_elements_of_category_2, keys=getParameterValueByName_4)
count = List.Count(list=all_elements_of_category_2)
ofRepeatedItem = List.OfRepeatedItem(item=code_block_18.out1, amount=count)
# note: coded types in selection, edit
# code block for proper sorting!
code_block_19 = CodeBlock(elem=groupByKey_2.groups, code=groupByKey_2.unique_keys, qty=ofRepeatedItem)
# ---------- code_block_19.designscript (4 lines) ----------
// SfB 31
elem[0];
code[0];
qty;
# ----------------------------------------

# group: Element Qantifying, grouped by Tree Structure and Type Code
code_block_20 = CodeBlock(element=code_block_19.out0, code=code_block_19.out1, quantity=code_block_19.qty)
# ---------- code_block_20.designscript (6 lines) ----------
[["(3.)","SECONDARY ELEMENTS, COMPLETION"],
["(31)","External Walls"]];

element;
code;
quantity;
# ----------------------------------------
code_block_21 = CodeBlock { "stk"; sigmaRegulation(); sigmaInstances(); }
# note: Orchid
component_3 = Orchid.Generic.Applications.Sigma.Component(componentTree=code_block_20.out0, element=code_block_20.element, code=code_block_20.code, quantity=code_block_20.quantity, sigmaUnit=code_block_21.out0, sigmaRegulation=code_block_21.out1, instance=code_block_21.out2)

# group: Sigma project from file
# note: Enter path and filename for the Sigma
# project file. Project file must not be compressed!
path_and_filename = CodeBlock { cur = Orchid.Directory.Current; cur + "\\test.sig"; }

# group: Sigma presets
# note: Enter Component Root in Sigma file,
# if DOESN'T exist, remove connection!
# Note: is cAsE sensitive!
branch_root = CodeBlock { ["","Modeled (3D)"]; }
# note: Component Root must
# exist when using clearning!
boolean = BoolSelector(true)  # graph input

# group: Sigma Revit Integration for Dynamo
join = List.Join(list0=component_2, list1=component, list2=component_3)
watch = Watch(join)
document = Orchid.Generic.Applications.Sigma.Document(file=path_and_filename.out1)
# note: Orchid
setData = Orchid.Generic.Applications.Sigma.SetData(document=document, branchRoot=branch_root, clearing=boolean, component=join)
watch_2 = Watch(setData)

# group: Clean a branch
code_block_22 = CodeBlock { ["(2.)","PRIMARY ELEMENTS, CARCASS"]; }
clearing = Orchid.Generic.Applications.Sigma.Clearing(branch=code_block_22)  # frozen
watch_3 = Watch(clearing)

# group: Delete a branch
code_block_23 = CodeBlock { ["(2.)","PRIMARY ELEMENTS, CARCASS"]; }
delete = Orchid.Generic.Applications.Sigma.Delete(branch=code_block_23)  # frozen
watch_4 = Watch(delete)

# group: Sigma project from template
path_and_filename_2 = StringInput("%userprofile%\Documents\Sigma Enterprise\Templates\DanEDU\Estimate (DanEDU).sit")  # graph input
fromPath = Orchid.Generic.Core.File.FromPath(path=path_and_filename_2)
