# Dynamo graph Document Contain.dyn (Dynamo 2.0.2.6826)

# group: Does document contain category?
code_block = CodeBlock()
# ---------- code_block.designscript (4 lines) ----------
// Categories to verify
["Areas","Rooms","Spaces"];
"Levels";
"Stairs";
# ----------------------------------------
containCategory = Orchid.Revit.Core.Document.ContainCategory(category=code_block.out0)
watch = Watch(containCategory)
categories = Categories(index=457)  # graph input

# group: Does document contain type?
code_block_2 = CodeBlock()
# ---------- code_block_2.designscript (4 lines) ----------
// Types to verify
["Area","Room","Space"];
"Level";
"Stairs";
# ----------------------------------------
containType = Orchid.Revit.Core.Document.ContainType(type=code_block_2.out0)
watch_2 = Watch(containType)
element_types = ElementTypes(index=285)  # graph input
