# Dynamo graph File.SaveFamily.dyn (Dynamo 2.0.1.5055)

# group: selected families by category in project
string = StringInput(".\testSet")  # graph input
natural_category_name = CodeBlock()
# ---------- natural_category_name.designscript (12 lines) ----------
[
"Casework",
"Columns",
"Doors",
"Windows",
"Specialty Equipment",
"Structural Columns",
"Structural Foundations",
"Structural Framing",
"Structural Beam Systems",
"Structural Stiffeners"
];
# ----------------------------------------
elementByCategory = Orchid.Revit.Elements.Selection.ElementByCategory(category=natural_category_name)
type = archilab.Revit.Elements.Elements.Type(element=elementByCategory.Element)
family = FamilyType.Family(familyType=type)
flatten = List.Flatten(list=family)
uniqueItems = List.UniqueItems(list=flatten)
clean = Orchid.Generic.Core.List.Clean(list=uniqueItems)
code_block = CodeBlock { true; }
saveFamily = Orchid.Revit.Core.File.SaveFamily(path=string, family=clean, subfolder=code_block)

watch = Watch(saveFamily)
