# Dynamo graph Info-Clipboard.dyn (Dynamo 2.0.1.5055)

# group: Current document Info and copy to clipboard
info = Orchid.Revit.Core.Document.Info()
copyTo = Orchid.Generic.Core.Clipboard.CopyTo(element=info)  # frozen

watch = Watch(info)

# group: File Info and copy to clipboard
path_and_filename = CodeBlock { cur = Orchid.Directory.Current(); cur + "\\testSet (2017)"; }
contents = Orchid.Generic.Core.Directory.Contents(directory=path_and_filename.out1)
info_2 = Orchid.Revit.Core.File.Info(file=contents)
copyTo_2 = Orchid.Generic.Core.Clipboard.CopyTo(element=info_2)

watch_2 = Watch(info_2)
watch_3 = Watch(copyTo_2)
watch_4 = Watch(copyTo)

# group: Clipboard --> copy int
code_block = CodeBlock { 1..5; }
watch_5 = Watch(code_block)
copyTo_3 = Orchid.Generic.Core.Clipboard.CopyTo(element=code_block)  # frozen

# group: Clipboard --> copy element
elementHasMaterial = Orchid.Revit.Elements.Selection.ElementHasMaterial()
code_block_2 = CodeBlock(data=elementHasMaterial.Element) { data[0]; }
watch_6 = Watch(code_block_2)
copyTo_4 = Orchid.Generic.Core.Clipboard.CopyTo(element=code_block_2)  # frozen
