# Dynamo graph List Index (3 nodes).dyn (Dynamo 2.1.0.6255)

# group: Input
code_block = CodeBlock()
# ---------- code_block.designscript (11 lines) ----------
//1D list
["a", "a", "a", "a", "b"];
//2D list
[["a", "a", "a", "a", "b"],
["a", "b", "a"],
["a", "a", "a", "b", "b", "a"]];
//nD list
["a", "a", "b",
["a", "a", "a", "a", "b"],
["a", "b", "a",
["a", "a", "b", "b", "a", "a"]]];
# ----------------------------------------
code_block_2 = CodeBlock { "b"; 9; }
code_block_3 = CodeBlock { "c"; 5; }
code_block_4 = CodeBlock()
# ---------- code_block_4.designscript (11 lines) ----------
//1D list
[1, 1, 9, 1, 1];
//2D list
[[1, 1, 9, 1, 1],
[9, 1, 1],
[1, 1, 9, 9, 1, 1]];
//nD list
[1, 9, 1,
[1, 1, 1, 9, 1],
[1, 1, 9,
[1, 1, 1, 9, 9, 1]]];
# ----------------------------------------
watch = Watch(code_block.out2)

# group: Item index
# note: OOTB node
indexOf = List.IndexOf(list=code_block.out2, element=code_block_2.out0)
watch_2 = Watch(indexOf)
# note: Orchid node
indexOf_2 = Orchid.Generic.Core.List.IndexOf(list=code_block.out2, element=code_block_2.out0)
watch_3 = Watch(indexOf_2)

# group: Get items by code block
code_block_5 = CodeBlock(t=code_block.out2) { t[4][3][3]; }
watch_4 = Watch(code_block_5)

# group: Replace items
# note: Orchid node
replaceItemAtIndex = Orchid.Generic.Core.List.ReplaceItemAtIndex(list=code_block.out2, index=indexOf_2, item=code_block_3.out0)
watch_5 = Watch(replaceItemAtIndex)
# note: OOTB node
replaceItemAtIndex_2 = List.ReplaceItemAtIndex(list=code_block.out2, index=indexOf, item=code_block_3.out0)
watch_6 = Watch(replaceItemAtIndex_2)

# group: Get items
# note: Orchid node
getItemAtIndex = Orchid.Generic.Core.List.GetItemAtIndex(list=code_block.out2, index=indexOf_2)
watch_7 = Watch(getItemAtIndex)
# note: OOTB node
getItemAtIndex_2 = List.GetItemAtIndex(list=code_block.out2, index=indexOf)
watch_8 = Watch(getItemAtIndex_2)
