# Dynamo graph List Index.dyn "List Index (3 nodes)" (Dynamo 2.0.1.5055)

# group: Input
code_block = CodeBlock { dataSet(); element(); replace(); }
code_block_2 = CodeBlock()
# ---------- code_block_2.designscript (53 lines) ----------
def dataSet() {
	// Char data sets
	// 1D list
	c1 = ["a", "a", "a", "a", "b"];

	// 2D list
	c2 = [["a", "a", "a", "a", "b"],
	["a", "b", "a"],
	["a", "a", "a", "b", "b", "a"]];

	// nD list
	c3 = ["a", "a", "b",
	["a", "a", "a", "a", "b"],
	["a", "b", "a",
	["a", "a", "b", "b", "a", "a"]]];

	// nD list
	c4 = ["a", "b", ["a", ["a", "b",
	["a", "b"]], "a", "b"],
	["a", "b", "a",
	["a", "a", "b", "b", "a"]]];

	// Integer data sets
	// 1D list
	i1 = [1, 1, 9, 1, 1];

	// 2D list
	i2 = [[1, 1, 9, 1, 1],
	[9, 1, 1],
	[1, 1, 9, 9, 1, 1]];

	// nD list
	i3 = [1, 9, 1,
	[1, 1, 1, 9, 1],
	[1, 1, 9,
	[1, 1, 1, 9, 9, 1]]];

	// nD list
	i4 = [1, 9, [1, [9, 1,
	[1, 9]], 1, 9],
	[9, 9, 1,
	[1, 9, 9, 1, 1]]];

	// element data set
	t = Orchid.Selection
	.ElementHasMaterial(null);
	e1 = DesignScript.Dictionary
	.ValueAtKey(t, "Element")
	.ElementType;

	// return data set
	return = c3;
};
# ----------------------------------------
code_block_3 = CodeBlock()
# ---------- code_block_3.designscript (7 lines) ----------
def element() {
	t1 = "b";
	t2 = 9;
	t3 = dataSet()[3][1];

	return = t1;
};
# ----------------------------------------
code_block_4 = CodeBlock()
# ---------- code_block_4.designscript (7 lines) ----------
def replace() {
	t1 = "c";
	t2 = 5;
	t3 = dataSet()[3][0];

	return = t1;
};
# ----------------------------------------

# group: Item index
# note: OOTB node
indexOf = List.IndexOf(list=code_block.out0, element=code_block.out1)
watch = Watch(indexOf)
# note: Orchid node
indexOf_2 = Orchid.Generic.Core.List.IndexOf(list=code_block.out0, element=code_block.out1)
watch_2 = Watch(indexOf_2)

# group: Get items by code block
code_block_5 = CodeBlock(t=code_block.out0) { t[4][3][3]; }
watch_3 = Watch(code_block_5)

# group: Replace items
# note: Orchid node
replaceItemAtIndex = Orchid.Generic.Core.List.ReplaceItemAtIndex(list=code_block.out0, index=indexOf_2, item=code_block.out2)
watch_4 = Watch(replaceItemAtIndex)
# note: OOTB node
replaceItemAtIndex_2 = List.ReplaceItemAtIndex(list=code_block.out0, index=indexOf, item=code_block.out2)
watch_5 = Watch(replaceItemAtIndex_2)

watch_6 = Watch(code_block.out0)

# group: Get items
# note: Orchid node
getItemAtIndex = Orchid.Generic.Core.List.GetItemAtIndex(list=code_block.out0, index=indexOf_2)
watch_7 = Watch(getItemAtIndex)
# note: OOTB node
getItemAtIndex_2 = List.GetItemAtIndex(list=code_block.out0, index=indexOf)
watch_8 = Watch(getItemAtIndex_2)
