# Dynamo graph List.Clean.dyn (Dynamo 2.0.1.5055)

list_values = CodeBlock()
# ---------- list_values.designscript (6 lines) ----------
[
"a","a", 0,
[],null,"",
"something",
"whatever"
];
# ----------------------------------------
clean = Orchid.Generic.Core.List.Clean(list=list_values)
watch = Watch(clean)
searchfor_values = CodeBlock()
# ---------- searchfor_values.designscript (8 lines) ----------
//default values
[[], null, ""];

//various test values
[[]];
"something";
["something", []];
[[], null, 0, "", "whatever"];
# ----------------------------------------
list_values_2 = CodeBlock()
# ---------- list_values_2.designscript (9 lines) ----------
[
"a","a", 0,
[],null,"",
"something",
[[["in",[]],
"several",null],
"depths","",0],
"whatever"
];
# ----------------------------------------
clean_2 = Orchid.Generic.Core.List.Clean(list=list_values_2)
watch_2 = Watch(clean_2)
watch_3 = Watch(list_values_2)
code_block = CodeBlock(list=list_values) { Orchid.Core.List.Clean(list,searchFor); }  # unwired: searchFor
watch_4 = Watch(code_block)
