# Dynamo graph List.Replace.dyn (Dynamo 2.0.1.5055)

searchfor_values = CodeBlock()
# ---------- searchfor_values.designscript (8 lines) ----------
//default values
[[], null, ""];

//various test values
[[]];
"something";
["something", []];
[[], null, 0, "", "whatever"];
# ----------------------------------------
code_block = CodeBlock()
# ---------- code_block.designscript (10 lines) ----------
//list values
[
[0,0,0],
["","",""],
[2,2,2]
];
//searchFor
"";
//replaceWith value
1;
# ----------------------------------------
replace = Orchid.Generic.Core.List.Replace(list=code_block.out0, searchFor=code_block.out1, replaceWith=code_block.out2)
watch = Watch(replace)
list_values = CodeBlock()
# ---------- list_values.designscript (9 lines) ----------
[
"a","a", 0,
[],null,"",
"something",
[[["in",[]],
"several",null],
"depths","",0],
"whatever"
];
# ----------------------------------------
replacewith_value = CodeBlock { "x"; }
replace_2 = Orchid.Generic.Core.List.Replace(list=list_values, replaceWith=replacewith_value)
watch_2 = Watch(replace_2)
list_values_2 = CodeBlock()
# ---------- list_values_2.designscript (6 lines) ----------
[
"a","a", 0,
[],null,"",
"something",
"whatever"
];
# ----------------------------------------
replace_3 = Orchid.Generic.Core.List.Replace(list=list_values_2, replaceWith=replacewith_value)
watch_3 = Watch(replace_3)
watch_4 = Watch(list_values)
code_block_2 = CodeBlock(list=list_values_2, replaceWith=replacewith_value) { Orchid.List.Replace(list, searchFor, replaceWith); }  # unwired: searchFor
watch_5 = Watch(code_block_2)
