# Dynamo graph Sorting.dyn (Dynamo 2.1.0.6255)

# group: testbed
code_block = CodeBlock { ["elm0", "elm10", "elm1", "Elm 2", "elm9", "Elm 11", "alm12", "elm13"]; }
code_block_2 = CodeBlock()
# ---------- code_block_2.designscript (6 lines) ----------
[
["elm0", "Elm 2", "elm10", "elm1","elm9",
["olm0", "olm10", "olm1", "Olm 2", "olm9"]
],
["Elm1", "elm5", "alm12"]
];
# ----------------------------------------
code_block_3 = CodeBlock { [["elm0", "elm10", "elm1", "Elm 2", "elm9"], ["Elm 11", "alm12", "elm13"]]; }
code_block_4 = CodeBlock { [[1,2,3,[6,4,5]],[2,1,5],[4,3,2]]; }
code_block_5 = CodeBlock()
# ---------- code_block_5.designscript (7 lines) ----------
[
[
["elm0", "Elm 2", "elm10", "elm1","elm9"],
["olm0", "olm10", "olm1", "Olm 2", "olm9"]
],
["Elm11", "alm12", "elm13"]
];
# ----------------------------------------
code_block_6 = CodeBlock { ["c",4,2.2,"b",6,"a1",3,"a10","a9"]; }

boolean = BoolSelector(false)  # graph input
sort = Orchid.Generic.Core.List.Sort(list=code_block_2, descending=boolean)
my_sort = Watch(sort)
sort_2 = List.Sort(list=code_block_2)
built_in = Watch(sort_2)
sortNatural = Orchid.Generic.Core.List.SortNatural(list=code_block_2, descending=boolean)
my_sort_natural = Watch(sortNatural)
input = Watch(code_block_2)

# group: numbers and chars mixed
sortNatural_2 = Orchid.Generic.Core.List.SortNatural(list=code_block_6)
code_block_7 = CodeBlock(t=sortNatural_2) { t[0]+t[1]; }
sort_3 = List.Sort(list=code_block_6)
code_block_8 = CodeBlock(t=sort_3) { t[0]+t[1]; }
type = Object.Type(obj=sortNatural_2)
type_2 = Object.Type(obj=sort_3)
sort_4 = Orchid.Generic.Core.List.Sort(list=code_block_6)
type_3 = Object.Type(obj=sort_4)

# group: ASCII table
string = StringInput(".\")  # graph input
string_2 = StringInput("AsciiTable.txt")  # graph input
contentsAll = Orchid.Generic.Core.Directory.ContentsAll(directory=string, searchString=string_2)
readText = FileSystem.ReadText(file=contentsAll)
string_3 = StringInput("\n")  # graph input
split = String.Split(str=readText, separater0=string_3)
shuffle = List.Shuffle(list=split)

sort_5 = List.Sort(list=shuffle)
built_in_2 = Watch(sort_5)
sort_6 = Orchid.Generic.Core.List.Sort(list=shuffle)
my_sort_2 = Watch(sort_6)
ascii = Watch(split)

# group: Revit elements
categories = Categories(index=619)  # graph input
all_elements_of_category = ElementsOfCategory(Category=categories)
categories_2 = Categories(index=159)  # graph input
all_elements_of_category_2 = ElementsOfCategory(Category=categories_2)
categories_3 = Categories(index=604)  # graph input
all_elements_of_category_3 = ElementsOfCategory(Category=categories_3)
code_block_9 = CodeBlock(Windows=all_elements_of_category, Doors=all_elements_of_category_2, Walls=all_elements_of_category_3)
# ---------- code_block_9.designscript (7 lines) ----------
[Windows,
Doors,
Walls];

[Windows.Name,
Doors.Name,
Walls.Name];
# ----------------------------------------
code_block_10 = CodeBlock(Windows=all_elements_of_category, Doors=all_elements_of_category_2, Walls=all_elements_of_category_3)
# ---------- code_block_10.designscript (7 lines) ----------
[Windows,
[Doors,
[Walls]]];

[Windows.Name,
[Doors.Name,
[Walls.Name]]];
# ----------------------------------------

sort_7 = List.Sort(list=code_block_9.out1)
built_in_3 = Watch(sort_7)
boolean_2 = BoolSelector(false)  # graph input
sortNatural_3 = Orchid.Generic.Core.List.SortNatural(list=code_block_10.out1, descending=boolean_2)
my_sort_natural_2 = Watch(sortNatural_3)
sort_8 = Orchid.Generic.Core.List.Sort(list=code_block_10.out1, descending=boolean_2)
my_sort_3 = Watch(sort_8)
input_2 = Watch(code_block_9.out1)
sortNatural_4 = Orchid.Generic.Core.List.SortNatural(list=code_block_10.out0, descending=boolean_2)
my_sort_natural_3 = Watch(sortNatural_4)
sort_9 = Orchid.Generic.Core.List.Sort(list=code_block_10.out0, descending=boolean_2)
my_sort_4 = Watch(sort_9)
sort_10 = List.Sort(list=code_block_9.out0)
built_in_4 = Watch(sort_10)
code_block_11 = CodeBlock(list=code_block_2, descending=boolean) { Orchid.List.SortNatural(list,descending); }
watch = Watch(code_block_11)
