# Dynamo graph Delete.dyn (Dynamo 2.1.0.6255)

categories = Categories(index=619)  # graph input
all_elements_of_category = ElementsOfCategory(Category=categories)
categories_2 = Categories(index=159)  # graph input
all_elements_of_category_2 = ElementsOfCategory(Category=categories_2)
categories_3 = Categories(index=506)  # graph input
all_elements_of_category_3 = ElementsOfCategory(Category=categories_3)
code_block = CodeBlock(Windows=all_elements_of_category, Doors=all_elements_of_category_2, columns=all_elements_of_category_3)
# ---------- code_block.designscript (3 lines) ----------
[Windows,
[Doors,
[columns]]];
# ----------------------------------------
categories_4 = Categories(index=604)  # graph input
all_elements_of_category_4 = ElementsOfCategory(Category=categories_4)
code_block_2 = CodeBlock(Windows=all_elements_of_category, Doors=all_elements_of_category_2, Walls=all_elements_of_category_4)
# ---------- code_block_2.designscript (3 lines) ----------
[Windows,
[Doors,
[Walls]]];
# ----------------------------------------
delete = Orchid.Revit.Elements.Element.Delete(element=code_block_2)
watch = Watch(delete)
code_block_3 = CodeBlock(element=code_block_2) { Orchid.Element.Delete(element); }  # frozen
