# Dynamo graph MaterialDensity.dyn (Dynamo 2.1.0.6255)

natural_category_name = CodeBlock()
# ---------- natural_category_name.designscript (26 lines) ----------
[
"Casework",
"Ceilings",
"Columns",
"Curtain Wall Mullions",
"Curtain Panels",
"Curtain Systems",
"Doors",
"Entourage",
"Floors",
"Furniture",
"Furniture Systems",
"Generic Models",
"Plumbing Fixtures",
"Ramps",
"Roofs",
"Specialty Equipment",
"Stairs",
"Structural Columns",
"Structural Foundations",
"Structural Framing",
"Structural Beam Systems",
"Structural Stiffeners",
"Walls",
"Windows"
];
# ----------------------------------------
byName = Category.ByName(name=natural_category_name)
all_elements_of_category = ElementsOfCategory(Category=byName)
code_block = CodeBlock { [[], null, ""]; }
clean = Orchid.Generic.Core.List.Clean(list=all_elements_of_category, searchFor=code_block)
# note: Clockwork
materials = Custom[Element.Materials](element=clean)  # Retrieves all materials froma given element
flatten = List.Flatten(list=materials.materialVolumes)
flatten_2 = List.Flatten(list=materials.materials)
groupByKey = List.GroupByKey(list=flatten, keys=flatten_2)
sum = Math.Sum(values=groupByKey.groups)
watch = Watch(sum)
materialDensity = Orchid.Revit.Elements.Element.MaterialDensity(material=groupByKey.unique_keys)
watch_2 = Watch(materialDensity.thermal)
watch_3 = Watch(materialDensity.name)
name = Element.Name(element=groupByKey.unique_keys)
watch_4 = Watch(name)
watch_5 = Watch(materialDensity.physical)
