# Dynamo graph Parameter.dyn "Parameter - Kopi (2)" (Dynamo 2.0.2.6826)

# group: Add project parameter
code_block = CodeBlock()
# ---------- code_block.designscript (10 lines) ----------
//Parameter name
["test1","test2"];
//Parameter type
"Text";
//Parameter group
"PG_IDENTITY_DATA";
//Instances
true;
//Category
["Walls","Windows"];
# ----------------------------------------
byName = Category.ByName(name=code_block.out4)
addProjectParameter = Orchid.Revit.Elements.Parameter.AddProjectParameter(parameterName=code_block.out0, type=code_block.out1, group=code_block.out2, category=byName)  # frozen

# group: Add shared parameter
# note: Please notice that I use a tab in my "SP Parameter group" names. This is not standard!
# "Sheet & Project" would be the normal way!
code_block_2 = CodeBlock()
# ---------- code_block_2.designscript (14 lines) ----------
//Parameter name
["Creator Name",
"Creator Organization",
"Creator Build"];
//SP Parameter group
"01:   Sheet & Project";
//SP Parameter type
"Text";
//Parameter group
"PG_ADSK_MODEL_PROPERTIES";
//Instances
true;
//Category
"Doors";
# ----------------------------------------
byName_2 = Category.ByName(name=code_block_2.out5)
addSharedParameter = Orchid.Revit.Elements.Parameter.AddSharedParameter(parameterName=code_block_2.out0, groupName=code_block_2.out1, type=code_block_2.out2, group=code_block_2.out3, category=byName_2)  # frozen

# group: Change parameter and category binding in the project
code_block_3 = CodeBlock()
# ---------- code_block_3.designscript (8 lines) ----------
//Parameter name
"Creator Name";
//Instances
true;
//Category
["Doors",
"Entourage",
"Floors"];
# ----------------------------------------
byName_3 = Category.ByName(name=code_block_3.out2)
changeCategory = Orchid.Revit.Elements.Parameter.ChangeCategory(parameterName=code_block_3.out0, category=byName_3)  # frozen

# group: Delete parameter
code_block_4 = CodeBlock()
# ---------- code_block_4.designscript (2 lines) ----------
["Creator Build",
"test2"];
# ----------------------------------------
deleteParameter = Orchid.Revit.Elements.Parameter.DeleteParameter(parameterName=code_block_4)  # frozen

# group: Add basic IFC parameter
addIfcParameter = Orchid.Revit.Elements.Parameter.AddIfcParameter()
