# Dynamo graph changeMaterial.dyn (Dynamo 2.1.0.6255)

categories = Categories(index=604)  # graph input
all_elements_of_category = ElementsOfCategory(Category=categories)
elementType = Element.ElementType(element=all_elements_of_category)
uniqueItems = List.UniqueItems(list=elementType)
code_block = CodeBlock { ["MyMat1","MyMat2"]; ["Glass","Copper"]; }
byName = Material.ByName(name=code_block.out1)
code_block_2 = CodeBlock { [0,1]; }
setCompoundLayerMaterial = Orchid.Revit.Elements.SystemFamily.SetCompoundLayerMaterial(elementType=uniqueItems, material=byName, index=code_block_2)
watch = Watch(setCompoundLayerMaterial)
