# Dynamo graph Collect families in project.dyn (Dynamo 2.0.1.5055)

# group: Open all files in directory and sub directories
string = StringInput("C:\Users\erfajo\Programming\Unit Testing\testSet")  # graph input
code_block = CodeBlock { "*.rfa"; true; }
contents = Orchid.Generic.Core.Directory.Contents(directory=string, searchString=code_block.out0)  # frozen
backgroundOpen = Orchid.Revit.Core.Document.BackgroundOpen(file=contents)

# group: Close files
boolean = BoolSelector(true)  # graph input
close = Orchid.Revit.Core.Document.Close(save=boolean)  # frozen; unwired: document

# group: Collect family as document from current document
code_block_2 = CodeBlock { ["Doors","Windows"]; }
elementByCategory = Orchid.Revit.Elements.Selection.ElementByCategory(category=code_block_2)
type = archilab.Revit.Elements.Elements.Type(element=elementByCategory.Element)
family = FamilyType.Family(familyType=type)
flatten = List.Flatten(list=family)
uniqueItems = List.UniqueItems(list=flatten)
getFamilyDocument = Orchid.Revit.Elements.Family.GetFamilyDocument(family=uniqueItems)

# note: Please notice that I use a tab in my "SP Parameter group" names. This is not standard!
# "Sheet & Project" would be the normal way!
code_block_3 = CodeBlock()
# ---------- code_block_3.designscript (12 lines) ----------
//Parameter name
"Creator Build";
//SP Parameter group
"01:   Sheet & Project";
//SP Parameter type
"Text";
//Parameter group
"PG_ADSK_MODEL_PROPERTIES";
//Instances
true;
//Reporting
false;
# ----------------------------------------
addSharedParameter = Orchid.Revit.FamilyDocument.Parameter.AddSharedParameter(familyDocument=getFamilyDocument, parameterName=code_block_3.out0, groupName=code_block_3.out1, type=code_block_3.out2, group=code_block_3.out3, instance=code_block_3.out4)

# group: load back into the current project
loadFamily = Orchid.Revit.FamilyDocument.Document.LoadFamily(familyDocument=addSharedParameter)
close_2 = Orchid.Revit.Core.Document.Close(document=loadFamily)
