# Dynamo graph FamilyDocument (all).dyn (Dynamo 2.0.1.5055)

# group: OOTB parameter nodes
select_builtin_parameter_group = BuiltInParameterGroup(index=0)  # graph input
watch = Watch(select_builtin_parameter_group)
select_parameter_type = ParameterType(index=73)  # graph input
watch_2 = Watch(select_parameter_type)

# group: Add shared parameter
# note: Please notice that I use a tab in my "SP Parameter group" names. This is not standard!
# "Sheet & Project" would be the normal way!
code_block = CodeBlock()
# ---------- code_block.designscript (16 lines) ----------
//Parameter name
["Creator Name",
"Creator Organization",
"Creator Build"];
//SP Parameter group
"01:   Sheet & Project";
//SP Parameter type
"Text";
//Parameter group
"PG_ADSK_MODEL_PROPERTIES";
//Tooltip
"Owner value";
//Instances
true;
//Reporting
false;
# ----------------------------------------
addSharedParameter = Orchid.Revit.FamilyDocument.Parameter.AddSharedParameter(parameterName=code_block.out0, groupName=code_block.out1, type=code_block.out2, group=code_block.out3, tooltip=code_block.out4, instance=code_block.out5)

# group: Utilities
current = Orchid.Revit.Core.Document.Current()
name = Orchid.Revit.Core.Document.Name(document=current)
code_block_2 = CodeBlock()
# ---------- code_block_2.designscript (2 lines) ----------
//Types to create
["Type 1", "Type 2"];
# ----------------------------------------
create = Orchid.Revit.FamilyDocument.FamilyType.Create(name=code_block_2)
current_2 = Orchid.Revit.FamilyDocument.FamilyType.Current()
name_2 = Orchid.Revit.FamilyDocument.FamilyType.Name(familyType=current_2)
loadFamily = Orchid.Revit.FamilyDocument.Document.LoadFamily()  # unwired: familyDocument
save = Orchid.Revit.Core.Document.Save()
code_block_3 = CodeBlock { "test"; }
saveAs = Orchid.Revit.Core.Document.SaveAs(name=code_block_3)
parameters = Orchid.Revit.FamilyDocument.Parameter.Parameters()

# group: Close files
boolean = BoolSelector(false)  # graph input
close = Orchid.Revit.Core.Document.Close(save=boolean)  # unwired: document

# group: Open all files in directory and sub directories
string = StringInput("C:\Users\erfajo\Programming\Unit Testing\testSet")  # graph input
code_block_4 = CodeBlock { "*.rfa"; }
boolean_2 = BoolSelector(false)  # graph input
contents = Orchid.Generic.Core.Directory.Contents(directory=string, searchString=code_block_4, deepSearch=boolean_2)
backgroundOpen = Orchid.Revit.Core.Document.BackgroundOpen(file=contents)

# group: Add parameter
code_block_5 = CodeBlock()
# ---------- code_block_5.designscript (13 lines) ----------
//Parameter name
["Test","something"];
//Parameter type
"Text";
//"Length";
//Parameter group
"PG_ADSK_MODEL_PROPERTIES";
//Tooltip
"Owner value";
//Instances
false;
//Reporting
true;
# ----------------------------------------
addParameter = Orchid.Revit.FamilyDocument.Parameter.AddParameter(parameterName=code_block_5.out0, type=code_block_5.out1, group=code_block_5.out2)

# group: Get all family type
all = Orchid.Revit.FamilyDocument.FamilyType.All()
name_3 = Orchid.Revit.FamilyDocument.FamilyType.Name(familyType=all.FamilyType)

# group: Delete parameter
code_block_6 = CodeBlock()
# ---------- code_block_6.designscript (4 lines) ----------
//Parameter name
["Creator Name",
"Creator Organization",
"Creator Build"];
# ----------------------------------------
delete = Orchid.Revit.FamilyDocument.Parameter.Delete(parameterName=code_block_6)

# group: Delete type
code_block_7 = CodeBlock()
# ---------- code_block_7.designscript (3 lines) ----------
//Type name
"Type 1";
"Type 2";
# ----------------------------------------
delete_2 = Orchid.Revit.FamilyDocument.FamilyType.Delete(familyType=code_block_7.out0)

# group: IsReporting parameter
code_block_8 = CodeBlock()
# ---------- code_block_8.designscript (5 lines) ----------
//Parameter name
["Test",
"something",
"Keynote",
"Model"];
# ----------------------------------------
isReporting = Orchid.Revit.FamilyDocument.Parameter.IsReporting(parameterName=code_block_8)

# group: Rename type
code_block_9 = CodeBlock()
# ---------- code_block_9.designscript (4 lines) ----------
//Source name
"Type 1";
//Target name
"Type 3";
# ----------------------------------------
rename = Orchid.Revit.FamilyDocument.FamilyType.Rename(sourceName=code_block_9.out0, targetName=code_block_9.out1)

# group: Rename parameter
code_block_10 = CodeBlock()  # same code as code_block_9
rename_2 = Orchid.Revit.FamilyDocument.Parameter.Rename(sourceName=code_block_10.out0, targetName=code_block_10.out1)

# group: Remove formula
code_block_11 = CodeBlock()  # same code as code_block_6
remove = Orchid.Revit.FamilyDocument.Formula.Remove(parameterName=code_block_11)

# group: Associate parameter
code_block_12 = CodeBlock()
# ---------- code_block_12.designscript (4 lines) ----------
//Parameter name
"Width";
//Parameter name
"Width";
# ----------------------------------------
associate = Orchid.Revit.FamilyDocument.Parameter.Associate(documentParameter=code_block_12.out0, familyParameter=code_block_12.out1)  # unwired: familyType

# group: Get nested families and family types
getNested = Orchid.Revit.FamilyDocument.Family.GetNested()
getNested_2 = Orchid.Revit.FamilyDocument.FamilyType.GetNested()
toDynamoElement = Orchid.Revit.Core.Object.ToDynamoElement(element=getNested_2.FamilyType)
toAutodeskElement = Orchid.Revit.Core.Object.ToAutodeskElement(element=toDynamoElement)
name_4 = Element.Name(element=toDynamoElement)

# group: Add lookup table
string_2 = StringInput("C:\Users\erfajo\Programming\Unit Testing\testSet\CSVLookuptable.csv")  # graph input
addLookupTable = Orchid.Revit.FamilyDocument.Document.AddLookupTable(file=string_2)

# group: Add parameter (Category)
code_block_13 = CodeBlock()
# ---------- code_block_13.designscript (10 lines) ----------
//Parameter name
["testFamily"];
//Parameter group
"PG_ADSK_MODEL_PROPERTIES";
//Tooltip
"Owner value";
//Instances
true;
//Reporting
false;
# ----------------------------------------
categories = Categories(index=106)  # graph input
addParameter_2 = Orchid.Revit.FamilyDocument.Parameter.AddParameter(parameterName=code_block_13.out0, category=categories, group=code_block_13.out1)

# group: Set parameter
code_block_14 = CodeBlock()
# ---------- code_block_14.designscript (6 lines) ----------
//Type
"Type 1";
//Parameter name
"Test";
//Value
"This is a test";
# ----------------------------------------
setValue = Orchid.Revit.FamilyDocument.Parameter.SetValue(parameterName=code_block_14.out1, value=code_block_14.out2)

# group: Get Parameter
code_block_15 = CodeBlock()
# ---------- code_block_15.designscript (7 lines) ----------
//Type name
//"Type 1";
["Type 1", "Type 2"];
//Parameter name
["Creator Name",
"Creator Organization",
"Creator Build"];
# ----------------------------------------
getValue = Orchid.Revit.FamilyDocument.Parameter.GetValue(familyType=code_block_15.out0, parameterName=code_block_15.out1)

# group: Set formula
code_block_16 = CodeBlock()
# ---------- code_block_16.designscript (8 lines) ----------
//Parameter name
["Creator Name",
"Creator Organization",
"Creator Build"];
//Values
["\"Erik Falck Jørgensen\"",
"\"Danish Educational Content\"",
"\"2017.0418.0\""];
# ----------------------------------------
setValue_2 = Orchid.Revit.FamilyDocument.Formula.SetValue(parameterName=code_block_16.out0, value=code_block_16.out1)

# group: Get Formula
code_block_17 = CodeBlock()  # same code as code_block_6
getValue_2 = Orchid.Revit.FamilyDocument.Formula.GetValue(parameterName=code_block_17)

# group: Remove parameter value
code_block_18 = CodeBlock()
# ---------- code_block_18.designscript (6 lines) ----------
//Parameter name
["Creator Name",
"Creator Organization",
"Creator Build"];
//value
["","",""];
# ----------------------------------------
setValue_3 = Orchid.Revit.FamilyDocument.Parameter.SetValue(parameterName=code_block_18.out0, value=code_block_18.out1)

# group: Set the document category
categories_2 = Categories(index=106)  # graph input
setCategory = Orchid.Revit.FamilyDocument.Document.SetCategory(category=categories_2)

# group: Get the document category
getCategory = Orchid.Revit.FamilyDocument.Document.GetCategory()
