# Dynamo graph ImportImage.dyn (Dynamo 2.0.1.5055)

# group: Create default family type
code_block = CodeBlock()
# ---------- code_block.designscript (2 lines) ----------
//Types to create
["Type 1", "Type 2"];
# ----------------------------------------
create = Orchid.Revit.FamilyDocument.FamilyType.Create()

# group: Open all files in directory and sub directories
string = StringInput(".\testSet")  # graph input
code_block_2 = CodeBlock { "*.rfa"; }
boolean = BoolSelector(false)  # graph input
contents = Orchid.Generic.Core.Directory.Contents(directory=string, searchString=code_block_2, deepSearch=boolean)
backgroundOpen = Orchid.Revit.Core.Document.BackgroundOpen(file=contents)  # frozen

# group: Create parameter
code_block_3 = CodeBlock()
# ---------- code_block_3.designscript (10 lines) ----------
//Parameter name
"Test";
//Parameter type
"Image";
//Parameter group
"PG_ADSK_MODEL_PROPERTIES";
//Instances
false;
//Reporting
true;
# ----------------------------------------
addParameter = Orchid.Revit.FamilyDocument.Parameter.AddParameter(familyDocument=create, parameterName=code_block_3.out0, type=code_block_3.out1, group=code_block_3.out2)

# group: import image
string_2 = StringInput(".\DefaultCustomNode.Small.png")  # graph input
importImage = Orchid.Revit.Core.Document.ImportImage(path=string_2)

# group: Set parameter
code_block_4 = CodeBlock()
# ---------- code_block_4.designscript (6 lines) ----------
//Type
"Type 1";
//Parameter name
"Test";
//Value
"_default.Large.png";
# ----------------------------------------
setValue = Orchid.Revit.FamilyDocument.Parameter.SetValue(familyDocument=addParameter, parameterName=code_block_4.out1, value=importImage)

# group: Close files
boolean_2 = BoolSelector(false)  # graph input
close = Orchid.Revit.Core.Document.Close(save=boolean_2)  # frozen; unwired: document

watch = Watch(importImage)
element_types = ElementTypes(index=158)  # graph input
all_elements_of_type = ElementsOfType(element_type=element_types)
watch_2 = Watch(all_elements_of_type)
