# Dynamo graph SetGetParameter.dyn (Dynamo 2.0.1.5055)

directory_path = StringInput(".\testSet")  # graph input
string = StringInput("*.rfa")  # graph input
boolean = BoolSelector(false)  # graph input
contents = Orchid.Generic.Core.Directory.Contents(directory=directory_path, searchString=string, deepSearch=boolean)
backgroundOpen = Orchid.Revit.Core.Document.BackgroundOpen(file=contents)
create = Orchid.Revit.FamilyDocument.FamilyType.Create(familyDocument=backgroundOpen)
code_block = CodeBlock(doc=create) { doc; }
all = Orchid.Revit.FamilyDocument.FamilyType.All(familyDocument=code_block)
code_block_2 = CodeBlock()
# ---------- code_block_2.designscript (4 lines) ----------
//parameter name
["Model", "Description"];
//value
["Testing1", "Testing2"];
# ----------------------------------------
setValue = Orchid.Revit.FamilyDocument.Parameter.SetValue(familyDocument=all.Document, familyType=all.FamilyType, parameterName=code_block_2.out0, value=code_block_2.out1)
getValue = Orchid.Revit.FamilyDocument.Parameter.GetValue(familyDocument=setValue, familyType=all.FamilyType, parameterName=code_block_2.out0)
boolean_2 = BoolSelector(true)  # graph input
close = Orchid.Revit.Core.Document.Close(document=getValue.Document, save=boolean_2)

# group: Cleanup backup files
await_ = Orchid.Generic.Core.Data.Await(pass=directory_path, waitFor=close)
string_2 = StringInput("*.0001.rfa")  # graph input
boolean_3 = BoolSelector(true)  # graph input
contents_2 = Orchid.Generic.Core.Directory.Contents(directory=await_, searchString=string_2, deepSearch=boolean_3)
deleteFile = FileSystem.DeleteFile(path=contents_2)

code_block_3 = CodeBlock()
# ---------- code_block_3.designscript (4 lines) ----------
//parameter name
"Model";
//value
"Testing";
# ----------------------------------------
current = Orchid.Revit.FamilyDocument.FamilyType.Current()  # frozen
current_2 = Orchid.Revit.FamilyDocument.FamilyType.Current(familyDocument=code_block)  # frozen
name = Orchid.Revit.FamilyDocument.FamilyType.Name(familyType=all.FamilyType)
watch = Watch(name)
all_2 = Orchid.Revit.FamilyDocument.FamilyType.All()  # frozen
