# Dynamo graph BuiltInParameter.dyn "BuiltInParameter_20" (Dynamo 2.0.2.6826)

all = Orchid.Revit.Core.BuiltInParameter.All()
name = Orchid.Revit.Core.BuiltInParameter.Name(parameter=all)
watch = Watch(name)
watch_2 = Watch(all)
builtin_parameter = BuiltInParameterDD(index=1148)  # graph input
watch_3 = Watch(builtin_parameter)
name_2 = Orchid.Revit.Core.BuiltInParameter.Name(parameter=builtin_parameter)
watch_4 = Watch(name_2)
label = Orchid.Revit.Core.BuiltInParameter.Label(parameter=all)
watch_5 = Watch(label)
label_2 = Orchid.Revit.Core.BuiltInParameter.Label(parameter=builtin_parameter)
watch_6 = Watch(label_2)
