# Dynamo graph Directory-Rename.dyn "Directory-Rename (2 nodes)" (Dynamo 2.0.1.5055)

# group: Open all files in directory and sub directories
string = StringInput(".\testSet")  # graph input
code_block = CodeBlock { "*.rfa"; false; }
contents = Orchid.Generic.Core.Directory.Contents(directory=string, searchString=code_block.out0, deepSearch=code_block.out1)

watch = Watch(contents)
code_block_2 = CodeBlock { false; }
fileName = FileSystem.FileName(path=contents, withExtension=code_block_2)

# group: rename all files in directory and sub directories
string_2 = StringInput(".\testSet")  # graph input
code_block_3 = CodeBlock()
# ---------- code_block_3.designscript (3 lines) ----------
"rfa";
//new names (check list length)
["dummy1","dummy2"];
# ----------------------------------------
rename = Orchid.Generic.Core.File.Rename(directory=string_2, extension=code_block_3.out0, sourceName=fileName, targetName=code_block_3.out1)

watch_2 = Watch(rename)
directory_path = StringInput(".\testSet")  # graph input
code_block_4 = CodeBlock { "*.rfa"; false; }
contents_2 = Orchid.Generic.Core.Directory.Contents(directory=directory_path, searchString=code_block_4.out0, deepSearch=code_block_4.out1)
partition = DoubleInput(1)  # graph input
sliced_into = DoubleInput(2)  # graph input
count = List.Count(list=contents_2)
code_block_5 = CodeBlock(partition=partition, sliced=sliced_into, count=count)
# ---------- code_block_5.designscript (4 lines) ----------
//start
Math.Floor(((partition-1)/sliced)*count);
//end
Math.Ceiling((partition/sliced)*count);
# ----------------------------------------
slice = List.Slice(list=contents_2, start=code_block_5.out0, end=code_block_5.out1)
watch_3 = Watch(slice)
