# Dynamo graph Ifc.dyn (Dynamo 2.0.2.6826)

# group: Prebuild IFC setting
ifc_setting = SettingDD(index=9)  # graph input
settingByName = Orchid.Revit.Core.IFC.SettingByName(name=ifc_setting)

# group: IFC setting --> General
ifc_space_boundary = SpaceBoundaryDD(index=1)  # graph input
ifc_project_origin = SitePlacementDD(index=3)  # graph input
boolean = BoolSelector(true)  # graph input
settingGeneral = Orchid.Revit.Core.IFC.SettingGeneral(setting=settingByName, spaceBoundary=ifc_space_boundary, projectOrigin=ifc_project_origin, splitByLevel=boolean)
ifc_file_type = FileTypeDD(index=0)  # graph input
ifc_version = VersionDD(index=8)  # graph input

# group: IFC setting --> Additional/LOD
boolean_2 = BoolSelector(true)  # graph input
ifc_level_of_detail = LevelOfDetailDD(index=2)  # graph input
settingAdditional = Orchid.Revit.Core.IFC.SettingAdditional(setting=settingGeneral, VisibleElements=boolean_2, LOD=ifc_level_of_detail)

# group: IFC setting --> Property
boolean_3 = BoolSelector(true)  # graph input
code_block = CodeBlock { t1 = Orchid.Directory.Current; t2 = "test"; t1+"\\"+t2; }
settingProperty = Orchid.Revit.Core.IFC.SettingProperty(setting=settingAdditional, baseQuantities=boolean_3, userPropertyFile=code_block.out2)

# group: IFC setting --> Advanced
boolean_4 = BoolSelector(true)  # graph input
settingAdvanced = Orchid.Revit.Core.IFC.SettingAdvanced(setting=settingProperty, storeGuid=boolean_4)

# group: IFC setting file format
type = Object.Type(obj=settingAdvanced)
watch = Watch(type)
watch_2 = Watch(settingAdvanced)

# group: IFC Export
current = Orchid.Generic.Core.Directory.Current()
string = StringInput("test")  # graph input
code_block_2 = CodeBlock(t1=current, t2=string) { t1+"\\"+t2; }
views = Views(index=0)  # graph input
export = Orchid.Revit.Core.IFC.Export(setting=settingAdvanced, view=views)
watch_3 = Watch(export)
boolean_5 = BoolSelector(false)  # graph input
phases = PhaseDD(index=0)  # graph input

# group: IFC Export --> Multiple document export
file_path = Filename("..\..\Data\2019_defaultBuilding.rvt")  # graph input
backgroundOpen = Orchid.Revit.Core.Document.BackgroundOpen(file=file_path)
export_2 = Orchid.Revit.Core.IFC.Export(document=backgroundOpen)
await_ = Orchid.Generic.Core.DataStream.Await(pass=backgroundOpen, waitFor=export_2)
close = Orchid.Revit.Core.Document.Close(document=await_)
watch_4 = Watch(export_2)

# group: IFC Export based on prebuild IFC setting and a view
ifc_setting_2 = SettingDD(index=1)  # graph input; frozen
settingByName_2 = Orchid.Revit.Core.IFC.SettingByName(name=ifc_setting_2)
views_2 = Views(index=0)  # graph input
export_3 = Orchid.Revit.Core.IFC.Export(setting=settingByName_2, view=views_2)
