# Dynamo graph LinkedDocument.dyn "LinkedDocument_20" (Dynamo 2.0.2.6826)

string = StringInput("C:\Users\erfajo\Programming\Source\Testing\Data\")  # graph input
string_2 = StringInput("2019_defaultProject")  # graph input
code_block = CodeBlock(a=string, b=string_2) { a+b+".rvt"; }
fromPath = Orchid.Generic.Core.File.FromPath(path=code_block)

# group: Revit links
linkedRevitFile = Orchid.Revit.Core.Document.LinkedRevitFile()
linkReload = Orchid.Revit.Core.Document.LinkReload(link=linkedRevitFile)  # frozen
linkRepath = Orchid.Revit.Core.Document.LinkRepath(link=linkedRevitFile, file=fromPath)  # frozen
linkUnload = Orchid.Revit.Core.Document.LinkUnload(link=linkedRevitFile)  # frozen
watch = Watch(linkedRevitFile)
name = Element.Name(element=linkedRevitFile)
watch_2 = Watch(name)

# group: CAD links
linkedCadFile = Orchid.Revit.Core.Document.LinkedCadFile()
watch_3 = Watch(linkedCadFile)
name_2 = Element.Name(element=linkedCadFile)
watch_4 = Watch(name_2)
linkReload_2 = Orchid.Revit.Core.Document.LinkReload(link=linkedCadFile)
watch_5 = Watch(linkReload_2)

# group: Get all linked files
linkedFile = Orchid.Revit.Core.Document.LinkedFile()
watch_6 = Watch(linkedFile.Type)
watch_7 = Watch(linkedFile.Link)

# group: Dropdown selector
linked_files = LinkFileDD(index=1)  # graph input
watch_8 = Watch(linked_files)
linked_revit_files = LinkRevitDD(index=0)  # graph input
watch_9 = Watch(linked_revit_files)
linked_cad_files = LinkCadDD(index=0)  # graph input
watch_10 = Watch(linked_cad_files)

# group: Convert to Revit link
select_model_element = DSModelElementSelection()  # 1 picked in the model; graph input
watch_11 = Watch(select_model_element)
convertToLink = Orchid.Revit.Core.Document.ConvertToLink(instance=select_model_element)
watch_12 = Watch(convertToLink)

# group: Convert to CAD link
select_model_element_2 = DSModelElementSelection()  # 1 picked in the model; graph input
watch_13 = Watch(select_model_element_2)
convertToLink_2 = Orchid.Revit.Core.Document.ConvertToLink(instance=select_model_element_2)
watch_14 = Watch(convertToLink_2)
