# Dynamo graph List.SummationByKey.dyn (Dynamo 2.1.0.6255)

categories = Categories(index=604)  # graph input
all_elements_of_category = ElementsOfCategory(Category=categories)
code_block = CodeBlock { "Area"; }
getParameterValueByName = Element.GetParameterValueByName(element=all_elements_of_category, parameterName=code_block)
code_block_2 = CodeBlock { "Family"; }
getParameterValueByName_2 = Element.GetParameterValueByName(element=all_elements_of_category, parameterName=code_block_2)
summationByKey = Orchid.Generic.Core.List.SummationByKey(list=getParameterValueByName, keys=getParameterValueByName_2)
watch = Watch(summationByKey.unique_keys)
watch_2 = Watch(summationByKey.summarized_groups)
groupByKey = List.GroupByKey(list=getParameterValueByName, keys=getParameterValueByName_2)
watch_3 = Watch(groupByKey.groups)
watch_4 = Watch(groupByKey.unique_keys)
code_block_3 = CodeBlock(x=getParameterValueByName) { x:int[]; }
type = Object.Type(obj=code_block_3)
type_2 = Object.Type(obj=summationByKey.summarized_groups)
type_3 = Object.Type(obj=groupByKey.groups)
groupByEqual = Orchid.Generic.Core.List.GroupByEqual(list=getParameterValueByName_2)
watch_5 = Watch(groupByEqual.groups)
watch_6 = Watch(groupByEqual.unique_keys)
