# Dynamo graph MergePDF.dyn "MergePDF_20" (Dynamo 2.0.2.6826)

code_block = CodeBlock()
# ---------- code_block.designscript (6 lines) ----------
//input documents
["%userprofile%\\Downloads\\PDF\\pdf1.pdf",
"%userprofile%\\Downloads\\PDF\\pdf2.pdf"];

//output file path
"%userprofile%\\Downloads\\PDF\\result.pdf";
# ----------------------------------------
mergePDF = Orchid.Generic.Core.Print.MergePDF(documents=code_block.out0, filePath=code_block.out1)
