# Dynamo graph Parameter.dyn (Dynamo 2.0.2.6826)

# group: Add project parameter
code_block = CodeBlock()
# ---------- code_block.designscript (10 lines) ----------
//Parameter name
["test1","test2"];
//Parameter type
"Text";
//Parameter group
"PG_IDENTITY_DATA";
//Instances
true;
//Category
["Walls","Windows"];
# ----------------------------------------
byName = Category.ByName(name=code_block.out4)
addProjectParameter = Orchid.Revit.Core.Parameter.AddProjectParameter(parameterName=code_block.out0, type=code_block.out1, group=code_block.out2, category=byName)  # frozen

# group: Add shared parameter
# note: Please notice that I use a tab in my "SP Parameter group" names. This is not standard!
# "Sheet & Project" would be the normal way!
code_block_2 = CodeBlock()
# ---------- code_block_2.designscript (14 lines) ----------
//Parameter name
["Creator Name",
"Creator Organization",
"Creator Build"];
//SP Parameter group
"01:   Sheet & Project";
//SP Parameter type
"Text";
//Parameter group
"PG_ADSK_MODEL_PROPERTIES";
//Instances
true;
//Category
"Doors";
# ----------------------------------------
byName_2 = Category.ByName(name=code_block_2.out5)
addSharedParameter = Orchid.Revit.Core.Parameter.AddSharedParameter(parameterName=code_block_2.out0, groupName=code_block_2.out1, type=code_block_2.out2, group=code_block_2.out3, category=byName_2)  # frozen

# group: Change parameter and category binding in the project
code_block_3 = CodeBlock()
# ---------- code_block_3.designscript (8 lines) ----------
//Parameter name
"Creator Name";
//Instances
true;
//Category
["Doors",
"Entourage",
"Floors"];
# ----------------------------------------
byName_3 = Category.ByName(name=code_block_3.out2)
changeCategory = Orchid.Revit.Core.Parameter.ChangeCategory(parameterName=code_block_3.out0, category=byName_3)  # frozen

# group: Delete parameter
code_block_4 = CodeBlock()
# ---------- code_block_4.designscript (2 lines) ----------
["Creator Build",
"test2"];
# ----------------------------------------
delete = Orchid.Revit.Core.Parameter.Delete(parameterName=code_block_4)  # frozen

# group: Project parameters in document
projectParameters = Orchid.Revit.Core.Parameter.ProjectParameters()
watch = Watch(projectParameters)
name = Element.Name(element=projectParameters)
watch_2 = Watch(name)

# group: Global parameters in document
globalParameters = Orchid.Revit.Core.Parameter.GlobalParameters()
watch_3 = Watch(globalParameters)
name_2 = Element.Name(element=globalParameters)
watch_4 = Watch(name_2)

# group: Shared parameters in document
sharedParameters = Orchid.Revit.Core.Parameter.SharedParameters()
name_3 = Element.Name(element=sharedParameters.parameter)
watch_5 = Watch(name_3)
watch_6 = Watch(sharedParameters.parameter)
watch_7 = Watch(sharedParameters.guid)

# group: clean for unwanted parameters
string = StringInput("ParameterCopy")  # graph input
contains = String.Contains(str=name_3, searchFor=string)
filterByBoolMask = List.FilterByBoolMask(list=sharedParameters.parameter, mask=contains)
delete_2 = Orchid.Revit.Elements.Element.Delete(element=filterByBoolMask.in)
name_4 = Element.Name(element=filterByBoolMask.in)
watch_8 = Watch(name_4)
watch_9 = Watch(filterByBoolMask.in)

# group: Add basic IFC parameter
addIfcParameters = Orchid.Revit.Core.Parameter.AddIfcParameters()  # frozen

# group: Associate --> global parameters
categories = Categories(index=619)  # graph input
all_elements_of_category = ElementsOfCategory(Category=categories)
code_block_5 = CodeBlock { "sometext"; }
associate = Orchid.Revit.Core.Parameter.Associate(element=all_elements_of_category, parameterName=code_block_5, globalParameter=globalParameters)
getAssociated = Orchid.Revit.Core.Parameter.GetAssociated(element=all_elements_of_category, parameterName=code_block_5)
watch_10 = Watch(getAssociated)
hasAssociated = Orchid.Revit.Core.Parameter.HasAssociated(element=all_elements_of_category, parameterName=code_block_5)
watch_11 = Watch(hasAssociated)
