# Dynamo graph Project.dyn (Dynamo 2.0.2.6826)

# group: Project phase
phases = PhaseDD(index=3)  # graph input
watch = Watch(phases)

# group: Project location
project_origin = OriginDD(index=0)  # graph input
setProjectLocation = Orchid.Revit.Core.Project.SetProjectLocation(origin=project_origin)
watch_2 = Watch(setProjectLocation)
getProjectLocation = Orchid.Revit.Core.Project.GetProjectLocation()
watch_3 = Watch(getProjectLocation)
