# Dynamo graph Purge.dyn (Dynamo 2.0.2.6826)

directory_path = StringInput(".\testSet")  # graph input
string = StringInput("*.rfa")  # graph input
boolean = BoolSelector(false)  # graph input
contents = Orchid.Generic.Core.Directory.Contents(directory=directory_path, searchString=string, deepSearch=boolean)
backgroundOpen = Orchid.Revit.Core.Document.BackgroundOpen(file=contents)

# group: Purge
boolean_2 = BoolSelector(true)  # graph input
purge = Orchid.Revit.Core.Document.Purge(document=backgroundOpen, completely=boolean_2)

await_ = Orchid.Generic.Core.DataStream.Await(pass=backgroundOpen, waitFor=purge)
boolean_3 = BoolSelector(true)  # graph input
close = Orchid.Revit.Core.Document.Close(document=await_, save=boolean_3)

# group: Cleanup backup files
await_2 = Orchid.Generic.Core.DataStream.Await(pass=directory_path, waitFor=close)
string_2 = StringInput("*.0001.rfa")  # graph input
boolean_4 = BoolSelector(true)  # graph input
contents_2 = Orchid.Generic.Core.Directory.Contents(directory=await_2, searchString=string_2, deepSearch=boolean_4)
deleteFile = FileSystem.DeleteFile(path=contents_2)
