# Dynamo graph String.dyn (Dynamo 2.0.2.6826)

# group: Import from txt file
string = StringInput("..\..\Data\test.txt")  # graph input
fromPath = FileObject(path=string)  # "File.FromPath"
readText = FileSystem.ReadText(file=fromPath)

string_2 = StringInput("nickname=\"Boolean.FaceFlipped|DanEDU\"")  # graph input
string_3 = StringInput("nickname=\"Boolean.Flipped|DanEDU\"")  # graph input
create = List.Create(item0=string_2, item1=string_3)
string_4 = StringInput("nickname=\"Element.IsFaceFlipped\"")  # graph input
string_5 = StringInput("nickname=\"Element.IsFlipped\"")  # graph input
create_2 = List.Create(item0=string_4, item1=string_5)

# group: Replace string
replace = Orchid.Generic.Core.String.Replace(str=readText, searchFor=create, replaceWith=create_2)
watch = Watch(replace)

string_6 = StringInput("e\">")  # graph input
count = List.Count(list=create)
cycle = List.Cycle(list=string_6, amount=count)

# group: Get substring
substring = Orchid.Generic.Core.String.Substring(str=readText, startsWith=create, endsWith=cycle)
watch_2 = Watch(substring)
