# Dynamo graph TransferProjectStandards.dyn (Dynamo 2.0.2.6826)

current = Orchid.Generic.Core.Directory.Current()
code_block = CodeBlock { "2019_defaultBuilding.rvt"; }
code_block_2 = CodeBlock(a=current, b=code_block) { a+"\\"+b; }
backgroundOpen = Orchid.Revit.Core.Document.BackgroundOpen(file=code_block_2)
categories = Categories(index=432)  # graph input
boolean = BoolSelector(false)  # graph input
transfer = Orchid.Revit.Core.Document.Transfer(source=backgroundOpen, category=categories, overwrite=boolean)
watch = Watch(transfer)
await_ = Orchid.Generic.Core.DataStream.Await(pass=backgroundOpen, waitFor=transfer)
close = Orchid.Revit.Core.Document.Close(document=await_)
