# Dynamo graph Elem+Fam.dyn (Dynamo 2.0.2.6826)

code_block = CodeBlock { ["Floors","Walls","Windows"]; }
elementByCategory = Orchid.Revit.Elements.Selection.ElementByCategory(category=code_block)
name = Element.Name(element=elementByCategory.Element)
watch = Watch(name)
familyName = Orchid.Revit.Elements.Element.FamilyName(element=elementByCategory.Element)
watch_2 = Watch(familyName)
elementType = Element.ElementType(element=elementByCategory.Element)
uniqueItems = List.UniqueItems(list=elementType@L2)
name_2 = Orchid.Revit.Elements.ElementType.Name(elementType=uniqueItems)
watch_3 = Watch(name_2)
familyName_2 = Orchid.Revit.Elements.ElementType.FamilyName(elementType=uniqueItems)
watch_4 = Watch(familyName_2)
info = Orchid.Revit.Elements.Element.Info(element=elementByCategory.Element)
watch_5 = Watch(info.Owner)
watch_6 = Watch(info.Creator)
watch_7 = Watch(info.LastChangedBy)
watch_8 = Watch(info.RequestedBy)

# group: Family
families = FamiliesDD(index=13)  # graph input
elementByFamily = Orchid.Revit.Elements.Selection.ElementByFamily(family=families)
watch_9 = Watch(elementByFamily)
