# Dynamo graph FamilyName.dyn (Dynamo 2.0.2.6826)

code_block = CodeBlock { ["Floors","Walls","Windows"]; }
elementByCategory = Orchid.Revit.Elements.Selection.ElementByCategory(category=code_block)
name = Element.Name(element=elementByCategory.Element)
watch = Watch(name)
familyName = Orchid.Revit.Elements.Element.FamilyName(element=elementByCategory.Element)
watch_2 = Watch(familyName)
elementType = Element.ElementType(element=elementByCategory.Element)
uniqueItems = List.UniqueItems(list=elementType@L2)
name_2 = Orchid.Revit.Elements.ElementType.Name(elementType=uniqueItems)
watch_3 = Watch(name_2)
familyName_2 = Orchid.Revit.Elements.ElementType.FamilyName(elementType=uniqueItems)
watch_4 = Watch(familyName_2)
