# Dynamo graph FamilyType.dyn (Dynamo 2.0.2.6826)

# group: Family (from Orchid package)
families = FamiliesDD(index=34)
elementByFamily = Orchid.Revit.Elements.Selection.ElementByFamily(family=families)
watch = Watch(elementByFamily)

# group: FamilyType
family_types = FamilyTypes(index=13)
family_types_2 = FamilyTypes(index=14)
list_create = List.Create(item0=family_types, item1=family_types_2)
all_elements_of_family_type = ElementsOfFamilyType(Family_Type=list_create)
watch_2 = Watch(all_elements_of_family_type)

# group: Family based on FamilyType
flatten = List.Flatten(list=all_elements_of_family_type)
id = Element.Id(element=flatten)
sortByKey = List.SortByKey(list=flatten, keys=id)
watch_3 = Watch(sortByKey.sorted_list)
