# Dynamo graph File+Fam-LoadFamily.dyn (Dynamo 2.0.2.6826)

# group: Open all files in directory and sub directories
string = StringInput(".\testSet")  # graph input
code_block = CodeBlock { "*.rvt"; }
boolean = BoolSelector(false)  # graph input
contents = Orchid.Generic.Core.Directory.Contents(directory=string, searchString=code_block, deepSearch=boolean)

# group: Open all files in directory and sub directories
string_2 = StringInput(".\testSet")  # graph input
code_block_2 = CodeBlock { "*.rfa"; }
boolean_2 = BoolSelector(false)  # graph input
contents_2 = Orchid.Generic.Core.Directory.Contents(directory=string_2, searchString=code_block_2, deepSearch=boolean_2)

loadFamily = Orchid.Revit.Core.File.LoadFamily(document=contents, family=contents_2)  # frozen
watch = Watch(loadFamily)
loadFamily_2 = Orchid.Revit.Core.File.LoadFamily(family=contents_2)
watch_2 = Watch(loadFamily_2)

# group: Open all files in directory and sub directories
string_3 = StringInput(".\testSet")  # graph input
code_block_3 = CodeBlock { "*.rfa"; }
boolean_3 = BoolSelector(false)  # graph input
contents_3 = Orchid.Generic.Core.Directory.Contents(directory=string_3, searchString=code_block_3, deepSearch=boolean_3)  # frozen
backgroundOpen = Orchid.Revit.Core.Document.BackgroundOpen(file=contents_3)

loadFamily_3 = Orchid.Revit.FamilyDocument.Document.LoadFamily(familyDocument=backgroundOpen)
watch_3 = Watch(loadFamily_3)
await_ = Orchid.Generic.Core.DataStream.Await(pass=backgroundOpen, waitFor=loadFamily_3)

# group: Close files
close = Orchid.Revit.Core.Document.Close(document=await_)
