# Dynamo graph Material.dyn (Dynamo 2.0.2.6826)

elementHasMaterial = Orchid.Revit.Elements.Selection.ElementHasMaterial()
clean = Orchid.Generic.Core.List.Clean(list=elementHasMaterial.Element)
flatten = List.Flatten(list=clean)

# group: get elements sorted by used materials including summarized area and volumne
getMaterials = Element.GetMaterials(element=flatten)
flatten_2 = List.Flatten(list=getMaterials)
uniqueItems = List.UniqueItems(list=flatten_2)
sum = Orchid.Revit.Elements.Material.Sum(material=uniqueItems)
element_by_material_watch = Watch(sum.Element)
volumne_watch = Watch(sum.volumne)
area_watch = Watch(sum.area)
name = Element.Name(element=uniqueItems)
material_name_watch = Watch(name)

natural_category_name = CodeBlock()
# ---------- natural_category_name.designscript (26 lines) ----------
[
"Casework",
"Ceilings",
"Columns",
"Curtain Wall Mullions",
"Curtain Panels",
"Curtain Systems",
"Doors",
"Entourage",
"Floors",
"Furniture",
"Furniture Systems",
"Generic Models",
"Plumbing Fixtures",
"Ramps",
"Roofs",
"Specialty Equipment",
"Stairs",
"Structural Columns",
"Structural Foundations",
"Structural Framing",
"Structural Beam Systems",
"Structural Stiffeners",
"Walls",
"Windows"
];
# ----------------------------------------
byName = Category.ByName(name=natural_category_name)
all_elements_of_category = ElementsOfCategory(Category=byName)

# group: get materials--their area and volumne--by elements
sumByElement = Orchid.Revit.Elements.Material.SumByElement(element=flatten)
area_watch_2 = Watch(sumByElement.area)
volumne_watch_2 = Watch(sumByElement.volumne)
material_by_element_watch = Watch(sumByElement.Material)
name_2 = Element.Name(element=sumByElement.Material)
material_name_watch_2 = Watch(name_2)

# group: get summarized (area and volumne) materials by elements and their asset density
quantity = Orchid.Revit.Elements.Material.Quantity(element=flatten)
volumne_watch_3 = Watch(quantity.volumne)
density = Orchid.Revit.Materials.Material.Density(material=quantity.Material)
physical_density_watch = Watch(density.Physical)
thermal_density_watch = Watch(density.Thermal)
name_3 = Element.Name(element=quantity.Material)
material_name_watch_3 = Watch(name_3)
area_watch_3 = Watch(quantity.area)
