# Dynamo graph SetType-Random.dyn (Dynamo 2.0.2.6826)

# group: Collect elements
family_types = FamilyTypes(index=349)  # graph input
family_types_2 = FamilyTypes(index=348)  # graph input
create = List.Create(item0=family_types, item1=family_types_2)
all_elements_of_family_type = ElementsOfFamilyType(Family_Type=create)

flatten = List.Flatten(list=all_elements_of_family_type)

# group: Randomization
count = List.Count(list=flatten)
randomList = Orchid.Generic.Core.Math.RandomList(amount=count)
round = Math.Round(number=randomList)

getItemAtIndex = List.GetItemAtIndex(list=create, index=round)

# group: SetType
setType = Orchid.Revit.Elements.Element.SetType(element=flatten, familyType=getItemAtIndex)

# group: Random
code_block = CodeBlock { 4; }
random = Orchid.Generic.Core.Math.Random(range=code_block)
watch = Watch(random)
randomList_2 = Orchid.Generic.Core.Math.RandomList(amount=count, range=code_block)
watch_2 = Watch(randomList_2)
