# Dynamo graph BulkUpgrade.dyn (Dynamo 2.0.2.6826)

directory_path = StringInput(".\testSet")  # graph input
string = StringInput("*.rfa")  # graph input
boolean = BoolSelector(false)  # graph input
contents = Orchid.Generic.Core.Directory.Contents(directory=directory_path, searchString=string, deepSearch=boolean)
backgroundOpen = Orchid.Revit.Core.Document.BackgroundOpen(file=contents)
# note: Please notice that I use a tab in my "SP Parameter group" names. This is not standard!
# "Sheet & Project" would be the normal way!
code_block = CodeBlock()
# ---------- code_block.designscript (12 lines) ----------
//Parameter name
"Creator Build";
//SP Parameter group
"01:   Sheet & Project";
//SP Parameter type
"Text";
//Parameter group
"PG_ADSK_MODEL_PROPERTIES";
//Instances
true;
//Reporting
false;
# ----------------------------------------
addSharedParameter = Orchid.Revit.FamilyDocument.Parameter.AddSharedParameter(familyDocument=backgroundOpen, parameterName=code_block.out0, groupName=code_block.out1, type=code_block.out2, group=code_block.out3, instance=code_block.out4)
await_ = Orchid.Generic.Core.DataStream.Await(pass=backgroundOpen, waitFor=addSharedParameter)
code_block_2 = CodeBlock()
# ---------- code_block_2.designscript (2 lines) ----------
//parameter name
"Creator Build";
# ----------------------------------------
creator_build = StringInput("\"2018\"")  # graph input
set = Orchid.Revit.FamilyDocument.Formula.Set(familyDocument=await_, parameterName=code_block_2, value=creator_build)
await_2 = Orchid.Generic.Core.DataStream.Await(pass=await_, waitFor=set)
boolean_2 = BoolSelector(true)  # graph input
close = Orchid.Revit.Core.Document.Close(document=await_2, save=boolean_2)

# group: Cleanup backup files
await_3 = Orchid.Generic.Core.DataStream.Await(pass=directory_path, waitFor=close)
string_2 = StringInput("*.0001.rfa")  # graph input
boolean_3 = BoolSelector(true)  # graph input
contents_2 = Orchid.Generic.Core.Directory.Contents(directory=await_3, searchString=string_2, deepSearch=boolean_3)
deleteFile = FileSystem.DeleteFile(path=contents_2)
