# Dynamo graph CategoryReportingIFC.dyn (Dynamo 2.0.2.6826)

current = Orchid.Revit.Core.Document.Current()

# group: Set the document category
categories = Categories(index=106)  # graph input
setCategory = Orchid.Revit.FamilyDocument.Document.SetCategory(familyDocument=current, category=categories)

# group: Get the document category
await_ = Orchid.Generic.Core.DataStream.Await(pass=current, waitFor=setCategory)
getCategory = Orchid.Revit.FamilyDocument.Document.GetCategory(familyDocument=await_)

# group: Create types
code_block = CodeBlock()
# ---------- code_block.designscript (2 lines) ----------
//Types to create
["Type 1", "Type 2"];
# ----------------------------------------
create = Orchid.Revit.FamilyDocument.FamilyType.Create(familyDocument=current, name=code_block)

# group: Add parameter
await_2 = Orchid.Generic.Core.DataStream.Await(pass=current, waitFor=create)
code_block_2 = CodeBlock()
# ---------- code_block_2.designscript (8 lines) ----------
//Parameter name
"dim";
//Parameter type
"Length";
//Parameter group
"PG_ADSK_MODEL_PROPERTIES";
//Reporting
true;
# ----------------------------------------
addParameter = Orchid.Revit.FamilyDocument.Parameter.AddParameter(familyDocument=await_2, parameterName=code_block_2.out0, type=code_block_2.out1, group=code_block_2.out2, reporting=code_block_2.out3)

# group: Parameters
parameters = Orchid.Revit.FamilyDocument.Parameter.Parameters(familyDocument=await_2)
name = Orchid.Revit.FamilyDocument.Parameter.Name(parameter=parameters)

watch = Watch(name)

# group: Add parameter
await_3 = Orchid.Generic.Core.DataStream.Await(pass=current, waitFor=create)
code_block_3 = CodeBlock()
# ---------- code_block_3.designscript (10 lines) ----------
//Parameter name
"Test";
//Parameter type
"Text";
//Parameter group
"PG_ADSK_MODEL_PROPERTIES";
//Tooltip
"Owner value";
//Instances
true;
# ----------------------------------------
addParameter_2 = Orchid.Revit.FamilyDocument.Parameter.AddParameter(familyDocument=await_3, parameterName=code_block_3.out0, type=code_block_3.out1, group=code_block_3.out2, tooltip=code_block_3.out3, instance=code_block_3.out4)

# group: Set parameter
await_4 = Orchid.Generic.Core.DataStream.Await(pass=await_3, waitFor=addParameter_2)
code_block_4 = CodeBlock()
# ---------- code_block_4.designscript (6 lines) ----------
//Type
"Type 1";
//Parameter name
"Test";
//Value
"This is a test";
# ----------------------------------------
setValue = Orchid.Revit.FamilyDocument.Parameter.SetValue(familyDocument=await_4, familyType=code_block_4.out0, parameterName=code_block_4.out1, value=code_block_4.out2)

create_2 = List.Create(item0=addParameter, item1=addParameter_2)

# group: IsReporting parameter
name_2 = Orchid.Revit.FamilyDocument.Parameter.Name(parameter=create_2)
isReporting = Orchid.Revit.FamilyDocument.Parameter.IsReporting(familyDocument=await_2, parameterName=name_2)

watch_2 = Watch(isReporting)
watch_3 = Watch(name_2)

# group: Add basic IFC parameters
addIfcParameters = Orchid.Revit.FamilyDocument.Parameter.AddIfcParameters(document=current)
name_3 = Orchid.Revit.FamilyDocument.Parameter.Name(parameter=addIfcParameters)
watch_4 = Watch(name_3)
