# Dynamo graph Collect families in project.dyn (Dynamo 2.0.2.6826)

# group: Open all files in directory and sub directories
string = StringInput("C:\Users\erfajo\Programming\Unit Testing\testSet")  # graph input
code_block = CodeBlock { "*.rfa"; true; }
contents = Orchid.Generic.Core.Directory.Contents(directory=string, searchString=code_block.out0)  # frozen
backgroundOpen = Orchid.Revit.Core.Document.BackgroundOpen(file=contents)

# group: Close files
await_ = Orchid.Generic.Core.DataStream.Await()  # unwired: pass, waitFor
boolean = BoolSelector(true)  # graph input
close = Orchid.Revit.Core.Document.Close(document=await_, save=boolean)  # frozen

# group: Collect family as document from current document
code_block_2 = CodeBlock { ["Doors","Windows"]; }
elementByCategory = Orchid.Revit.Elements.Selection.ElementByCategory(category=code_block_2)
type = archilab.Revit.Elements.Elements.Type(element=elementByCategory.Element)
family = FamilyType.Family(familyType=type)
flatten = List.Flatten(list=family)
uniqueItems = List.UniqueItems(list=flatten)
familyDocument = Orchid.Revit.Elements.Family.FamilyDocument(family=uniqueItems)

# note: Please notice that I use a tab in my "SP Parameter group" names. This is not standard!
# "Sheet & Project" would be the normal way!
code_block_3 = CodeBlock()
# ---------- code_block_3.designscript (12 lines) ----------
//Parameter name
"Creator Build";
//SP Parameter group
"01:   Sheet & Project";
//SP Parameter type
"Text";
//Parameter group
"PG_ADSK_MODEL_PROPERTIES";
//Instances
true;
//Reporting
false;
# ----------------------------------------
addSharedParameter = Orchid.Revit.FamilyDocument.Parameter.AddSharedParameter(familyDocument=familyDocument, parameterName=code_block_3.out0, groupName=code_block_3.out1, type=code_block_3.out2, group=code_block_3.out3, instance=code_block_3.out4)

# group: load back into the current project
await_2 = Orchid.Generic.Core.DataStream.Await(pass=familyDocument, waitFor=addSharedParameter)
loadFamily = Orchid.Revit.FamilyDocument.Document.LoadFamily(familyDocument=await_2)
await_3 = Orchid.Generic.Core.DataStream.Await(pass=await_2, waitFor=loadFamily)
close_2 = Orchid.Revit.Core.Document.Close(document=await_3)
