# Dynamo graph Convert.dyn (Dynamo 2.0.2.6826)

# group: create family type
current = Orchid.Revit.Core.Document.Current()
create = Orchid.Revit.FamilyDocument.FamilyType.Create(familyDocument=current)

# group: Add shared parameter
await_ = Orchid.Generic.Core.DataStream.Await(pass=current, waitFor=create)
# note: Please notice that I use a tab in my "SP Parameter group" names. This is not standard!
# "Sheet & Project" would be the normal way!
code_block = CodeBlock()
# ---------- code_block.designscript (16 lines) ----------
//Parameter name
["Creator Name",
"Creator Organization",
"Creator Build"];
//SP Parameter group
"01:   Sheet & Project";
//SP Parameter type
"Text";
//Parameter group
"PG_ADSK_MODEL_PROPERTIES";
//Tooltip
"Owner value";
//Instances
true;
//Reporting
false;
# ----------------------------------------
addSharedParameter = Orchid.Revit.FamilyDocument.Parameter.AddSharedParameter(familyDocument=await_, parameterName=code_block.out0, groupName=code_block.out1, type=code_block.out2, group=code_block.out3, tooltip=code_block.out4, instance=code_block.out5)

# group: Set formula
await_2 = Orchid.Generic.Core.DataStream.Await(pass=current, waitFor=addSharedParameter)
code_block_2 = CodeBlock()
# ---------- code_block_2.designscript (8 lines) ----------
//Parameter name
["Creator Name",
"Creator Organization",
"Creator Build"];
//Values
["\"Erik Falck Jørgensen\"",
"\"Danish Educational Content\"",
"\"2017.0418.0\""];
# ----------------------------------------
set = Orchid.Revit.FamilyDocument.Formula.Set(familyDocument=await_2, parameterName=code_block_2.out0, value=code_block_2.out1)

# group: Get Formula
await_3 = Orchid.Generic.Core.DataStream.Await(pass=await_2, waitFor=set)
code_block_3 = CodeBlock()
# ---------- code_block_3.designscript (4 lines) ----------
//Parameter name
["Creator Name",
"Creator Organization",
"Creator Build"];
# ----------------------------------------
get = Orchid.Revit.FamilyDocument.Formula.Get(familyDocument=await_3, parameterName=code_block_3)

watch = Watch(get)

# group: Convert parameter
name = Orchid.Revit.FamilyDocument.Parameter.Name(parameter=addSharedParameter)
code_block_4 = CodeBlock()
# ---------- code_block_4.designscript (2 lines) ----------
//Instances
true;
# ----------------------------------------
convert = Orchid.Revit.FamilyDocument.Parameter.Convert(familyDocument=await_, parameterName=name, instance=code_block_4)

name_2 = Orchid.Revit.FamilyDocument.Parameter.Name(parameter=convert)
watch_2 = Watch(name_2)

# group: Remove formula
await_4 = Orchid.Generic.Core.DataStream.Await(pass=await_3, waitFor=get)
code_block_5 = CodeBlock()  # same code as code_block_3
remove = Orchid.Revit.FamilyDocument.Formula.Remove(familyDocument=await_4, parameterName=code_block_5)

# group: Remove parameter value
await_5 = Orchid.Generic.Core.DataStream.Await(pass=await_4, waitFor=remove)
code_block_6 = CodeBlock()
# ---------- code_block_6.designscript (6 lines) ----------
//Parameter name
["Creator Name",
"Creator Organization",
"Creator Build"];
//value
["","",""];
# ----------------------------------------
setValue = Orchid.Revit.FamilyDocument.Parameter.SetValue(familyDocument=await_5, parameterName=code_block_6.out0, value=code_block_6.out1)
