# Dynamo graph FamilyType.dyn (Dynamo 2.0.2.6826)

current = Orchid.Revit.Core.Document.Current()

# group: Add parameter
code_block = CodeBlock()
# ---------- code_block.designscript (13 lines) ----------
//Parameter name
["Test","something"];
//Parameter type
"Text";
//"Length";
//Parameter group
"PG_ADSK_MODEL_PROPERTIES";
//Tooltip
"Owner value";
//Instances
false;
//Reporting
true;
# ----------------------------------------
addParameter = Orchid.Revit.FamilyDocument.Parameter.AddParameter(familyDocument=current, parameterName=code_block.out0, type=code_block.out1, group=code_block.out2)

# group: Rename parameter
await_ = Orchid.Generic.Core.DataStream.Await(pass=current, waitFor=addParameter)
code_block_2 = CodeBlock()
# ---------- code_block_2.designscript (4 lines) ----------
//Source name
"Test";
//Target name
"NewTest";
# ----------------------------------------
rename = Orchid.Revit.FamilyDocument.Parameter.Rename(familyDocument=await_, sourceName=code_block_2.out0, targetName=code_block_2.out1)

# group: Delete parameter
await_2 = Orchid.Generic.Core.DataStream.Await(pass=await_, waitFor=rename)
code_block_3 = CodeBlock()
# ---------- code_block_3.designscript (2 lines) ----------
//Parameter name
"NewTest";
# ----------------------------------------
delete = Orchid.Revit.FamilyDocument.Parameter.Delete(familyDocument=await_2, parameterName=code_block_3)

# group: Create type
code_block_4 = CodeBlock()
# ---------- code_block_4.designscript (2 lines) ----------
//Types to create
["Type 1", "Type 2"];
# ----------------------------------------
create = Orchid.Revit.FamilyDocument.FamilyType.Create(familyDocument=current, name=code_block_4)

# group: Rename type
await_3 = Orchid.Generic.Core.DataStream.Await(pass=current, waitFor=create)
code_block_5 = CodeBlock()
# ---------- code_block_5.designscript (4 lines) ----------
//Source name
"Type 1";
//Target name
"Type 3";
# ----------------------------------------
rename_2 = Orchid.Revit.FamilyDocument.FamilyType.Rename(familyDocument=await_3, sourceName=code_block_5.out0, targetName=code_block_5.out1)

# group: Delete type
await_4 = Orchid.Generic.Core.DataStream.Await(pass=await_3, waitFor=rename_2)
code_block_6 = CodeBlock()
# ---------- code_block_6.designscript (2 lines) ----------
//Type name
"Type 3";
# ----------------------------------------
delete_2 = Orchid.Revit.FamilyDocument.FamilyType.Delete(familyDocument=await_4, familyType=code_block_6)

# group: Get all family type
# note: This node is being processed among the first, while it always look at the current document and don't need a document to be loaded. Therefore, run the graph twice if you greate/delete types in the graph! This node is best to use in families where types are not added!
all = Orchid.Revit.FamilyDocument.FamilyType.All()
name = Orchid.Revit.FamilyDocument.FamilyType.Name(familyType=all)
watch = Watch(name)
watch_2 = Watch(all)

# group: Get all family type by document
await_5 = Orchid.Generic.Core.DataStream.Await(pass=current, waitFor=create)
all_2 = Orchid.Revit.FamilyDocument.FamilyType.All(familyDocument=await_5)
name_2 = Orchid.Revit.FamilyDocument.FamilyType.Name(familyType=all_2)
watch_3 = Watch(name_2)
watch_4 = Watch(all_2)

# group: Current family type by document
current_2 = Orchid.Revit.FamilyDocument.FamilyType.Current(familyDocument=await_5)
name_3 = Orchid.Revit.FamilyDocument.FamilyType.Name(familyType=current_2)
watch_5 = Watch(name_3)

# group: Current family type
# note: This node is being processed among the first, while it always look at the current document and don't need a document to be loaded. Therefore, run the graph twice if you greate/delete types in the graph! This node is best to use in families where types are not added!
current_3 = Orchid.Revit.FamilyDocument.FamilyType.Current()
name_4 = Orchid.Revit.FamilyDocument.FamilyType.Name(familyType=current_3)
watch_6 = Watch(name_4)
