# Dynamo graph FormSetGet.dyn (Dynamo 2.0.2.6826)

# group: Create ordinary parameter
current = Orchid.Revit.Core.Document.Current()
code_block = CodeBlock()
# ---------- code_block.designscript (6 lines) ----------
//Parameter name
"Material";
//Parameter type
"Material";
//Parameter group
"PG_ADSK_MODEL_PROPERTIES";
# ----------------------------------------
addParameter = Orchid.Revit.FamilyDocument.Parameter.AddParameter(familyDocument=current, parameterName=code_block.out0, type=code_block.out1, group=code_block.out2)

# group: Set parameter
await_ = Orchid.Generic.Core.DataStream.Await(pass=current, waitFor=addParameter)
code_block_2 = CodeBlock()
# ---------- code_block_2.designscript (2 lines) ----------
//Parameter name
"Material";
# ----------------------------------------
material = MaterialDD(index=0)  # graph input
setValue = Orchid.Revit.FamilyDocument.Parameter.SetValue(familyDocument=await_, parameterName=code_block_2, value=material)

# group: Select geometry
element_types = ElementTypes(index=106)  # graph input
all_elements_of_type = ElementsOfType(element_type=element_types)

# group: Associate parameter
await_2 = Orchid.Generic.Core.DataStream.Await(pass=await_, waitFor=setValue)
code_block_3 = CodeBlock()  # same code as code_block_2
associate = Orchid.Revit.FamilyDocument.Parameter.Associate(familyDocument=await_2, element=all_elements_of_type, documentParameter=code_block_3, elementParameter=code_block_3)
