# Dynamo graph ImportImage.dyn (Dynamo 2.0.2.6826)

# group: Open all files in directory and sub directories
string = StringInput(".\testSet")  # graph input
code_block = CodeBlock { "*.rfa"; }
boolean = BoolSelector(false)  # graph input
contents = Orchid.Generic.Core.Directory.Contents(directory=string, searchString=code_block, deepSearch=boolean)
backgroundOpen = Orchid.Revit.Core.Document.BackgroundOpen(file=contents)  # frozen

current = Orchid.Revit.Core.Document.Current()

# group: Create default family type
code_block_2 = CodeBlock()
# ---------- code_block_2.designscript (2 lines) ----------
//Types to create
["Type 1", "Type 2"];
# ----------------------------------------
create = Orchid.Revit.FamilyDocument.FamilyType.Create(familyDocument=current)

# group: Create parameter
await_ = Orchid.Generic.Core.DataStream.Await(pass=current, waitFor=create)
code_block_3 = CodeBlock()
# ---------- code_block_3.designscript (10 lines) ----------
//Parameter name
"AddedImage";
//Parameter type
"Image";
//Parameter group
"PG_ADSK_MODEL_PROPERTIES";
//Instances
false;
//Reporting
true;
# ----------------------------------------
addParameter = Orchid.Revit.FamilyDocument.Parameter.AddParameter(familyDocument=await_, parameterName=code_block_3.out0, type=code_block_3.out1, group=code_block_3.out2)

# group: import image
string_2 = StringInput(".\DefaultCustomNode.Small.png")  # graph input
boolean_2 = BoolSelector(false)  # graph input
importImage = Orchid.Revit.Core.Document.ImportImage(path=string_2, overwrite=boolean_2)

# group: Set parameter
await_2 = Orchid.Generic.Core.DataStream.Await(pass=await_, waitFor=addParameter)
code_block_4 = CodeBlock()
# ---------- code_block_4.designscript (6 lines) ----------
//Type
"Type 1";
//Parameter name
"AddedImage";
//Value
"_default.Large.png";
# ----------------------------------------
setValue = Orchid.Revit.FamilyDocument.Parameter.SetValue(familyDocument=await_2, parameterName=code_block_4.out1, value=importImage)

# group: Close files
await_3 = Orchid.Generic.Core.DataStream.Await(pass=await_2, waitFor=setValue)
boolean_3 = BoolSelector(false)  # graph input
close = Orchid.Revit.Core.Document.Close(document=await_3, save=boolean_3)  # frozen

watch = Watch(importImage)
element_types = ElementTypes(index=158)  # graph input
all_elements_of_type = ElementsOfType(element_type=element_types)
watch_2 = Watch(all_elements_of_type)
