# Dynamo graph Parameter-Test.dyn (Dynamo 2.0.2.6826)

current = Orchid.Revit.Core.Document.Current()

# group: Utilities
code_block = CodeBlock()
# ---------- code_block.designscript (2 lines) ----------
//Types to create
"Type 1";
# ----------------------------------------
create = Orchid.Revit.FamilyDocument.FamilyType.Create(familyDocument=current, name=code_block)

# group: Add parameter
await_ = Orchid.Generic.Core.DataStream.Await(pass=current, waitFor=create)
code_block_2 = CodeBlock()
# ---------- code_block_2.designscript (8 lines) ----------
//Parameter name
"Test1";
//Parameter type
"Integer";
//Parameter group
"PG_ADSK_MODEL_PROPERTIES";
//ToolTip
"do this work?";
# ----------------------------------------
addParameter = Orchid.Revit.FamilyDocument.Parameter.AddParameter(familyDocument=await_, parameterName=code_block_2.out0, type=code_block_2.out1, group=code_block_2.out2, tooltip=code_block_2.out3)

# group: Add parameter
await_2 = Orchid.Generic.Core.DataStream.Await(pass=await_, waitFor=addParameter)
code_block_3 = CodeBlock()
# ---------- code_block_3.designscript (6 lines) ----------
//Parameter name
"Test2";
//Parameter type
"Number";
//Parameter group
"PG_ADSK_MODEL_PROPERTIES";
# ----------------------------------------
addParameter_2 = Orchid.Revit.FamilyDocument.Parameter.AddParameter(familyDocument=await_2, parameterName=code_block_3.out0, type=code_block_3.out1, group=code_block_3.out2)

# group: Add parameter
await_3 = Orchid.Generic.Core.DataStream.Await(pass=await_2, waitFor=addParameter_2)
code_block_4 = CodeBlock()
# ---------- code_block_4.designscript (6 lines) ----------
//Parameter name
"Test3";
//Parameter type
"Text";
//Parameter group
"PG_ADSK_MODEL_PROPERTIES";
# ----------------------------------------
addParameter_3 = Orchid.Revit.FamilyDocument.Parameter.AddParameter(familyDocument=await_3, parameterName=code_block_4.out0, type=code_block_4.out1, group=code_block_4.out2)

# group: Add parameter
await_4 = Orchid.Generic.Core.DataStream.Await(pass=await_3, waitFor=addParameter_3)
code_block_5 = CodeBlock()
# ---------- code_block_5.designscript (6 lines) ----------
//Parameter name
"Test4";
//Parameter type
"Material";
//Parameter group
"PG_ADSK_MODEL_PROPERTIES";
# ----------------------------------------
addParameter_4 = Orchid.Revit.FamilyDocument.Parameter.AddParameter(familyDocument=await_4, parameterName=code_block_5.out0, type=code_block_5.out1, group=code_block_5.out2)

# group: Set parameter
await_5 = Orchid.Generic.Core.DataStream.Await(pass=await_4, waitFor=addParameter_4)
code_block_6 = CodeBlock()
# ---------- code_block_6.designscript (6 lines) ----------
//Type
"Type 1";
//Parameter name
"Test1";
//Value
1;
# ----------------------------------------
setValue = Orchid.Revit.FamilyDocument.Parameter.SetValue(familyDocument=await_5, familyType=code_block_6.out0, parameterName=code_block_6.out1, value=code_block_6.out2)

# group: Set parameter
await_6 = Orchid.Generic.Core.DataStream.Await(pass=await_5, waitFor=setValue)
code_block_7 = CodeBlock()
# ---------- code_block_7.designscript (6 lines) ----------
//Type
"Type 1";
//Parameter name
"Test2";
//Value
1.5;
# ----------------------------------------
setValue_2 = Orchid.Revit.FamilyDocument.Parameter.SetValue(familyDocument=await_6, familyType=code_block_7.out0, parameterName=code_block_7.out1, value=code_block_7.out2)

# group: Set parameter
await_7 = Orchid.Generic.Core.DataStream.Await(pass=await_6, waitFor=setValue_2)
code_block_8 = CodeBlock()
# ---------- code_block_8.designscript (6 lines) ----------
//Type
"Type 1";
//Parameter name
"Test3";
//Value
"string";
# ----------------------------------------
setValue_3 = Orchid.Revit.FamilyDocument.Parameter.SetValue(familyDocument=await_7, familyType=code_block_8.out0, parameterName=code_block_8.out1, value=code_block_8.out2)

# group: Set parameter
await_8 = Orchid.Generic.Core.DataStream.Await(pass=await_7, waitFor=setValue_3)
code_block_9 = CodeBlock()
# ---------- code_block_9.designscript (4 lines) ----------
//Type
"Type 1";
//Parameter name
"Test4";
# ----------------------------------------
code_block_10 = CodeBlock { "Glass"; }
byName = Material.ByName(name=code_block_10)
setValue_4 = Orchid.Revit.FamilyDocument.Parameter.SetValue(familyDocument=await_8, familyType=code_block_9.out0, parameterName=code_block_9.out1, value=byName)

# group: Parameters
await_9 = Orchid.Generic.Core.DataStream.Await(pass=await_8, waitFor=setValue_4)
parameters = Orchid.Revit.FamilyDocument.Parameter.Parameters(familyDocument=await_9)
watch = Watch(parameters)

# group: Get Parameter
await_10 = Orchid.Generic.Core.DataStream.Await(pass=await_8, waitFor=setValue_4)
code_block_11 = CodeBlock()
# ---------- code_block_11.designscript (7 lines) ----------
//Type name
"Type 1";
//Parameter name
["Test1",
"Test2",
"Test3",
"Test4"];
# ----------------------------------------
getValue = Orchid.Revit.FamilyDocument.Parameter.GetValue(familyDocument=await_10, familyType=code_block_11.out0, parameterName=code_block_11.out1)
watch_2 = Watch(getValue.valueByParameter)
type = Object.Type(obj=getValue.valueByParameter)
watch_3 = Watch(type)
code_block_12 = CodeBlock(t=getValue.valueByParameter) { t[3]; }
name = Material.Name(material=code_block_12)
watch_4 = Watch(name)
