# Dynamo graph SetGetParameter.dyn (Dynamo 2.0.2.6826)

directory_path = StringInput(".\testSet")  # graph input
string = StringInput("*.rfa")  # graph input
boolean = BoolSelector(false)  # graph input
contents = Orchid.Generic.Core.Directory.Contents(directory=directory_path, searchString=string, deepSearch=boolean)
backgroundOpen = Orchid.Revit.Core.Document.BackgroundOpen(file=contents)
create = Orchid.Revit.FamilyDocument.FamilyType.Create(familyDocument=backgroundOpen)
await_ = Orchid.Generic.Core.DataStream.Await(pass=backgroundOpen, waitFor=create)
all = Orchid.Revit.FamilyDocument.FamilyType.All(familyDocument=await_)
await_2 = Orchid.Generic.Core.DataStream.Await(pass=await_, waitFor=all)
code_block = CodeBlock()
# ---------- code_block.designscript (4 lines) ----------
//parameter name
["Model", "Description"];
//value
["Testing1", "Testing2"];
# ----------------------------------------
setValue = Orchid.Revit.FamilyDocument.Parameter.SetValue(familyDocument=await_2, parameterName=code_block.out0, value=code_block.out1)
await_3 = Orchid.Generic.Core.DataStream.Await(pass=await_2, waitFor=setValue)
getValue = Orchid.Revit.FamilyDocument.Parameter.GetValue(familyDocument=await_3, parameterName=code_block.out0)
await_4 = Orchid.Generic.Core.DataStream.Await(pass=await_3, waitFor=getValue.valueByType)
boolean_2 = BoolSelector(true)  # graph input
close = Orchid.Revit.Core.Document.Close(document=await_4, save=boolean_2)

# group: Cleanup backup files
await_5 = Orchid.Generic.Core.DataStream.Await(pass=directory_path, waitFor=close)
string_2 = StringInput("*.0001.rfa")  # graph input
boolean_3 = BoolSelector(true)  # graph input
contents_2 = Orchid.Generic.Core.Directory.Contents(directory=await_5, searchString=string_2, deepSearch=boolean_3)
deleteFile = FileSystem.DeleteFile(path=contents_2)

code_block_2 = CodeBlock()
# ---------- code_block_2.designscript (4 lines) ----------
//parameter name
"Model";
//value
"Testing";
# ----------------------------------------
current = Orchid.Revit.FamilyDocument.FamilyType.Current()  # frozen
current_2 = Orchid.Revit.FamilyDocument.FamilyType.Current(familyDocument=await_)  # frozen
name = Orchid.Revit.FamilyDocument.FamilyType.Name()  # unwired: familyType
watch = Watch(name)
all_2 = Orchid.Revit.FamilyDocument.FamilyType.All()  # frozen
