# Dynamo graph Density-Sum.dyn (Dynamo 2.0.2.6826)

elementHasMaterial = Orchid.Revit.Elements.Selection.ElementHasMaterial()
clean = Orchid.Generic.Core.List.Clean(list=elementHasMaterial.Element)
flatten = List.Flatten(list=clean)

# group: get elements sorted by used materials including summarized area and volumne
getMaterials = Element.GetMaterials(element=flatten)
flatten_2 = List.Flatten(list=getMaterials)
uniqueItems = List.UniqueItems(list=flatten_2)
sumByMaterial = Orchid.Revit.Elements.Element.SumByMaterial(material=uniqueItems)
element_by_material_watch = Watch(sumByMaterial.Element)
volumne_watch = Watch(sumByMaterial.volumne)
area_watch = Watch(sumByMaterial.area)
name = Element.Name(element=uniqueItems)
material_name_watch = Watch(name)

natural_category_name = CodeBlock()
# ---------- natural_category_name.designscript (26 lines) ----------
[
"Casework",
"Ceilings",
"Columns",
"Curtain Wall Mullions",
"Curtain Panels",
"Curtain Systems",
"Doors",
"Entourage",
"Floors",
"Furniture",
"Furniture Systems",
"Generic Models",
"Plumbing Fixtures",
"Ramps",
"Roofs",
"Specialty Equipment",
"Stairs",
"Structural Columns",
"Structural Foundations",
"Structural Framing",
"Structural Beam Systems",
"Structural Stiffeners",
"Walls",
"Windows"
];
# ----------------------------------------
byName = Category.ByName(name=natural_category_name)
all_elements_of_category = ElementsOfCategory(Category=byName)

# group: get materials--their area and volumne--by elements
getMaterial = Orchid.Revit.Elements.Element.GetMaterial(element=flatten)
area_watch_2 = Watch(getMaterial.area)
volumne_watch_2 = Watch(getMaterial.volumne)
material_by_element_watch = Watch(getMaterial.Material)

# group: get summarized (area and volumne) materials by elements and their asset density
sumByElement = Orchid.Revit.Materials.Material.SumByElement(element=flatten)
volumne_watch_3 = Watch(sumByElement.volumne)
density = Orchid.Revit.Materials.Material.Density(material=sumByElement.Material)
physical_density_watch = Watch(density.physical)
thermal_density_watch = Watch(density.thermal)
name_2 = Element.Name(element=sumByElement.Material)
material_name_watch_2 = Watch(name_2)
area_watch_3 = Watch(sumByElement.area)
