# Dynamo graph Graphics.dyn (Dynamo 2.0.2.6826)

# group: Create, Set Render Appearance, SetShadingColor, Set Transparency, Set Surface Pattern, Set Surface Pattern Color, Set Cut Pattern, Set Cut Pattern Color --> For Revit 2019
code_block = CodeBlock { "_test3"; }
create = Orchid.Revit.Materials.Material.Create(name=code_block)
fill_patterns = FillPatterns(index=31)  # graph input
setSurfaceForegroundPattern = Orchid.Revit.Materials.Graphics.SetSurfaceForegroundPattern(material=create, pattern=fill_patterns)
code_block_2 = CodeBlock { DSCore.Color.ByARGB(255,145,185,165); }
setSurfaceForegroundPatternColor = Orchid.Revit.Materials.Graphics.SetSurfaceForegroundPatternColor(material=setSurfaceForegroundPattern, color=code_block_2)
getCutForegroundPattern = Orchid.Revit.Materials.Graphics.GetCutForegroundPattern(material=setSurfaceForegroundPatternColor)
watch = Watch(getCutForegroundPattern)
name = Material.Name(material=create)
watch_2 = Watch(name)
code_block_3 = CodeBlock { DSCore.Color.ByARGB(255,25,60,30); }
setShadingColor = Orchid.Revit.Materials.Graphics.SetShadingColor(material=create, color=code_block_3)
getShadingColor = Orchid.Revit.Materials.Graphics.GetShadingColor(material=setShadingColor)
watch_3 = Watch(getShadingColor)
code_block_4 = CodeBlock { 75; }
setTransparency = Orchid.Revit.Materials.Graphics.SetTransparency(material=create, transparency=code_block_4)
getTransparency = Orchid.Revit.Materials.Graphics.GetTransparency(material=setTransparency)
watch_4 = Watch(getTransparency)
watch_5 = Watch(create)
setCutForegroundPattern = Orchid.Revit.Materials.Graphics.SetCutForegroundPattern(material=create, pattern=fill_patterns)
setCutForegroundPatternColor = Orchid.Revit.Materials.Graphics.SetCutForegroundPatternColor(material=setCutForegroundPattern, color=code_block_2)
getCutForegroundPatternColor = Orchid.Revit.Materials.Graphics.GetCutForegroundPatternColor(material=setCutForegroundPatternColor)
watch_6 = Watch(getCutForegroundPatternColor)
fill_patterns_2 = FillPatterns(index=36)  # graph input
setCutBackgroundPattern = Orchid.Revit.Materials.Graphics.SetCutBackgroundPattern(material=create, pattern=fill_patterns_2)
code_block_5 = CodeBlock { 55; 125; 85; }
byARGB = Color.ByARGB(r=code_block_5.out0, g=code_block_5.out1, b=code_block_5.out2)
setCutBackgroundPatternColor = Orchid.Revit.Materials.Graphics.SetCutBackgroundPatternColor(material=setCutBackgroundPattern, color=byARGB)
getCutBackgroundPatternColor = Orchid.Revit.Materials.Graphics.GetCutBackgroundPatternColor(material=setCutBackgroundPatternColor)
watch_7 = Watch(getCutBackgroundPatternColor)
setSurfaceBackgroundPattern = Orchid.Revit.Materials.Graphics.SetSurfaceBackgroundPattern(material=create, pattern=fill_patterns_2)
setSurfaceBackgroundPatternColor = Orchid.Revit.Materials.Graphics.SetSurfaceBackgroundPatternColor(material=setSurfaceBackgroundPattern, color=byARGB)
getCutBackgroundPattern = Orchid.Revit.Materials.Graphics.GetCutBackgroundPattern(material=setSurfaceBackgroundPatternColor)
watch_8 = Watch(getCutBackgroundPattern)
boolean = BoolSelector(false)  # graph input
setRenderAppearance = Orchid.Revit.Materials.Graphics.SetRenderAppearance(material=create, useRenderAppearance=boolean)
getRenderAppearance = Orchid.Revit.Materials.Graphics.GetRenderAppearance(material=setRenderAppearance)
watch_9 = Watch(getRenderAppearance)
watch_10 = Watch(setCutBackgroundPattern)
watch_11 = Watch(setSurfaceBackgroundPattern)
watch_12 = Watch(setSurfaceForegroundPattern)
watch_13 = Watch(setCutForegroundPattern)

# group: Create, Get --> For Revit 2019
code_block_6 = CodeBlock { "_test2"; }
create_2 = Orchid.Revit.Materials.Material.Create(name=code_block_6)
watch_14 = Watch(create_2)
boolean_2 = BoolSelector(false)  # graph input
code_block_7 = CodeBlock { DSCore.Color.ByARGB(255,25,60,30); 50; }
fill_patterns_3 = FillPatterns(index=41)  # graph input
code_block_8 = CodeBlock { 45; 85; 65; }
byARGB_2 = Color.ByARGB(r=code_block_8.out0, g=code_block_8.out1, b=code_block_8.out2)
set = Orchid.Revit.Materials.Graphics.Set(material=create_2, useRenderAppearance=boolean_2, shadingColor=code_block_7.out0, transparency=code_block_7.out1, surfaceForegroundPattern=fill_patterns_3, surfaceForegroundPatternColor=byARGB_2, cutBackgroundPattern=fill_patterns_3, cutBackgroundPatternColor=byARGB_2)
get = Orchid.Revit.Materials.Graphics.Get(material=set)
watch_15 = Watch(get.UseRenderAppearance)
watch_16 = Watch(get.ShadingColor)
watch_17 = Watch(get.Transparency)
watch_18 = Watch(get.surfaceForegroundPattern)
watch_19 = Watch(get.surfaceForegroundPatternColor)
watch_20 = Watch(get.surfaceBackgroundPattern)
name_2 = Material.Name(material=create_2)
watch_21 = Watch(name_2)
watch_22 = Watch(get.surfaceBackgroundPatternColor)
watch_23 = Watch(get.cutBackgroundPattern)
watch_24 = Watch(get.cutBackgroundPatternColor)
watch_25 = Watch(get.cutForegroundPatternColor)
watch_26 = Watch(get.cutForegroundPattern)

# group: Smoothness, Shininess
code_block_9 = CodeBlock { "_test1"; }
create_3 = Orchid.Revit.Materials.Material.Create(name=code_block_9)
code_block_10 = CodeBlock { 50; }
setSmoothness = Orchid.Revit.Materials.Graphics.SetSmoothness(material=create_3, smoothness=code_block_10)
getSmoothness = Orchid.Revit.Materials.Graphics.GetSmoothness(material=setSmoothness)
watch_27 = Watch(getSmoothness)
setShininess = Orchid.Revit.Materials.Graphics.SetShininess(material=create_3, shininess=code_block_10)
getShininess = Orchid.Revit.Materials.Graphics.GetShininess(material=setShininess)
watch_28 = Watch(getShininess)

# group: Create, Get --> For Revit 2018
code_block_11 = CodeBlock { "_test4"; }
create_4 = Orchid.Revit.Materials.Material.Create(name=code_block_11)
watch_29 = Watch(create_4)
boolean_3 = BoolSelector(false)  # graph input
code_block_12 = CodeBlock { DSCore.Color.ByARGB(255,25,60,30); 50; }
fill_patterns_4 = FillPatterns(index=5)  # graph input
code_block_13 = CodeBlock { 45; 85; 65; }
byARGB_3 = Color.ByARGB(r=code_block_13.out0, g=code_block_13.out1, b=code_block_13.out2)
setGraphics = Orchid.Revit.Materials.Graphics.SetGraphics(material=create_4, useRenderAppearance=boolean_3, shadingColor=code_block_12.out0, transparency=code_block_12.out1, surfacePattern=fill_patterns_4, surfacePatternColor=byARGB_3)
getGraphics = Orchid.Revit.Materials.Graphics.GetGraphics(material=setGraphics)
watch_30 = Watch(getGraphics.UseRenderAppearance)
watch_31 = Watch(getGraphics.ShadingColor)
watch_32 = Watch(getGraphics.Transparency)
watch_33 = Watch(getGraphics.SurfacePattern)
watch_34 = Watch(getGraphics.SurfacePatternColor)
watch_35 = Watch(getGraphics.CutPattern)
name_3 = Material.Name(material=create_4)
watch_36 = Watch(name_3)
watch_37 = Watch(getGraphics.CutPatternColor)

# group: Create, Set Render Appearance, SetShadingColor, Set Transparency, Set Surface Pattern, Set Surface Pattern Color, Set Cut Pattern, Set Cut Pattern Color --> For Revit 2018
code_block_14 = CodeBlock { "_test5"; }
create_5 = Orchid.Revit.Materials.Material.Create(name=code_block_14)
watch_38 = Watch(create_5)
name_4 = Material.Name(material=create_5)
watch_39 = Watch(name_4)
code_block_15 = CodeBlock { DSCore.Color.ByARGB(255,25,60,30); }
setShadingColor_2 = Orchid.Revit.Materials.Graphics.SetShadingColor(material=create_5, color=code_block_15)
getShadingColor_2 = Orchid.Revit.Materials.Graphics.GetShadingColor(material=setShadingColor_2)
watch_40 = Watch(getShadingColor_2)
code_block_16 = CodeBlock { 75; }
setTransparency_2 = Orchid.Revit.Materials.Graphics.SetTransparency(material=create_5, transparency=code_block_16)
getTransparency_2 = Orchid.Revit.Materials.Graphics.GetTransparency(material=setTransparency_2)
watch_41 = Watch(getTransparency_2)
fill_patterns_5 = FillPatterns(index=1)  # graph input
setSurfacePattern = Orchid.Revit.Materials.Graphics.SetSurfacePattern(material=create_5, pattern=fill_patterns_5)
getSurfacePattern = Orchid.Revit.Materials.Graphics.GetSurfacePattern(material=setSurfacePattern)
watch_42 = Watch(getSurfacePattern)
setCutPattern = Orchid.Revit.Materials.Graphics.SetCutPattern(material=create_5, pattern=fill_patterns_5)
getCutPattern = Orchid.Revit.Materials.Graphics.GetCutPattern(material=setCutPattern)
watch_43 = Watch(getCutPattern)
code_block_17 = CodeBlock { 145; 185; 165; }
byARGB_4 = Color.ByARGB(r=code_block_17.out0, g=code_block_17.out1, b=code_block_17.out2)
setCutPatternColor = Orchid.Revit.Materials.Graphics.SetCutPatternColor(material=setCutPattern, color=byARGB_4)
getCutPatternColor = Orchid.Revit.Materials.Graphics.GetCutPatternColor(material=setCutPatternColor)
watch_44 = Watch(getCutPatternColor)
setSurfacePatternColor = Orchid.Revit.Materials.Graphics.SetSurfacePatternColor(material=setSurfacePattern, color=byARGB_4)
getSurfacePatternColor = Orchid.Revit.Materials.Graphics.GetSurfacePatternColor(material=setSurfacePatternColor)
watch_45 = Watch(getSurfacePatternColor)
boolean_4 = BoolSelector(false)  # graph input
setRenderAppearance_2 = Orchid.Revit.Materials.Graphics.SetRenderAppearance(material=create_5, useRenderAppearance=boolean_4)
getRenderAppearance_2 = Orchid.Revit.Materials.Graphics.GetRenderAppearance(material=setRenderAppearance_2)
watch_46 = Watch(getRenderAppearance_2)
