# Dynamo graph Material.dyn (Dynamo 2.0.2.6826)

# group: Duplicate, Set
material = MaterialDD(index=0)  # graph input
code_block = CodeBlock { "_test3"; }
duplicate = Orchid.Revit.Materials.Material.Duplicate(material=material, name=code_block)
code_block_2 = CodeBlock { [125,160,130]; 90; }
fill_patterns = FillPatterns(index=14)  # graph input
code_block_3 = CodeBlock { 155; 135; 115; }
byARGB = Color.ByARGB(r=code_block_3.out0, g=code_block_3.out1, b=code_block_3.out2)
set = Orchid.Revit.Materials.Material.Set(material=duplicate, shadingColor=code_block_2.out0, transparency=code_block_2.out1, cutPattern=fill_patterns, cutPatternColor=byARGB)
watch = Watch(set)

# group: Create, Set Render Appearance, SetShadingColor, Set Transparency, Set Surface Pattern, Set Surface Pattern Color, Set Cut Pattern, Set Cut Pattern Color
code_block_4 = CodeBlock { "_test2"; }
create = Orchid.Revit.Materials.Material.Create(name=code_block_4)
boolean = BoolSelector(false)  # graph input
setRenderAppearance = Orchid.Revit.Materials.Material.SetRenderAppearance(material=create, useRenderAppearance=boolean)
code_block_5 = CodeBlock { [25,60,30,0]; }
setShadingColor = Orchid.Revit.Materials.Material.SetShadingColor(material=setRenderAppearance, color=code_block_5)
code_block_6 = CodeBlock { 75; }
setTransparency = Orchid.Revit.Materials.Material.SetTransparency(material=setShadingColor, transparency=code_block_6)
fill_patterns_2 = FillPatterns(index=1)  # graph input
setSurfacePattern = Orchid.Revit.Materials.Material.SetSurfacePattern(material=setTransparency, pattern=fill_patterns_2)
code_block_7 = CodeBlock { 145; 185; 165; }
byARGB_2 = Color.ByARGB(r=code_block_7.out0, g=code_block_7.out1, b=code_block_7.out2)
setSurfacePatternColor = Orchid.Revit.Materials.Material.SetSurfacePatternColor(material=setSurfacePattern, color=byARGB_2)
setCutPattern = Orchid.Revit.Materials.Material.SetCutPattern(material=setSurfacePatternColor, pattern=fill_patterns_2)
watch_2 = Watch(setCutPattern)
name = Material.Name(material=setCutPattern)
watch_3 = Watch(name)
getShadingColor = Orchid.Revit.Materials.Material.GetShadingColor(material=setShadingColor)
watch_4 = Watch(getShadingColor)
getTransparency = Orchid.Revit.Materials.Material.GetTransparency(material=setTransparency)
watch_5 = Watch(getTransparency)
getSurfacePattern = Orchid.Revit.Materials.Material.GetSurfacePattern(material=setSurfacePattern)
watch_6 = Watch(getSurfacePattern)
getSurfacePatternColor = Orchid.Revit.Materials.Material.GetSurfacePatternColor(material=setSurfacePatternColor)
watch_7 = Watch(getSurfacePatternColor)
setCutPatternColor = Orchid.Revit.Materials.Material.SetCutPatternColor(material=setCutPattern, color=byARGB_2)
getCutPatternColor = Orchid.Revit.Materials.Material.GetCutPatternColor(material=setCutPatternColor)
watch_8 = Watch(getCutPatternColor)
getCutPattern = Orchid.Revit.Materials.Material.GetCutPattern(material=setCutPattern)
watch_9 = Watch(getCutPattern)
getRenderAppearance = Orchid.Revit.Materials.Material.GetRenderAppearance(material=setRenderAppearance)
watch_10 = Watch(getRenderAppearance)

# group: Create, Get
code_block_8 = CodeBlock { "_test1"; 50; }
boolean_2 = BoolSelector(false)  # graph input
code_block_9 = CodeBlock { [25,60,30,0]; }
fill_patterns_3 = FillPatterns(index=5)  # graph input
code_block_10 = CodeBlock { 45; 85; 65; }
byARGB_3 = Color.ByARGB(r=code_block_10.out0, g=code_block_10.out1, b=code_block_10.out2)
create_2 = Orchid.Revit.Materials.Material.Create(name=code_block_8.out0, useRenderAppearance=boolean_2, shadingColor=code_block_9, transparency=code_block_8.out1, surfacePattern=fill_patterns_3, surfacePatternColor=byARGB_3)
watch_11 = Watch(create_2)
get = Orchid.Revit.Materials.Material.Get(material=create_2)
watch_12 = Watch(get.UseRenderAppearance)
watch_13 = Watch(get.ShadingColor)
watch_14 = Watch(get.Transparency)
watch_15 = Watch(get.SurfacePattern)
watch_16 = Watch(get.SurfacePatternColor)
watch_17 = Watch(get.CutPattern)
name_2 = Material.Name(material=create_2)
watch_18 = Watch(name_2)
watch_19 = Watch(get.CutPatternColor)

# group: All
all = Orchid.Revit.Materials.Material.All()
name_3 = Material.Name(material=all)
watch_20 = Watch(name_3)
watch_21 = Watch(all)

material_2 = MaterialDD(index=1)  # graph input
getCategory = Orchid.Revit.Materials.Material.GetCategory(material=material_2)
watch_22 = Watch(getCategory)
getClass = Orchid.Revit.Materials.Material.GetClass(material=material_2)
watch_23 = Watch(getClass)

# group: Asset
material_3 = MaterialDD(index=1)  # graph input
asset = Orchid.Revit.Materials.Material.Asset(material=material_3)
watch_24 = Watch(asset.Appearance)
watch_25 = Watch(asset.Physical)
watch_26 = Watch(asset.Thermal)

# group: Smoothness, Shininess
code_block_11 = CodeBlock { "_test4"; }
create_3 = Orchid.Revit.Materials.Material.Create(name=code_block_11)
code_block_12 = CodeBlock { 50; }
setSmoothness = Orchid.Revit.Materials.Material.SetSmoothness(material=create_3, smoothness=code_block_12)
getSmoothness = Orchid.Revit.Materials.Material.GetSmoothness(material=setSmoothness)
watch_27 = Watch(getSmoothness)
setShininess = Orchid.Revit.Materials.Material.SetShininess(material=create_3, shininess=code_block_12)
getShininess = Orchid.Revit.Materials.Material.GetShininess(material=setShininess)
watch_28 = Watch(getShininess)

# group: Asset Parameter
material_4 = MaterialDD(index=1)  # graph input
assetParameter = Orchid.Revit.Materials.Material.AssetParameter(material=material_4)
watch_29 = Watch(assetParameter.Appearance)
watch_30 = Watch(assetParameter.Physical)
watch_31 = Watch(assetParameter.Thermal)

# group: Parameter
material_5 = MaterialDD(index=1)  # graph input
parameter = Orchid.Revit.Materials.Material.Parameter(material=material_5)
watch_32 = Watch(parameter)
