# Dynamo graph Physical-Thermal.dyn (Dynamo 2.0.2.6826)

# group: Create material: Concrete (C30)
code_block = CodeBlock { "_Concrete"; }
create = Orchid.Revit.Materials.Material.Create(name=code_block)
material_aspect = MaterialAspectDD(index=1)  # graph input
thermal_type = ThermalTypeDD(index=2)  # graph input
boolean = BoolSelector(true)  # graph input
create_2 = Orchid.Revit.Materials.ThermalAsset.Create(name=code_block, type=thermal_type, uniqueName=boolean)
code_block_2 = CodeBlock()
# ---------- code_block_2.designscript (6 lines) ----------
"Concrete f'c=30 MPa";
"structural,concrete,CC:BS 8110";
"thermal,solid";
"Concrete";
"Orchid generated";
"https://github.com/erfajo/OrchidForDynamo";
# ----------------------------------------
setInformation = Orchid.Revit.Materials.ThermalAsset.SetInformation(propertySet=create_2, description=code_block_2.out0, keywords=code_block_2.out2, subclass=code_block_2.out3, source=code_block_2.out4, sourceUrl=code_block_2.out5)
boolean_2 = BoolSelector(false)  # graph input
asset_behavior = AssetBehaviorDD(index=0)  # graph input
code_block_3 = CodeBlock { 1.046; 0.657; 2300; 0.95; 182.4; 0.01; 0; 2000000; }
setProperties = Orchid.Revit.Materials.ThermalAsset.SetProperties(propertySet=setInformation, transmitsLight=boolean_2, behavior=asset_behavior, thermalConductivity=code_block_3.out0, specificHeat=code_block_3.out1, density=code_block_3.out2, emissivity=code_block_3.out3, permeability=code_block_3.out4, porosity=code_block_3.out5, reflectivity=code_block_3.out6, electricalResistivity=code_block_3.out7)
setAsset = Orchid.Revit.Materials.Material.SetAsset(material=create, aspect=material_aspect, propertySet=setProperties)
name = Material.Name(material=setAsset)
watch = Watch(name)
watch_2 = Watch(setAsset)
material_aspect_2 = MaterialAspectDD(index=0)  # graph input
physical_type = PhysicalTypeDD(index=1)  # graph input
create_3 = Orchid.Revit.Materials.PhysicalAsset.Create(name=code_block, type=physical_type, uniqueName=boolean)
setInformation_2 = Orchid.Revit.Materials.PhysicalAsset.SetInformation(propertySet=create_3, description=code_block_2.out0, keywords=code_block_2.out1, subclass=code_block_2.out3, source=code_block_2.out4, sourceUrl=code_block_2.out5)
asset_behavior_2 = AssetBehaviorDD(index=0)  # graph input
setBehavior = Orchid.Revit.Materials.PhysicalAsset.SetBehavior(propertySet=setInformation_2, behavior=asset_behavior_2)
code_block_4 = CodeBlock { 0.00001; }
setBasicThermal = Orchid.Revit.Materials.PhysicalAsset.SetBasicThermal(propertySet=setBehavior, expansionCoefficient=code_block_4)
code_block_5 = CodeBlock { 20500; 0.2; 11200; 2406.45; }
setMechanical = Orchid.Revit.Materials.PhysicalAsset.SetMechanical(propertySet=setBasicThermal, youngModulus=code_block_5.out0, poissonRatio=code_block_5.out1, shearModulus=code_block_5.out2, density=code_block_5.out3)
code_block_6 = CodeBlock { 30.0; 1.0; }
boolean_3 = BoolSelector(false)  # graph input
setConcrete = Orchid.Revit.Materials.PhysicalAsset.SetConcrete(propertySet=setMechanical, compression=code_block_6.out0, shearStrengthReduction=code_block_6.out1, lightweight=boolean_3)
setAsset_2 = Orchid.Revit.Materials.Material.SetAsset(material=create, aspect=material_aspect_2, propertySet=setConcrete)
name_2 = Material.Name(material=setAsset_2)
watch_3 = Watch(name_2)
watch_4 = Watch(setAsset_2)

# group: Create material: Oxygen
code_block_7 = CodeBlock { "_Oxygen"; }
create_4 = Orchid.Revit.Materials.Material.Create(name=code_block_7)
material_aspect_3 = MaterialAspectDD(index=1)  # graph input
thermal_type_2 = ThermalTypeDD(index=0)  # graph input
boolean_4 = BoolSelector(true)  # graph input
create_5 = Orchid.Revit.Materials.ThermalAsset.Create(name=code_block_7, type=thermal_type_2, uniqueName=boolean_4)
code_block_8 = CodeBlock()
# ---------- code_block_8.designscript (6 lines) ----------
"Oxygen, properties at atmospheric pressure";
"structural,gas";
"thermal,gas";
"Gas";
"Orchid generated";
"https://github.com/erfajo/OrchidForDynamo";
# ----------------------------------------
setInformation_3 = Orchid.Revit.Materials.ThermalAsset.SetInformation(propertySet=create_5, description=code_block_8.out0, keywords=code_block_8.out2, subclass=code_block_8.out3, source=code_block_8.out4, sourceUrl=code_block_8.out5)
code_block_9 = CodeBlock { 0.0242; 0.9118; 1.35; 0.01; 0; 1; }
setBasicThermal_2 = Orchid.Revit.Materials.ThermalAsset.SetBasicThermal(propertySet=setInformation_3, thermalConductivity=code_block_9.out0, specificHeat=code_block_9.out1, density=code_block_9.out2, emissivity=code_block_9.out3, gasViscosity=code_block_9.out4, compressibility=code_block_9.out5)
setAsset_3 = Orchid.Revit.Materials.Material.SetAsset(material=create_4, aspect=material_aspect_3, propertySet=setBasicThermal_2)
watch_5 = Watch(setAsset_3)
name_3 = Material.Name(material=setAsset_3)
watch_6 = Watch(name_3)
material_aspect_4 = MaterialAspectDD(index=0)  # graph input
physical_type_2 = PhysicalTypeDD(index=5)  # graph input
create_6 = Orchid.Revit.Materials.PhysicalAsset.Create(name=code_block_7, type=physical_type_2, uniqueName=boolean_4)
setInformation_4 = Orchid.Revit.Materials.PhysicalAsset.SetInformation(propertySet=create_6, description=code_block_8.out0, keywords=code_block_8.out1, subclass=code_block_8.out3, source=code_block_8.out4, sourceUrl=code_block_8.out5)
code_block_10 = CodeBlock { 500; }
setBasicThermal_3 = Orchid.Revit.Materials.PhysicalAsset.SetBasicThermal(propertySet=setInformation_4, expansionCoefficient=code_block_10)
code_block_11 = CodeBlock { 1.35; }
setMechanical_2 = Orchid.Revit.Materials.PhysicalAsset.SetMechanical(propertySet=setBasicThermal_3, density=code_block_11)
setAsset_4 = Orchid.Revit.Materials.Material.SetAsset(material=create_4, aspect=material_aspect_4, propertySet=setMechanical_2)
watch_7 = Watch(setAsset_4)
name_4 = Material.Name(material=setAsset_4)
watch_8 = Watch(name_4)

# group: Create material: Steel (S275)
code_block_12 = CodeBlock { "_Steel S275"; }
create_7 = Orchid.Revit.Materials.Material.Create(name=code_block_12)
material_aspect_5 = MaterialAspectDD(index=0)  # graph input
physical_type_3 = PhysicalTypeDD(index=2)  # graph input
boolean_5 = BoolSelector(true)  # graph input
create_8 = Orchid.Revit.Materials.PhysicalAsset.Create(name=code_block_12, type=physical_type_3, uniqueName=boolean_5)
code_block_13 = CodeBlock()
# ---------- code_block_13.designscript (6 lines) ----------
"Steel, S275 (EN 10025-2)";
"1.0044,structural,metal,CC:EN 10025";
"thermal,solid";
"Steel";
"Orchid generated";
"https://github.com/erfajo/OrchidForDynamo";
# ----------------------------------------
setInformation_5 = Orchid.Revit.Materials.PhysicalAsset.SetInformation(propertySet=create_8, description=code_block_13.out0, keywords=code_block_13.out1, subclass=code_block_13.out3, source=code_block_13.out4, sourceUrl=code_block_13.out5)
asset_behavior_3 = AssetBehaviorDD(index=0)  # graph input
setBehavior_2 = Orchid.Revit.Materials.PhysicalAsset.SetBehavior(propertySet=setInformation_5, behavior=asset_behavior_3)
code_block_14 = CodeBlock { 0.00001; }
setBasicThermal_4 = Orchid.Revit.Materials.PhysicalAsset.SetBasicThermal(propertySet=setBehavior_2, expansionCoefficient=code_block_14)
code_block_15 = CodeBlock { 205000; 0.3; 80000; 7850; }
setMechanical_3 = Orchid.Revit.Materials.PhysicalAsset.SetMechanical(propertySet=setBasicThermal_4, youngModulus=code_block_15.out0, poissonRatio=code_block_15.out1, shearModulus=code_block_15.out2, density=code_block_15.out3)
code_block_16 = CodeBlock { 275; 430; }
boolean_6 = BoolSelector(false)  # graph input
setStrength = Orchid.Revit.Materials.PhysicalAsset.SetStrength(propertySet=setMechanical_3, yieldStress=code_block_16.out0, tensileStrength=code_block_16.out1, thermalTreated=boolean_6)
setAsset_5 = Orchid.Revit.Materials.Material.SetAsset(material=create_7, aspect=material_aspect_5, propertySet=setStrength)
name_5 = Material.Name(material=setAsset_5)
watch_9 = Watch(name_5)
watch_10 = Watch(setAsset_5)
material_aspect_6 = MaterialAspectDD(index=1)  # graph input
thermal_type_3 = ThermalTypeDD(index=2)  # graph input
create_9 = Orchid.Revit.Materials.ThermalAsset.Create(name=code_block_12, type=thermal_type_3, uniqueName=boolean_5)
setInformation_6 = Orchid.Revit.Materials.ThermalAsset.SetInformation(propertySet=create_9, description=code_block_13.out0, keywords=code_block_13.out2, subclass=code_block_13.out3, source=code_block_13.out4, sourceUrl=code_block_13.out5)
boolean_7 = BoolSelector(false)  # graph input
asset_behavior_4 = AssetBehaviorDD(index=0)  # graph input
code_block_17 = CodeBlock { 45; 0.48; 7850; 0.4; 0; 0.01; 0; 0; }
setProperties_2 = Orchid.Revit.Materials.ThermalAsset.SetProperties(propertySet=setInformation_6, transmitsLight=boolean_7, behavior=asset_behavior_4, thermalConductivity=code_block_17.out0, specificHeat=code_block_17.out1, density=code_block_17.out2, emissivity=code_block_17.out3, permeability=code_block_17.out4, porosity=code_block_17.out5, reflectivity=code_block_17.out6, electricalResistivity=code_block_17.out7)
setAsset_6 = Orchid.Revit.Materials.Material.SetAsset(material=create_7, aspect=material_aspect_6, propertySet=setProperties_2)
name_6 = Material.Name(material=setAsset_6)
watch_11 = Watch(name_6)
watch_12 = Watch(setAsset_6)

# group: Create material: Timber (C24)
code_block_18 = CodeBlock { "_Timber C24"; }
create_10 = Orchid.Revit.Materials.Material.Create(name=code_block_18)
material_aspect_7 = MaterialAspectDD(index=0)  # graph input
physical_type_4 = PhysicalTypeDD(index=3)  # graph input
boolean_8 = BoolSelector(true)  # graph input
create_11 = Orchid.Revit.Materials.PhysicalAsset.Create(name=code_block_18, type=physical_type_4, uniqueName=boolean_8)
code_block_19 = CodeBlock()
# ---------- code_block_19.designscript (6 lines) ----------
"Strength Class C24 Timber";
"Eurocode,Structural,structural,wood,CC:EN 338";
"Wood,thermal,solid";
"Wood";
"Orchid generated";
"https://github.com/erfajo/OrchidForDynamo";
# ----------------------------------------
setInformation_7 = Orchid.Revit.Materials.PhysicalAsset.SetInformation(propertySet=create_11, description=code_block_19.out0, keywords=code_block_19.out1, subclass=code_block_19.out3, source=code_block_19.out4, sourceUrl=code_block_19.out5)
asset_behavior_5 = AssetBehaviorDD(index=1)  # graph input
setBehavior_3 = Orchid.Revit.Materials.PhysicalAsset.SetBehavior(propertySet=setInformation_7, behavior=asset_behavior_5)
code_block_20 = CodeBlock { 0.00004; }
setBasicThermal_5 = Orchid.Revit.Materials.PhysicalAsset.SetBasicThermal(propertySet=setBehavior_3, expansionCoefficient=code_block_20)
code_block_21 = CodeBlock { 11000; 0.38; 690; 420; }
setMechanical_4 = Orchid.Revit.Materials.PhysicalAsset.SetMechanical(propertySet=setBasicThermal_5, youngModulus=code_block_21.out0, poissonRatio=code_block_21.out1, shearModulus=code_block_21.out2, density=code_block_21.out3)
code_block_22 = CodeBlock { "Multiple"; "C24"; 24; 21; 2.5; 4; 14; 0.5; 11000; }
wood_construction = WoodConstructionDD(index=0)  # graph input
setStrengthExtended = Orchid.Revit.Materials.PhysicalAsset.SetStrengthExtended(propertySet=setMechanical_4, species=code_block_22.out0, grade=code_block_22.out1, bending=code_block_22.out2, parallelCompression=code_block_22.out3, perpendicularCompression=code_block_22.out4, parallelShear=code_block_22.out5, tensionParallel=code_block_22.out6, tensionPerpendicular=code_block_22.out7, averageModulus=code_block_22.out8, construction=wood_construction)
setAsset_7 = Orchid.Revit.Materials.Material.SetAsset(material=create_10, aspect=material_aspect_7, propertySet=setStrengthExtended)
name_7 = Material.Name(material=setAsset_7)
watch_13 = Watch(name_7)
watch_14 = Watch(setAsset_7)
material_aspect_8 = MaterialAspectDD(index=1)  # graph input
thermal_type_4 = ThermalTypeDD(index=2)  # graph input
create_12 = Orchid.Revit.Materials.ThermalAsset.Create(name=code_block_18, type=thermal_type_4, uniqueName=boolean_8)
setInformation_8 = Orchid.Revit.Materials.ThermalAsset.SetInformation(propertySet=create_12, description=code_block_19.out0, keywords=code_block_19.out2, subclass=code_block_19.out3, source=code_block_19.out4, sourceUrl=code_block_19.out5)
boolean_9 = BoolSelector(false)  # graph input
asset_behavior_6 = AssetBehaviorDD(index=0)  # graph input
code_block_23 = CodeBlock { 0.12; 0.19; 496; 0.85; 0; 0.01; 0; 10000000; }
setProperties_3 = Orchid.Revit.Materials.ThermalAsset.SetProperties(propertySet=setInformation_8, transmitsLight=boolean_9, behavior=asset_behavior_6, thermalConductivity=code_block_23.out0, specificHeat=code_block_23.out1, density=code_block_23.out2, emissivity=code_block_23.out3, permeability=code_block_23.out4, porosity=code_block_23.out5, reflectivity=code_block_23.out6, electricalResistivity=code_block_23.out7)
setAsset_8 = Orchid.Revit.Materials.Material.SetAsset(material=create_10, aspect=material_aspect_8, propertySet=setProperties_3)
name_8 = Material.Name(material=setAsset_8)
watch_15 = Watch(name_8)
watch_16 = Watch(setAsset_8)

# group: Create material: Timber (C24) --> XYZ values for SetBasicThermal and SetMechanical
code_block_24 = CodeBlock { "_Timber C24 (XYZ)"; }
create_13 = Orchid.Revit.Materials.Material.Create(name=code_block_24)
material_aspect_9 = MaterialAspectDD(index=1)  # graph input
thermal_type_5 = ThermalTypeDD(index=2)  # graph input
boolean_10 = BoolSelector(true)  # graph input
create_14 = Orchid.Revit.Materials.ThermalAsset.Create(name=code_block_24, type=thermal_type_5, uniqueName=boolean_10)
code_block_25 = CodeBlock()  # same code as code_block_19
setInformation_9 = Orchid.Revit.Materials.ThermalAsset.SetInformation(propertySet=create_14, description=code_block_25.out0, keywords=code_block_25.out2, subclass=code_block_25.out3, source=code_block_25.out4, sourceUrl=code_block_25.out5)
boolean_11 = BoolSelector(false)  # graph input
asset_behavior_7 = AssetBehaviorDD(index=0)  # graph input
code_block_26 = CodeBlock { 0.12; 0.19; 496; 0.85; 0; 0.01; 0; 10000000; }
setProperties_4 = Orchid.Revit.Materials.ThermalAsset.SetProperties(propertySet=setInformation_9, transmitsLight=boolean_11, behavior=asset_behavior_7, thermalConductivity=code_block_26.out0, specificHeat=code_block_26.out1, density=code_block_26.out2, emissivity=code_block_26.out3, permeability=code_block_26.out4, porosity=code_block_26.out5, reflectivity=code_block_26.out6, electricalResistivity=code_block_26.out7)
setAsset_9 = Orchid.Revit.Materials.Material.SetAsset(material=create_13, aspect=material_aspect_9, propertySet=setProperties_4)
watch_17 = Watch(setAsset_9)
name_9 = Material.Name(material=setAsset_9)
watch_18 = Watch(name_9)
material_aspect_10 = MaterialAspectDD(index=0)  # graph input
physical_type_5 = PhysicalTypeDD(index=3)  # graph input
create_15 = Orchid.Revit.Materials.PhysicalAsset.Create(name=code_block_24, type=physical_type_5, uniqueName=boolean_10)
setInformation_10 = Orchid.Revit.Materials.PhysicalAsset.SetInformation(propertySet=create_15, description=code_block_25.out0, keywords=code_block_25.out1, subclass=code_block_25.out3, source=code_block_25.out4, sourceUrl=code_block_25.out5)
asset_behavior_8 = AssetBehaviorDD(index=1)  # graph input
setBehavior_4 = Orchid.Revit.Materials.PhysicalAsset.SetBehavior(propertySet=setInformation_10, behavior=asset_behavior_8)
code_block_27 = CodeBlock { 0.0001; 0.0002; 0.0003; }
XYZ = Orchid.Revit.Core.Object.XYZ(x=code_block_27.out0, y=code_block_27.out1, z=code_block_27.out2)
setBasicThermalByXYZ = Orchid.Revit.Materials.PhysicalAsset.SetBasicThermalByXYZ(propertySet=setBehavior_4, expansionCoefficient=XYZ)
code_block_28 = CodeBlock()
# ---------- code_block_28.designscript (4 lines) ----------
Orchid.Revit.Object.XYZ(10000,11000,12000);
Orchid.Revit.Object.XYZ(0.3,0.35,0.4);
Orchid.Revit.Object.XYZ(650,700,750);
420;
# ----------------------------------------
setMechanicalByXYZ = Orchid.Revit.Materials.PhysicalAsset.SetMechanicalByXYZ(propertySet=setBasicThermalByXYZ, youngModulus=code_block_28.out0, poissonRatio=code_block_28.out1, shearModulus=code_block_28.out2, density=code_block_28.out3)
code_block_29 = CodeBlock { "Multiple"; "C24"; 24; 21; 2.5; 4; 14; 0.5; 11000; }
wood_construction_2 = WoodConstructionDD(index=0)  # graph input
setStrengthExtended_2 = Orchid.Revit.Materials.PhysicalAsset.SetStrengthExtended(propertySet=setMechanicalByXYZ, species=code_block_29.out0, grade=code_block_29.out1, bending=code_block_29.out2, parallelCompression=code_block_29.out3, perpendicularCompression=code_block_29.out4, parallelShear=code_block_29.out5, tensionParallel=code_block_29.out6, tensionPerpendicular=code_block_29.out7, averageModulus=code_block_29.out8, construction=wood_construction_2)
setAsset_10 = Orchid.Revit.Materials.Material.SetAsset(material=create_13, aspect=material_aspect_10, propertySet=setStrengthExtended_2)
watch_19 = Watch(setAsset_10)
name_10 = Material.Name(material=setAsset_10)
watch_20 = Watch(name_10)

# group: All --> Physical Asset
all = Orchid.Revit.Materials.PhysicalAsset.All()
watch_21 = Watch(all)
name_11 = Element.Name(element=all)
watch_22 = Watch(name_11)

# group: All --> Thermal Asset
all_2 = Orchid.Revit.Materials.ThermalAsset.All()
watch_23 = Watch(all_2)
name_12 = Element.Name(element=all_2)
watch_24 = Watch(name_12)

# group: Duplicate --> Physical Asset
physical_propertyset = PhysicalPropertySetDD(index=0)  # graph input
code_block_30 = CodeBlock { "_xx (physical)"; }
duplicate = Orchid.Revit.Materials.PhysicalAsset.Duplicate(propertySet=physical_propertyset, name=code_block_30)
watch_25 = Watch(duplicate)

# group: Duplicate --> Thermal Asset
thermal_propertyset = ThermalPropertySetDD(index=0)  # graph input
code_block_31 = CodeBlock { "_xx (thermal)"; }
duplicate_2 = Orchid.Revit.Materials.ThermalAsset.Duplicate(propertySet=thermal_propertyset, name=code_block_31)
watch_26 = Watch(duplicate_2)

getInformation = Orchid.Revit.Materials.ThermalAsset.GetInformation(propertySet=setInformation_3)
watch_27 = Watch(getInformation.subclass)
watch_28 = Watch(getInformation.keywords)
watch_29 = Watch(getInformation.description)
watch_30 = Watch(getInformation.source)
watch_31 = Watch(getInformation.sourceUrl)
getBasicThermal = Orchid.Revit.Materials.ThermalAsset.GetBasicThermal(propertySet=setBasicThermal_2)
watch_32 = Watch(getBasicThermal.density)
watch_33 = Watch(getBasicThermal.emissivity)
watch_34 = Watch(getBasicThermal.gasViscosity)
watch_35 = Watch(getBasicThermal.specificHeat)
watch_36 = Watch(getBasicThermal.thermalConductivity)
watch_37 = Watch(getBasicThermal.compressibility)
getExpansionCoefficient = Orchid.Revit.Materials.PhysicalAsset.GetExpansionCoefficient(propertySet=setBasicThermal_3)
watch_38 = Watch(getExpansionCoefficient.expansionCoefficientY)
watch_39 = Watch(getExpansionCoefficient.expansionCoefficientZ)
watch_40 = Watch(getExpansionCoefficient.expansionCoefficient1)
watch_41 = Watch(getExpansionCoefficient.expansionCoefficientX)
watch_42 = Watch(getExpansionCoefficient.expansionCoefficient2)
watch_43 = Watch(getExpansionCoefficient.expansionCoefficient)
getInformation_2 = Orchid.Revit.Materials.PhysicalAsset.GetInformation(propertySet=setInformation_4)
watch_44 = Watch(getInformation_2.keywords)
watch_45 = Watch(getInformation_2.description)
watch_46 = Watch(getInformation_2.subclass)
watch_47 = Watch(getInformation_2.source)
watch_48 = Watch(getInformation_2.sourceUrl)
getDensity = Orchid.Revit.Materials.PhysicalAsset.GetDensity(propertySet=setMechanical_2)
watch_49 = Watch(getDensity)
getInformation_3 = Orchid.Revit.Materials.ThermalAsset.GetInformation(propertySet=setInformation)
watch_50 = Watch(getInformation_3.sourceUrl)
watch_51 = Watch(getInformation_3.source)
watch_52 = Watch(getInformation_3.subclass)
watch_53 = Watch(getInformation_3.keywords)
watch_54 = Watch(getInformation_3.description)
getInformation_4 = Orchid.Revit.Materials.PhysicalAsset.GetInformation(propertySet=setInformation_2)
watch_55 = Watch(getInformation_4.keywords)
watch_56 = Watch(getInformation_4.subclass)
watch_57 = Watch(getInformation_4.source)
watch_58 = Watch(getInformation_4.sourceUrl)
watch_59 = Watch(getInformation_4.description)
getYoungModulus = Orchid.Revit.Materials.PhysicalAsset.GetYoungModulus(propertySet=setMechanical)
watch_60 = Watch(getYoungModulus.youngModulusX)
watch_61 = Watch(getYoungModulus.youngModulusY)
watch_62 = Watch(getYoungModulus.youngModulus)
watch_63 = Watch(getYoungModulus.youngModulusZ)
watch_64 = Watch(getYoungModulus.youngModulus1)
getPoissonRatio = Orchid.Revit.Materials.PhysicalAsset.GetPoissonRatio(propertySet=setMechanical)
watch_65 = Watch(getPoissonRatio.poissonRatioX)
watch_66 = Watch(getPoissonRatio.poissonRatioY)
watch_67 = Watch(getPoissonRatio.poissonRatio)
watch_68 = Watch(getPoissonRatio.poissonRatioZ)
watch_69 = Watch(getPoissonRatio.poissonRatio12)
getShearModulus = Orchid.Revit.Materials.PhysicalAsset.GetShearModulus(propertySet=setMechanical)
watch_70 = Watch(getShearModulus.shearModulusX)
watch_71 = Watch(getShearModulus.shearModulusY)
watch_72 = Watch(getShearModulus.shearModulus)
watch_73 = Watch(getShearModulus.shearModulusZ)
watch_74 = Watch(getShearModulus.shearModulus12)
getConcrete = Orchid.Revit.Materials.PhysicalAsset.GetConcrete(propertySet=setConcrete)
watch_75 = Watch(getConcrete.shearStrengthReduction)
watch_76 = Watch(getConcrete.lightweight)
watch_77 = Watch(getConcrete.compression)
watch_78 = Watch(getYoungModulus.youngModulus2)
watch_79 = Watch(getPoissonRatio.poissonRatio23)
getExpansionCoefficient_2 = Orchid.Revit.Materials.PhysicalAsset.GetExpansionCoefficient(propertySet=setBasicThermal)
watch_80 = Watch(getExpansionCoefficient_2.expansionCoefficientX)
watch_81 = Watch(getExpansionCoefficient_2.expansionCoefficientY)
watch_82 = Watch(getExpansionCoefficient_2.expansionCoefficient)
watch_83 = Watch(getExpansionCoefficient_2.expansionCoefficientZ)
watch_84 = Watch(getExpansionCoefficient_2.expansionCoefficient1)
watch_85 = Watch(getExpansionCoefficient_2.expansionCoefficient2)
getBehavior = Orchid.Revit.Materials.PhysicalAsset.GetBehavior(propertySet=setBehavior)
watch_86 = Watch(getBehavior)
getInformation_5 = Orchid.Revit.Materials.PhysicalAsset.GetInformation(propertySet=setInformation_10)
watch_87 = Watch(getInformation_5.subclass)
watch_88 = Watch(getInformation_5.source)
watch_89 = Watch(getInformation_5.sourceUrl)
getYoungModulus_2 = Orchid.Revit.Materials.PhysicalAsset.GetYoungModulus(propertySet=setMechanicalByXYZ)
watch_90 = Watch(getYoungModulus_2.youngModulusY)
watch_91 = Watch(getYoungModulus_2.youngModulusZ)
watch_92 = Watch(getYoungModulus_2.youngModulus1)
getPoissonRatio_2 = Orchid.Revit.Materials.PhysicalAsset.GetPoissonRatio(propertySet=setMechanicalByXYZ)
watch_93 = Watch(getPoissonRatio_2.poissonRatioX)
watch_94 = Watch(getPoissonRatio_2.poissonRatioY)
watch_95 = Watch(getPoissonRatio_2.poissonRatioZ)
watch_96 = Watch(getPoissonRatio_2.poissonRatio12)
getShearModulus_2 = Orchid.Revit.Materials.PhysicalAsset.GetShearModulus(propertySet=setMechanicalByXYZ)
watch_97 = Watch(getShearModulus_2.shearModulusX)
watch_98 = Watch(getShearModulus_2.shearModulusY)
watch_99 = Watch(getShearModulus_2.shearModulus)
watch_100 = Watch(getShearModulus_2.shearModulusZ)
watch_101 = Watch(getShearModulus_2.shearModulus12)
watch_102 = Watch(getYoungModulus_2.youngModulus2)
watch_103 = Watch(getPoissonRatio_2.poissonRatio23)
getExpansionCoefficient_3 = Orchid.Revit.Materials.PhysicalAsset.GetExpansionCoefficient(propertySet=setBasicThermalByXYZ)
watch_104 = Watch(getExpansionCoefficient_3.expansionCoefficientX)
watch_105 = Watch(getExpansionCoefficient_3.expansionCoefficientY)
watch_106 = Watch(getExpansionCoefficient_3.expansionCoefficientZ)
watch_107 = Watch(getExpansionCoefficient_3.expansionCoefficient1)
watch_108 = Watch(getExpansionCoefficient_3.expansionCoefficient2)
getBehavior_2 = Orchid.Revit.Materials.PhysicalAsset.GetBehavior(propertySet=setBehavior_4)
watch_109 = Watch(getBehavior_2)
watch_110 = Watch(getInformation_5.keywords)
watch_111 = Watch(getInformation_5.description)
watch_112 = Watch(getPoissonRatio_2.poissonRatio)
watch_113 = Watch(getYoungModulus_2.youngModulusX)
watch_114 = Watch(getYoungModulus_2.youngModulus)
watch_115 = Watch(getExpansionCoefficient_3.expansionCoefficient)
getInformation_6 = Orchid.Revit.Materials.ThermalAsset.GetInformation(propertySet=setInformation_9)
watch_116 = Watch(getInformation_6.sourceUrl)
watch_117 = Watch(getInformation_6.source)
watch_118 = Watch(getInformation_6.subclass)
watch_119 = Watch(getInformation_6.keywords)
watch_120 = Watch(getInformation_6.description)
getProperties = Orchid.Revit.Materials.ThermalAsset.GetProperties(propertySet=setProperties_4)
watch_121 = Watch(getProperties.emissivity)
watch_122 = Watch(getProperties.density)
watch_123 = Watch(getProperties.specificHeat)
watch_124 = Watch(getProperties.thermalConductivity)
watch_125 = Watch(getProperties.behavior)
watch_126 = Watch(getProperties.transmitsLight)
watch_127 = Watch(getProperties.electricalResistivity)
watch_128 = Watch(getProperties.reflectivity)
watch_129 = Watch(getProperties.porosity)
watch_130 = Watch(getProperties.permeability)
getStrengthExtended = Orchid.Revit.Materials.PhysicalAsset.GetStrengthExtended(propertySet=setStrengthExtended_2)
watch_131 = Watch(getStrengthExtended.parallelShear)
watch_132 = Watch(getStrengthExtended.tensionParallel)
watch_133 = Watch(getStrengthExtended.tensionPerpendicular)
watch_134 = Watch(getStrengthExtended.perpendicularCompression)
watch_135 = Watch(getStrengthExtended.parallelCompression)
watch_136 = Watch(getStrengthExtended.averageModulus)
watch_137 = Watch(getStrengthExtended.construction)
watch_138 = Watch(getStrengthExtended.species)
watch_139 = Watch(getStrengthExtended.grade)
watch_140 = Watch(getStrengthExtended.bending)
getStrength = Orchid.Revit.Materials.PhysicalAsset.GetStrength(propertySet=setStrength)
watch_141 = Watch(getStrength.thermalTreated)
watch_142 = Watch(getStrength.tensileStrength)
watch_143 = Watch(getStrength.yieldStress)
getShearModulus_3 = Orchid.Revit.Materials.PhysicalAsset.GetShearModulus(propertySet=setMechanical_3)
watch_144 = Watch(getShearModulus_3.shearModulusX)
watch_145 = Watch(getShearModulus_3.shearModulusY)
watch_146 = Watch(getShearModulus_3.shearModulus)
getPoissonRatio_3 = Orchid.Revit.Materials.PhysicalAsset.GetPoissonRatio(propertySet=setMechanical_3)
watch_147 = Watch(getPoissonRatio_3.poissonRatioX)
watch_148 = Watch(getPoissonRatio_3.poissonRatioY)
watch_149 = Watch(getPoissonRatio_3.poissonRatio)
watch_150 = Watch(getShearModulus_3.shearModulusZ)
watch_151 = Watch(getShearModulus_3.shearModulus12)
watch_152 = Watch(getPoissonRatio_3.poissonRatioZ)
watch_153 = Watch(getPoissonRatio_3.poissonRatio12)
getYoungModulus_3 = Orchid.Revit.Materials.PhysicalAsset.GetYoungModulus(propertySet=setMechanical_3)
watch_154 = Watch(getYoungModulus_3.youngModulusY)
watch_155 = Watch(getYoungModulus_3.youngModulusZ)
watch_156 = Watch(getYoungModulus_3.youngModulus1)
watch_157 = Watch(getYoungModulus_3.youngModulusX)
watch_158 = Watch(getYoungModulus_3.youngModulus)
watch_159 = Watch(getPoissonRatio_3.poissonRatio23)
watch_160 = Watch(getYoungModulus_3.youngModulus2)
getExpansionCoefficient_4 = Orchid.Revit.Materials.PhysicalAsset.GetExpansionCoefficient(propertySet=setBasicThermal_4)
watch_161 = Watch(getExpansionCoefficient_4.expansionCoefficientX)
watch_162 = Watch(getExpansionCoefficient_4.expansionCoefficientY)
watch_163 = Watch(getExpansionCoefficient_4.expansionCoefficientZ)
watch_164 = Watch(getExpansionCoefficient_4.expansionCoefficient1)
watch_165 = Watch(getExpansionCoefficient_4.expansionCoefficient2)
watch_166 = Watch(getExpansionCoefficient_4.expansionCoefficient)
getInformation_7 = Orchid.Revit.Materials.PhysicalAsset.GetInformation(propertySet=setInformation_5)
watch_167 = Watch(getInformation_7.subclass)
watch_168 = Watch(getInformation_7.source)
watch_169 = Watch(getInformation_7.sourceUrl)
getBehavior_3 = Orchid.Revit.Materials.PhysicalAsset.GetBehavior(propertySet=setBehavior_2)
watch_170 = Watch(getBehavior_3)
watch_171 = Watch(getInformation_7.keywords)
watch_172 = Watch(getInformation_7.description)
getInformation_8 = Orchid.Revit.Materials.ThermalAsset.GetInformation(propertySet=setInformation_6)
watch_173 = Watch(getInformation_8.sourceUrl)
watch_174 = Watch(getInformation_8.source)
watch_175 = Watch(getInformation_8.subclass)
watch_176 = Watch(getInformation_8.keywords)
watch_177 = Watch(getInformation_8.description)
getProperties_2 = Orchid.Revit.Materials.ThermalAsset.GetProperties(propertySet=setProperties_2)
watch_178 = Watch(getProperties_2.thermalConductivity)
watch_179 = Watch(getProperties_2.specificHeat)
watch_180 = Watch(getProperties_2.density)
watch_181 = Watch(getProperties_2.behavior)
watch_182 = Watch(getProperties_2.transmitsLight)
watch_183 = Watch(getProperties_2.electricalResistivity)
watch_184 = Watch(getProperties_2.reflectivity)
watch_185 = Watch(getProperties_2.porosity)
watch_186 = Watch(getProperties_2.permeability)
watch_187 = Watch(getProperties_2.emissivity)
getProperties_3 = Orchid.Revit.Materials.ThermalAsset.GetProperties(propertySet=setProperties)
watch_188 = Watch(getProperties_3.thermalConductivity)
watch_189 = Watch(getProperties_3.specificHeat)
watch_190 = Watch(getProperties_3.density)
watch_191 = Watch(getProperties_3.behavior)
watch_192 = Watch(getProperties_3.transmitsLight)
watch_193 = Watch(getProperties_3.electricalResistivity)
watch_194 = Watch(getProperties_3.reflectivity)
watch_195 = Watch(getProperties_3.porosity)
watch_196 = Watch(getProperties_3.permeability)
watch_197 = Watch(getProperties_3.emissivity)
